# Dynamo custom node CoreGeometry + PointExtraction.dyf (Dynamo 0.8.0.1233)
# category: Service Core Modeller
# Builds the 3d core geometries and exports the two opposite diagonal points of relevant core elements

serviceCoreCurve = Input()
code_block = CodeBlock { Vector.ZAxis(); h=100; }
floorCurves = Input()
techRoomsRestRooms = Input()
code_block_2 = CodeBlock(a=techRoomsRestRooms) { b = {a[0]}; }
transpose = List.Transpose(code_block_2)
extruded_tech_rooms = Python(IN[0]=floorCurves, IN[1]=transpose)
# ---------- extruded_tech_rooms.python (46 lines) ----------
import clr
clr.AddReference('ProtoGeometry')
from Autodesk.DesignScript.Geometry import *
#The inputs to this node will be stored as a list in the IN variable.
dataEnteringNode = IN

floorsList		=	IN[0]
techRoomsList	=	IN[1]



def extruder():
	extruded=[]
	for i in range(len(techRooms)):
		flr = floors[-1]
		cen = flr.EndPoint
		zVal= cen.Z
		crv = techRooms[i]
		extN = crv.Extrude(zVal)
		extruded.append(extN)
	return extruded

finExt = []
heightlist=[]
for i in range(len(techRoomsList)):
	techRoomsL = techRoomsList[i]
	floors = floorsList[i]
	flr = floors[-1]	
	cen = flr.EndPoint
	zVal= cen.Z
	heightL=[]
	for j in range(len(techRoomsL)):		
		techRooms = techRoomsL[j]
		extruded=[]
		for k in range(len(techRooms)):
			techR = techRooms[k]
			
			extN = techR.ExtrudeAsSolid(zVal)
			extruded.append(extN)
			heightL.append(zVal)
		finExt.append(extruded)
	heightlist.append(heightL)
		
		
#Assign your output to the OUT variable
OUT = finExt,heightlist
# ----------------------------------------
height_zval = CodeBlock(a=extruded_tech_rooms) { a[1]; }
fullservicecoreblock_extruded = Curve.ExtrudeAsSolid(curve=serviceCoreCurve, direction=code_block.out0, distance=height_zval)
vertices = Face.Vertices(fullservicecoreblock_extruded)
keyFloors = Input()
code_block_3 = CodeBlock(a=keyFloors) { a[0]; }
elevBankLists = Input()
code_block_4 = CodeBlock(a=elevBankLists) { a[0]; }
variable_height_elevators = Python(IN[0]=floorCurves, IN[1]=code_block_3, IN[2]=code_block_4)
# ---------- variable_height_elevators.python (45 lines) ----------
import clr
clr.AddReference('ProtoGeometry')
from Autodesk.DesignScript.Geometry import *

#The inputs to this node will be stored as a list in the IN variable.
dataEnteringNode = IN

floorsList		=	IN[0]
keyFloorsList	=	IN[1]
elevListList	=	IN[2]

def elevExtruder():
	extruded=[]
	keyFloors.reverse()
	p1		=	Point.ByCoordinates(0,0,0);
	p2		=	Point.ByCoordinates(0,0,100);
	vec		=	Vector.ByTwoPoints(p1,p2)
	for i in range(len(elevList)):
		flr = floors[keyFloors[i]]
		cen = flr.EndPoint
		zVal= cen.Z
		crv = elevList[i]
		geom=[]
		for j in range(len(crv)):
			ext	=	Curve.ExtrudeAsSolid(crv[j],vec,zVal)		
			geom.append(ext)		
		extruded.append(geom)
	return extruded

finExt=[]
for i in range(len(elevListList)):
	floors = floorsList[i]	
	keyFloors = keyFloorsList[i]
	elevList = elevListList[i]
	extL=[]
	for j in range(len(elevList)):	
		keyFloors = keyFloorsList[i][j]
		elevList = elevListList[i][j]	
		ext = elevExtruder()
		extL.append(ext)
	finExt.append(extL)


#Assign your output to the OUT variable
OUT = finExt#finExt
# ----------------------------------------
vertices_2 = Face.Vertices(variable_height_elevators)
all_points = Python(IN[0]=vertices_2)
# ---------- all_points.python (26 lines) ----------
import clr
clr.AddReference('ProtoGeometry')
from Autodesk.DesignScript.Geometry import *
#The inputs to this node will be stored as a list in the IN variable.
dataEnteringNode = IN

vertexList = IN[0]
tupleList = []
for i in range(len(vertexList)):
	ver = vertexList[i]
	for j in range(len(ver)):
		verO = ver[j]
		for k in range(len(verO)):
			verN = verO[k]
			for l in range(len(verN)):
				verM = verN[l]
				for m in range(len(verM)):				
					tup = (verM[m].PointGeometry.X,verM[m].PointGeometry.Y,verM[m].PointGeometry.Z)
					tupleList.append(tup)


		


#Assign your output to the OUT variable
OUT = tupleList
# ----------------------------------------
code_block_5 = CodeBlock(a=extruded_tech_rooms) { a[0]; }
vertices_3 = Face.Vertices(code_block_5)
all_points_2 = Python(IN[0]=vertices_3)
# ---------- all_points_2.python (22 lines) ----------
import clr
clr.AddReference('ProtoGeometry')
from Autodesk.DesignScript.Geometry import *
#The inputs to this node will be stored as a list in the IN variable.
dataEnteringNode = IN

vertexList = IN[0]
tupleList = []
for i in range(len(vertexList)):
	ver = vertexList[i]
	for j in range(len(ver)):
		verM = ver[j]
		for m in range(len(verM)):							
			tup = (verM[m].PointGeometry.X,verM[m].PointGeometry.Y,verM[m].PointGeometry.Z)
			tupleList.append(tup)


		


#Assign your output to the OUT variable
OUT = tupleList
# ----------------------------------------
two_diagonal_point_finder = Python(IN[0]=vertices_2)
# ---------- two_diagonal_point_finder.python (27 lines) ----------
import clr
clr.AddReference('ProtoGeometry')
from Autodesk.DesignScript.Geometry import *
#The inputs to this node will be stored as a list in the IN variable.
dataEnteringNode = IN

vertexList = IN[0]
tupleList = []
for i in range(len(vertexList)):
	ver = vertexList[i]
	for j in range(len(ver)):
		verO = ver[j]
		for k in range(len(verO)):
			verN = verO[k]
			for l in range(len(verN)):
				verM = verN[l]				
				tup = (verM[0].PointGeometry.X,verM[0].PointGeometry.Y,verM[0].PointGeometry.Z)
				tupleList.append(tup)
				tup = (verM[7].PointGeometry.X,verM[7].PointGeometry.Y,verM[7].PointGeometry.Z)
				tupleList.append(tup)


		


#Assign your output to the OUT variable
OUT = tupleList
# ----------------------------------------
point_creator = Python(IN[0]=two_diagonal_point_finder)
# ---------- point_creator.python (15 lines) ----------
import clr
clr.AddReference('ProtoGeometry')
from Autodesk.DesignScript.Geometry import *
#The inputs to this node will be stored as a list in the IN variable.
dataEnteringNode = IN

units = IN[0]
ptList = []
for i in range(len(units)):
	cod = units[i]
	pt = Point.ByCoordinates(cod[0],cod[1],cod[2])
	ptList.append(pt)

#Assign your output to the OUT variable
OUT = ptList
# ----------------------------------------
edges = Face.Edges(variable_height_elevators)
curveGeometry = Edge.CurveGeometry(edges)
two_diagonal_point_finder_2 = Python(IN[0]=vertices_3)
# ---------- two_diagonal_point_finder_2.python (24 lines) ----------
import clr
clr.AddReference('ProtoGeometry')
from Autodesk.DesignScript.Geometry import *
#The inputs to this node will be stored as a list in the IN variable.
dataEnteringNode = IN

vertexList = IN[0]
tupleList = []
for i in range(len(vertexList)):
	ver = vertexList[i]
	for j in range(len(ver)):
		verM = ver[j]
		for k in range(len(verM)):						
			tup = (verM[0].PointGeometry.X,verM[0].PointGeometry.Y,verM[0].PointGeometry.Z)
			tupleList.append(tup)
			tup = (verM[7].PointGeometry.X,verM[7].PointGeometry.Y,verM[7].PointGeometry.Z)
			tupleList.append(tup)


		


#Assign your output to the OUT variable
OUT = tupleList
# ----------------------------------------
point_creator_2 = Python(IN[0]=two_diagonal_point_finder_2)  # same code as point_creator
elevatorsModel = Output(variable_height_elevators)
code_block_6 = CodeBlock(a=techRoomsRestRooms) { a[1..2]; }
lowlevel_restrms_extruder = Python(IN[0]=code_block_3, IN[1]=code_block_6, IN[2]=floorCurves)
# ---------- lowlevel_restrms_extruder.python (42 lines) ----------
import clr
clr.AddReference('ProtoGeometry')
from Autodesk.DesignScript.Geometry import *
#The inputs to this node will be stored as a list in the IN variable.
dataEnteringNode = IN

keyFloorList = IN[0]
restrmList = IN[1]
floorList = IN[2]


#to compute the lower lvl restrm spaces------------------------------
def restrmLowLvlExtruder(keyFloorList,restrmL,floorList):
	extruded = []
	p1		=	Point.ByCoordinates(0,0,0);
	p2		=	Point.ByCoordinates(0,0,100);
	vec		=	Vector.ByTwoPoints(p1,p2)
	for i in range(len(keyFloorList)):
		key1 = keyFloorList[i]
		floorL = floorList[i]
		rest1 = restrmL[i]
		extF=[]
		for j in range(len(key1)):
			key2 = key1[j]
			rest2 = rest1[j]
			floor = floorL[key2[0]]
			zVal = floor.Center().Z
			ext1 = Curve.ExtrudeAsSolid(rest2,vec,zVal)
			extF.append(ext1)
			#extF.append(ext2)
		extruded.append(extF)			
			
	return extruded
#--------------------------------------------------------------------
extF=[]
for i in range(len(restrmList)):
	restrmL = restrmList[i]
	ext = restrmLowLvlExtruder(keyFloorList,restrmL,floorList)
	extF.append(ext)

#Assign your output to the OUT variable
OUT =extF
# ----------------------------------------
lowLevelRestroomModel = Output(lowlevel_restrms_extruder)
fullServiceCoreModel = Output(fullservicecoreblock_extruded)
techRoomsModel = Output(code_block_5)
key_floorplates_finder = Python(IN[0]=floorCurves, IN[1]=code_block_3, IN[2]=code_block_4)
# ---------- key_floorplates_finder.python (100 lines) ----------
import clr
clr.AddReference('ProtoGeometry')
from Autodesk.DesignScript.Geometry import *
#The inputs to this node will be stored as a list in the IN variable.
dataEnteringNode = IN

floorList = IN[0]
keyFloorList = IN[1]
elevatorBanksList = IN[2]

#given an input elevator lists it will return the bouding rectangle volume-------------------------------------------------------------------------------
def boudingRecMaker(elevList):
	boundingBox = BoundingBox.ByGeometry(elevList)
	cuboid = boundingBox.ToCuboid()
	cubLines = cuboid.Edges
	
	p1 = cubLines[0].StartVertex.PointGeometry;
	p2 = cubLines[0].EndVertex.PointGeometry;
	p3 = cubLines[2].StartVertex.PointGeometry;
	p4 = cubLines[2].EndVertex.PointGeometry;
	
	boundingRec = Rectangle.ByCornerPoints(p1,p2,p3,p4)
	
	return boundingRec
#--------------------------------------------------------------------------------------------------------------------------------------------------------

# places the bounding boxes at the selected elev banks dropped-------------------------------------------------------------------------------------------
def restroomPlacer():
	restRmBlocks = []
	translatedElevListFinal = translateElevators(elevatorBanksList,floorList,keyFloorList)
	for i in range(len(translatedElevListFinal)):
		rest1 = []
		elev1 = translatedElevListFinal[i]
		for j in range(len(elev1)):	
			rest2 =[]		
			elev2 = elev1[j]
			for k in range(len(elev2)):
				if k == 0 : continue
				elev3 = elev2[k]
				boundingRestrms = boudingRecMaker(elev3)
				area = boundingRestrms.Width*boundingRestrms.Height
				if area < 2: continue
				rest2.append(boundingRestrms)
			rest1.append(rest2)
		restRmBlocks.append(rest1)	
	return restRmBlocks,translatedElevListFinal
#--------------------------------------------------------------------------------------------------------------------------------------------------------





#function to translate the elev banks to the key floors plates in sequence--------------------------------
def translateElevators(elevatorBanksList,floorList,keyFloorList):
	translatedElevListFinal = []
	floorSelectedListFinal=[]
	placeforRestroomList =[]
	
	p1		=	Point.ByCoordinates(0,0,0);
	p2		=	Point.ByCoordinates(0,0,100);
	vec1		=	Vector.ByTwoPoints(p1,p2)
	
	for i in range(len(elevatorBanksList)):	
		baseFloor = floorList[i][0]
		basePt = baseFloor.Center()	
		floorL = floorList[i]
		keyFloorL = keyFloorList[i]
		floorSelectedList=[]
		translatedElevList = []
		elevatorBanksL = elevatorBanksList[i]
		for j in range(len(elevatorBanksL)):
			floorSelectedL=[]
			translatedElevL=[]
			keys = keyFloorL[j]
			keys.reverse()
			elevatorBanks = elevatorBanksL[j]
			for k in range(len(elevatorBanks)):				
				elevBank = elevatorBanks[k]
				index = keys[k]
				floor = floorL[index]
				zPt = floor.Center()
				vec = Vector.ByTwoPoints(basePt,zPt)
				elevL=[]
				for l in range(len(elevBank)):
					elev = elevBank[l]
					elevBankNew = elev.Translate(vec)	
					elevL.append(elevBankNew)
				translatedElevL.append(elevL)
				floorSelectedL.append(floor)
			translatedElevList.append(translatedElevL)
			floorSelectedList.append(floorSelectedL)
		translatedElevListFinal.append(translatedElevList)
		floorSelectedListFinal.append(floorSelectedList)	
	return translatedElevListFinal
#---------------------------------------------------------------------------------------------------------



#Assign your output to the OUT variable
OUT = restroomPlacer()
# ----------------------------------------
relocated_toilet_extruder = Python(IN[0]=key_floorplates_finder, IN[1]=code_block_3, IN[2]=floorCurves)
# ---------- relocated_toilet_extruder.python (75 lines) ----------
import clr
clr.AddReference('ProtoGeometry')
from Autodesk.DesignScript.Geometry import *
#The inputs to this node will be stored as a list in the IN variable.
dataEnteringNode = IN


toiletRecList = IN[0][0]
keyFloorList = IN[1]
floorList = IN[2]


def keyFloorCleaner(keyFloorList):
	keyFloorCleanedList = []
	for i in range(len(keyFloorList)):
		key1 = keyFloorList[i]
		ext1 = []
		for j in range(len(key1)):
			key2 = key1[j]
			ext2 =[]			
			for k in range(len(key2)):
				key3 = key2[k]
				ext2.append(key3)
			ext1.append(ext2)
		keyFloorCleanedList.append(ext1)			
	return keyFloorCleanedList


#to compute the extrusion height for the toilet rect blocks-----------------------------------------------------------------------------
def restroomExtruder(toiletRecList,keyL):
	keyFloorList = keyFloorCleaner(keyL)
	restRmExtruded = []
	testF=[]
	p1		=	Point.ByCoordinates(0,0,0);
	p2		=	Point.ByCoordinates(0,0,100);
	vec		=	Vector.ByTwoPoints(p1,p2)
	for i in range(len(toiletRecList)):
		floorL = floorList[i]
		toil1 = toiletRecList[i]
		key1 = keyFloorList[i]
		ext1 = []
		test1=[]
		for j in range(len(toil1)):
			
			toil2 = toil1[j]
			key2 = key1[j]
			toil2.reverse()
			ext2 =[]
			test1.append(toil2)
			for k in range(len(toil2)):
				toil3 = toil2[k]
				key3 = key2[k]
				keyA = key2[k]
				keyB = key2[k+1]
				key3 = keyB - keyA 
				floor = floorL[key3]
				
				flrA = floorL[keyA]
				flrB = floorL[keyB]
				
				zVal = flrB.EndPoint.Z - flrA.EndPoint.Z				
				ext	=	Curve.ExtrudeAsSolid(toil3,vec,zVal)
				ext2.append(ext)
			ext1.append(ext2)
		testF.append(test1)
		restRmExtruded.append(ext1)
		
				
				
	return restRmExtruded,testF
#---------------------------------------------------------------------------------------------------------------------------------------

#Assign your output to the OUT variable
OUT = restroomExtruder(toiletRecList,keyFloorList)
#OUT = keyFloorCleaner(keyFloorList)
# ----------------------------------------
code_block_7 = CodeBlock(a=relocated_toilet_extruder) { a[0]; }
relocatedRestroomsModel = Output(code_block_7)
floor_surface = Surface.ByPatch(floorCurves)
floorSurface = Output(floor_surface)
heightCores = Output(height_zval)
file_location = CodeBlock { a={"c:\write_ServiceModule.csv"}; }
writeToFile = CSV.WriteToFile(file_location, two_diagonal_point_finder)
file_location_2 = CodeBlock { a={"c:\write_Elevators.csv"}; }
writeToFile_2 = CSV.WriteToFile(file_location_2, two_diagonal_point_finder_2)
create = List.Create(writeToFile, writeToFile_2)
outputCSVFiles = Output(create)
