# Dynamo custom node ShellSlicerFromSTL.dyf (Dynamo 0.8.0.1233)
# category: Service Core Modeller
# Slices an input shell object from an STL file

STLPath = Input()
shell_type = Python(IN[0]=STLPath)
# ---------- shell_type.python (15 lines) ----------
import clr
clr.AddReference('ProtoGeometry')
from Autodesk.DesignScript.Geometry import *
#The inputs to this node will be stored as a list in the IN variable.
dataEnteringNode = IN


a = IN[0][-5]


a = int(a)


#Assign your output to the OUT variable
OUT = a
# ----------------------------------------
shellTypes = Output(shell_type)
fromPath = FileObject(STLPath)  # "File.FromPath"
readText = File.ReadText(fromPath)
byASCII = stuffer.STL.ByASCII(readText)
mesh = stuffer.STL.Mesh(byASCII)
byMesh = stuffer.Shell.ByMesh(mesh)
number = DoubleInput(0.5)
number_2 = DoubleInput(3.5)
bySize = stuffer.GridBasis.BySize(number, number_2)
number_3 = DoubleInput(0)
height = stuffer.Shell.Height(byMesh)
level = DoubleInput(1)
floorHeight = stuffer.GridBasis.FloorHeight(bySize, level)
number_range = NumberRange(number_3, height, floorHeight, lacing=Longest)
div = number_range / floorHeight
floorHeight_2 = stuffer.GridBasis.FloorHeight(bySize, div)
getFloorOutline = stuffer.Shell.GetFloorOutline(byMesh, floorHeight_2)
flatten = Flatten(getFloorOutline)
random_generator = DoubleSlider(51.1, range=0..100 step 0.1)
box_floor_maker = Python(IN[0]=flatten, IN[1]=shell_type, IN[2]=floorHeight_2, IN[3]=random_generator)
# ---------- box_floor_maker.python (302 lines) ----------
import clr
clr.AddReference('ProtoGeometry')
from Autodesk.DesignScript.Geometry import *
import math
#The inputs to this node will be stored as a list in the IN variable.
dataEnteringNode = IN

polygonList = IN[0]
type = IN[1]
heightList = IN[2]
iter = IN[3]

#last polygon is null, so take it off
del polygonList[-1]

srfAreaList=[]
selectedpolyList=[]
zHeightList=[]


#computes for all except type 4-----------------------------------------------------------------------------------------------
def boxFloorMaker4():	
	newpolygonList=[]
	poly1st = polygonList[0]
	srf0 = Surface.ByPatch(poly1st)
	area1st = srf0.Area
	# compute floor areas	
	for i in range(len(polygonList)):
		
		polygon = polygonList[i]
		srf = Surface.ByPatch(polygon)		
		area  = srf.Area
		if math.pow((area1st - area),2) < 5 :continue 
		srfAreaList.append(area)
		newpolygonList.append(polygon)
		
	# select floors where area changes
	for i in range(len(srfAreaList)-1):
		areaCurrent = srfAreaList[i]
		
		areaNext = srfAreaList[i+1]
		areaSubtract = areaNext-areaCurrent
		if math.pow(areaSubtract,2) < 5:
			pass
		else:
			selectedpolyList.append(newpolygonList[i])	
	selectedpolyList.append(newpolygonList[-1])
	
	#translate the selected floors to ground lvl
	newPolyList=[]
	zHeightList=[]
	
	for i in range(len(selectedpolyList)):
		selPolygon = selectedpolyList[i]
		pCenter = selPolygon.Center()
		pOrigin = Point.ByCoordinates(pCenter.X,pCenter.Y,0)		 
		vec = Vector.ByTwoPoints(pCenter,pOrigin)
		newPoly = selPolygon.Translate(vec)
					
		newPolyList.append(newPoly)
		zHeightList.append(pCenter.Z)	
		
	#trim the floors polygons to make individual blocks
	trimmedSrfList=[]
	perimeterList = []
	for i in range(len(newPolyList)-1):
		polyA = newPolyList[i]
		polyB = newPolyList[i+1]
		polyBSolid = polyB.ExtrudeAsSolid(Vector.ZAxis(),5)
		polyASrf = Surface.ByPatch(polyA)
		trimmedSurf = Surface.SubtractFrom(polyASrf,polyBSolid)
		trimmedSrfList.append(trimmedSurf)
		pass	
	trimmedSrfList.append(Surface.ByPatch(newPolyList[-1]))
	
	#just for type4
	polyBSolid = poly1st.ExtrudeAsSolid(Vector.ZAxis(),-5)
	polyASrf = trimmedSrfList[0][0]
	trimmedSurf = Surface.SubtractFrom(polyASrf,polyBSolid)
	trimmedSrfList[0] = trimmedSurf	
	
	newtrimmedList=[]
	newperimeterList = []
	
	
	# flatten the list
	for i in range(len(trimmedSrfList)):
		crv = trimmedSrfList[i]
		try :
			for j in range(len(crv)):
				newtrimmedList.append(crv[j])
				perim = crv[j].Perimeter
				newperimeterList.append(perim)
		except:
			newtrimmedList.append(crv)
			perim = crv.Perimeter
			newperimeterList.append(perim)
			
	#make floor curves for the individual blocks		
	trimmedCurvesList=[]
	ptList=[]
	rectangleList = []
	testL=[]
	for i in range(len(newtrimmedList)):
		srf = newtrimmedList[i]
		crvs = srf.PerimeterCurves()
		crvs = PolyCurve.ByJoinedCurves(crvs)
		testL.append(crvs)		

		#IF ERROR TRIGGER THESE DIST VALUES, BOTH WORKS
		dist= crvs.Length/4
		#dist= float(newperimeterList[i]/4)
		
		#pt1 = crvs.PointAtDistance(dist)
		pt2 = crvs.PointAtDistance(dist*2)
		pt4 = crvs.PointAtDistance(dist*3.999)
		pt1 = Point.ByCoordinates(pt2.X,pt4.Y)
		pt3 = Point.ByCoordinates(pt4.X,pt2.Y)
		#pt3 = crvs.PointAtDistance(dist*3)
		
		# make rectangles for the floor curves
		ptList.append((pt1,pt2,pt3,pt4))
		"""
		if type == 3:
			rec = Rectangle.ByCornerPoints(pt3,pt4,pt1,pt2)
		else:
		"""
		rec = Rectangle.ByCornerPoints(pt1,pt2,pt3,pt4)
		rectangleList.append(rec)
		trimmedCurvesList.append(crvs)
		
	if type == 3:
		tmp = rectangleList[1]
		tmp1 = zHeightList[1]
		zHeightList[1] = zHeightList[2]
		zHeightList[2] = tmp1
		rectangleList[1] = rectangleList[2]
		rectangleList[2] = tmp
	
	# make floor curves as rectangle objects
	newRecList = []
	boxRecList = []
	for i in range(len(rectangleList)):
		rec = rectangleList[i]
		boxRecList.append(rec)
		zHeight = zHeightList[i]
		newRecL=[]
		for j in range(len(heightList)):
			
			heightVal =  heightList[j]
			if zHeight < heightVal : break		 
			vec = Vector.ZAxis()
			newRecs = rec.Translate(vec,heightVal)
			newRecL.append(newRecs)
		newRecList.append(newRecL)
	#return testL
	return boxRecList,newRecList
#-------------------------------------------------------------------------------------------------------------------------------------------------------



	
	
	

	
	
#computes for all except type 4-----------------------------------------------------------------------------------------------
def boxFloorMakerAll():	
	# compute floor areas	
	for i in range(len(polygonList)):
		polygon = polygonList[i]
		srf = Surface.ByPatch(polygon)
		area  = srf.Area
		srfAreaList.append(area)
		
	# select floors where area changes
	for i in range(len(srfAreaList)-1):
		areaCurrent = srfAreaList[i]
		areaNext = srfAreaList[i+1]
		areaSubtract = areaNext-areaCurrent
		if math.pow(areaSubtract,2) < 5:
			pass
		else:
			selectedpolyList.append(polygonList[i])	
	selectedpolyList.append(polygonList[-1])
	
	#translate the selected floors to ground lvl
	newPolyList=[]
	zHeightList=[]
	for i in range(len(selectedpolyList)):
		selPolygon = selectedpolyList[i]
		pCenter = selPolygon.Center()
		pOrigin = Point.ByCoordinates(pCenter.X,pCenter.Y,0)		 
		vec = Vector.ByTwoPoints(pCenter,pOrigin)
		newPoly = selPolygon.Translate(vec)		
		newPolyList.append(newPoly)
		zHeightList.append(pCenter.Z)	
		
	#trim the floors polygons to make individual blocks
	trimmedSrfList=[]
	perimeterList = []
	for i in range(len(newPolyList)-1):
		polyA = newPolyList[i]
		polyB = newPolyList[i+1]
		polyBSolid = polyB.ExtrudeAsSolid(Vector.ZAxis(),5)
		polyASrf = Surface.ByPatch(polyA)
		trimmedSurf = Surface.SubtractFrom(polyASrf,polyBSolid)
		trimmedSrfList.append(trimmedSurf)
		pass	
	trimmedSrfList.append(Surface.ByPatch(newPolyList[-1]))
		
	newtrimmedList=[]
	newperimeterList = []
	
	# flatten the list
	for i in range(len(trimmedSrfList)):
		crv = trimmedSrfList[i]
		try :
			for j in range(len(crv)):
				newtrimmedList.append(crv[j])
				perim = crv[j].Perimeter
				newperimeterList.append(perim)
		except:
			newtrimmedList.append(crv)
			perim = crv.Perimeter
			newperimeterList.append(perim)
			
	#make floor curves for the individual blocks		
	trimmedCurvesList=[]
	ptList=[]
	rectangleList = []
	for i in range(len(newtrimmedList)):
		srf = newtrimmedList[i]
		crvs = srf.PerimeterCurves()
		crvs = PolyCurve.ByJoinedCurves(crvs)
	
		#IF ERROR TRIGGER THESE DIST VALUES, BOTH WORKS
		#dist= crvs.Length/4
		dist= float(newperimeterList[i]/4)
		
		#pt1 = crvs.PointAtDistance(dist)
		pt2 = crvs.PointAtDistance(dist*0)
		pt4 = crvs.PointAtDistance(dist*2)
		pt1 = Point.ByCoordinates(pt2.X,pt4.Y)
		pt3 = Point.ByCoordinates(pt4.X,pt2.Y)
		#pt3 = crvs.PointAtDistance(dist*3)
		
		# make rectangles for the floor curves
		ptList.append((pt1,pt2,pt3,pt4))
		"""
		if type == 3:
			rec = Rectangle.ByCornerPoints(pt3,pt4,pt1,pt2)
		else:
		"""
		rec = Rectangle.ByCornerPoints(pt1,pt2,pt3,pt4)
		rectangleList.append(rec)
		trimmedCurvesList.append(crvs)
		
	if type == 3:
		tmp = rectangleList[1]
		tmp1 = zHeightList[1]
		zHeightList[1] = zHeightList[2]
		zHeightList[2] = tmp1
		rectangleList[1] = rectangleList[2]
		rectangleList[2] = tmp
	
	# make floor curves as rectangle objects
	newRecList = []
	boxRecList = []
	for i in range(len(rectangleList)):
		rec = rectangleList[i]
		boxRecList.append(rec)
		zHeight = zHeightList[i]
		newRecL=[]
		for j in range(len(heightList)):
			
			heightVal =  heightList[j]
			if zHeight < heightVal : break		 
			vec = Vector.ZAxis()
			newRecs = rec.Translate(vec,heightVal)
			newRecL.append(newRecs)
		newRecList.append(newRecL)
	
	return boxRecList,newRecList
#-------------------------------------------------------------------------------------------------------------------------------------------------------

# type 4 is O SHELL, so needs different treatment

if type == 4:
	out =boxFloorMaker4()
else :	
	out = boxFloorMakerAll()
	
			
	
	
	
	
#Assign your output to the OUT variable
#OUT = newPolyList,trimmedSrfList,zHeightList,newtrimmedList,newRecList,ptList
OUT = out
# ----------------------------------------
floor_curves = CodeBlock(a=box_floor_maker) { a[1]; }
floorCurves = Output(floor_curves)
box_low_level = CodeBlock(a=box_floor_maker) { a[0]; }
lowLevelBoxes = Output(box_low_level)
