# Dynamo graph CORE GENERATOR_CUSTOM NODE NEW.dyn (Dynamo 0.8.0.1233)

pos_x = IntegerSlider(-164, range=-200..-75 step 1)
pos_y = IntegerSlider(100, range=50..200 step 1)
length = IntegerSlider(137, range=10..200 step 1)
width = IntegerSlider(90, range=10..200 step 1)
shell_type = IntegerSlider(4, range=1..4 step 1)
height = DoubleSlider(183.9, range=1..600 step 0.1)
user_input_floor_heights = CodeBlock { regularFloorHeight = 5; mechanicalFloorHeight = 7; mechFloor_Frequency = 18; }
random_height_generator = IntegerSlider(92, range=0..100 step 1)
shellMakerInbuilt = Custom[ShellMakerInbuilt](posX=pos_x, posY=pos_y, length=length, width=width, shellType=shell_type, totalHeight=height, regularFloorHeight=user_input_floor_heights.regularFloorHeight, mechanicalFloorHeight=user_input_floor_heights.mechanicalFloorHeight, mechanicalFloorFreq=user_input_floor_heights.mechFloor_Frequency, randomKey=random_height_generator)  # Builds four types of shell based on inbuilt algorithm
floor_maker = CodeBlock(floorMaker=shellMakerInbuilt.floorCurves) { floorMaker; }
boxMaker = CodeBlock(boxMaker=shellMakerInbuilt.lowLevelBoxes) { boxMaker; }
area_one_elevator_can_serve = DoubleSlider(5259, range=200..10000 step 1)
lift_lobby_width = DoubleSlider(2, range=0.5..11 step 0.1)
shell_type_2 = CodeBlock(type=shellMakerInbuilt.shellType) { type; }
max_distance_from_nearest_core = IntegerSlider(60, range=5..609 step 1)
max_elevators = IntegerSlider(5, range=2..33 step 1)
servicecoremaker_analyzer = Custom[ServiceCoreMaker + Analyzer](floorCurves=floor_maker, lowLevelBoxes=boxMaker, areaServedPerElev=area_one_elevator_can_serve, liftLobbyWidth=lift_lobby_width, shellType=shell_type_2, maxDistanceToCore=max_distance_from_nearest_core, maxElevatorPerBank=max_elevators)  # Computes the service core configuration and analyzes its efficiency
bank_rectangle_piece = CodeBlock(Bank_Rectangle=servicecoremaker_analyzer.elevBankSpace) { Bank_Rectangle[0]; }
elev_banks = CodeBlock(a=servicecoremaker_analyzer.elevatorBanks) { a[0]; }
elev_bank_converter = Python(IN[0]=elev_banks)
# ---------- elev_bank_converter.python (23 lines) ----------
import clr
clr.AddReference('ProtoGeometry')
from Autodesk.DesignScript.Geometry import *
#The inputs to this node will be stored as a list in the IN variable.
dataEnteringNode = IN

elevBanksList = IN[0]

finalNew = []
for i in range(len(elevBanksList)):
	elevL = elevBanksList[i]
	newL1=[]
	for j in range(len(elevL)):
		newL2=[]
		elev = elevL[j]
		for k in range(len(elev)):	
			newL2.extend(elev[k])
		newL1.append(newL2)			
	finalNew.append(newL1)
	

#Assign your output to the OUT variable
OUT = finalNew
# ----------------------------------------
lobby_corridor_finder = Python(IN[0]=servicecoremaker_analyzer.elevBankSpace, IN[1]=elev_bank_converter)
# ---------- lobby_corridor_finder.python (48 lines) ----------
import clr
clr.AddReference('ProtoGeometry')
from Autodesk.DesignScript.Geometry import *
#The inputs to this node will be stored as a list in the IN variable.
dataEnteringNode = IN

bankRecList = IN[0]
elevBanksList= IN[1]


"""
polyBSolid = polyB.ExtrudeAsSolid(Vector.ZAxis(),5)
		polyASrf = Surface.ByPatch(polyA)
		trimmedSurf = Surface.SubtractFrom(polyASrf,polyBSolid)
		trimmedSrfList.append(trimmedSurf)
		
		
"""


# to make the 


trimmedList = []
solidN = []
for i in range(len(bankRecList)):
	bankRecL = bankRecList[i]
	elevBankL = elevBanksList[i]
	trimmedL=[]
	solidListAll = []
	for j in range(len(bankRecL)):
		bankRec = bankRecL[j]
		elevB = elevBankL[j]
		solidList = []
		for k in range(len(elevB)):
			elev = elevB[k]
			polySolid = elev.ExtrudeAsSolid(Vector.ZAxis(),-5)
			solidList.append(polySolid)
		solidListAll.append(solidList)
		polyBSolid = Solid.ByUnion(solidList)
		polyASrf = Surface.ByPatch(bankRec)
		trimmedSurf = Surface.SubtractFrom(polyASrf,polyBSolid)
		trimmedL.append(trimmedSurf)
	trimmedList.append(trimmedL)
	solidN.append(solidListAll)

#Assign your output to the OUT variable
OUT = trimmedList
# ----------------------------------------
corridorSystem = CodeBlock(corridorSystem=lobby_corridor_finder) { corridorSystem; }
coregeometry_pointextraction = Custom[CoreGeometry + PointExtraction](techRoomsRestRooms=servicecoremaker_analyzer.techRooms_restRooms, floorCurves=floor_maker, keyFloors=servicecoremaker_analyzer.keyFloors, elevBankLists=servicecoremaker_analyzer.elevatorBanks, serviceCoreCurve=servicecoremaker_analyzer.serviceCoreCurve)  # Builds the 3d core geometries and exports the two opposite diagonal points of relevant core elements
corridor_extruded = Python(IN[0]=corridorSystem, IN[1]=coregeometry_pointextraction.heightCores)
# ---------- corridor_extruded.python (21 lines) ----------
import clr
clr.AddReference('ProtoGeometry')
from Autodesk.DesignScript.Geometry import *
#The inputs to this node will be stored as a list in the IN variable.
dataEnteringNode = IN

corridorList = IN[0]
zValList = IN[1]

corVolList = []
for i in range(len(corridorList)):
	corL = corridorList[i]
	zValL = zValList[i]
	corVolL=[]
	for j in range(len(corL)):
		coridorVol = Surface.Thicken(corL[j][0],zValL[j])
		corVolL.append(coridorVol)
	corVolList.append(corVolL)

#Assign your output to the OUT variable
OUT = corVolList
# ----------------------------------------
flatten = Flatten(corridor_extruded)
byUnion = Solid.ByUnion(flatten)
create = List.Create(coregeometry_pointextraction.lowLevelRestroomModel, coregeometry_pointextraction.relocatedRestroomsModel, coregeometry_pointextraction.elevatorsModel, coregeometry_pointextraction.techRoomsModel)
flatten_2 = Flatten(create)
byUnion_2 = Solid.ByUnion(flatten_2)
difference = Solid.Difference(solid=coregeometry_pointextraction.fullServiceCoreModel, other=byUnion_2)
flatten_3 = Flatten(difference)
byUnion_3 = Solid.ByUnion(flatten_3)
difference_2 = Solid.Difference(solid=byUnion, other=byUnion_3)
intersect = Geometry.Intersect(geometry=byUnion_3, other=byUnion)
file_path = Filename("D:\SUBHAJIT PROJECTS\WORK\00 DYNAMO AUTOMATED STAIRCORE\00 STL FILES\L-Shell2.stl")
shellSlicerFromSTL = Custom[ShellSlicerFromSTL](STLPath=file_path)  # Slices an input shell object from an STL file
