# Dynamo custom node Core Geometry Maker.dyf (Dynamo 0.8.0.1233)
# category: ServiceCore New
# Builds Core Geometry

Floors = Input()
keyFloors = Input()
key_floors = CodeBlock(keyFloors=keyFloors) { keyFloors[0]; }
Elevators = Input()
elevators = CodeBlock(a=Elevators) { a[0]; }
variable_height_elevators = Python(IN[0]=Floors, IN[1]=key_floors, IN[2]=elevators)
# ---------- variable_height_elevators.python (45 lines) ----------
import clr
clr.AddReference('ProtoGeometry')
from Autodesk.DesignScript.Geometry import *

#The inputs to this node will be stored as a list in the IN variable.
dataEnteringNode = IN

floorsList		=	IN[0]
keyFloorsList	=	IN[1]
elevListList	=	IN[2]

def elevExtruder():
	extruded=[]
	keyFloors.reverse()
	p1		=	Point.ByCoordinates(0,0,0);
	p2		=	Point.ByCoordinates(0,0,100);
	vec		=	Vector.ByTwoPoints(p1,p2)
	for i in range(len(elevList)):
		flr = floors[keyFloors[i]]
		cen = flr.EndPoint
		zVal= cen.Z
		crv = elevList[i]
		geom=[]
		for j in range(len(crv)):
			ext	=	Curve.Extrude(crv[j],vec,zVal)		
			geom.append(ext)		
		extruded.append(geom)
	return extruded

finExt=[]
for i in range(len(elevListList)):
	floors = floorsList[i]	
	keyFloors = keyFloorsList[i]
	elevList = elevListList[i]
	extL=[]
	for j in range(len(elevList)):	
		keyFloors = keyFloorsList[i][j]
		elevList = elevListList[i][j]	
		ext = elevExtruder()
		extL.append(ext)
	finExt.append(extL)


#Assign your output to the OUT variable
OUT = finExt#finExt
# ----------------------------------------
Extruded_Elevators = Output(variable_height_elevators)
TechrmsRestrms = Input()
techrooms_restrooms = CodeBlock(TECHRMS_RESTRMS=TechrmsRestrms) { TECHRMS_RESTRMS; }
code_block = CodeBlock(a=techrooms_restrooms) { b={a[0]}; }
transpose = List.Transpose(code_block)
extruded_tech_rooms = Python(IN[0]=Floors, IN[1]=transpose)
# ---------- extruded_tech_rooms.python (60 lines) ----------
import clr
clr.AddReference('ProtoGeometry')
from Autodesk.DesignScript.Geometry import *
#The inputs to this node will be stored as a list in the IN variable.
dataEnteringNode = IN

floorsList		=	IN[0]
techRoomsList	=	IN[1]



def extruder():
	extruded=[]
	for i in range(len(techRooms)):
		flr = floors[-1]
		cen = flr.EndPoint
		zVal= cen.Z
		crv = techRooms[i]
		extN = crv.Extrude(zVal)
		extruded.append(extN)
	return extruded

finExt = []
for i in range(len(techRoomsList)):
	techRoomsL = techRoomsList[i]
	floors = floorsList[i]
	flr = floors[-1]	
	cen = flr.EndPoint
	zVal= cen.Z
	for j in range(len(techRoomsL)):		
		techRooms = techRoomsL[j]
		extruded=[]
		for k in range(len(techRooms)):
			techR = techRooms[k]		
			extN = techR.Extrude(zVal)
			extruded.append(extN)
		finExt.append(extruded)
		
		
#Assign your output to the OUT variable
OUT = finExt






"""
finExt=[]
for i in range(len(elevListList)):
	floors = floorsList[i]	
	elevList = elevListList[i]
	extL=[]
	for j in range(len(elevList)):	
		keyFloors = keyFloorsList[i][j]
		elevList = elevListList[i][j]	
		ext = elevExtruder()
		extL.append(ext)
	finExt.append(extL)
"""
# ----------------------------------------
Extruded_Service_Module = Output(extruded_tech_rooms)
code_block_2 = CodeBlock(a=techrooms_restrooms) { a[1..2]; }
translated_floors = CodeBlock(FLOORS=Floors) { FLOORS; }
lowlevel_restroom_extruder = Python(IN[0]=key_floors, IN[1]=code_block_2, IN[2]=translated_floors)
# ---------- lowlevel_restroom_extruder.python (43 lines) ----------
import clr
clr.AddReference('ProtoGeometry')
from Autodesk.DesignScript.Geometry import *
#The inputs to this node will be stored as a list in the IN variable.
dataEnteringNode = IN

keyFloorList = IN[0]
restrmList = IN[1]
floorList = IN[2]


#to compute the lower lvl restrm spaces------------------------------
def restrmLowLvlExtruder(keyFloorList,restrmL,floorList):
	extruded = []
	p1		=	Point.ByCoordinates(0,0,0);
	p2		=	Point.ByCoordinates(0,0,100);
	vec		=	Vector.ByTwoPoints(p1,p2)
	for i in range(len(keyFloorList)):
		key1 = keyFloorList[i]
		floorL = floorList[i]
		rest1 = restrmL[i]
		extF=[]
		for j in range(len(key1)):
			key2 = key1[j]
			rest2 = rest1[j]
			floor = floorL[key2[0]]
			zVal = floor.Center().Z
			ext1 = Curve.Extrude(rest2,vec,zVal)
			#ext2 = Curve.Extrude(rest2[1],vec,zVal)
			extF.append(ext1)
			#extF.append(ext2)
		extruded.append(extF)			
			
	return extruded
#--------------------------------------------------------------------
extF=[]
for i in range(len(restrmList)):
	restrmL = restrmList[i]
	ext = restrmLowLvlExtruder(keyFloorList,restrmL,floorList)
	extF.append(ext)

#Assign your output to the OUT variable
OUT =extF
# ----------------------------------------
Low_Level_restrooms = Output(lowlevel_restroom_extruder)
watch = Watch(code_block_2)
