# Dynamo custom node Shell Maker.dyf (Dynamo 0.8.0.1233)
# category: ServiceCore New
#  Creates Building Shell

posX = Input()
posY = Input()
length = Input()
width = Input()
shellType = Input()
irregular_shape_maker = Python(IN[0]=posX, IN[1]=posY, IN[2]=length, IN[3]=width, IN[4]=shellType)
# ---------- irregular_shape_maker.python (215 lines) ----------
import clr
clr.AddReference('ProtoGeometry')
from Autodesk.DesignScript.Geometry import *
#The inputs to this node will be stored as a list in the IN variable.
dataEnteringNode = IN


x = IN[0]
y = IN[1]
lenX = IN[2]
lenY = IN[3]
type = int(IN[4])

pt = Point.ByCoordinates(x,y,0)

#find the closest point from a point-------------------------------------------------------------------------------------	
def closestPoint(ptA,ptList):
	shortLen	=	100000000000000 # set as a really high value
	index		=	0
	for i in range(len(ptList)):
		vec				= 	Vector.ByTwoPoints(ptA,ptList[i])
		vecLen			=	vec.Length
		if ( vecLen < shortLen ):
			shortLen	=	vecLen
			index		=	i
	# returns the closest point to ptA from the list
	return ptList[index]
#------------------------------------------------------------------------------------------------------------------------

#function which makes l shaped profile-----------------------------------------------------------------------------------
def shapeMaker():
	linList = []
	ptList = []
	
	ptX = Point.ByCoordinates(200000,0,0)
	ptY = Point.ByCoordinates(0,200000,0)
	
	xvec = Vector.ByTwoPoints(pt,ptX)
	yvec = Vector.ByTwoPoints(pt,ptY)
	xvecN = xvec.Reverse()
	yvecN = yvec.Reverse()
	a = int(lenX/2)
	b = int(lenY/3)
	len = [lenX,a,b,lenY-a,lenX-b,lenY]
	dir = [0,0,1,0,1,1]
	point = pt
	ptList.append(point)
	for i in range(6):
		#toggle vec values
		if i%2 ==0:
			if dir[i]==0: vec = xvec
			else: vec = xvecN
		else:
			if dir[i]==0: vec = yvec
			else: vec = yvecN	
		l1 = Line.ByStartPointDirectionLength(point,vec,len[i])
		linList.append(l1)
		point = l1.EndPoint
		ptList.append(point)
	polygon = Polygon.ByPoints(ptList)
	polyCenter = polygon.Center()
	closePt = closestPoint(polyCenter,ptList)
	return polygon,closePt
#---------------------------------------------------------------------------------------------------------------------------


def typeListMaker():
	if type == 1:		
		len = [lenX,lenY,lenX,lenY]
		dir = [0,0,1,1]
		sides = 4		
	if type == 2:
		a = int(lenX/2)		
		b = int(lenY/3)			
		len = [lenX,a,b,lenY-a,lenX-b,lenY]
		dir = [0,0,1,0,1,1]
		sides = 6
	if type == 3:		
		a1 = int(lenX/3)
		a2 = int(lenX/4)
		b = int(lenY/2)	
		len = [lenX,lenY,a1,b,a2,b,lenX-a1-a2,lenY]
		dir = [0,0,1,1,1,0,1,1]
		sides = 8
	if type == 4:
		len = [lenX,lenY,lenX,lenY]
		dir = [0,0,1,1]
		sides = 4	
	return len,dir,sides


#function which makes l shaped profile-----------------------------------------------------------------------------------
def shapeGenerator():
	linList = []
	ptList = []
	
	ptX = Point.ByCoordinates(200000,0,0)
	ptY = Point.ByCoordinates(0,200000,0)
	
	xvec = Vector.ByTwoPoints(pt,ptX)
	yvec = Vector.ByTwoPoints(pt,ptY)
	xvecN = xvec.Reverse()
	yvecN = yvec.Reverse()
	a = int(lenX/2)
	b = int(lenY/3)
	
	#len = [lenX,a,b,lenY-a,lenX-b,lenY]
	#dir = [0,0,1,0,1,1]
	#sides = 6
	 
	len = typeListMaker()[0]
	dir = typeListMaker()[1]
	sides = typeListMaker()[2]
	
	point = pt
	ptList.append(point)
	for i in range(sides):
		#toggle vec values
		if i%2 ==0:
			if dir[i]==0: vec = xvec
			else: vec = xvecN
		else:
			if dir[i]==0: vec = yvec
			else: vec = yvecN	
		l1 = Line.ByStartPointDirectionLength(point,vec,len[i])
		linList.append(l1)
		point = l1.EndPoint
		ptList.append(point)
	polygon = Polygon.ByPoints(ptList)
	polyCenter = polygon.Center()
	closePt = closestPoint(polyCenter,ptList)
	return polygon,closePt
#---------------------------------------------------------------------------------------------------------------------------



#function which makes  shaped profile---------------------------------------------------------------------------------------
def shapeGenType4():
	linList = []
	ptList = []
	
	ptX = Point.ByCoordinates(200000,0,0)
	ptY = Point.ByCoordinates(0,200000,0)
	
	xvec = Vector.ByTwoPoints(pt,ptX)
	yvec = Vector.ByTwoPoints(pt,ptY)
	xvecN = xvec.Reverse()
	yvecN = yvec.Reverse()
		
	 
	len = typeListMaker()[0]
	dir = typeListMaker()[1]
	sides = typeListMaker()[2]
	
	#1st outer polygon===============================================================
	point = pt
	ptList.append(point)
	for i in range(sides):
		#toggle vec values
		if i%2 ==0:
			if dir[i]==0: vec = xvec
			else: vec = xvecN
		else:
			if dir[i]==0: vec = yvec
			else: vec = yvecN	
		l1 = Line.ByStartPointDirectionLength(point,vec,len[i])
		linList.append(l1)
		point = l1.EndPoint
		ptList.append(point)
	polygon = Polygon.ByPoints(ptList)
	polyCenter = polygon.Center()
	closePt = closestPoint(polyCenter,ptList)
	#================================================================================
	a = lenX/1.8
	b = lenY/2.2
	len[0] = len[0] - a
	len[1] = len[1] - b
	len[2] = len[0]
	len[3] = len[1]
	
	linList = []
	ptList = []
	#inner polygon====================================================================
	point = pt
	ptList.append(point)
	for i in range(sides):
		#toggle vec values
		if i%2 ==0:
			if dir[i]==0: vec = xvec
			else: vec = xvecN
		else:
			if dir[i]==0: vec = yvec
			else: vec = yvecN	
		l1 = Line.ByStartPointDirectionLength(point,vec,len[i])
		linList.append(l1)
		point = l1.EndPoint
		ptList.append(point)
	polygon2 = Polygon.ByPoints(ptList)
	ptN = Point.ByCoordinates(pt.X+(a/2),pt.Y+(b/2))
	vecShift = Vector.ByTwoPoints(pt,ptN)
	polygon2 = polygon2.Translate(vecShift)
	#polyCenter = polygon.Center()
	#closePt = closestPoint(polyCenter,ptList)
	#================================================================================
	
	
	return [polygon,polygon2],closePt
#---------------------------------------------------------------------------------------------------------------------------


if type == 4: out = shapeGenType4()
else : out = shapeGenerator()

#Assign your output to the OUT variable
OUT = out
# ----------------------------------------
box_maker = Python(IN[0]=irregular_shape_maker, IN[1]=shellType)
# ---------- box_maker.python (158 lines) ----------
import clr
clr.AddReference('ProtoGeometry')
from Autodesk.DesignScript.Geometry import *
#The inputs to this node will be stored as a list in the IN variable.
dataEnteringNode = IN

polygon = IN[0][0]
closPt = IN[0][1]
type = IN[1]
if type!=4:
	polyPts = polygon.Points

#finds the opposite point to the closest point-------------------------------------------------
def oppPointFinder(poly,closPt):
	polyPts = poly.Points
	for i in range(len(polyPts)):
		if closPt == polyPts[i]:
			oppPt = polyPts[i-3]
			index = i
			break	
	return oppPt,index
#---------------------------------------------------------------------------------------------


#find the closest point from a point-------------------------------------------------------------------------------------	
def closestPoint(ptA,ptList):
	shortLen	=	100000000000000 # set as a really high value
	index		=	0
	for i in range(len(ptList)):
		vec				= 	Vector.ByTwoPoints(ptA,ptList[i])
		vecLen			=	vec.Length
		if ( vecLen < shortLen ):
			shortLen	=	vecLen
			index		=	i
	# returns the closest point to ptA from the list
	return ptList[index]
#------------------------------------------------------------------------------------------------------------------------




#func to split the type3 polygon to regular rect and l shape rect-----------------------------
def multiRecMaker():
	oppPt = oppPointFinder(polygon,closPt)[0]
	id = oppPointFinder(polygon,closPt)[1]-3
	siz = len(polyPts)
	
	lin = Line.ByStartPointEndPoint(closPt,polyPts[id+4])
	lin = lin.Extend(300,lin.StartPoint)
	
	crvsPoly = polygon.Curves()
	for crvs in crvsPoly:		
		pt = Geometry.Intersect(lin,crvs)
		if pt != None:
			break
	ptListA = [polyPts[0],pt[0],polyPts[id+4],polyPts[id+5]]
	ptListB = [pt[0],polyPts[id-1],polyPts[id],polyPts[id+1],polyPts[id+2],polyPts[id+3]]
	polyA = Polygon.ByPoints(ptListA)	
	polyB = Polygon.ByPoints(ptListB)
	polyNew = recMakers(polyB)
	#return lin,oppPt,polyPts[id],crvsPoly,pt,polyA,polyB
	return polyA,polyNew[0],polyNew[1]
#----------------------------------------------------------------------------------------------	
	
	
def recFromType4():
	poly1 = polygon[0]
	poly2 = polygon[1]
	polyPts1 = poly1.Points
	polyPts2 = poly2.Points
	pt=[]
	
	lin1 = Line.ByStartPointEndPoint(polyPts2[0],polyPts2[1])
	lin1 = lin1.Extend(300,lin1.StartPoint)
	lin1 = lin1.Extend(300,lin1.EndPoint)
	
	lin2 = Line.ByStartPointEndPoint(polyPts2[2],polyPts2[3])
	lin2 = lin2.Extend(300,lin2.StartPoint)
	lin2 = lin2.Extend(300,lin2.EndPoint)
	
	crvsPoly1 = poly1.Curves()
	for crvs in crvsPoly1:
		ptInt = Geometry.Intersect(lin1,crvs)
		if len(ptInt) == 0:	continue
		else: pt.append(ptInt[0])
		
	ptList1 = [pt[0],pt[1],polyPts1[0],polyPts1[1]]
	polyA = Polygon.ByPoints(ptList1)	
	for crvs in crvsPoly1:		
		ptInt = Geometry.Intersect(lin2,crvs)
		if len(ptInt) == 0:	continue
		else: pt.append(ptInt[0])	
		
	ptList2 = [pt[3],pt[2],polyPts1[2],polyPts1[3]]
	polyB = Polygon.ByPoints(ptList2)
	
	ptList3 = [pt[2],pt[0],polyPts2[1],polyPts2[2]]
	polyC = Polygon.ByPoints(ptList3)
	
	ptList4 = [pt[3],pt[1],polyPts2[0],polyPts2[3]]
	polyD = Polygon.ByPoints(ptList4)
	return polyA,polyB,polyC,polyD
	
	
	
	
#func to convert polygon to a rectangle---------------------------------------------------
def polytoRect(poly):
	crvs = poly.Curves()
	polyPts = poly.Points
	polyCen = poly.Center()
	wid = Line.ByStartPointEndPoint(polyPts[0],polyPts[1]).Length
	ht = Line.ByStartPointEndPoint(polyPts[0],polyPts[3]).Length
	
	cs = CoordinateSystem.ByOrigin(polyCen)
	#rec = Rectangle.ByWidthHeight(cs,wid,ht)
	
	ptList=[]
	for i in range(len(crvs)-1):
		pt = crvs[i].StartPoint
		ptList.append(pt)	
	rec = Rectangle.ByCornerPoints(ptList)
	return rec
#-----------------------------------------------------------------------------------------

#makes two polygons for two places in the l shape---------------------------------------------
def recMakers(poly):
	#poly = multiRecMaker()[1]
	polyPts = poly.Points
	polyCen = poly.Center()
	
	closPt = closestPoint(polyCen,polyPts)
	 
	oppPt = oppPointFinder(poly,closPt)[0]
	id = oppPointFinder(poly,closPt)[1]-3
	line1 = Line.ByStartPointEndPoint(polyPts[id],polyPts[id+1])
	line2 = Line.ByStartPointEndPoint(polyPts[id-1],polyPts[id-2])
	dist = line2.Length	
	ptNew = line1.PointAtParameter(dist/line1.Length)
	
	ptListA = [polyPts[id],polyPts[id-1],polyPts[id-2],ptNew]
	ptListB = [ptNew,polyPts[id-3],polyPts[id-4],polyPts[id-5]]
	
	polyA = Polygon.ByPoints(ptListA)
	polyB = Polygon.ByPoints(ptListB)
	
	return polyA,polyB
#---------------------------------------------------------------------------------------------

if type==1: out = [polygon]
if type==2: out = recMakers(polygon)
if type==3: out = multiRecMaker()
if type==4: out = recFromType4()

recListFinal = [polytoRect(out[i]) for i in range(len(out)) ]
#Assign your output to the OUT variable
OUT = recListFinal
#OUT = recMakers()
# ----------------------------------------
height = Input()
regFloorHeight = Input()
mechFloorHeight = Input()
mechFloorFrequency = Input()
generates_floor_plane_heights = Python(IN[0]=height, IN[1]=regFloorHeight, IN[2]=mechFloorHeight, IN[3]=mechFloorFrequency)
# ---------- generates_floor_plane_heights.python (45 lines) ----------
import clr
clr.AddReference('ProtoGeometry')
from Autodesk.DesignScript.Geometry import *
import math
#The inputs to this node will be stored as a list in the IN variable.
dataEnteringNode = IN

#inputs------------------------------------------------------------
twr_Height = IN[0]
regflr_Ht  = IN[1]
mechflr_Ht = IN[2]
keyflr_Mech= IN[3]
#inputs------------------------------------------------------------

approxNum_Floors  =  twr_Height / regflr_Ht
numberof_MechFloors = math.ceil(approxNum_Floors / keyflr_Mech)
height_Counter = 0
height_List=[]
height = 0
tag = 0

while height<twr_Height:		
	#iterate to add the heights for the regular floors till first mechanical lvl
	for i in range(keyflr_Mech):
		if i == 0 and tag == 0:
			height += 0
			tag = 1
		else:
			height += regflr_Ht
		height_List.append(height)
		
		if ((height + mechflr_Ht + 1) > twr_Height): break
				
	if ((height) > twr_Height):	break		
		
	height += mechflr_Ht
	# add the mechanical floor height to the height list
	height_List.append(height)
 




#Assign your output to the OUT variable
OUT = height_List
# ----------------------------------------
triggerHeight = Input()
floor_maker = Python(IN[0]=box_maker, IN[1]=generates_floor_plane_heights, IN[2]=triggerHeight)
# ---------- floor_maker.python (51 lines) ----------
import clr
clr.AddReference('ProtoGeometry')
from Autodesk.DesignScript.Geometry import *
import sys
sys.path.append("C:\Program Files (x86)\IronPython 2.7\Lib")
import random
#The inputs to this node will be stored as a list in the IN variable.
dataEnteringNode = IN

recList=IN[0]
floorHeights = IN[1]

#makes variable length floor height list-------------------------------------------------------------------------------------------
def variableFloorHeight(flrHtList):
	newFlrHtList = []
	for i in range(len(recList)):
		y = len(flrHtList)
		x = y/2
		a = int(random.uniform(x,y))
		flrTest = flrHtList[:a]
		newFlrHtList.append(flrTest)
	return newFlrHtList
#----------------------------------------------------------------------------------------------------------------------------------




#makes floors translate to given height list---------------------------------------------------------------------------------------
def floorTranslator(recList,flrHtList):
	newRecList = []
	ptA = Point.ByCoordinates(0,0,0)
	ptB = Point.ByCoordinates(0,0,100)
	vec = Vector.ByTwoPoints(ptA,ptB)
	for i in range(len(recList)):
		rec = recList[i]
		recNList=[]
		flrHeights = flrHtList[i]
		for j in range(len(flrHeights)):
			dist = flrHeights[j]
			newRec = rec.Translate(vec,dist)
			recNList.append(newRec)
		newRecList.append(recNList)
	return newRecList
#---------------------------------------------------------------------------------------------------------------------------------


flrNewHeights = variableFloorHeight(floorHeights)
out = floorTranslator(recList,flrNewHeights)

#Assign your output to the OUT variable
OUT = out
# ----------------------------------------
Floors = Output(floor_maker)
Boxed_Rectangle = Output(box_maker)
major_floor_builder = Python(IN[0]=floor_maker)
# ---------- major_floor_builder.python (18 lines) ----------
import clr
clr.AddReference('ProtoGeometry')
from Autodesk.DesignScript.Geometry import *
#The inputs to this node will be stored as a list in the IN variable.
dataEnteringNode = IN

floorList = IN[0]

outFlr=[]
for i in range(len(floorList)):
	floorL = floorList[i]
	outFlr.Add(floorL[0])
	outFlr.Add(floorL[int(len(floorL)/4)])
	outFlr.Add(floorL[int(len(floorL)/2)])
	outFlr.Add(floorL[int(len(floorL)*3/4)])
	outFlr.Add(floorL[-1])
#Assign your output to the OUT variable
OUT = outFlr
# ----------------------------------------
watch = Watch(major_floor_builder)
MassProfile = Output(major_floor_builder)
