# Dynamo graph 5TH AUG_CN_COLINS_1.dyn (Dynamo 0.8.0.1233)

file_location = CodeBlock { a={"c:\write_Elevators.csv"}; }
posY = IntegerSlider(0, range=-200..0 step 1)
posX = IntegerSlider(0, range=0..200 step 1)
length = IntegerSlider(48, range=10..200 step 1)
width = IntegerSlider(62, range=10..200 step 1)
height = DoubleSlider(308.5, range=5..600 step 0.5)
shell_type = IntegerSlider(3, range=1..4 step 1)
user_input_floor_heights = CodeBlock { regularFloorHeight = 4; mechanicalFloorHeight = 7; mechFloor_Frequency = 12; }
trigger_height_generator = IntegerSlider(35, range=0..100 step 1)
shell_maker = Custom[Shell Maker](posX=posY, posY=posX, length=length, width=width, height=height, shellType=shell_type, regFloorHeight=user_input_floor_heights.regularFloorHeight, mechFloorHeight=user_input_floor_heights.mechanicalFloorHeight, mechFloorFrequency=user_input_floor_heights.mechFloor_Frequency, triggerHeight=trigger_height_generator)  # Creates Building Shell
floorCurves = CodeBlock(floorCurves=shell_maker.Floors) { floorCurves; }
boxMakers = CodeBlock(boxMakers=shell_maker.Boxed_Rectangle) { boxMakers; }
shellType = CodeBlock(shellType=shell_type) { shellType; }
max_distance_to_core = IntegerSlider(25, range=8..250 step 1)
lift_lobby_width = DoubleSlider(2, range=0.5..4 step 0.25)
max_elevators = IntegerSlider(7, range=2..33 step 1)
area_one_elevator_can_serve = DoubleSlider(7000, range=4000..10000 step 200)
core_placer_analyzer = Custom[Core Placer + Analyzer](rectangleBox=boxMakers, floorCurve=floorCurves, shellType=shellType, maxDistancetoCore=max_distance_to_core, liftLobbyWidth=lift_lobby_width, maxElevperRow=max_elevators, AreaOneElevatorServes=area_one_elevator_can_serve)  # Core Maker and analyzes efficiency
core_geometry_maker = Custom[Core Geometry Maker](Floors=floorCurves, keyFloors=core_placer_analyzer.keyFloorsHeights, TechrmsRestrms=core_placer_analyzer.TechRooms_RestRooms, Elevators=core_placer_analyzer.CoreDetails)  # Builds Core Geometry
vertices = Face.Vertices(core_geometry_maker.Extruded_Elevators)
pointFinder = Python(IN[0]=vertices)
# ---------- pointFinder.python (22 lines) ----------
import clr
clr.AddReference('ProtoGeometry')
from Autodesk.DesignScript.Geometry import *
#The inputs to this node will be stored as a list in the IN variable.
dataEnteringNode = IN

vertexList = IN[0]
tupleList = []
for i in range(len(vertexList)):
	ver = vertexList[i]
	for j in range(len(vertexList[i])):
		ver2 = ver[j]
		for k in range(len(ver2)):
			tup = (ver2[k].PointGeometry.X,ver2[k].PointGeometry.Y,ver2[k].PointGeometry.Z)
			tupleList.append(tup)


		


#Assign your output to the OUT variable
OUT = tupleList
# ----------------------------------------
writeToFile = CSV.WriteToFile(file_location, pointFinder)
file_location_2 = CodeBlock { a={"c:\write_ServiceModule.csv"}; }
vertices_2 = Face.Vertices(core_geometry_maker.Extruded_Elevators)
pointFinder_2 = Python(IN[0]=vertices_2)
# ---------- pointFinder_2.python (20 lines) ----------
import clr
clr.AddReference('ProtoGeometry')
from Autodesk.DesignScript.Geometry import *
#The inputs to this node will be stored as a list in the IN variable.
dataEnteringNode = IN

vertexList = IN[0]
tupleList = []
for i in range(len(vertexList)):
	ver = vertexList[i]
	for j in range(len(vertexList[i])):
		tup = (ver[j].PointGeometry.X,ver[j].PointGeometry.Y,ver[j].PointGeometry.Z)
		tupleList.append(tup)


		


#Assign your output to the OUT variable
OUT = tupleList
# ----------------------------------------
writeToFile_2 = CSV.WriteToFile(file_location_2, pointFinder_2)
edges = Face.Edges(core_geometry_maker.Extruded_Elevators)
keyfloorplates_finder = Python(IN[0]=floorCurves, IN[1]=core_placer_analyzer.keyFloorsHeights, IN[2]=core_placer_analyzer.CoreDetails)
# ---------- keyfloorplates_finder.python (101 lines) ----------
import clr
clr.AddReference('ProtoGeometry')
from Autodesk.DesignScript.Geometry import *
#The inputs to this node will be stored as a list in the IN variable.
dataEnteringNode = IN

floorList = IN[0]
keyFloorList = IN[1][0]
elevatorBanksList = IN[2][0]

#given an input elevator lists it will return the bouding rectangle volume-------------------------------------------------------------------------------
def boudingRecMaker(elevList):
	boundingBox = BoundingBox.ByGeometry(elevList)
	cuboid = boundingBox.ToCuboid()
	cubLines = cuboid.Edges
	
	p1 = cubLines[0].StartVertex.PointGeometry;
	p2 = cubLines[0].EndVertex.PointGeometry;
	p3 = cubLines[2].StartVertex.PointGeometry;
	p4 = cubLines[2].EndVertex.PointGeometry;
	
	boundingRec = Rectangle.ByCornerPoints(p1,p2,p3,p4)
	
	return boundingRec
#--------------------------------------------------------------------------------------------------------------------------------------------------------

# places the bounding boxes at the selected elev banks dropped-------------------------------------------------------------------------------------------
def restroomPlacer():
	restRmBlocks = []
	translatedElevListFinal = translateElevators(elevatorBanksList,floorList,keyFloorList)
	for i in range(len(translatedElevListFinal)):
		rest1 = []
		elev1 = translatedElevListFinal[i]
		for j in range(len(elev1)):	
			rest2 =[]		
			elev2 = elev1[j]
			for k in range(len(elev2)):
				if k == 0 : continue
				elev3 = elev2[k]
				boundingRestrms = boudingRecMaker(elev3)
				area = boundingRestrms.Width*boundingRestrms.Height
				if area < 2: continue
				rest2.append(boundingRestrms)
			rest1.append(rest2)
		restRmBlocks.append(rest1)	
	return restRmBlocks,translatedElevListFinal
#--------------------------------------------------------------------------------------------------------------------------------------------------------





#function to translate the elev banks to the key floors plates in sequence--------------------------------
def translateElevators(elevatorBanksList,floorList,keyFloorList):
	translatedElevListFinal = []
	floorSelectedListFinal=[]
	placeforRestroomList =[]
	
	p1		=	Point.ByCoordinates(0,0,0);
	p2		=	Point.ByCoordinates(0,0,100);
	vec1		=	Vector.ByTwoPoints(p1,p2)
	
	for i in range(len(elevatorBanksList)):	
		baseFloor = floorList[i][0]
		basePt = baseFloor.Center()	
		floorL = floorList[i]
		keyFloorL = keyFloorList[i]
		floorSelectedList=[]
		translatedElevList = []
		elevatorBanksL = elevatorBanksList[i]
		for j in range(len(elevatorBanksL)):
			floorSelectedL=[]
			translatedElevL=[]
			keys = keyFloorL[j]
			keys.reverse()
			elevatorBanks = elevatorBanksL[j]
			for k in range(len(elevatorBanks)):				
				elevBank = elevatorBanks[k]
				index = keys[k]
				floor = floorL[index]
				zPt = floor.Center()
				vec = Vector.ByTwoPoints(basePt,zPt)
				elevL=[]
				for l in range(len(elevBank)):
					elev = elevBank[l]
					elevBankNew = elev.Translate(vec)	
					elevL.append(elevBankNew)
				translatedElevL.append(elevL)
				floorSelectedL.append(floor)
			translatedElevList.append(translatedElevL)
			floorSelectedList.append(floorSelectedL)
		translatedElevListFinal.append(translatedElevList)
		floorSelectedListFinal.append(floorSelectedList)	
	return translatedElevListFinal
#---------------------------------------------------------------------------------------------------------



#Assign your output to the OUT variable
#OUT = translateElevators(elevatorBanksList,floorList,keyFloorList)
OUT = restroomPlacer()
# ----------------------------------------
toiletrelocated_extruder = Python(IN[0]=keyfloorplates_finder, IN[1]=core_placer_analyzer.keyFloorsHeights, IN[2]=floorCurves)
# ---------- toiletrelocated_extruder.python (82 lines) ----------
import clr
clr.AddReference('ProtoGeometry')
from Autodesk.DesignScript.Geometry import *
#The inputs to this node will be stored as a list in the IN variable.
dataEnteringNode = IN


toiletRecList = IN[0][0]
keyFloorList = IN[1][0]
floorList = IN[2]


def keyFloorCleaner(keyFloorList):
	keyFloorCleanedList = []
	for i in range(len(keyFloorList)):
		key1 = keyFloorList[i]
		ext1 = []
		for j in range(len(key1)):
			key2 = key1[j]
			ext2 =[]			
			for k in range(len(key2)):
				#if k == len(key2)-1: continue
				#if k == 0: continue
				key3 = key2[k]
				ext2.append(key3)
			ext1.append(ext2)
		keyFloorCleanedList.append(ext1)			
	return keyFloorCleanedList


#to compute the extrusion height for the toilet rect blocks-----------------------------------------------------------------------------
def restroomExtruder(toiletRecList,keyL):
	keyFloorList = keyFloorCleaner(keyL)
	restRmExtruded = []
	testF=[]
	p1		=	Point.ByCoordinates(0,0,0);
	p2		=	Point.ByCoordinates(0,0,100);
	vec		=	Vector.ByTwoPoints(p1,p2)
	for i in range(len(toiletRecList)):
		floorL = floorList[i]
		toil1 = toiletRecList[i]
		key1 = keyFloorList[i]
		ext1 = []
		test1=[]
		for j in range(len(toil1)):
			
			toil2 = toil1[j]
			key2 = key1[j]
			#key2.reverse()
			toil2.reverse()
			ext2 =[]
			test1.append(toil2)
			#floorL.reverse()
			for k in range(len(toil2)):
				toil3 = toil2[k]
				key3 = key2[k]
				#floor = floorL[key3]
				keyA = key2[k]
				keyB = key2[k+1]
				key3 = keyB - keyA 
				floor = floorL[key3]
				
				flrA = floorL[keyA]
				flrB = floorL[keyB]
				
				zVal = flrB.EndPoint.Z - flrA.EndPoint.Z
				#zVal = floor.Center().Z	
				#zVal = floor.EndPoint.Z				
				ext	=	Curve.Extrude(toil3,vec,zVal)
				ext2.append(ext)
			ext1.append(ext2)
		testF.append(test1)
		restRmExtruded.append(ext1)
		
				
				
	return restRmExtruded,testF
#---------------------------------------------------------------------------------------------------------------------------------------

#Assign your output to the OUT variable
OUT = restroomExtruder(toiletRecList,keyFloorList)
#OUT = keyFloorCleaner(keyFloorList)
# ----------------------------------------
code_block = CodeBlock(a=core_placer_analyzer.strategyUsed) { a; }
file_path = Filename("D:\SUBHAJIT PROJECTS\WORK\00 DYNAMO AUTOMATED STAIRCORE\00 STL FILES\RectShell1.stl")
shell_slicer = Custom[Shell Slicer](shellSTLPath=file_path)  # Slices the input shell into floor plates and regular boxes
code_block_2 = CodeBlock(a=shell_slicer.floorMaker) { a; }
