# Dynamo graph 22JUL_OLD ROTATED TOWERS.dyn (Dynamo 0.8.0.1233)

width = DoubleSlider(30, range=1..300 step 0.1)
length = DoubleSlider(50, range=1..250 step 0.1)
lowest_floor_width_length = CodeBlock(width=width, length=length) { width; length; }
x_orig = DoubleSlider(-40.9, range=-100..100 step 0.1)
y_orig = DoubleSlider(0, range=-100..100 step 0.1)
z_orig = DoubleSlider(0, range=-100..100 step 0.1)
coordinatesystem_at_pt = Python(IN[0]=x_orig, IN[1]=y_orig, IN[2]=z_orig)
# ---------- coordinatesystem_at_pt.python (14 lines) ----------
import clr
clr.AddReference('ProtoGeometry')
from Autodesk.DesignScript.Geometry import *
#The inputs to this node will be stored as a list in the IN variable.
dataEnteringNode = IN

x=IN[0]
y=IN[1]
z=IN[2]

cs = CoordinateSystem.ByOrigin(x,y,z)

#Assign your output to the OUT variable
OUT = cs
# ----------------------------------------
base_curve = Rectangle.ByWidthHeight(coordinatesystem_at_pt, width, length)
base_curve_center = Polygon.Center(base_curve)
tower_base_point = CodeBlock(tower_CenterPoint_Base=base_curve_center) { tower_CenterPoint_Base; }
projected_line_specifications = CodeBlock { -100; 100; 0; 100; 0.5; }
byCoordinates = Point.ByCoordinates(x=projected_line_specifications.out0, y=projected_line_specifications.out1, z=projected_line_specifications.out2)
byCoordinates_2 = Point.ByCoordinates(x=projected_line_specifications.out3, y=projected_line_specifications.out1, z=projected_line_specifications.out2)
projection_line = Line.ByStartPointEndPoint(startPoint=byCoordinates, endPoint=byCoordinates_2)
vector_xyz_units = CodeBlock { 0; 0; 5; }
byCoordinates_3 = Vector.ByCoordinates(x=vector_xyz_units.out0, y=vector_xyz_units.out1, z=vector_xyz_units.out2)
height = DoubleSlider(400, range=1..600 step 0.1)
user_input_floor_heights = CodeBlock { regularFloorHeight = 4; mechanicalFloorHeight = 7; mechFloor_Frequency = 18; }
generates_floor_plane_heights = Python(IN[0]=height, IN[1]=user_input_floor_heights.regularFloorHeight, IN[2]=user_input_floor_heights.mechanicalFloorHeight, IN[3]=user_input_floor_heights.mechFloor_Frequency)
# ---------- generates_floor_plane_heights.python (40 lines) ----------
import clr
clr.AddReference('ProtoGeometry')
from Autodesk.DesignScript.Geometry import *
import math
#The inputs to this node will be stored as a list in the IN variable.
dataEnteringNode = IN

#inputs------------------------------------------------------------
twr_Height = IN[0]
regflr_Ht  = IN[1]
mechflr_Ht = IN[2]
keyflr_Mech= IN[3]
#inputs------------------------------------------------------------

approxNum_Floors  =  twr_Height / regflr_Ht
numberof_MechFloors = math.ceil(approxNum_Floors / keyflr_Mech)
height_Counter = 0
height_List=[]
height = 0


while height<twr_Height:		
	#iterate to add the heights for the regular floors till first mechanical lvl
	for i in range(keyflr_Mech):
		height += regflr_Ht
		height_List.append(height)
		if ((height + mechflr_Ht + 1) > twr_Height): break
				
	if ((height) > twr_Height):	break		
		
	height += mechflr_Ht
	# add the mechanical floor height to the height list
	height_List.append(height)
 




#Assign your output to the OUT variable
OUT = height_List
# ----------------------------------------
translate = Geometry.Translate(geometry=projection_line, direction=byCoordinates_3, distance=generates_floor_plane_heights)
translate_2 = Geometry.Translate(geometry=base_curve, direction=byCoordinates_3, distance=height)
translated_curve_center = Polygon.Center(translate_2)
rotation_angle = DoubleSlider(35, range=0..90 step 0.1)
top_curve = Geometry.Rotate(geometry=translate_2, origin=translated_curve_center, axis=byCoordinates_3, degrees=rotation_angle)
list_of_curves = CodeBlock(a=base_curve, b=top_curve) { {a,b}; }
tower_surface = Surface.ByLoft(list_of_curves)
pointAtParameter = Curve.PointAtParameter(curve=projection_line, param=projected_line_specifications.out4)
byTwoPoints = Vector.ByTwoPoints(start=pointAtParameter, end=base_curve_center)
floor_plans = Curve.Project(curve=translate, baseGeometry=tower_surface, projectionDirection=byTwoPoints)
join_curves_for_each_floor = Python(IN[0]=floor_plans)
# ---------- join_curves_for_each_floor.python (26 lines) ----------
import clr
clr.AddReference('ProtoGeometry')
from Autodesk.DesignScript.Geometry import *
#The inputs to this node will be stored as a list in the IN variable.
dataEnteringNode = IN

flr_Curves = IN[0]

num = len(IN[0])-1

joinedCrvList = []
for i in range(num):
	selflrCrv = flr_Curves[i]
	num2 = len(selflrCrv)
	crv_Join = []
	for j in range(num2):
		if (selflrCrv is None):
			break
		crv_Join.append(selflrCrv[j])
	joinedCrvList.append(PolyCurve.ByJoinedCurves(crv_Join))

	

#Assign your output to the OUT variable
OUT = joinedCrvList
#OUT = flr_Curves[3]
# ----------------------------------------
translate_floors = Python(IN[0]=join_curves_for_each_floor, IN[1]=user_input_floor_heights.regularFloorHeight)
# ---------- translate_floors.python (19 lines) ----------
import clr
clr.AddReference('ProtoGeometry')
from Autodesk.DesignScript.Geometry import *
#The inputs to this node will be stored as a list in the IN variable.
dataEnteringNode = IN

flrList	=	IN[0]
flrHt	=	IN[1]
newflrList = []
for i in range(len(flrList)):
	flr = flrList[i]
	ptA = Point.ByCoordinates(0,0,flrHt)
	ptB	= Point.ByCoordinates(0,0,0)
	vec = Vector.ByTwoPoints(ptA,ptB)
	newflr = Geometry.Translate(flr,vec,flrHt)
	newflrList.append(newflr)

#Assign your output to the OUT variable
OUT = newflrList
# ----------------------------------------
floor_surface = Surface.ByPatch(translate_floors)
gba_floor_area = Surface.Area(floor_surface)
total_built_area = Python(IN[0]=gba_floor_area)
# ---------- total_built_area.python (12 lines) ----------
import clr
clr.AddReference('ProtoGeometry')
from Autodesk.DesignScript.Geometry import *
#The inputs to this node will be stored as a list in the IN variable.
dataEnteringNode = IN

floor_Area = IN[0]
totalBuiltArea = sum(floor_Area)


#Assign your output to the OUT variable
OUT = totalBuiltArea
# ----------------------------------------
user_inputs = CodeBlock { building_sections = 3; area_passElev = 8000; area_servElev = 7000; restroom_Prop = 0.15; techroom_Prop = 0.25; }
number_of_elevators_needed = Python(IN[0]=total_built_area, IN[1]=user_inputs.area_passElev, IN[2]=user_inputs.area_servElev)
# ---------- number_of_elevators_needed.python (20 lines) ----------
import clr
clr.AddReference('ProtoGeometry')
from Autodesk.DesignScript.Geometry import *
import math
#The inputs to this node will be stored as a list in the IN variable.
dataEnteringNode = IN

totalBuiltArea 	= 	IN[0]
passArea		=	IN[1]
servArea		=	IN[2]
passElev = math.ceil(totalBuiltArea/passArea)
servElev = math.ceil(totalBuiltArea/servArea)

#make sure elevator counts are even
if (passElev % 2 == 1): passElev += 1
if (servElev % 2 == 1): servElev += 1


#Assign your output to the OUT variable
OUT = [passElev, servElev]
# ----------------------------------------
area_per_elevator = DoubleSlider(4, range=1..100 step 0.1)
tag_switch = CodeBlock { A=1; B="EITHER 0 OR 1"; }
ratio_dimelevator = DoubleSlider(1.1, range=0.1..3 step 0.1)
elevator_dimensions = Python(IN[0]=area_per_elevator, IN[1]=ratio_dimelevator)
# ---------- elevator_dimensions.python (15 lines) ----------
import clr
clr.AddReference('ProtoGeometry')
from Autodesk.DesignScript.Geometry import *
import math
#The inputs to this node will be stored as a list in the IN variable.
dataEnteringNode = IN
elevArea	=	IN[0]
ratio		=	IN[1]


len			=	math.sqrt(elevArea/ratio)
wid			=	elevArea/len
#Assign your output to the OUT variable
OUT = wid,len
#OUT = len,wid
# ----------------------------------------
lift_lobby_width = DoubleSlider(2, range=0.5..11 step 0.1)
service_core_components = Python(IN[0]=lowest_floor_width_length.width, IN[1]=lowest_floor_width_length.length, IN[2]=tower_base_point, IN[3]=number_of_elevators_needed, IN[4]=area_per_elevator, IN[5]=tag_switch.A, IN[6]=elevator_dimensions, IN[7]=user_inputs.restroom_Prop, IN[8]=user_inputs.techroom_Prop, IN[9]=lift_lobby_width)
# ---------- service_core_components.python (152 lines) ----------
import clr
clr.AddReference('ProtoGeometry')
from Autodesk.DesignScript.Geometry import *
import math
#The inputs to this node will be stored as a list in the IN variable.
dataEnteringNode = IN

flr_Width			=	IN[0]
flr_Height			=	IN[1]
twr_Basept			=	IN[2]
num_passElev		=	IN[3][0]
num_servElev		=	IN[3][1]

passElev_Area		=	IN[4]
servElev_Area		=	IN[4]
tag					=	IN[5]
elevWidth			=	IN[6][0]
elevLength			=	IN[6][1]
restroomProp		=	IN[7]
techrmProp			=	IN[8]
liftLobbyWidth		=	IN[9]

cirProp = liftLobbyWidth/1.5
FACTOR = 1
perc = 1.2
#passElev_Area 		*=	FACTOR
#servElev_Area		*=	FACTOR

#globals var, computer area banks, area restrm, area techrms--------------------------------------------------------------------------------------------
area_banks			= servElev_Area*num_servElev/perc + passElev_Area*num_passElev/perc
area_banks			+=cirProp*area_banks # added the circulation area
area_restroom 		= restroomProp*area_banks;								
area_servmodule 	= techrmProp*area_banks;




#computer service core width, length, and serviceCore====================================================================================================
def serviceCoreMaker():		
	#calc total area for service core for the tower
	serviceCore_Area 	= area_banks + area_restroom + area_servmodule;	
	#calc aspect ratio of floor plate
	aspect_Ratio 		= 	flr_Width/flr_Height
	#calc service core length and width
	servCore_Length 	=	math.sqrt(serviceCore_Area/aspect_Ratio)
	servCore_Width		=	serviceCore_Area/servCore_Length
	
	# get the coordinates of center pt
	x,y,z 					= 	twr_Basept.X,twr_Basept.Y,twr_Basept.Z	
	#make the service core rectangle object--------------------------------------------------------------------------------------------------------------1
	cs					= 	CoordinateSystem.ByOrigin(x,y,z)
	serviceCore_Rec 	= 	Rectangle.ByWidthHeight(cs,servCore_Width,servCore_Length)
	coreVertices		=	serviceCore_Rec.Points
	
	#comput elev bank factor--------------------------------------------------------------------
	b_Fac				=	area_banks/serviceCore_Area
	#return serviceCore_Rec,b_Fac,coreVertices,area_banks,area_banks,area_servmodule
	return servCore_Width,servCore_Length,coreVertices,b_Fac,serviceCore_Rec



#function to make boxes based off of width, length and vertices===========================================================================================
def makeBox(width,length,vertices,factor,tag):
	#calculate the shorter of width or height of service core
	if ( tag == 0):
		if (width < length):
			new_Length 		=	length
			new_Width		=	factor*width
			other_Length 	=	length
			other_Width		=	width - new_Width
			index			=	3		
		else:
			new_Width		=	width	
			new_Length		=	factor*length
			other_Width 	=	width
			other_Length	=	length - new_Length
			index			=	2
	else:
		if (width > length):
			new_Length 		=	length
			new_Width		=	factor*width
			other_Length 	=	length
			other_Width		=	width - new_Width
			index			=	3		
		else:
			new_Width		=	width	
			new_Length		=	factor*length
			other_Width 	=	width
			other_Length	=	length - new_Length
			index			=	2		

	
	cs1					= 	CoordinateSystem.ByOrigin(vertices[0].X,vertices[0].Y,0)
	cs2					= 	CoordinateSystem.ByOrigin(vertices[index].X,vertices[index].Y,0)
	# to make the primary rectangle ----------------------------------------------------------------------	
	new_Rec 			= 	Rectangle.ByWidthHeight(cs1,new_Width,new_Length)	
	new_Vec				= 	Vector.ByTwoPoints(new_Rec.Points[0],vertices[0])
	new_Rec				=	Geometry.Translate(new_Rec, new_Vec)
	ptsnew_Rec			=	new_Rec.Points
	# to make the secondary rectangle ----------------------------------------------------------------------	
	other_Rec 			= 	Rectangle.ByWidthHeight(cs2,other_Width,other_Length)	
	other_Vec			= 	Vector.ByTwoPoints(other_Rec.Points[index],vertices[index])
	other_Rec			=	Geometry.Translate(other_Rec, other_Vec)
	ptsother_Rec		=	other_Rec.Points
	
	return [new_Rec,other_Rec]
#============================================================================================================================================================



#make post computations======================================================================================================================================
def coreConfigurator(b_Fac):
	#make the elevator bank rectangle object-----------------------------------------------------1	
	bank_Rec			=	makeBox(servCore_Width,servCore_Length,coreVertices,b_Fac,tag)	
	widtry1				=	bank_Rec[0].Width
	lentry1				=	bank_Rec[0].Height
				
	# code to readjust the bank rectangle piece based on the final tech rooms and restroom blocks
	if ( widtry1<lentry1):
		shortEdge		=	widtry1
		marked			=	0	
	else:
		shortEdge		=	lentry1
		marked			=	1
			
	if (elevWidth<elevLength):elevEdge = elevWidth
	else:elevEdge =	elevLength			
	numE				=	int(shortEdge / elevEdge)
	numE				+=	1
		
	newDim				=	numE*elevEdge
	if ( marked ==0): ratio	= widtry1/newDim
	else: ratio	= lentry1/newDim
	b_Fac				=	ratio*b_Fac
	bank_Rec			=	makeBox(servCore_Width,servCore_Length,coreVertices,b_Fac,tag)	
	return bank_Rec
	#-------------------------------------------------------------------------------------------------
#============================================================================================================================================================


#OUTPUT VALUES-------------------------------------------------------
vals 				= 	serviceCoreMaker()
servCore_Width		=	vals[0]
servCore_Length		=	vals[1]
coreVertices		=	vals[2]
b_Fac				=	vals[3]
serviceCore_Rec		=	vals[4]
bank_Rec 			= 	coreConfigurator(b_Fac)	

#Assign your output to the OUT variable
OUT = [bank_Rec,area_restroom,area_servmodule,serviceCore_Rec]
#OUT = 0
# ----------------------------------------
other_part_service_area = CodeBlock(a=service_core_components) { a[0][1]; }
area_service_module_tech_rooms = CodeBlock(a=service_core_components) { a[2]; }
area_RestRooms = CodeBlock(a=service_core_components) { a[1]; }
technical_rooms_restrooms = Python(IN[0]=other_part_service_area, IN[1]=area_service_module_tech_rooms, IN[2]=area_RestRooms)
# ---------- technical_rooms_restrooms.python (76 lines) ----------
import clr
clr.AddReference('ProtoGeometry')
from Autodesk.DesignScript.Geometry import *
#The inputs to this node will be stored as a list in the IN variable.
dataEnteringNode = IN

wrapperRect		=	IN[0]
areaTechnical	=	IN[1]
areaRestrm		=	IN[2]

# incoming rectangle specifications
wrapPts			=	wrapperRect.Points
wrapWidth		=	wrapperRect.Width
wrapLength		=	wrapperRect.Height
#----------------------------------------------------------------------------------------


#totArea			=	areaTechnical + areaRestrm 
totArea			=	wrapWidth * wrapLength
facT			=	areaTechnical / totArea
facR			=	areaRestrm / totArea


def makeThreePiece(width,length,pts,f1,f2):
	if (width < length):
		rec1Length 		=	f1*length
		rec1Width		=	width
		
		rec2Length 		=	f2*length
		rec2Width		=	width
		
		rec3Length 		=	length - rec1Length - rec2Length
		rec3Width		=	width
		
		index			=	1		
	else:
		rec1Length 		=	length
		rec1Width		=	f1*width
		
		rec2Length 		=	length
		rec2Width		=	f2*width
		
		rec3Length 		=	length
		rec3Width		=	width - rec1Width - rec2Width
		
		index			=	3
	
	cs1					= 	CoordinateSystem.ByOrigin(pts[0].X,pts[0].Y,0) 
	
	# to make the 1st rectangle ----------------------------------------------------------------------	
	rec1 				= 	Rectangle.ByWidthHeight(cs1,rec1Width,rec1Length)	
	rec1Vec				= 	Vector.ByTwoPoints(rec1.Points[0],pts[0])
	rec1				=	Geometry.Translate(rec1, rec1Vec)
	rec1Pt				=	rec1.Points	
	cs1					= 	CoordinateSystem.ByOrigin(rec1Pt[0].X,rec1Pt[0].Y,0)
	
	# to make the 2nd rectangle ----------------------------------------------------------------------	
	rec2 				= 	Rectangle.ByWidthHeight(cs1,rec2Width,rec2Length)	
	rec2Vec				= 	Vector.ByTwoPoints(rec2.Points[0],rec1Pt[index])
	rec2				=	Geometry.Translate(rec2, rec2Vec)
	rec2Pt				=	rec2.Points	
	cs1					= 	CoordinateSystem.ByOrigin(rec2Pt[0].X,rec2Pt[0].Y,0)
	
	# to make the 2nd rectangle ----------------------------------------------------------------------	
	rec3 				= 	Rectangle.ByWidthHeight(cs1,rec3Width,rec3Length)	
	rec3Vec				= 	Vector.ByTwoPoints(rec3.Points[0],rec2Pt[index])
	rec3				=	Geometry.Translate(rec3, rec3Vec)
	
	return rec1,rec2,rec3
	#END OF FUNCTION#


recList = makeThreePiece(wrapWidth,wrapLength,wrapPts,0.4,0.2)
#Assign your output to the OUT variable
#OUT = [techRec1,otherRec]
OUT = recList
# ----------------------------------------
techRoom = CodeBlock(techRoom=technical_rooms_restrooms) { {techRoom[0],techRoom[2]}; }
toilets = CodeBlock(Toilet=technical_rooms_restrooms) { Toilet[1]; }
floor_curve = CodeBlock(floorcrv=base_curve) { floorcrv; }
toilet_arrangement_different = Python(IN[0]=toilets, IN[1]=floor_curve, IN[2]=tag_switch.A)
# ---------- toilet_arrangement_different.python (169 lines) ----------
import clr
clr.AddReference('ProtoGeometry')
from Autodesk.DesignScript.Geometry import *
#The inputs to this node will be stored as a list in the IN variable.
dataEnteringNode = IN

restroomRec		=	IN[0]
floorRec		=	IN[1]
marker			=	IN[2]

widthRestrm		=	restroomRec.Width
lengthRestrm	=	restroomRec.Height
pointsRestrm	=	restroomRec.Points

#---------------------------------------------------------------

# 1 = LONGITUDINAL CUT		0 = TRAVERSAL CUT
#make boxes inside--------------------------------------------------------------------------------
def splitRec(rec,f1,tag):
	recPoints	=	rec.Points
	width		=	rec.Width
	length		=	rec.Height
	#make the four edges of the input rectangle
	lineList	=	[]
	for i in range(len(recPoints)):
		if(i== len(recPoints)-1):
			k = 0
		else:
			k = i+1
		ptA		=	recPoints[i]
		ptB		=	recPoints[k]
		lin		=	Line.ByStartPointEndPoint(ptA,ptB)
		lineList.append(lin)
		
	#pick two points on the shorter lines
	len1	=	lineList[0].Length
	len2	=	lineList[1].Length
	if (tag == 1):
		if (len1<len2):
			lineShort1	=	lineList[0]
			lineShort2	=	lineList[2]
		else:
			lineShort1	=	lineList[1]
			lineShort2	=	lineList[3]
	else:
		if (len1>len2):
			lineShort1	=	lineList[0]
			lineShort2	=	lineList[2]
		else:
			lineShort1	=	lineList[1]
			lineShort2	=	lineList[3]
		
		
	ptOut1	=	lineShort1.PointAtParameter(f1)
	ptOut2	=	lineShort2.PointAtParameter(1-f1)
	stPt1	=	lineShort1.StartPoint
	endPt1	=	lineShort1.EndPoint
	stPt2	=	lineShort2.StartPoint
	endPt2	=	lineShort2.EndPoint
	# make the new rectangle by corner points !! SEQUENCE OF CORNER POINTS MIGHT BE AN ISSUE
	outRec1	=	Rectangle.ByCornerPoints(stPt1,endPt2,ptOut2,ptOut1)
	outRec2	=	Rectangle.ByCornerPoints(stPt2,endPt1,ptOut1,ptOut2)
		
	#return lineShort1,lineShort2,ptOut1,ptOut2,width,length,outRec1,outRec2
	return outRec1,outRec2
	#return lineList
#END OF FUNCTION# --------------------------------------------------------------------------------



#-----------------------------------------------------------------------------------------------------
def findOuterPt():
	restrmPoints	=	restroomRec.Points
	floorPoints		=	floorRec.Points

	selectedLines	=	[]
	selectedPoints	=	[]
	lineStoreList=[]
	lineList	=	[]
	lineStore=0
	for i in range(len(restrmPoints)):
		ptA 		= 	restrmPoints[i]
		#lineList	=	[]
		# iterate to make the 4 lines 
		for j in range(len(floorPoints)):
			ptB 		= 	floorPoints[j]
			lineAB		=	Line.ByStartPointEndPoint(ptA,ptB)
			lineList.append(lineAB)
		prevLine=""
		#lineStore=0
		# iterate to find the shortest line out of the four
		for k in range(len(lineList)):
			currentLine = lineList[k]
			if ( prevLine != ""):
				if ( prevLine.Length > currentLine.Length ): lineStore = currentLine
				else : lineStore = prevLine
			prevLine = currentLine
		lineStoreList.append(lineStore)
	
	prevLen = ""
	indexVal= 0
	for l in range(len(lineStoreList)):
		currentLen	=	lineStoreList[l].Length
		if ( prevLen != ""):
			if ( prevLen > currentLen ): indexVal = l
		prevLen = currentLen
		
	shortLine = lineStoreList[indexVal]
	finalPoint= shortLine.StartPoint
	return finalPoint
#END OF FUNCTION# --------------------------------------------------------------------------------


#decide the proportion of fraction----------------------------------------------------------------
def facDecider(rec,pt):
	points	=	rec.Points
	width	=	rec.Width
	length	=	rec.Height
	line	=	Vector.ByTwoPoints(points[0],pt)
	#line	=	Line.ByStartPointEndPoint(points[0],pt)
	len		=	line.Length
	
	if (width<length):
		shortDist = width
	else:
		shortDist = length
	
	if (len>shortDist):
		fac = 0.8
	else:
		fac = 0.2
	return fac
#END OF FUNCTION# --------------------------------------------------------------------------------

def closerRect(recList,pt):
	lenList=[]
	for i in range(0,len(recList)):	
		rec	=	recList[i]
		lin = 	Line.ByStartPointEndPoint(rec.Center(),pt)
		lenList.append(lin.Length)
	index= ""
	for i in range(0,len(lenList)-1):
		len1 = lenList[i]
		len2 = lenList[i+1]
	if (len1<len2):
		index = 0
	else:
		index = 1
	return recList[index]
		


finalPoint= findOuterPt()

if(marker == 1):
	key1 = 0
	key2 = 1
else:
	key1 = 1
	key2 = 0

recs	=	splitRec(restroomRec,0.5,key1)
closeRec=	closerRect(recs,finalPoint)
fac		=	facDecider(closeRec,finalPoint)
rec2	=	splitRec(closeRec,fac,key2)

#Assign your output to the OUT variable
#OUT = lineStoreList,lineList,restrmPoints,shortLine,finalPoint
OUT = recs[0],rec2#finalPoint"
# ----------------------------------------
technical_rooms = CodeBlock(Toilet=technical_rooms_restrooms) { Toilet[0]; Toilet[2]; }
technical_room_arrangements = Python(IN[0]=technical_rooms.out1)
# ---------- technical_room_arrangements.python (86 lines) ----------
import clr
clr.AddReference('ProtoGeometry')
from Autodesk.DesignScript.Geometry import *
import math
#import random
#The inputs to this node will be stored as a list in the IN variable.
dataEnteringNode = IN

mainRec		=	IN[0]

#---------------------------------------------------------------



# 1 = LONGITUDINAL CUT		0 = TRAVERSAL CUT
#make boxes inside--------------------------------------------------------------------------------
def splitRec(rec,f1,tag):
	recPoints	=	rec.Points
	width		=	rec.Width
	length		=	rec.Height
	#make the four edges of the input rectangle
	lineList	=	[]
	for i in range(len(recPoints)):
		if(i== len(recPoints)-1):
			k = 0
		else:
			k = i+1
		ptA		=	recPoints[i]
		ptB		=	recPoints[k]
		lin		=	Line.ByStartPointEndPoint(ptA,ptB)
		lineList.append(lin)
		
	#pick two points on the shorter lines
	len1	=	lineList[0].Length
	len2	=	lineList[1].Length
	if (tag == 1):
		if (len1<len2):
			lineShort1	=	lineList[0]
			lineShort2	=	lineList[2]
		else:
			lineShort1	=	lineList[1]
			lineShort2	=	lineList[3]
	else:
		if (len1>len2):
			lineShort1	=	lineList[0]
			lineShort2	=	lineList[2]
		else:
			lineShort1	=	lineList[1]
			lineShort2	=	lineList[3]
		
		
	ptOut1	=	lineShort1.PointAtParameter(f1)
	ptOut2	=	lineShort2.PointAtParameter(1-f1)
	stPt1	=	lineShort1.StartPoint
	endPt1	=	lineShort1.EndPoint
	stPt2	=	lineShort2.StartPoint
	endPt2	=	lineShort2.EndPoint
	# make the new rectangle by corner points !! SEQUENCE OF CORNER POINTS MIGHT BE AN ISSUE
	outRec1	=	Rectangle.ByCornerPoints(stPt1,endPt2,ptOut2,ptOut1)
	outRec2	=	Rectangle.ByCornerPoints(stPt2,endPt1,ptOut1,ptOut2)
		
	#return lineShort1,lineShort2,ptOut1,ptOut2,width,length,outRec1,outRec2
	return outRec1,outRec2
	#return lineList
#END OF FUNCTION# --------------------------------------------------------------------------------

outList	=	[]
twoLinearRecs	=	splitRec(mainRec,0.38,1)
rec1			=	twoLinearRecs[0]
rec2			=	twoLinearRecs[1]
for i in range(4):
	#fac		=	random.random()
	fac 	=	0.4
	out1 	=	splitRec(rec1,fac,0)
	outList.append(out1)
	rec1	=	out1[1]
	
	out2 	=	splitRec(rec2,fac,0)
	outList.append(out2)
	rec2	=	out2[1]
	


#Assign your output to the OUT variable
#OUT = lineStoreList,lineList,restrmPoints,shortLine,finalPoint
OUT = outList
# ----------------------------------------
technical_room_arrangements_2 = Python(IN[0]=technical_rooms.out0)
# ---------- technical_room_arrangements_2.python (88 lines) ----------
import clr
clr.AddReference('ProtoGeometry')
from Autodesk.DesignScript.Geometry import *
import math
#import random
#The inputs to this node will be stored as a list in the IN variable.
dataEnteringNode = IN

mainRec		=	IN[0]

#---------------------------------------------------------------



# 1 = LONGITUDINAL CUT		0 = TRAVERSAL CUT
#make boxes inside--------------------------------------------------------------------------------
def splitRec(rec,f1,tag):
	recPoints	=	rec.Points
	width		=	rec.Width
	length		=	rec.Height
	#make the four edges of the input rectangle
	lineList	=	[]
	for i in range(len(recPoints)):
		if(i== len(recPoints)-1):
			k = 0
		else:
			k = i+1
		ptA		=	recPoints[i]
		ptB		=	recPoints[k]
		lin		=	Line.ByStartPointEndPoint(ptA,ptB)
		lineList.append(lin)
		
	#pick two points on the shorter lines
	len1	=	lineList[0].Length
	len2	=	lineList[1].Length
	if (tag == 1):
		if (len1<len2):
			lineShort1	=	lineList[0]
			lineShort2	=	lineList[2]
		else:
			lineShort1	=	lineList[1]
			lineShort2	=	lineList[3]
	else:
		if (len1>len2):
			lineShort1	=	lineList[0]
			lineShort2	=	lineList[2]
		else:
			lineShort1	=	lineList[1]
			lineShort2	=	lineList[3]
		
		
	ptOut1	=	lineShort1.PointAtParameter(f1)
	ptOut2	=	lineShort2.PointAtParameter(1-f1)
	stPt1	=	lineShort1.StartPoint
	endPt1	=	lineShort1.EndPoint
	stPt2	=	lineShort2.StartPoint
	endPt2	=	lineShort2.EndPoint
	# make the new rectangle by corner points !! SEQUENCE OF CORNER POINTS MIGHT BE AN ISSUE
	outRec1	=	Rectangle.ByCornerPoints(stPt1,endPt2,ptOut2,ptOut1)
	outRec2	=	Rectangle.ByCornerPoints(stPt2,endPt1,ptOut1,ptOut2)
		
	#return lineShort1,lineShort2,ptOut1,ptOut2,width,length,outRec1,outRec2
	return outRec1,outRec2
	#return lineList
#END OF FUNCTION# --------------------------------------------------------------------------------


outList	=	[]
twoLinearRecs	=	splitRec(mainRec,0.60,0)
rec1			=	twoLinearRecs[0]
rec2			=	twoLinearRecs[1]
for i in range(3):
	#fac		=	random.random()
	fac 	=	0.35
	out1 	=	splitRec(rec1,fac,0)
	outList.append(out1)
	rec1	=	out1[1]
	
	out2 	=	splitRec(rec2,fac,0)
	outList.append(out2)
	rec2	=	out2[1]
	
	
	

#Assign your output to the OUT variable
#OUT = lineStoreList,lineList,restrmPoints,shortLine,finalPoint
OUT = outList
# ----------------------------------------
service_core_full_block = CodeBlock(a=service_core_components) { a[3]; }
elevators_per_bank = Python(IN[0]=user_inputs.building_sections, IN[1]=number_of_elevators_needed)
# ---------- elevators_per_bank.python (45 lines) ----------
import clr
clr.AddReference('ProtoGeometry')
from Autodesk.DesignScript.Geometry import *
#The inputs to this node will be stored as a list in the IN variable.
dataEnteringNode = IN


numBanks_Elev		=	IN[0]
elev_List			=	IN[1]

#calc total number of elevators needed ( passenger + service )
totalElev_Num		=	elev_List[0] + elev_List[1]

# int value of per bank elevator
perBank_Elev		=	int(totalElev_Num / numBanks_Elev)
leftElev			=	totalElev_Num - ( perBank_Elev * numBanks_Elev )

#equally add the elevators to each banks
numElevBank_List 	=	[]
for i in range(numBanks_Elev):
	numElevBank_List.append(perBank_Elev)

# add the left over elevators to each banks
index = 0
while (leftElev > 0):
	numElevBank_List[index] += 1
	leftElev				-= 1
	index					+= 1

# check for even number of elevators per bank
num		=	numBanks_Elev-1
for i in range(num):
	if (numElevBank_List[i] % 2 == 1): 
		numElevBank_List[i] 	-= 1
		numElevBank_List[i+1]	+= 1

#final total elev alloted 
totalElev	=	sum(numElevBank_List)

	

	

#Assign your output to the OUT variable
OUT = [numElevBank_List,totalElev,leftElev]
# ----------------------------------------
building_sections = CodeBlock(buildSections=user_inputs.building_sections) { buildSections; }
gross_building_area = CodeBlock(GBA=gba_floor_area) { GBA; }
bank_rectangle_piece = CodeBlock(Bank_Rectangle=service_core_components) { Bank_Rectangle[0][0]; }
total_elev_pass_service = CodeBlock(a=number_of_elevators_needed) { totalElevs = a[0]+a[1]; }
intersect = Geometry.Intersect(geometry=bank_rectangle_piece, other=other_part_service_area)
max_elevators = IntegerSlider(5, range=2..33 step 1)
latest_new_elevator_packings = Python(IN[0]=bank_rectangle_piece, IN[1]=elevator_dimensions, IN[2]=total_elev_pass_service, IN[3]=lift_lobby_width, IN[4]=other_part_service_area, IN[5]=intersect, IN[6]=max_elevators)
# ---------- latest_new_elevator_packings.python (459 lines) ----------
import clr
clr.AddReference('ProtoGeometry')
from Autodesk.DesignScript.Geometry import *
import math
#The inputs to this node will be stored as a list in the IN variable.
dataEnteringNode = IN

mainRec		=	IN[0]
elevWidth	=	IN[1][0]
elevLength	=	IN[1][1]
totElev		=	IN[2]
lobbyWidth	=	IN[3]
servicRec	=	IN[4]
interLine	=	IN[5][0]
maxElevs	=	IN[6]



commonLen	=	interLine.Length
otherLen1	=	0
bankRec 	= 	mainRec
if (commonLen > mainRec.Width-0.005 and commonLen < mainRec.Width+0.005): otherLen1 = mainRec.Height
if (commonLen > mainRec.Height-0.005 and commonLen < mainRec.Height+0.005): otherLen1 = mainRec.Width





#FIRST CALLS **********************************************************************************************************************************FIRST CALLS
#to calc how many sub rectangles the elevbankrect needs to be split-------------------------
def getNumRects():
	#very imp transition@@@@@@@@@@@
	recShort	=	otherLen1
	recLong		=	commonLen	
	elevShort	=	getElevShorterDim(elevWidth,elevLength)[0]
	numRects	=	1	
	approx_numElevs	=	int(math.floor(recLong/elevShort))

	#Added to make total num of Elevs always even
	if approx_numElevs%2 > 0: approx_numElevs += 1
	#-----------------------------------------------		
	elevShort 	=	recLong/approx_numElevs		
	while approx_numElevs > maxElevs:
		numRects += 1
		approx_numElevs = int(approx_numElevs/2	)	
	return numRects
#------------------------------------------------------------------------------------------

#to subdivide given rect to num of rects based on a num------------------------------------
def subDivRect(num):	
	numRects = getNumRects()
	numRects = num
	if numRects < 2 : 
		return "no need to split"
	
	recList = []
	length1 = commonLen
	length2 = otherLen1
	
	dimension = length1/numRects

	startRec = mainRec
	for i in range(numRects):		
		try:
			rec = splitBox(startRec,dimension,length2)
		except:
			recList.append(rec[1])
			return recList			
		recList.append(rec[0])		
		startRec = rec[1]			
	return recList
#------------------------------------------------------------------------------------------

#function to scale rectangles to add in corridors in between elevators-------------------------------------------------------------
def scaledRects(recLists):
	#make new recLists
	newRecs = recLists[:]
	del newRecs[0]
	del newRecs[-1]
	
	endRecs = [recLists[0],recLists[-1]]
	
	outRec=[]
	for rec in newRecs:
		pts = rec.Points
		basePt = pts[0]
		wid = rec.Width
		length = rec.Height
		
		l1 = Line.ByStartPointEndPoint(pts[0],pts[1])
		l2 = Line.ByStartPointEndPoint(pts[0],pts[3])
		
		len1 = l1.Length
		len2 = l2.Length
		fac = 0.75 # hardcoded
		
		#prepare basept, p1 and p2 from Scale1D
		if wid == len1: 
			fromPt = pts[1]
			toPt = l1.PointAtParameter(fac)
			midPt = l1.PointAtParameter(0.5)
		else: 
			fromPt = pts[3]
			toPt = l2.PointAtParameter(fac)
			midPt = l2.PointAtParameter(0.5)
		
		#find the vector to translate the scaled rect		
		pCrv = rec.Scale1D(basePt,fromPt,toPt)
		crv = pCrv.Curves()
		ptsNew = [x.StartPoint for x in crv]
			
		lNew1 = Line.ByStartPointEndPoint(ptsNew[0],ptsNew[1])
		lNew2 = Line.ByStartPointEndPoint(ptsNew[0],ptsNew[3])
			
		if wid == len1: midPtNew = lNew1.PointAtParameter(0.5)
		else: midPtNew = lNew2.PointAtParameter(0.5)
			
			
		#make the vec for translation
		vec= Vector.ByTwoPoints(midPtNew,midPt)
		pCrv = pCrv.Translate(vec)
		
		#block to make rectangle
		crv = pCrv.Curves()
		ptsNew = [x.StartPoint for x in crv]		
		rec = Rectangle.ByCornerPoints(ptsNew[0],ptsNew[3],ptsNew[2],ptsNew[1])
		outRec.append(rec)
			
		
	#code to work on the first and last rectangles.	
	for i in range(len(endRecs)):
		if (i==0):pass
		rec = endRecs[i]
		
		pts = rec.Points
		basePt = pts[0]
		wid = rec.Width
		length = rec.Height
		
		l1 = Line.ByStartPointEndPoint(pts[0],pts[1])
		l2 = Line.ByStartPointEndPoint(pts[0],pts[3])
		
		len1 = l1.Length
		len2 = l2.Length
		fac = 0.9 # hardcoded
		
		#prepare basept, p1 and p2 from Scale1D
		if wid == len1: 
			fromPt = pts[1]
			toPt = l1.PointAtParameter(fac)
			midPt = l1.PointAtParameter(0.5)
		else: 
			fromPt = pts[3]
			toPt = l2.PointAtParameter(fac)
			midPt = l2.PointAtParameter(0.5)
		
		
		
		#find the vector to translate the scaled rect		
		pCrv = rec.Scale1D(basePt,fromPt,toPt)
		crv = pCrv.Curves()
		if(i>0):
			ptsNew = [x.StartPoint for x in crv]
			
			lNew1 = Line.ByStartPointEndPoint(ptsNew[0],ptsNew[1])
			lNew2 = Line.ByStartPointEndPoint(ptsNew[0],ptsNew[3])
			
			if wid == len1: midPtNew = lNew1.PointAtParameter(fac/2)
			else: midPtNew = lNew2.PointAtParameter(fac/2)
		
			#make the vec for translation
			vec= Vector.ByTwoPoints(midPtNew,midPt)
			pCrv = pCrv.Translate(vec)

		#block to make rectangle
		crv = pCrv.Curves()
		ptsNew = [x.StartPoint for x in crv]		
		rec = Rectangle.ByCornerPoints(ptsNew[0],ptsNew[3],ptsNew[2],ptsNew[1])
		
		endRecs[i] = rec
		#break	
		
		
	#finally merge all components
	finList=[]		
	finList.extend([endRecs[0]])
	finList.extend(outRec)
	finList.extend([endRecs[-1]])
		
	return finList
#-----------------------------------------------------------------------------------------------------------------------------------
#FIRST CALLS **********************************************************************************************************************************FIRST CALLS

#get the shorter dimension---------------------------------------------------------------
def getShorterDim(rec):
	width	=	rec.Width
	length	=	rec.Height
	if(width<=length): 
		shortEdge	= width
		longEdge	= length
	else: 
		shortEdge 	= length
		longEdge  	= width
	return shortEdge,longEdge
	#return longEdge,shortEdge
# END OF FUNCTION ------------------------------------------------------------------------

#get the shorter dimension---------------------------------------------------------------
def getElevShorterDim(width,length):
	if(width<length): 
		shortEdge	= width
		longEdge	= length
	else: 
		shortEdge = length
		longEdge  = width
	return shortEdge,longEdge
	#return longEdge,shortEdge
# END OF FUNCTION ------------------------------------------------------------------------

#====================================================================================================================================================================================
#make rects based on dimension given------------------------------------------------------------------------
def splitBox(rec,dim,length):
	recPts	=	rec.Points
	#make four lines for the input rectangles
	lin0		=	Line.ByStartPointEndPoint(recPts[0],recPts[1])#0
	lin1		=	Line.ByStartPointEndPoint(recPts[1],recPts[2])#1
	lin2 		=	Line.ByStartPointEndPoint(recPts[2],recPts[3])#2
	lin3		=	Line.ByStartPointEndPoint(recPts[3],recPts[0])#3
	# get the first point of first line
	firstPt		=	lin0.StartPoint
	
	# get the length and lines for those edges whose length matches input length
	if lin0.Length >= length-0.005 and lin0.Length <= length+0.005: 
		bigDimension = lin1.Length
		lineShort1 = lin1
		lineShort2 = lin3				
	if lin1.Length >= length-0.005 and lin1.Length <= length+0.005: 
		bigDimension = lin0.Length
		lineShort1 = lin0
		lineShort2 = lin2
	
	#get the points to make the two rectangles
	f1 		=	dim/bigDimension
	ptOut1	=	lineShort1.PointAtParameter(f1)
	ptOut2	=	lineShort2.PointAtParameter(1-f1)
	stPt1	=	lineShort1.StartPoint
	endPt1	=	lineShort1.EndPoint
	stPt2	=	lineShort2.StartPoint
	endPt2	=	lineShort2.EndPoint
	
	# make the new rectangle by corner points !! SEQUENCE OF CORNER POINTS MIGHT BE AN ISSUE
	rec1	=	Rectangle.ByCornerPoints(stPt1,endPt2,ptOut2,ptOut1)
	rec2	=	Rectangle.ByCornerPoints(ptOut1,ptOut2,stPt2,endPt1)
	#get the center points for two rects
	rec1Cen	=	rec1.Center()
	rec2Cen = 	rec2.Center()
	#get the vectors from the first pt
	vec1	=	Vector.ByTwoPoints(firstPt,rec1Cen)
	vec2	=	Vector.ByTwoPoints(firstPt,rec2Cen)
	#compare the length of the vectors to get how far are they from start pt
	vcLen1 	=	vec1.Length
	vcLen2 	=	vec2.Length
	#finally set them as the final ouput rect
	if vcLen1 < vcLen2 :
		outRec1 = 	rec1
		outRec2 = 	rec2
	else:
		outRec1 = 	rec2
		outRec2 = 	rec1	
			
	return outRec1,outRec2
	
	
#main function making the elevator packings------------------------------------------------
def makeElevBox(bkRec,commonLen,otherLen1):
	inpRec = []
	inpRec.append(bkRec)

	elevDims	=	getElevShorterDim(elevWidth,elevLength)
	elevShort	=	elevDims[0]
	elevLong	=	elevDims[1]
	
	longCounter = 	0
	listDims	=	[]
	frstPtList	=	[]
	count		=	0
	
	#very imp transition@@@@@@@@@@@
	recShort	=	otherLen1
	recLong		=	commonLen
		
	numElevs	=	int(math.floor(recLong/elevShort))
	#"""
	#Added to make total num of Elevs always even
	if numElevs%2 > 0: 
		numElevs += 1
		#elevShort = recLong/numElevs
	#-----------------------------------------------

	elevShort 	=	recLong/numElevs	
	areaElev 	=	elevShort*commonLen

	
	
	cap = 5		
	#BLOCK TO MAKE LIST OF DIMENSIONS TO PREPARE ELEV ROWS AND LOBBY PLACEMENTS
	#@@@@@@@@@@@@@@@@@@@@@@@@@@@@@@@@@@@@@@@@@@@@@@@@@@@@@@@@@@@@@@@@@@@@@@@@@@@@@@@@@@@@@@@@@@@@@@@@@@@@@@@@@@@@@@@@@@@@@@@@@@@@@@@@@@@@@@@@	
	#loop till you catch up with the dimension longitudinally
	while (cap>0):
		longCounter += elevLong
		if (longCounter > recShort): # recShort replaced by otherLen   +++ longCounter > recShort-0.005 and longCounter < recShort+0.005
			break
		listDims.append(elevLong)
		if (count%2 ==0):
			longCounter += lobbyWidth	
			if (longCounter > recShort):# recShort replaced by otherLen
				break
			listDims.append(lobbyWidth)			
		count		+= 1
	ct = 0
	lobbies = 0
	# test to check whole length added
	for i in range(len(listDims)):
		ct += listDims[i]
		if (listDims[i] == lobbyWidth):
			lobbies += 1
	#if lobbies == 0: lobbies =1
	#get the left over space
	leftOver =  recShort - ct
	perBayAdd=  leftOver/lobbies
	perBayAdd+=	0.002
	
	# distribute it to the lift lobbies
	if (perBayAdd > 0):
		for i in range(len(listDims)):
			if (listDims[i] == lobbyWidth):
				listDims[i] += perBayAdd + 0.002
	
	#added to make sure the total dimension not exceeding
	if sum(listDims)>otherLen1:
		extra = sum(listDims)-otherLen1
		listDims[-1] -= extra
	
	recLists = []
	stRec	 = bkRec

	index1 = 0
	index2 = 1
	longDim = getShorterDim(servicRec)[1]
	#@@@@@@@@@@@@@@@@@@@@@@@@@@@@@@@@@@@@@@@@@@@@@@@@@@@@@@@@@@@@@@@@@@@@@@@@@@@@@@@@@@@@@@@@@@@@@@@@@@@@@@@@@@@@@@@@@@@@@@@@@@@@@@@@@@@@@@@@	
	
	str =""
	prnList=[]
	#BLOCK TO MAKE ELEVATOR ROWS
	#@@@@@@@@@@@@@@@@@@@@@@@@@@@@@@@@@@@@@@@@@@@@@@@@@@@@@@@@@@@@@@@@@@@@@@@@@@@@@@@@@@@@@@@@@@@@@@@@	
	for i in range(len(listDims)-1):		
		try:
			rec = splitBox(stRec,listDims[i],commonLen)		
			prnList.append("DID IT")
		except:
			#nRec = stRec.Reverse
			#rec = splitBox(nRec,listDims[i],commonLen)	
			str =  "Not Done"
			prnList.append("FAILED")
			#continue
		recLists.append(rec[0])
		#frstPtList.append(rec[2])
		stRec = rec[1]
		if (i==len(listDims)-2): 
			recLists.append(rec[1])
			prnList.append("LAST CASE")
			#break
	
	#make the list of elevator row first
	elevRowLists = []
	copRecLists =  []
	str = "dont know"
	strN= ""
	for i in range(len(recLists)):
		if i ==0: dimA = listDims[i+1]		
		#if dimA != listDims[i]: copRecLists.append(recLists[i])		

		if i != 0 and dimA !=listDims[i-1] and i == len(recLists)-1 : 
			pass
		elif dimA != listDims[i]: copRecLists.append(recLists[i])
			
		#copRecLists = list(recLists[i] if dimA == listDims[i]:)
	
	#@@@@@@@@@@@@@@@@@@@@@@@@@@@@@@@@@@@@@@@@@@@@@@@@@@@@@@@@@@@@@@@@@@@@@@@@@@@@@@@@@@@@@@@@@@@@@@@@
	
	#BLOCK TO PLACE ELEVATOR BOXES IN THE ROWS
	#@@@@@@@@@@@@@@@@@@@@@@@@@@@@@@@@@@@@@@@@@@@@@@@@@@@@@@@@@@@@@@@@@@@@@@@@@@@@@@@@@@@@@@@@@@@@@@@@
	str2 = ""
	recElevs=[]
	recElevsRow=[]
	for i in range(len(copRecLists)):
		stRec = copRecLists[i]
		elevRow=[]
		shorter = getShorterDim(stRec)[0]
		for j in range(int(numElevs)-1):		
			try:
				rec = splitBox(stRec,elevShort+0.0002,shorter)				
			except:
				#continue
				stt = ""
			stRec = rec[1]
			elevRow.append(rec[0])
			if j==int(numElevs)-2: 
				elevRow.append(rec[1])
			
			#frstPtList.append(rec[2])
			recElevs.append(rec)
			str2 =  " all added" 
		recElevsRow.append(elevRow)
	#@@@@@@@@@@@@@@@@@@@@@@@@@@@@@@@@@@@@@@@@@@@@@@@@@@@@@@@@@@@@@@@@@@@@@@@@@@@@@@@@@@@@@@@@@@@@@@@@	
	totalElev = [len(x) for x in recElevsRow]
	sumtotalElev = sum(totalElev)
	#return recLists,listDims,recDims[0],copRecLists,recElevs,len(recElevs)
	return recElevsRow


def mainCode():
	numRc = getNumRects()
	if numRc >=2:
		aRects = subDivRect(getNumRects())
		subRects = scaledRects(aRects)
	else:
		subRects = [mainRec]

	outL = []
	strList=[]
	for i in range(numRc):
		
		bankRec = subRects[i]
		comLen = interLine.Length/numRc
		
		# set commonLength and otherLength
		if (comLen == bankRec.Width): 
			otrLen = bankRec.Height
		elif (comLen == bankRec.Height): 
			otrLen = bankRec.Width
		elif (bankRec.Width<bankRec.Height):
			comLen = bankRec.Width
			otrLen = bankRec.Height
		else:
			comLen = bankRec.Height
			otrLen = bankRec.Width
				
		out = makeElevBox(bankRec,comLen,otrLen)
		outL.append(out)
	return outL
	

#aRects = subDivRect(getNumRects())
#outL = scaledRects(aRects)
outL = mainCode()
#Assign your output to the OUT variable
#OUT = out,numRc,subRects,bankRec
OUT = outL
# ----------------------------------------
oneList = Python(IN[0]=latest_new_elevator_packings, IN[1]=intersect)
# ---------- oneList.python (127 lines) ----------
import clr
clr.AddReference('ProtoGeometry')
from Autodesk.DesignScript.Geometry import *
#The inputs to this node will be stored as a list in the IN variable.
dataEnteringNode = IN

listElevs = IN[0]
interLine = IN[1]





#make one list of the whole elev sublists---------------------------------
def oneList():
	return [z for x in listElevs for y in x for z in y]
#-------------------------------------------------------------------------


#to get the sorted elevs based on distance from closest point to the intersect line---------------------------------------------------------------------
def newSortElevs():
	sortedRect=[]
	avgRecList=[]
	recList = oneList()
	closePtList =[]	
	distList = []
	for i in range(len(recList)):
		recPt = recList[i].Center()		
		closePt = Geometry.ClosestPointTo(interLine[0],recList[i])
		closePtList.append(closePt)
		dist = Line.ByStartPointEndPoint(closePt,recPt).Length
		distList.append(dist)
	
	copyRecList = recList[:]
	sortedDistList = distList[:]
	sortedDistList.sort()
	
	for i in range(len(recList)):
		sortDis = sortedDistList[i]
		for j in range(len(copyRecList)):
			if sortDis == distList[j]:
				found = copyRecList[j]
				del copyRecList[j]
				del distList[j]
				break
		sortedRect.append(found)
	#return distList,sortedDistList,recList,sortedRect,copyRecList
	return sortedRect
#-----------------------------------------------------------------------------------------------------------------------------------------------------------

#calc number of elev per row---------------------------------------------------------------------------------------------------------------------------------
def numElevsperRow():
	for i in range(len(listElevs)):
		x = len(listElevs)
		y = len(listElevs[0][0])
		val = x*y
		break
	return val
#-----------------------------------------------------------------------------------------------------------------------------------------------------------

#make one list into lists as per rows of elev----------------------------------------------------------------------------------------------------------------
def makeListRow():
	numElevsRow = numElevsperRow()
	sortedElevList = newSortElevs()
	
	#create list of elevators who are combined together per row.
	num = int(len(oneList())/numElevsRow)
	megaList=[]	
	for i in range(num):
		x = i*numElevsRow
		alist = []
		for j in range(x,x+numElevsRow):			
			alist.append(sortedElevList[j])
		megaList.append(alist)
	return megaList
#-----------------------------------------------------------------------------------------------------------------------------------------------------------

#sort the rows based on the start point of instersect line--------------------------------------------------------------------------------------------------
def sortSecondRun():
	rowElevList = makeListRow()
	stPoint = interLine[0].PointAtParameter(0)

	# get the distance list for each row
	fullDistance=[]
	for i in range(len(rowElevList)):
		recList = rowElevList[i]
		disList=[]		
		for j in range(len(recList)):
			rec = recList[j]
			dist = Line.ByStartPointEndPoint(stPoint,rec.Center()).Length
			disList.append(dist)
		fullDistance.append(disList)
	
	
	#sort the distance list
	sortedDistList = fullDistance[:]
	copyElevs = rowElevList[:]
	for i in range(len(sortedDistList)):
		sortedDistList[i] = fullDistance[i][:]
		copyElevs[i] = rowElevList[i][:]
		sortedDistList[i].sort()
	
	#make the new recLists sorted
	for i in range(len(rowElevList)):
		recList = rowElevList[i]
		sortList = sortedDistList[i]
		distList1 = fullDistance[i]
				
		for j in range(len(sortList)):
			rec = recList[j]
			sortdis = sortList[j]
			newRec=[]
			for k in range(len(sortList)):
				if float(sortdis) == float(distList1[k]):
					rowElevList[i][j] = copyElevs[i][k]					
					break
	rev = []
	for i in range(len(rowElevList)):
		rev.append(rowElevList[-i])
	#return fullDistance,rowElevList,distList1,sortedDistList
	return rowElevList
#-----------------------------------------------------------------------------------------------------------------------------------------------------------


#Assign your output to the OUT variable
#OUT = oneList(),out,makePts(),scaleVals(),newSortElevs(),numElevsperRow(),sortSecondRun()
OUT = sortSecondRun()
# ----------------------------------------
separate_bank_maker = Python(IN[0]=oneList, IN[1]=building_sections)
# ---------- separate_bank_maker.python (136 lines) ----------
import clr
clr.AddReference('ProtoGeometry')
from Autodesk.DesignScript.Geometry import *
import math
#The inputs to this node will be stored as a list in the IN variable.
dataEnteringNode = IN

elevBoxes = IN[0]
buildSections=IN[1]
numElevRow = len(elevBoxes[0])
numRows = len(elevBoxes)


#to fix the sequence of elevators in the elv boxes----------------------------------------------------------------------		
def reverseList():
	global elevBoxes	
	cnt =0
	for i in range(len(elevBoxes)-1):	
		if (i)%2 == 0:
			cnt += 1
			if cnt%2==0:
				str =""
				elevBoxes[i].reverse()
				elevBoxes[i+1].reverse()
#-----------------------------------------------------------------------------------------------------------------------	


#to make one list of input elev lists-----------------------------------------------------------------------------------
def totalElevList():
	newElevBoxes=[]	
	for i in range(len(elevBoxes)):
		elev = elevBoxes[i]
		for j in range(len(elev)):
			newElevBoxes.append(elev[j])
	return newElevBoxes
#-----------------------------------------------------------------------------------------------------------------------	


#to distribute number of elevators per bank based on number elev per row------------------------------------------------
def bankNumbers():
	listElevBoxes=totalElevList()
	totalElevNum = len(listElevBoxes)
	bankNum=[]
	
	perDivision = int(math.floor(totalElevNum/buildSections))
	if (perDivision >= numElevRow): perDivision = numElevRow
	if (perDivision < numElevRow): perDivision = int(numElevRow/2)
	diff = totalElevNum - (perDivision*buildSections)
	
	#perDivision = [numElevRow if perDivision >= numElevRow]
	#perDivision = [numElevRow/2 if perDivision < numElevRow]
	
	if perDivision >=1:
		for i in range(buildSections):
			bankNum.append(perDivision)
		bankNum[-1] += diff
	
	
	#to make all if they all are even numbers
	surplus =0
	for i in range(len(bankNum)):
		if bankNum[i]%2 !=0:
			bankNum[i] -= 1
			surplus	+= 1
	if surplus > 0 : bankNum[-1] += surplus	
	bankNum.sort()
	bankNum.reverse()

	return bankNum
#-----------------------------------------------------------------------------------------------------------------------

#to make separate banks of elevs based on number of building sections---------------------------------------------------
def makePairs():
	str = []
	newElevsList =[]
	for i in range(0,numRows,2): 
		if i == numRows-1:			
			newElevsList.extend(elevBoxes[-1])
			str.append("entered here")
		else:		
			listA = elevBoxes[i]
			listB = elevBoxes[i+1]
			newList = crossLists(listA,listB)
			newElevsList.extend(newList)
			str.append("may be")				
	return newElevsList
#-----------------------------------------------------------------------------------------------------------------------

#to cross two lists togthr and return one list out----------------------------------------------------------------------
def crossLists(listA,listB):
	crossedList = []
	for i in range(len(listA)):
		crossedList.append(listA[i])
		crossedList.append(listB[i])
	return crossedList
#-----------------------------------------------------------------------------------------------------------------------


#to make separate banks of elevs based on number of building sections---------------------------------------------------
def makeBanks():
	#listElevBoxes=totalElevList()
	#totalElevNum = len(listElevBoxes)
	
	listElevBoxes=makePairs()
	totalElevNum = len(listElevBoxes)
	
	elevperBank = bankNumbers()
	elevCount   = 0
	perRowCount = 0
	listBanks=[]
	temp =0	
	for i in range(buildSections):
		elevAtBank =[]
		xVal = elevperBank[i]		
		for j in range(xVal):
			try:
				elevAtBank.append(listElevBoxes[temp+j])
			except:
				print "some error"
			#elevAtBank.append(listElevBoxes[temp+j])
			if ( j == xVal-1): temp = temp + xVal
		listBanks.append(elevAtBank)
	return listBanks,totalElevNum
#------------------------------------------------------------------------------------------------------------------------

#reverseList()

out = makeBanks()
out2 = bankNumbers()
#crossed = makePairs()



#Assign your output to the OUT variable
OUT = out,out2,len(totalElevList())
#OUT = out2
# ----------------------------------------
number_of_elev_per_bank = CodeBlock(numberElevPerBank=separate_bank_maker) { numberElevPerBank[1]; }
boundary_factor = CodeBlock { boundaryFactor = 0.9; }
floors_final = CodeBlock(Floors_Final=translate_floors) { Floors_Final; }
count = List.Count(floors_final)
key_floor_finder = Python(IN[0]=building_sections, IN[1]=gross_building_area, IN[2]=number_of_elev_per_bank, IN[3]=boundary_factor, IN[4]=area_service_module_tech_rooms, IN[5]=area_per_elevator, IN[6]=count)
# ---------- key_floor_finder.python (97 lines) ----------
import clr
clr.AddReference('ProtoGeometry')
from Autodesk.DesignScript.Geometry import *
#The inputs to this node will be stored as a list in the IN variable.
dataEnteringNode = IN

buildSections 	= 	IN[0]
grossBuildArea	=	IN[1]
#grossBuildArea	=	IN[2]
elevPerbankList	=	IN[2]
boundaryFactor	=	IN[3]
servModArea		=	IN[4]
elevArea		=	IN[5]
numFloors		=	IN[6]



#compute target area for each bank of elev serving each building section--------------------------------------------------------------------
def targetAreaCalculator(uba,buildSections):
	#output target area list for each bank of elev for each building section
	tarAreaList = []	
	#make the uba array
	totalBuildArea = 0
	for i in range(len(uba)):
		totalBuildArea += uba[i]		
	# compute the fraction
	frac 	=	totalBuildArea/buildSections
	
	#compute the target areas by iterating
	for i in range(1,buildSections+1):
		tarAreaList.append(frac*i)	
	return tarAreaList
#-------------------------------------------------------------------------------------------------------------------------------------------

#ccompute the key floors where the banks of elevators needs to be dropped-------------------------------------------------------------------
def keyFloorFinder():
	currentFloor = 1 # current floor counter
	#computer bank Area for each bank ( from elev Area )
	bankArea = [x*elevArea for x in elevPerbankList] 
	#bankArea = [10000 for x in elevPerbankList] 
	
	# iterate to find usable Build Area first
	ubaList = []
	for i in range(len(grossBuildArea)):
		ubaList.append(grossBuildArea[i]-servModArea)
	#compute the targetAreaList
	tarAreaList = targetAreaCalculator(ubaList,buildSections)
	
	#make the served areas list and key floor list and set as 0 values
	servedAreaList = [0 for x in range(buildSections)]		
	key = [0 for x in range(buildSections)]
	
	while currentFloor <= len(ubaList)-1:
		#iterate to check if target is reached
		for i in range(buildSections):
			if servedAreaList[i] < tarAreaList[i] and tarAreaList[i] - servedAreaList[i] >= ubaList[currentFloor]*boundaryFactor:
				ubaList[currentFloor] = ubaList[currentFloor] - bankArea[i] 
		#iterate to check if target is reached	
		for i in range(buildSections):
			if servedAreaList[i] < tarAreaList[i] and tarAreaList[i] - servedAreaList[i] >= ubaList[currentFloor]*boundaryFactor:
				# update served areas and the key floors
				servedAreaList[i] = servedAreaList[i] + ubaList[currentFloor] 
				key[i]	=	key[i] + 1		
		#still checking if target has been reached
		for i in range(buildSections):
			if servedAreaList[i] > tarAreaList[i] and servedAreaList[i] - tarAreaList[i] >= ubaList[currentFloor] - ubaList[currentFloor]*boundaryFactor:
				servedAreaList[i] = servedAreaList[i] - ubaList[key[i]]
				ubaList[key[i]] = ubaList[key[i]] + bankArea[i] 
				for j in range(i+1,buildSections):
					servedAreaList[j] = servedAreaList[j] + bankArea[i] 
					key[i] = key[i] - 1
		tarAreaList = targetAreaCalculator(ubaList,buildSections)
		currentFloor += 1
	return [key,servedAreaList,tarAreaList,ubaList]
#-------------------------------------------------------------------------------------------------------------------------------------------
tarAreaList = 	targetAreaCalculator(grossBuildArea,buildSections)
keyFloors	=	keyFloorFinder()

keysTest = keyFloors[0]



count =0
for i in range(len(keysTest)):
	if keysTest[i] ==0: count += 1

if count > len(keysTest)/2:
	for i in range(len(keysTest)):
		keysTest[i] = numFloors

keyFloors[0]	= 	keysTest
	


#Assign your output to the OUT variable
#OUT = keysTest#
OUT = keyFloors
# ----------------------------------------
updated_uba = CodeBlock(updatedUBA=key_floor_finder) { updatedUBA[3]; }
served_areas_by_banks = CodeBlock(servedAreas=key_floor_finder) { servedAreas[1]; }
ecap = CodeBlock { ecap= 1000; }
feedback_function = Python(IN[0]=updated_uba, IN[1]=served_areas_by_banks, IN[2]=number_of_elev_per_bank, IN[3]=ecap, IN[4]=building_sections)
# ---------- feedback_function.python (51 lines) ----------
import clr
clr.AddReference('ProtoGeometry')
from Autodesk.DesignScript.Geometry import *
#The inputs to this node will be stored as a list in the IN variable.
dataEnteringNode = IN

ubaList 			= 	IN[0]
servedAreaList		=	IN[1]
numElevPerBank		=	IN[2]
ecap				=	IN[3]
buildSections		=	IN[4]

#--------------------------------------------------------------------------------------------------------------------

# to compute the efficiency of set elevator layouts------------------------------------------------------------------
def feedBack():
	#totBankCap	= [numElevPerBank[x]*ecap for x in range(buildSections)]
	#make a list of area for building sections
	sections	= [0 for x in range(buildSections)]
	sections[0] = servedAreaList[0] # first building section area
	#isolated building section areas  
	totBankCap = 0
	for i in range(1,buildSections):
		sections[i] = servedAreaList[i] - servedAreaList[i-1]
		# total elevator bank capacity
		totBankCap  +=numElevPerBank[i]*ecap	
	#total UBA
	ubaTotal = 0
	for i in range(len(ubaList)):
		ubaTotal 	+=ubaList[i]
	
	#percentage of uba served by every bank
	percentUBA_Bank	= [0 for x in range(buildSections)]
	#used capacity of the banks
	ucap			= [0 for x in range(buildSections)]
	# added to test errors
	if totBankCap ==0 : totBankCap  =1
	for i in range(buildSections):
		percentUBA_Bank[i] = (sections[i]*100)/ubaTotal
		ucap[i] = (sections[i]*100)/totBankCap
	
	
	return percentUBA_Bank,ucap
	#return ubaTotal,totBankCap
	
#--------------------------------------------------------------------------------------------------------------------	

out = feedBack()

#Assign your output to the OUT variable
OUT = out
# ----------------------------------------
target_areas_for_banks = CodeBlock(targetAreas=key_floor_finder) { targetAreas[2]; }
key_floors = CodeBlock(keyFloors=key_floor_finder) { keyFloors[0]; }
elevators = CodeBlock(a=separate_bank_maker) { a[0][0]; }
variable_height_elevators = Python(IN[0]=translate_floors, IN[1]=key_floors, IN[2]=elevators)
# ---------- variable_height_elevators.python (29 lines) ----------
import clr
clr.AddReference('ProtoGeometry')
from Autodesk.DesignScript.Geometry import *

#The inputs to this node will be stored as a list in the IN variable.
dataEnteringNode = IN

floors		=	IN[0]
keyFloors	=	IN[1]
elevList	=	IN[2]

extruded=[]
keyFloors.reverse()
p1		=	Point.ByCoordinates(0,0,0);
p2		=	Point.ByCoordinates(0,0,100);
vec		=	Vector.ByTwoPoints(p1,p2)
for i in range(len(elevList)):
	flr = floors[keyFloors[i]]
	cen = flr.EndPoint
	zVal= cen.Z
	crv = elevList[i]
	geom=[]
	for j in range(len(crv)):
		ext	=	Curve.Extrude(crv[j],vec,zVal)		
		geom.append(ext)		
	extruded.append(geom)

#Assign your output to the OUT variable
OUT = extruded
# ----------------------------------------
edges = Face.Edges(variable_height_elevators)
curveGeometry = Edge.CurveGeometry(edges)
same_height_elevators = Python(IN[0]=translate_floors, IN[1]=key_floors, IN[2]=elevators)
# ---------- same_height_elevators.python (36 lines) ----------
import clr
clr.AddReference('ProtoGeometry')
from Autodesk.DesignScript.Geometry import *
#The inputs to this node will be stored as a list in the IN variable.
dataEnteringNode = IN

floors		=	IN[0]
keyFloors	=	IN[1]
elevList	=	IN[2]

extruded=[]
#keyFloors.reverse()
p1		=	Point.ByCoordinates(0,0,0);
p2		=	Point.ByCoordinates(0,0,100);
vec		=	Vector.ByTwoPoints(p1,p2)
zValList= []
for i in range(len(elevList)):
	flr = floors[keyFloors[i]]
	cen = flr.EndPoint
	zVal= cen.Z
	crv = elevList[i]
	geom=[]
	zValList.append(zVal)
	
mx = max(zValList)
	
for i in range(len(elevList)):
	crv = elevList[i]
	for j in range(len(crv)):
		ext	=	Curve.Extrude(crv[j],vec,mx)		
		geom.append(ext)		
	extruded.append(geom)


#Assign your output to the OUT variable
OUT = extruded
# ----------------------------------------
total_elevator_expected = CodeBlock(totElev_Expected=total_elev_pass_service) { totElev_Expected; }
final_num_elevators = Python(IN[0]=oneList)
# ---------- final_num_elevators.python (13 lines) ----------
import clr
clr.AddReference('ProtoGeometry')
from Autodesk.DesignScript.Geometry import *
#The inputs to this node will be stored as a list in the IN variable.
dataEnteringNode = IN

rectList = IN[0]

x = len(rectList)*len(rectList[0])


#Assign your output to the OUT variable
OUT = x
# ----------------------------------------
file_location = CodeBlock { a={"c:\write_Elevators.csv"}; }
vertices = Face.Vertices(variable_height_elevators)
pointFinder = Python(IN[0]=vertices)
# ---------- pointFinder.python (22 lines) ----------
import clr
clr.AddReference('ProtoGeometry')
from Autodesk.DesignScript.Geometry import *
#The inputs to this node will be stored as a list in the IN variable.
dataEnteringNode = IN

vertexList = IN[0]
tupleList = []
for i in range(len(vertexList)):
	ver = vertexList[i]
	for j in range(len(vertexList[i])):
		ver2 = ver[j]
		for k in range(len(ver2)):
			tup = (ver2[k].PointGeometry.X,ver2[k].PointGeometry.Y,ver2[k].PointGeometry.Z)
			tupleList.append(tup)


		


#Assign your output to the OUT variable
OUT = tupleList
# ----------------------------------------
writeToFile = CSV.WriteToFile(file_location, pointFinder)
file_location_2 = CodeBlock { a={"c:\write_ServiceModule.csv"}; }
extruded_tech_rooms = Python(IN[0]=translate_floors, IN[1]=key_floors, IN[2]=technical_rooms_restrooms)
# ---------- extruded_tech_rooms.python (23 lines) ----------
import clr
clr.AddReference('ProtoGeometry')
from Autodesk.DesignScript.Geometry import *
#The inputs to this node will be stored as a list in the IN variable.
dataEnteringNode = IN

floors		=	IN[0]
keyFloors	=	IN[1]
techRooms	=	IN[2]

extruded=[]
keyFloors.reverse()
lastFloor = keyFloors[0]
for i in range(len(techRooms)):
	flr = floors[lastFloor]
	cen = flr.EndPoint
	zVal= cen.Z
	crv = techRooms[i]
	ext = crv.Extrude(zVal)
	extruded.append(ext)

#Assign your output to the OUT variable
OUT = extruded
# ----------------------------------------
vertices_2 = Face.Vertices(extruded_tech_rooms)
pointFinder_2 = Python(IN[0]=vertices_2)
# ---------- pointFinder_2.python (20 lines) ----------
import clr
clr.AddReference('ProtoGeometry')
from Autodesk.DesignScript.Geometry import *
#The inputs to this node will be stored as a list in the IN variable.
dataEnteringNode = IN

vertexList = IN[0]
tupleList = []
for i in range(len(vertexList)):
	ver = vertexList[i]
	for j in range(len(vertexList[i])):
		tup = (ver[j].PointGeometry.X,ver[j].PointGeometry.Y,ver[j].PointGeometry.Z)
		tupleList.append(tup)


		


#Assign your output to the OUT variable
OUT = tupleList
# ----------------------------------------
writeToFile_2 = CSV.WriteToFile(file_location_2, pointFinder_2)
Y = IntegerSlider(-164, range=-200..-75 step 1)
X = IntegerSlider(100, range=50..200 step 1)
LENX = IntegerSlider(77, range=10..200 step 1)
LENY = IntegerSlider(133, range=10..200 step 1)
TYPE = IntegerSlider(4, range=1..4 step 1)
irregular_shape_maker = Python(IN[0]=Y, IN[1]=X, IN[2]=LENX, IN[3]=LENY, IN[4]=TYPE)
# ---------- irregular_shape_maker.python (215 lines) ----------
import clr
clr.AddReference('ProtoGeometry')
from Autodesk.DesignScript.Geometry import *
#The inputs to this node will be stored as a list in the IN variable.
dataEnteringNode = IN


x = IN[0]
y = IN[1]
lenX = IN[2]
lenY = IN[3]
type = int(IN[4])

pt = Point.ByCoordinates(x,y,0)

#find the closest point from a point-------------------------------------------------------------------------------------	
def closestPoint(ptA,ptList):
	shortLen	=	100000000000000 # set as a really high value
	index		=	0
	for i in range(len(ptList)):
		vec				= 	Vector.ByTwoPoints(ptA,ptList[i])
		vecLen			=	vec.Length
		if ( vecLen < shortLen ):
			shortLen	=	vecLen
			index		=	i
	# returns the closest point to ptA from the list
	return ptList[index]
#------------------------------------------------------------------------------------------------------------------------

#function which makes l shaped profile-----------------------------------------------------------------------------------
def shapeMaker():
	linList = []
	ptList = []
	
	ptX = Point.ByCoordinates(200000,0,0)
	ptY = Point.ByCoordinates(0,200000,0)
	
	xvec = Vector.ByTwoPoints(pt,ptX)
	yvec = Vector.ByTwoPoints(pt,ptY)
	xvecN = xvec.Reverse()
	yvecN = yvec.Reverse()
	a = int(lenX/2)
	b = int(lenY/3)
	len = [lenX,a,b,lenY-a,lenX-b,lenY]
	dir = [0,0,1,0,1,1]
	point = pt
	ptList.append(point)
	for i in range(6):
		#toggle vec values
		if i%2 ==0:
			if dir[i]==0: vec = xvec
			else: vec = xvecN
		else:
			if dir[i]==0: vec = yvec
			else: vec = yvecN	
		l1 = Line.ByStartPointDirectionLength(point,vec,len[i])
		linList.append(l1)
		point = l1.EndPoint
		ptList.append(point)
	polygon = Polygon.ByPoints(ptList)
	polyCenter = polygon.Center()
	closePt = closestPoint(polyCenter,ptList)
	return polygon,closePt
#---------------------------------------------------------------------------------------------------------------------------


def typeListMaker():
	if type == 1:		
		len = [lenX,lenY,lenX,lenY]
		dir = [0,0,1,1]
		sides = 4		
	if type == 2:
		a = int(lenX/2)		
		b = int(lenY/3)			
		len = [lenX,a,b,lenY-a,lenX-b,lenY]
		dir = [0,0,1,0,1,1]
		sides = 6
	if type == 3:		
		a1 = int(lenX/3)
		a2 = int(lenX/4)
		b = int(lenY/2)	
		len = [lenX,lenY,a1,b,a2,b,lenX-a1-a2,lenY]
		dir = [0,0,1,1,1,0,1,1]
		sides = 8
	if type == 4:
		len = [lenX,lenY,lenX,lenY]
		dir = [0,0,1,1]
		sides = 4	
	return len,dir,sides


#function which makes l shaped profile-----------------------------------------------------------------------------------
def shapeGenerator():
	linList = []
	ptList = []
	
	ptX = Point.ByCoordinates(200000,0,0)
	ptY = Point.ByCoordinates(0,200000,0)
	
	xvec = Vector.ByTwoPoints(pt,ptX)
	yvec = Vector.ByTwoPoints(pt,ptY)
	xvecN = xvec.Reverse()
	yvecN = yvec.Reverse()
	a = int(lenX/2)
	b = int(lenY/3)
	
	#len = [lenX,a,b,lenY-a,lenX-b,lenY]
	#dir = [0,0,1,0,1,1]
	#sides = 6
	 
	len = typeListMaker()[0]
	dir = typeListMaker()[1]
	sides = typeListMaker()[2]
	
	point = pt
	ptList.append(point)
	for i in range(sides):
		#toggle vec values
		if i%2 ==0:
			if dir[i]==0: vec = xvec
			else: vec = xvecN
		else:
			if dir[i]==0: vec = yvec
			else: vec = yvecN	
		l1 = Line.ByStartPointDirectionLength(point,vec,len[i])
		linList.append(l1)
		point = l1.EndPoint
		ptList.append(point)
	polygon = Polygon.ByPoints(ptList)
	polyCenter = polygon.Center()
	closePt = closestPoint(polyCenter,ptList)
	return polygon,closePt
#---------------------------------------------------------------------------------------------------------------------------



#function which makes  shaped profile---------------------------------------------------------------------------------------
def shapeGenType4():
	linList = []
	ptList = []
	
	ptX = Point.ByCoordinates(200000,0,0)
	ptY = Point.ByCoordinates(0,200000,0)
	
	xvec = Vector.ByTwoPoints(pt,ptX)
	yvec = Vector.ByTwoPoints(pt,ptY)
	xvecN = xvec.Reverse()
	yvecN = yvec.Reverse()
		
	 
	len = typeListMaker()[0]
	dir = typeListMaker()[1]
	sides = typeListMaker()[2]
	
	#1st outer polygon===============================================================
	point = pt
	ptList.append(point)
	for i in range(sides):
		#toggle vec values
		if i%2 ==0:
			if dir[i]==0: vec = xvec
			else: vec = xvecN
		else:
			if dir[i]==0: vec = yvec
			else: vec = yvecN	
		l1 = Line.ByStartPointDirectionLength(point,vec,len[i])
		linList.append(l1)
		point = l1.EndPoint
		ptList.append(point)
	polygon = Polygon.ByPoints(ptList)
	polyCenter = polygon.Center()
	closePt = closestPoint(polyCenter,ptList)
	#================================================================================
	a = lenX/1.8
	b = lenY/2.2
	len[0] = len[0] - a
	len[1] = len[1] - b
	len[2] = len[0]
	len[3] = len[1]
	
	linList = []
	ptList = []
	#inner polygon====================================================================
	point = pt
	ptList.append(point)
	for i in range(sides):
		#toggle vec values
		if i%2 ==0:
			if dir[i]==0: vec = xvec
			else: vec = xvecN
		else:
			if dir[i]==0: vec = yvec
			else: vec = yvecN	
		l1 = Line.ByStartPointDirectionLength(point,vec,len[i])
		linList.append(l1)
		point = l1.EndPoint
		ptList.append(point)
	polygon2 = Polygon.ByPoints(ptList)
	ptN = Point.ByCoordinates(pt.X+(a/2),pt.Y+(b/2))
	vecShift = Vector.ByTwoPoints(pt,ptN)
	polygon2 = polygon2.Translate(vecShift)
	#polyCenter = polygon.Center()
	#closePt = closestPoint(polyCenter,ptList)
	#================================================================================
	
	
	return [polygon,polygon2],closePt
#---------------------------------------------------------------------------------------------------------------------------


if type == 4: out = shapeGenType4()
else : out = shapeGenerator()

#Assign your output to the OUT variable
OUT = out
# ----------------------------------------
geometry_base_block = CodeBlock(a=irregular_shape_maker) { a[0]; }
box_maker = Python(IN[0]=irregular_shape_maker, IN[1]=TYPE)
# ---------- box_maker.python (158 lines) ----------
import clr
clr.AddReference('ProtoGeometry')
from Autodesk.DesignScript.Geometry import *
#The inputs to this node will be stored as a list in the IN variable.
dataEnteringNode = IN

polygon = IN[0][0]
closPt = IN[0][1]
type = IN[1]
if type!=4:
	polyPts = polygon.Points

#finds the opposite point to the closest point-------------------------------------------------
def oppPointFinder(poly,closPt):
	polyPts = poly.Points
	for i in range(len(polyPts)):
		if closPt == polyPts[i]:
			oppPt = polyPts[i-3]
			index = i
			break	
	return oppPt,index
#---------------------------------------------------------------------------------------------


#find the closest point from a point-------------------------------------------------------------------------------------	
def closestPoint(ptA,ptList):
	shortLen	=	100000000000000 # set as a really high value
	index		=	0
	for i in range(len(ptList)):
		vec				= 	Vector.ByTwoPoints(ptA,ptList[i])
		vecLen			=	vec.Length
		if ( vecLen < shortLen ):
			shortLen	=	vecLen
			index		=	i
	# returns the closest point to ptA from the list
	return ptList[index]
#------------------------------------------------------------------------------------------------------------------------




#func to split the type3 polygon to regular rect and l shape rect-----------------------------
def multiRecMaker():
	oppPt = oppPointFinder(polygon,closPt)[0]
	id = oppPointFinder(polygon,closPt)[1]-3
	siz = len(polyPts)
	
	lin = Line.ByStartPointEndPoint(closPt,polyPts[id+4])
	lin = lin.Extend(300,lin.StartPoint)
	
	crvsPoly = polygon.Curves()
	for crvs in crvsPoly:		
		pt = Geometry.Intersect(lin,crvs)
		if pt != None:
			break
	ptListA = [polyPts[0],pt[0],polyPts[id+4],polyPts[id+5]]
	ptListB = [pt[0],polyPts[id-1],polyPts[id],polyPts[id+1],polyPts[id+2],polyPts[id+3]]
	polyA = Polygon.ByPoints(ptListA)	
	polyB = Polygon.ByPoints(ptListB)
	polyNew = recMakers(polyB)
	#return lin,oppPt,polyPts[id],crvsPoly,pt,polyA,polyB
	return polyA,polyNew[0],polyNew[1]
#----------------------------------------------------------------------------------------------	
	
	
def recFromType4():
	poly1 = polygon[0]
	poly2 = polygon[1]
	polyPts1 = poly1.Points
	polyPts2 = poly2.Points
	pt=[]
	
	lin1 = Line.ByStartPointEndPoint(polyPts2[0],polyPts2[1])
	lin1 = lin1.Extend(300,lin1.StartPoint)
	lin1 = lin1.Extend(300,lin1.EndPoint)
	
	lin2 = Line.ByStartPointEndPoint(polyPts2[2],polyPts2[3])
	lin2 = lin2.Extend(300,lin2.StartPoint)
	lin2 = lin2.Extend(300,lin2.EndPoint)
	
	crvsPoly1 = poly1.Curves()
	for crvs in crvsPoly1:
		ptInt = Geometry.Intersect(lin1,crvs)
		if len(ptInt) == 0:	continue
		else: pt.append(ptInt[0])
		
	ptList1 = [pt[0],pt[1],polyPts1[0],polyPts1[1]]
	polyA = Polygon.ByPoints(ptList1)	
	for crvs in crvsPoly1:		
		ptInt = Geometry.Intersect(lin2,crvs)
		if len(ptInt) == 0:	continue
		else: pt.append(ptInt[0])	
		
	ptList2 = [pt[3],pt[2],polyPts1[2],polyPts1[3]]
	polyB = Polygon.ByPoints(ptList2)
	
	ptList3 = [pt[2],pt[0],polyPts2[1],polyPts2[2]]
	polyC = Polygon.ByPoints(ptList3)
	
	ptList4 = [pt[3],pt[1],polyPts2[0],polyPts2[3]]
	polyD = Polygon.ByPoints(ptList4)
	return polyA,polyB,polyC,polyD
	
	
	
	
#func to convert polygon to a rectangle---------------------------------------------------
def polytoRect(poly):
	crvs = poly.Curves()
	polyPts = poly.Points
	polyCen = poly.Center()
	wid = Line.ByStartPointEndPoint(polyPts[0],polyPts[1]).Length
	ht = Line.ByStartPointEndPoint(polyPts[0],polyPts[3]).Length
	
	cs = CoordinateSystem.ByOrigin(polyCen)
	#rec = Rectangle.ByWidthHeight(cs,wid,ht)
	
	ptList=[]
	for i in range(len(crvs)-1):
		pt = crvs[i].StartPoint
		ptList.append(pt)	
	rec = Rectangle.ByCornerPoints(ptList)
	return rec
#-----------------------------------------------------------------------------------------

#makes two polygons for two places in the l shape---------------------------------------------
def recMakers(poly):
	#poly = multiRecMaker()[1]
	polyPts = poly.Points
	polyCen = poly.Center()
	
	closPt = closestPoint(polyCen,polyPts)
	 
	oppPt = oppPointFinder(poly,closPt)[0]
	id = oppPointFinder(poly,closPt)[1]-3
	line1 = Line.ByStartPointEndPoint(polyPts[id],polyPts[id+1])
	line2 = Line.ByStartPointEndPoint(polyPts[id-1],polyPts[id-2])
	dist = line2.Length	
	ptNew = line1.PointAtParameter(dist/line1.Length)
	
	ptListA = [polyPts[id],polyPts[id-1],polyPts[id-2],ptNew]
	ptListB = [ptNew,polyPts[id-3],polyPts[id-4],polyPts[id-5]]
	
	polyA = Polygon.ByPoints(ptListA)
	polyB = Polygon.ByPoints(ptListB)
	
	return polyA,polyB
#---------------------------------------------------------------------------------------------

if type==1: out = [polygon]
if type==2: out = recMakers(polygon)
if type==3: out = multiRecMaker()
if type==4: out = recFromType4()

recListFinal = [polytoRect(out[i]) for i in range(len(out)) ]
#Assign your output to the OUT variable
OUT = recListFinal
#OUT = recMakers()
# ----------------------------------------
core_freq = IntegerSlider(41, range=10..250 step 1)
core_dimension = CodeBlock(a=LENX, b=LENY) { (a+b)/15; }
core_placer = Python(IN[0]=box_maker, IN[1]=TYPE, IN[2]=core_freq, IN[3]=core_dimension)
# ---------- core_placer.python (104 lines) ----------
import clr
clr.AddReference('ProtoGeometry')
from Autodesk.DesignScript.Geometry import *
import math
#The inputs to this node will be stored as a list in the IN variable.
dataEnteringNode = IN

emptyBox = IN[0]
type = IN[1]
inputLen = IN[2]
coreDim = IN[3]

#get the shorter dimension---------------------------------------------------------------
def getShorterDim(rec):
	width	=	rec.Width
	length	=	rec.Height
	points = 	rec.Points
	diagDist = Line.ByStartPointEndPoint(points[0],points[2]).Length
	if(width<=length): 
		shortEdge	= width
		longEdge	= length
	else: 
		shortEdge 	= length
		longEdge  	= width
	return shortEdge,longEdge,diagDist
	#return longEdge,shortEdge
# END OF FUNCTION ------------------------------------------------------------------------


#makes the core rectangle based on number of req it has---------------------------------------------------------------------------------------
def makeCoreBox(rec,numCore,wid,ht,longEdge):
	coreList=[]
	cen = rec.Center()
	pts = rec.Points
	#when just need to place one core
	if numCore ==1:
		cs = CoordinateSystem.ByOrigin(cen)
		coreRec= Rectangle.ByWidthHeight(cs,wid,ht)
		coreList.append(coreRec)
	#when more than one core needs to be placed
	else:
		len1 = Line.ByStartPointEndPoint(pts[0],pts[1]).Length
		len2 = Line.ByStartPointEndPoint(pts[0],pts[3]).Length
		#find the longer edge and that line
		if len1 == longEdge:
			lin = Line.ByStartPointEndPoint(pts[0],pts[1])
		else:
			lin = Line.ByStartPointEndPoint(pts[0],pts[3])			
		linCen = lin.PointAtParameter(0.5)
		vec = Vector.ByTwoPoints(linCen,cen)
		linNew = lin.Translate(vec)
		#divide the line to get the points to place core		
		linNewLen = linNew.Length
		perDist = linNewLen/(numCore+1)
		ptPlaceList = []
		#prepare the pointlist
		for i in range(numCore):
			pt = linNew.PointAtDistance((i+1)*perDist)
			ptPlaceList.append(pt)
		#add the core rectangles on the points
		for i in range(numCore):
			cs = CoordinateSystem.ByOrigin(ptPlaceList[i])
			coreRec= Rectangle.ByWidthHeight(cs,wid,ht)
			coreList.append(coreRec)			
	return coreList
#---------------------------------------------------------------------------------------------------------------------------------------------

# function which places core boxes into the empty boxes----------------------------------------------------------------------------------------
def placeCoreBox(boxList):		
	shortEdgeList=[]
	longEdgeList=[]
	recList=[]
	ptCoreList=[]
	allCores=[]
	lenMeasure = inputLen
	wid = coreDim
	ht = coreDim
	for i in range(len(boxList)):
		rec = boxList[i]
		recList.append(rec)
		shortEdge = getShorterDim(rec)[0]
		longEdge = getShorterDim(rec)[1]
		diagDist = getShorterDim(rec)[2]
		if longEdge > lenMeasure :
			numCore = int(math.ceil(longEdge/lenMeasure))	
			ptCoreList.append(numCore)
		else :
			numCore=1		
			ptCore = rec.Center()
			ptCoreList.append(ptCore)
		coreRecs = makeCoreBox(rec,numCore,wid,ht,longEdge)
		shortEdgeList.append(shortEdge)
		longEdgeList.append(longEdge)
		allCores.append(coreRecs)
	#return shortEdgeList,longEdgeList,recList,ptCoreList,allCores
	return allCores
#----------------------------------------------------------------------------------------------------------------------------------------------



out = placeCoreBox(emptyBox)
#Assign your output to the OUT variable
OUT = out
#OUT = polytoRect(emptyBox[0])
# ----------------------------------------
floor_plan_heights = CodeBlock(a=generates_floor_plane_heights) { a; }
random_height_generator = IntegerSlider(31, range=0..100 step 1)
floor_maker = Python(IN[0]=box_maker, IN[1]=floor_plan_heights, IN[2]=random_height_generator)
# ---------- floor_maker.python (51 lines) ----------
import clr
clr.AddReference('ProtoGeometry')
from Autodesk.DesignScript.Geometry import *
import sys
sys.path.append("C:\Program Files (x86)\IronPython 2.7\Lib")
import random
#The inputs to this node will be stored as a list in the IN variable.
dataEnteringNode = IN

recList=IN[0]
floorHeights = IN[1]

#makes variable length floor height list-------------------------------------------------------------------------------------------
def variableFloorHeight(flrHtList):
	newFlrHtList = []
	for i in range(len(recList)):
		y = len(flrHtList)
		x = y/2
		a = int(random.uniform(x,y))
		flrTest = flrHtList[:a]
		newFlrHtList.append(flrTest)
	return newFlrHtList
#----------------------------------------------------------------------------------------------------------------------------------




#makes floors translate to given height list---------------------------------------------------------------------------------------
def floorTranslator(recList,flrHtList):
	newRecList = []
	ptA = Point.ByCoordinates(0,0,0)
	ptB = Point.ByCoordinates(0,0,100)
	vec = Vector.ByTwoPoints(ptA,ptB)
	for i in range(len(recList)):
		rec = recList[i]
		recNList=[]
		flrHeights = flrHtList[i]
		for j in range(len(flrHeights)):
			dist = flrHeights[j]
			newRec = rec.Translate(vec,dist)
			recNList.append(newRec)
		newRecList.append(recNList)
	return newRecList
#---------------------------------------------------------------------------------------------------------------------------------


flrNewHeights = variableFloorHeight(floorHeights)
out = floorTranslator(recList,flrNewHeights)

#Assign your output to the OUT variable
OUT = out
# ----------------------------------------
floor_surface_2 = Surface.ByPatch(floor_maker)
core_extrusions = Python(IN[0]=core_placer, IN[1]=floor_surface_2)
# ---------- core_extrusions.python (39 lines) ----------
import clr
clr.AddReference('ProtoGeometry')
from Autodesk.DesignScript.Geometry import *
#The inputs to this node will be stored as a list in the IN variable.
dataEnteringNode = IN

coreRecList = IN[0]
flrSrfList = IN[1]



#to make volumes extruded to set heights--------------------------------------------------------
def coreExtruder(coreRecs):
	zValList=[]
	coreVolList = []
	testList = []
	for i in range(len(flrSrfList)):
		frlSrfL = flrSrfList[i]
		point = frlSrfL[-1].PointAtParameter(0.5)
		zVal = point.Z
		testList.append(frlSrfL[-1])
		zValList.append(zVal)
		#zValList.append(point)
	
	for i in range(len(coreRecs)):
		recL = coreRecs[i]
		recVols = []
		ext = zValList[i]+5
		for j in range(len(recL)):
			rec = recL[j]
			recExt = rec.Extrude(ext)
			recVols.append(recExt)
		coreVolList.append(recVols)
	
	return coreVolList,testList
#-----------------------------------------------------------------------------------------------
out = coreExtruder(coreRecList)
#Assign your output to the OUT variable
OUT = out
# ----------------------------------------
core_dimension_2 = IntegerSlider(15, range=5..25 step 1)
elev_points = CodeBlock(a=vertices) { a.PointGeometry; }
basefloor_assets = CodeBlock(a=box_maker) { {a.Width,a.Height}; }
block_width_height = CodeBlock(width=basefloor_assets, height=basefloor_assets) { width[0]; height[1]; }
basepoint_maker = Python(IN[0]=box_maker)
# ---------- basepoint_maker.python (10 lines) ----------
import clr
clr.AddReference('ProtoGeometry')
from Autodesk.DesignScript.Geometry import *
#The inputs to this node will be stored as a list in the IN variable.
dataEnteringNode = IN
rectList = IN[0]

ptList= [x.Center() for x in rectList]
#Assign your output to the OUT variable
OUT = ptList
# ----------------------------------------
gba_floor_area_2 = Surface.Area(floor_surface_2)
builtarea_blocks = Python(IN[0]=gba_floor_area_2)
# ---------- builtarea_blocks.python (17 lines) ----------
import clr
clr.AddReference('ProtoGeometry')
from Autodesk.DesignScript.Geometry import *
#The inputs to this node will be stored as a list in the IN variable.
dataEnteringNode = IN

floor_AreaSrf = IN[0]
totalAREA=[]
for i in range(len(floor_AreaSrf)):
	floor_Area = floor_AreaSrf[i]
	totalBuiltArea = sum(floor_Area)
	totalAREA.append(totalBuiltArea)



#Assign your output to the OUT variable
OUT = totalAREA,sum(totalAREA)
# ----------------------------------------
total_built_area_2 = CodeBlock(a=builtarea_blocks) { a[0]; a[1]; }
number_of_elevators_needed_2 = Python(IN[0]=total_built_area_2.out0, IN[1]=user_inputs.area_passElev, IN[2]=user_inputs.area_servElev)
# ---------- number_of_elevators_needed_2.python (30 lines) ----------
import clr
clr.AddReference('ProtoGeometry')
from Autodesk.DesignScript.Geometry import *
import math
#The inputs to this node will be stored as a list in the IN variable.
dataEnteringNode = IN

totalBuiltAreaL	= 	IN[0]
passArea		=	IN[1]
servArea		=	IN[2]

passElevList=[]
servElevList=[]
for i in range(len(totalBuiltAreaL)):
	totalBuiltArea = totalBuiltAreaL[i]
	passElev = math.ceil(totalBuiltArea/passArea)
	servElev = math.ceil(totalBuiltArea/servArea)
	
	#make sure elevator counts are even
	if (passElev % 2 == 1): passElev += 1
	if (servElev % 2 == 1): servElev += 1
	
	passElevList.append(passElev)
	servElevList.append(servElev)




#Assign your output to the OUT variable
OUT = [passElevList, servElevList]
# ----------------------------------------
core_placer_points = Python(IN[0]=box_maker, IN[1]=TYPE, IN[2]=core_freq, IN[3]=core_dimension)
# ---------- core_placer_points.python (90 lines) ----------
import clr
clr.AddReference('ProtoGeometry')
from Autodesk.DesignScript.Geometry import *
import math
#The inputs to this node will be stored as a list in the IN variable.
dataEnteringNode = IN

emptyBox = IN[0]
type = IN[1]
inputLen = IN[2]
coreDim = IN[3]

#get the shorter dimension---------------------------------------------------------------
def getShorterDim(rec):
	width	=	rec.Width
	length	=	rec.Height
	points = 	rec.Points
	diagDist = Line.ByStartPointEndPoint(points[0],points[2]).Length
	if(width<=length): 
		shortEdge	= width
		longEdge	= length
	else: 
		shortEdge 	= length
		longEdge  	= width
	return shortEdge,longEdge,diagDist
	#return longEdge,shortEdge
# END OF FUNCTION ------------------------------------------------------------------------


#makes the core rectangle based on number of req it has---------------------------------------------------------------------------------------
def makeCoreBox(rec,numCore,wid,ht,longEdge):
	coreList=[]
	cen = rec.Center()
	pts = rec.Points
	ptPlaceList = []
	#when just need to place one core
	if numCore ==1:
		cs = CoordinateSystem.ByOrigin(cen)
		coreRec= Rectangle.ByWidthHeight(cs,wid,ht)
		coreList.append(coreRec)
		ptPlaceList.append(cen)
	#when more than one core needs to be placed
	else:
		len1 = Line.ByStartPointEndPoint(pts[0],pts[1]).Length
		len2 = Line.ByStartPointEndPoint(pts[0],pts[3]).Length
		#find the longer edge and that line
		if len1 == longEdge:
			lin = Line.ByStartPointEndPoint(pts[0],pts[1])
		else:
			lin = Line.ByStartPointEndPoint(pts[0],pts[3])			
		linCen = lin.PointAtParameter(0.5)
		vec = Vector.ByTwoPoints(linCen,cen)
		linNew = lin.Translate(vec)
		#divide the line to get the points to place core		
		linNewLen = linNew.Length
		perDist = linNewLen/(numCore+1)
		
		#prepare the pointlist
		for i in range(numCore):
			pt = linNew.PointAtDistance((i+1)*perDist)
			ptPlaceList.append(pt)
	return ptPlaceList
#---------------------------------------------------------------------------------------------------------------------------------------------

# function which places core boxes into the empty boxes----------------------------------------------------------------------------------------
def placeCoreBox(boxList):		
	allCores=[]
	lenMeasure = inputLen
	wid = coreDim
	ht = coreDim
	for i in range(len(boxList)):
		rec = boxList[i]
		shortEdge = getShorterDim(rec)[0]
		longEdge = getShorterDim(rec)[1]
		diagDist = getShorterDim(rec)[2]
		if longEdge > lenMeasure :
			numCore = int(math.ceil(longEdge/lenMeasure))	
		else :
			numCore=1
		coreRecs = makeCoreBox(rec,numCore,wid,ht,longEdge)
		allCores.append(coreRecs)
	return allCores
#----------------------------------------------------------------------------------------------------------------------------------------------



out = placeCoreBox(emptyBox)
#Assign your output to the OUT variable
OUT = out
#OUT = polytoRect(emptyBox[0])
# ----------------------------------------
service_core_components_2 = Python(IN[0]=block_width_height.out0, IN[1]=block_width_height.out1, IN[2]=basepoint_maker, IN[3]=number_of_elevators_needed_2, IN[4]=area_per_elevator, IN[5]=tag_switch.A, IN[6]=elevator_dimensions, IN[7]=user_inputs.restroom_Prop, IN[8]=user_inputs.techroom_Prop, IN[9]=lift_lobby_width, IN[10]=core_placer_points)
# ---------- service_core_components_2.python (222 lines) ----------
import clr
clr.AddReference('ProtoGeometry')
from Autodesk.DesignScript.Geometry import *
import math
#The inputs to this node will be stored as a list in the IN variable.
dataEnteringNode = IN

flr_WidthList		=	IN[0]
flr_HeightList		=	IN[1]
twr_BaseptList		=	IN[2]
num_passElev		=	IN[3][0]
num_servElev		=	IN[3][1]

passElev_Area		=	IN[4]
servElev_Area		=	IN[4]
tag					=	IN[5]
elevWidth			=	IN[6][0]
elevLength			=	IN[6][1]
restroomProp		=	IN[7]
techrmProp			=	IN[8]
liftLobbyWidth		=	IN[9]
corePtList			=	IN[10]




#compute service core width, length, and serviceCore====================================================================================================
def serviceCoreMaker(ptL):
	global area_banks, area_restroom,area_servmodule
	#calc total area for service core for the tower
	serviceCore_Area 	= area_banks + area_restroom + area_servmodule;
	serviceCore_Area	= serviceCore_Area/len(ptL)
	area_banks			= area_banks/len(ptL)
	area_restroom		= area_restroom/len(ptL)
	area_servmodule		= area_servmodule/len(ptL)
	
	servCore_WidthL = []
	servCore_LengthL = []
	coreVerticesL = []
	b_FacL =[]
	serviceCore_RecL = []
	for i in range(len(ptL)):
		pt = ptL[i]			
		#calc aspect ratio of floor plate
		aspect_Ratio 		= 	flr_Width/flr_Height
		
		#adjust aspectratio
		if aspect_Ratio < 0.65 : aspect_Ratio = 0.75
		if aspect_Ratio > 1.3 : aspect_Ratio = 1.2
		#calc service core length and width
		servCore_Length 	=	math.sqrt(serviceCore_Area/aspect_Ratio)
		servCore_Width		=	serviceCore_Area/servCore_Length	
		
		servCore_Width		=	math.sqrt(serviceCore_Area/aspect_Ratio)
		servCore_Length 	=	serviceCore_Area/servCore_Width	
		
		"""LATER MAKE AN ORIENT FUNCTION
		if len(ptL) == 1:
			#flipped width and length
			tm = servCore_Length
			servCore_Length = servCore_Width  
			servCore_Width = tm
		"""
		# get the coordinates of center pt
		x,y,z 					= 	pt.X,pt.Y,pt.Z	
		#make the service core rectangle object--------------------------------------------------------------------------------------------------------------1
		cs					= 	CoordinateSystem.ByOrigin(x,y,z)
		serviceCore_Rec 	= 	Rectangle.ByWidthHeight(cs,servCore_Width,servCore_Length)
		coreVertices		=	serviceCore_Rec.Points
		servCore_WidthL.append(servCore_Width)
		servCore_LengthL.append(servCore_Length)
		coreVerticesL.append(coreVertices)
		serviceCore_RecL.append(serviceCore_Rec)
	#comput elev bank factor--------------------------------------------------------------------
	b_Fac				=	area_banks/serviceCore_Area
	#return serviceCore_Rec,b_Fac,coreVertices,area_banks,area_banks,area_servmodule
	return servCore_WidthL,servCore_LengthL,coreVerticesL,b_Fac,serviceCore_RecL



#function to make boxes based off of width, length and vertices===========================================================================================
def makeBox(widthL,lengthL,verticesL,factor,tag):
	new_RecL=[]
	other_RecL=[]
	for i in range(len(widthL)):
		width = widthL[i]
		length = lengthL[i]
		vertices = verticesL[i]
		
		#calculate the shorter of width or height of service core
		if ( tag == 0):
			if (width < length):
				new_Length 		=	length
				new_Width		=	factor*width
				other_Length 	=	length
				other_Width		=	width - new_Width
				index			=	3		
			else:
				new_Width		=	width	
				new_Length		=	factor*length
				other_Width 	=	width
				other_Length	=	length - new_Length
				index			=	2
		else:
			if (width > length):
				new_Length 		=	length
				new_Width		=	factor*width
				other_Length 	=	length
				other_Width		=	width - new_Width
				index			=	3		
			else:
				new_Width		=	width	
				new_Length		=	factor*length
				other_Width 	=	width
				other_Length	=	length - new_Length
				index			=	2		
	
		
		cs1					= 	CoordinateSystem.ByOrigin(vertices[0].X,vertices[0].Y,0)
		cs2					= 	CoordinateSystem.ByOrigin(vertices[index].X,vertices[index].Y,0)
		# to make the primary rectangle ----------------------------------------------------------------------	
		new_Rec 			= 	Rectangle.ByWidthHeight(cs1,new_Width,new_Length)	
		new_Vec				= 	Vector.ByTwoPoints(new_Rec.Points[0],vertices[0])
		new_Rec				=	Geometry.Translate(new_Rec, new_Vec)
		ptsnew_Rec			=	new_Rec.Points
		# to make the secondary rectangle ----------------------------------------------------------------------	
		other_Rec 			= 	Rectangle.ByWidthHeight(cs2,other_Width,other_Length)	
		other_Vec			= 	Vector.ByTwoPoints(other_Rec.Points[index],vertices[index])
		other_Rec			=	Geometry.Translate(other_Rec, other_Vec)
		ptsother_Rec		=	other_Rec.Points
		
		new_RecL.append(new_Rec)
		other_RecL.append(other_Rec)
	
	return [new_RecL,other_RecL]
#============================================================================================================================================================



#make post computations======================================================================================================================================
def coreConfigurator(b_Fac):
	#make the elevator bank rectangle object-----------------------------------------------------1	
	bank_RecL			=	makeBox(servCore_Width,servCore_Length,coreVertices,b_Fac,tag)
	bank_RecLNew = []
	for i in range(len(bank_RecL)):
		bank_Rec = 	bank_RecL[i]
		widtry1				=	bank_Rec[0].Width
		lentry1				=	bank_Rec[0].Height
				
		# code to readjust the bank rectangle piece based on the final tech rooms and restroom blocks
		if ( widtry1<lentry1):
			shortEdge		=	widtry1
			marked			=	0	
		else:
			shortEdge		=	lentry1
			marked			=	1
				
		if (elevWidth<elevLength):elevEdge = elevWidth
		else:elevEdge =	elevLength			
		numE				=	int(shortEdge / elevEdge)
		numE				+=	1
			
		newDim				=	numE*elevEdge
		if ( marked ==0): ratio	= widtry1/newDim
		else: ratio	= lentry1/newDim
		b_Fac				=	ratio*b_Fac
		#bank_RecL			=	makeBox(servCore_Width,servCore_Length,coreVertices,b_Fac,tag)
		
	return bank_RecL
	#-------------------------------------------------------------------------------------------------
#============================================================================================================================================================


#iterate through all the blocks and output lists for each---------------------------------------------
outList=[]
bankRecList= []
otherRecList=[]
areaRestrmList=[]
areaServModList=[]
servCoreList=[]

perc = 1.1

for i in range(len(twr_BaseptList)):

	flr_Width  = flr_WidthList[i]
	flr_Height = flr_HeightList[i]
	twr_Basept = twr_BaseptList[i]
	corePts	   = corePtList[i]
	
	#globals var, computer area banks, area restrm, area techrms--------------------------------------------------------------------------------------------
	cirProp = liftLobbyWidth/1.5
	
	area_banks			= servElev_Area*num_servElev[i]/perc + passElev_Area*num_passElev[i]/perc
	area_banks			+=cirProp*area_banks # added the circulation area
	area_restroom 		= restroomProp*area_banks								
	area_servmodule 	= techrmProp*area_banks
	
	
	#OUTPUT VALUES-------------------------------------------------------
	vals 				= 	serviceCoreMaker(corePts)
	servCore_Width		=	vals[0]
	servCore_Length		=	vals[1]
	coreVertices		=	vals[2]
	b_Fac				=	vals[3]
	serviceCore_Rec		=	vals[4]
	bank_Rec 			= 	coreConfigurator(b_Fac)	
	
	bankRecList.append(bank_Rec[0])
	otherRecList.append(bank_Rec[1])
	areaRestrmList.append(area_restroom)
	areaServModList.append(area_servmodule)
	servCoreList.append(serviceCore_Rec)
	
	

out = bankRecList,otherRecList,areaRestrmList,areaServModList,servCoreList


#Assign your output to the OUT variable
OUT = out
#OUT = flr_WidthList,flr_HeightList
# ----------------------------------------
service_core_full_block_2 = CodeBlock(a=service_core_components_2) { a[4]; }
other_part_service_area_2 = CodeBlock(a=service_core_components_2) { a[1]; }
area_RestRooms_2 = CodeBlock(a=service_core_components_2) { a[2]; }
area_service_module_tech_rooms_2 = CodeBlock(a=service_core_components_2) { a[3]; }
area_generator_restroom_techroom = Python(IN[0]=other_part_service_area_2, IN[1]=area_RestRooms_2, IN[2]=area_service_module_tech_rooms_2)
# ---------- area_generator_restroom_techroom.python (55 lines) ----------
import clr
clr.AddReference('ProtoGeometry')
from Autodesk.DesignScript.Geometry import *
#The inputs to this node will be stored as a list in the IN variable.
dataEnteringNode = IN

otherRecList = IN[0]
restRmAreaL  = IN[1]
techRmAreaL  = IN[2]



#proportion generator for restrm Area and Techroom Area---------------------------------------------------
def propGenerator():
	propTechL=[]
	propRestL = []
	for i in range(len(otherRecList)):
		techArea = techRmAreaL[i]
		restrmArea = restRmAreaL[i]
		propTechArea = techArea/(techArea+restrmArea)
		propRestArea = 1-propTechArea
		propTechL.append(propTechArea)
		propRestL.append(propRestArea)
	return propTechL,propRestL
#---------------------------------------------------------------------------------------------------------

#main Code called and run---------------------------------------------------------------------------------
def mainCode():
	areaRestrmList=[]
	areaTechrmList=[]
	propL = propGenerator()
	for i in range(len(otherRecList)):
		otherRecL = otherRecList[i]	
		propTech = propL[0][i]	
		propRest = propL[1][i]
		restAreaL = []
		techAreaL = []
		for j in range(len(otherRecL)):
			rec = otherRecL[j]
			recArea = rec.Width * rec.Height
			techArea = propTech * recArea
			restArea = propRest * recArea
			techAreaL.append(techArea)
			restAreaL.append(restArea)
		areaTechrmList.append(techAreaL)
		areaRestrmList.append(restAreaL)			

	return areaTechrmList, areaRestrmList
#--------------------------------------------------------------------------------------------------------


out = mainCode()
#Assign your output to the OUT variable
#OUT = [areaTechrmList, areaRestrmList]
OUT = out
# ----------------------------------------
area_tech_rooms_final = CodeBlock(a=area_generator_restroom_techroom) { a[0]; }
area_RestRooms_Final = CodeBlock(a=area_generator_restroom_techroom) { a[1]; }
technical_rooms_restrooms_2 = Python(IN[0]=other_part_service_area_2, IN[1]=area_tech_rooms_final, IN[2]=area_RestRooms_Final)
# ---------- technical_rooms_restrooms_2.python (94 lines) ----------
import clr
clr.AddReference('ProtoGeometry')
from Autodesk.DesignScript.Geometry import *
#The inputs to this node will be stored as a list in the IN variable.
dataEnteringNode = IN

wrapperRectL		=	IN[0]
areaTechnicalL		=	IN[1]
areaRestrmL			=	IN[2]


def makeThreePiece(width,length,pts,f1,f2):
	if (width < length):
		rec1Length 		=	f1*length
		rec1Width		=	width
		
		rec2Length 		=	f2*length
		rec2Width		=	width
		
		rec3Length 		=	length - rec1Length - rec2Length
		rec3Width		=	width
		
		index			=	1		
	else:
		rec1Length 		=	length
		rec1Width		=	f1*width
		
		rec2Length 		=	length
		rec2Width		=	f2*width
		
		rec3Length 		=	length
		rec3Width		=	width - rec1Width - rec2Width
		
		index			=	3
	
	cs1					= 	CoordinateSystem.ByOrigin(pts[0].X,pts[0].Y,0) 
	
	# to make the 1st rectangle ----------------------------------------------------------------------	
	rec1 				= 	Rectangle.ByWidthHeight(cs1,rec1Width,rec1Length)	
	rec1Vec				= 	Vector.ByTwoPoints(rec1.Points[0],pts[0])
	rec1				=	Geometry.Translate(rec1, rec1Vec)
	rec1Pt				=	rec1.Points	
	cs1					= 	CoordinateSystem.ByOrigin(rec1Pt[0].X,rec1Pt[0].Y,0)
	
	# to make the 2nd rectangle ----------------------------------------------------------------------	
	rec2 				= 	Rectangle.ByWidthHeight(cs1,rec2Width,rec2Length)	
	rec2Vec				= 	Vector.ByTwoPoints(rec2.Points[0],rec1Pt[index])
	rec2				=	Geometry.Translate(rec2, rec2Vec)
	rec2Pt				=	rec2.Points	
	cs1					= 	CoordinateSystem.ByOrigin(rec2Pt[0].X,rec2Pt[0].Y,0)
	
	# to make the 2nd rectangle ----------------------------------------------------------------------	
	rec3 				= 	Rectangle.ByWidthHeight(cs1,rec3Width,rec3Length)	
	rec3Vec				= 	Vector.ByTwoPoints(rec3.Points[0],rec2Pt[index])
	rec3				=	Geometry.Translate(rec3, rec3Vec)
	
	return rec1,rec2,rec3
#END OF FUNCTION#-------------------------------------------------------------------------------------

#main function called and executed----------------------------------------------------------------------
def mainCode():
	outT1 = []
	outT2 = []
	outR = []
	for i in range(len(wrapperRectL)):
		# incoming rectangle specifications
		wrapR = wrapperRectL[i]
		recListTech1=[]
		recListTech2=[]
		recListRest=[]
		for j in range(len(wrapR)):
			wrapPts			=	wrapR[j].Points
			wrapWidth		=	wrapR[j].Width
			wrapLength		=	wrapR[j].Height
			#----------------------------------------------------------------------------------------
				
			#totArea			=	areaTechnical + areaRestrm 
			totArea			=	wrapWidth * wrapLength
			facT			=	areaTechnicalL[i][j] / totArea
			facR			=	areaRestrmL[i][j] / totArea
			
			recListTech1.append(makeThreePiece(wrapWidth,wrapLength,wrapPts,0.4,0.2)[0])
			recListTech2.append(makeThreePiece(wrapWidth,wrapLength,wrapPts,0.4,0.2)[2])
			
			recListRest.append(makeThreePiece(wrapWidth,wrapLength,wrapPts,0.4,0.2)[1])
		outT1.append(recListTech1)
		outR.append(recListRest)
		outT2.append(recListTech2)
	return outT1,outR,outT2
#-------------------------------------------------------------------------------------------------------

#Assign your output to the OUT variable
#OUT = [techRec1,otherRec]
OUT = mainCode()
# ----------------------------------------
toilets_2 = CodeBlock(Toilet=technical_rooms_restrooms_2) { Toilet[1]; }
floor_curve_2 = CodeBlock(floorcrv=box_maker) { floorcrv; }
toilet_arrangement_different_2 = Python(IN[0]=toilets_2, IN[1]=floor_curve_2, IN[2]=tag_switch.A)
# ---------- toilet_arrangement_different_2.python (183 lines) ----------
import clr
clr.AddReference('ProtoGeometry')
from Autodesk.DesignScript.Geometry import *
#The inputs to this node will be stored as a list in the IN variable.
dataEnteringNode = IN

restroomRecList		=	IN[0]
floorRecList		=	IN[1]
marker				=	IN[2]



#---------------------------------------------------------------

# 1 = LONGITUDINAL CUT		0 = TRAVERSAL CUT
#make boxes inside--------------------------------------------------------------------------------
def splitRec(rec,f1,tag):
	recPoints	=	rec.Points
	width		=	rec.Width
	length		=	rec.Height
	#make the four edges of the input rectangle
	lineList	=	[]
	for i in range(len(recPoints)):
		if(i== len(recPoints)-1):
			k = 0
		else:
			k = i+1
		ptA		=	recPoints[i]
		ptB		=	recPoints[k]
		lin		=	Line.ByStartPointEndPoint(ptA,ptB)
		lineList.append(lin)
		
	#pick two points on the shorter lines
	len1	=	lineList[0].Length
	len2	=	lineList[1].Length
	if (tag == 1):
		if (len1<len2):
			lineShort1	=	lineList[0]
			lineShort2	=	lineList[2]
		else:
			lineShort1	=	lineList[1]
			lineShort2	=	lineList[3]
	else:
		if (len1>len2):
			lineShort1	=	lineList[0]
			lineShort2	=	lineList[2]
		else:
			lineShort1	=	lineList[1]
			lineShort2	=	lineList[3]
		
		
	ptOut1	=	lineShort1.PointAtParameter(f1)
	ptOut2	=	lineShort2.PointAtParameter(1-f1)
	stPt1	=	lineShort1.StartPoint
	endPt1	=	lineShort1.EndPoint
	stPt2	=	lineShort2.StartPoint
	endPt2	=	lineShort2.EndPoint
	# make the new rectangle by corner points !! SEQUENCE OF CORNER POINTS MIGHT BE AN ISSUE
	outRec1	=	Rectangle.ByCornerPoints(stPt1,endPt2,ptOut2,ptOut1)
	outRec2	=	Rectangle.ByCornerPoints(stPt2,endPt1,ptOut1,ptOut2)
		
	#return lineShort1,lineShort2,ptOut1,ptOut2,width,length,outRec1,outRec2
	return outRec1,outRec2
	#return lineList
#END OF FUNCTION# --------------------------------------------------------------------------------


#-----------------------------------------------------------------------------------------------------
def findOuterPt():
	restrmPoints	=	restroomRec.Points
	floorPoints		=	floorRec.Points

	selectedLines	=	[]
	selectedPoints	=	[]
	lineStoreList=[]
	lineList	=	[]
	lineStore=0
	for i in range(len(restrmPoints)):
		ptA 		= 	restrmPoints[i]
		# iterate to make the 4 lines 
		for j in range(len(floorPoints)):
			ptB 		= 	floorPoints[j]
			lineAB		=	Line.ByStartPointEndPoint(ptA,ptB)
			lineList.append(lineAB)
		prevLine=""
		# iterate to find the shortest line out of the four
		for k in range(len(lineList)):
			currentLine = lineList[k]
			if ( prevLine != ""):
				if ( prevLine.Length > currentLine.Length ): lineStore = currentLine
				else : lineStore = prevLine
			prevLine = currentLine
		lineStoreList.append(lineStore)
	
	prevLen = ""
	indexVal= 0
	for l in range(len(lineStoreList)):
		currentLen	=	lineStoreList[l].Length
		if ( prevLen != ""):
			if ( prevLen > currentLen ): indexVal = l
		prevLen = currentLen
		
	shortLine = lineStoreList[indexVal]
	finalPoint= shortLine.StartPoint
	return finalPoint
#END OF FUNCTION# --------------------------------------------------------------------------------


#decide the proportion of fraction----------------------------------------------------------------
def facDecider(rec,pt):
	points	=	rec.Points
	width	=	rec.Width
	length	=	rec.Height
	line	=	Vector.ByTwoPoints(points[0],pt)
	#line	=	Line.ByStartPointEndPoint(points[0],pt)
	len		=	line.Length
	
	if (width<length):
		shortDist = width
	else:
		shortDist = length
	
	if (len>shortDist):
		fac = 0.8
	else:
		fac = 0.2
	return fac
#END OF FUNCTION# --------------------------------------------------------------------------------

def closerRect(recList,pt):
	lenList=[]
	for i in range(0,len(recList)):	
		rec	=	recList[i]
		lin = 	Line.ByStartPointEndPoint(rec.Center(),pt)
		lenList.append(lin.Length)
	index= ""
	for i in range(0,len(lenList)-1):
		len1 = lenList[i]
		len2 = lenList[i+1]
	if (len1<len2):
		index = 0
	else:
		index = 1
	return recList[index]
	
	
"""	
restroomRecList		=	IN[0]
floorRecList		=	IN[1]
markerList			=	IN[2]
"""
rec1List=[]
rec2List=[]
for i in range(len(restroomRecList)):
	restRmL = restroomRecList[i]
	rec1L=[]
	rec2L=[]
	floorRec = floorRecList[i]
	for j in range(len(restRmL)):
		restroomRec = restRmL[j]
		widthRestrm		=	restroomRec.Width
		lengthRestrm	=	restroomRec.Height
		pointsRestrm	=	restroomRec.Points
		
		finalPoint= findOuterPt()		
		if(marker == 1):
			key1 = 0
			key2 = 1
		else:
			key1 = 1
			key2 = 0
				
		recs	=	splitRec(restroomRec,0.5,key1)
		closeRec=	closerRect(recs,finalPoint)
		fac		=	facDecider(closeRec,finalPoint)
		rec2	=	splitRec(closeRec,fac,key2)
		rec1L.append(recs[0])
		rec2L.append(rec2)
	rec1List.append(rec1L)
	rec2List.append(rec2L)
#Assign your output to the OUT variable
#OUT = lineStoreList,lineList,restrmPoints,shortLine,finalPoint
OUT = rec1List,rec2List
# ----------------------------------------
technical_rooms_2 = CodeBlock(Toilet=technical_rooms_restrooms_2) { Toilet[0]; Toilet[2]; }
technical_room_arrangements_3 = Python(IN[0]=technical_rooms_2.out0)
# ---------- technical_room_arrangements_3.python (94 lines) ----------
import clr
clr.AddReference('ProtoGeometry')
from Autodesk.DesignScript.Geometry import *
import math
#import random
#The inputs to this node will be stored as a list in the IN variable.
dataEnteringNode = IN

mainRecList		=	IN[0]

#---------------------------------------------------------------



# 1 = LONGITUDINAL CUT		0 = TRAVERSAL CUT
#make boxes inside--------------------------------------------------------------------------------
def splitRec(rec,f1,tag):
	recPoints	=	rec.Points
	width		=	rec.Width
	length		=	rec.Height
	#make the four edges of the input rectangle
	lineList	=	[]
	for i in range(len(recPoints)):
		if(i== len(recPoints)-1):
			k = 0
		else:
			k = i+1
		ptA		=	recPoints[i]
		ptB		=	recPoints[k]
		lin		=	Line.ByStartPointEndPoint(ptA,ptB)
		lineList.append(lin)
		
	#pick two points on the shorter lines
	len1	=	lineList[0].Length
	len2	=	lineList[1].Length
	if (tag == 1):
		if (len1<len2):
			lineShort1	=	lineList[0]
			lineShort2	=	lineList[2]
		else:
			lineShort1	=	lineList[1]
			lineShort2	=	lineList[3]
	else:
		if (len1>len2):
			lineShort1	=	lineList[0]
			lineShort2	=	lineList[2]
		else:
			lineShort1	=	lineList[1]
			lineShort2	=	lineList[3]
		
		
	ptOut1	=	lineShort1.PointAtParameter(f1)
	ptOut2	=	lineShort2.PointAtParameter(1-f1)
	stPt1	=	lineShort1.StartPoint
	endPt1	=	lineShort1.EndPoint
	stPt2	=	lineShort2.StartPoint
	endPt2	=	lineShort2.EndPoint
	# make the new rectangle by corner points !! SEQUENCE OF CORNER POINTS MIGHT BE AN ISSUE
	outRec1	=	Rectangle.ByCornerPoints(stPt1,endPt2,ptOut2,ptOut1)
	outRec2	=	Rectangle.ByCornerPoints(stPt2,endPt1,ptOut1,ptOut2)
		
	#return lineShort1,lineShort2,ptOut1,ptOut2,width,length,outRec1,outRec2
	return outRec1,outRec2
	#return lineList
#END OF FUNCTION# --------------------------------------------------------------------------------


finalList=[]
for i in range(len(mainRecList)):
	mainRecL = mainRecList[i]
	getList = []
	for j in range(len(mainRecL)):
		mainRec 		= 	mainRecL[j]
		outList			=	[]
		twoLinearRecs	=	splitRec(mainRec,0.60,0)
		rec1			=	twoLinearRecs[0]
		rec2			=	twoLinearRecs[1]
		for k in range(3):
			#fac		=	random.random()
			fac 	=	0.35
			out1 	=	splitRec(rec1,fac,0)
			outList.append(out1)
			rec1	=	out1[1]			
			out2 	=	splitRec(rec2,fac,0)
			outList.append(out2)
			rec2	=	out2[1]		
		getList.append(outList)
	finalList.append(getList)
	
	

#Assign your output to the OUT variable
#OUT = lineStoreList,lineList,restrmPoints,shortLine,finalPoint
OUT = finalList
# ----------------------------------------
technical_room_arrangements_4 = Python(IN[0]=technical_rooms_2.out1)
# ---------- technical_room_arrangements_4.python (90 lines) ----------
import clr
clr.AddReference('ProtoGeometry')
from Autodesk.DesignScript.Geometry import *
import math
#import random
#The inputs to this node will be stored as a list in the IN variable.
dataEnteringNode = IN

mainRecList		=	IN[0]

#---------------------------------------------------------------
# 1 = LONGITUDINAL CUT		0 = TRAVERSAL CUT
#make boxes inside--------------------------------------------------------------------------------
def splitRec(rec,f1,tag):
	recPoints	=	rec.Points
	width		=	rec.Width
	length		=	rec.Height
	#make the four edges of the input rectangle
	lineList	=	[]
	for i in range(len(recPoints)):
		if(i== len(recPoints)-1):
			k = 0
		else:
			k = i+1
		ptA		=	recPoints[i]
		ptB		=	recPoints[k]
		lin		=	Line.ByStartPointEndPoint(ptA,ptB)
		lineList.append(lin)
		
	#pick two points on the shorter lines
	len1	=	lineList[0].Length
	len2	=	lineList[1].Length
	if (tag == 1):
		if (len1<len2):
			lineShort1	=	lineList[0]
			lineShort2	=	lineList[2]
		else:
			lineShort1	=	lineList[1]
			lineShort2	=	lineList[3]
	else:
		if (len1>len2):
			lineShort1	=	lineList[0]
			lineShort2	=	lineList[2]
		else:
			lineShort1	=	lineList[1]
			lineShort2	=	lineList[3]
		
		
	ptOut1	=	lineShort1.PointAtParameter(f1)
	ptOut2	=	lineShort2.PointAtParameter(1-f1)
	stPt1	=	lineShort1.StartPoint
	endPt1	=	lineShort1.EndPoint
	stPt2	=	lineShort2.StartPoint
	endPt2	=	lineShort2.EndPoint
	# make the new rectangle by corner points !! SEQUENCE OF CORNER POINTS MIGHT BE AN ISSUE
	outRec1	=	Rectangle.ByCornerPoints(stPt1,endPt2,ptOut2,ptOut1)
	outRec2	=	Rectangle.ByCornerPoints(stPt2,endPt1,ptOut1,ptOut2)
		
	#return lineShort1,lineShort2,ptOut1,ptOut2,width,length,outRec1,outRec2
	return outRec1,outRec2
	#return lineList
#END OF FUNCTION# --------------------------------------------------------------------------------

finalList=[]
for i in range(len(mainRecList)):
	mainRecL = mainRecList[i]
	getList = []
	for j in range(len(mainRecL)):
		mainRec 		= 	mainRecL[j]
		outList	=	[]
		twoLinearRecs	=	splitRec(mainRec,0.38,1)
		rec1			=	twoLinearRecs[0]
		rec2			=	twoLinearRecs[1]
		for k in range(4):
			#fac		=	random.random()
			fac 	=	0.35
			out1 	=	splitRec(rec1,fac,0)
			outList.append(out1)
			rec1	=	out1[1]			
			out2 	=	splitRec(rec2,fac,0)
			outList.append(out2)
			rec2	=	out2[1]		
		getList.append(outList)
	finalList.append(getList)
	
	

#Assign your output to the OUT variable
#OUT = lineStoreList,lineList,restrmPoints,shortLine,finalPoint
OUT = finalList
# ----------------------------------------
buildSections = CodeBlock { buildSections = 3; }
building_sections_per_volume = Python(IN[0]=floor_curve_2, IN[1]=buildSections)
# ---------- building_sections_per_volume.python (16 lines) ----------
import clr
clr.AddReference('ProtoGeometry')
from Autodesk.DesignScript.Geometry import *
#The inputs to this node will be stored as a list in the IN variable.
dataEnteringNode = IN

spaceList = IN[0]
buildSec = IN[1]

buildSecs = []
for i in range(len(spaceList)):
	buildSecs.append(buildSec)
	

#Assign your output to the OUT variable
OUT = buildSecs
# ----------------------------------------
GBA = CodeBlock(grossBuildingArea=gba_floor_area_2) { grossBuildingArea; }
bank_rectangle_piece_2 = CodeBlock(Bank_Rectangle=service_core_components_2) { Bank_Rectangle[0]; }
transpose = List.Transpose(number_of_elevators_needed_2)
total_elevs_per_block = Python(IN[0]=transpose)
# ---------- total_elevs_per_block.python (19 lines) ----------
import clr
clr.AddReference('ProtoGeometry')
from Autodesk.DesignScript.Geometry import *
#The inputs to this node will be stored as a list in the IN variable.
dataEnteringNode = IN


elevLists = IN[0]

num = len(elevLists)
finLists=[]
for i in range(num):
	finLists.append(sum(elevLists[i]))


	

#Assign your output to the OUT variable
OUT = finLists
# ----------------------------------------
intersect_2 = Geometry.Intersect(geometry=bank_rectangle_piece_2, other=other_part_service_area_2)
latest_new_elevator_packings_2 = Python(IN[0]=bank_rectangle_piece_2, IN[1]=elevator_dimensions, IN[2]=total_elevs_per_block, IN[3]=lift_lobby_width, IN[4]=other_part_service_area_2, IN[5]=intersect_2, IN[6]=max_elevators)
# ---------- latest_new_elevator_packings_2.python (518 lines) ----------
import clr
clr.AddReference('ProtoGeometry')
from Autodesk.DesignScript.Geometry import *
import math
#The inputs to this node will be stored as a list in the IN variable.
dataEnteringNode = IN

mainRecL	=	IN[0]
elevWidth	=	IN[1][0]
elevLength	=	IN[1][1]
totElev		=	IN[2]
lobbyWidth	=	IN[3]
servicRecL	=	IN[4]
interLineL	=	IN[5]
maxElevs	=	IN[6]





#FIRST CALLS **********************************************************************************************************************************FIRST CALLS
#to calc how many sub rectangles the elevbankrect needs to be split-------------------------
def getNumRects():
	#very imp transition@@@@@@@@@@@
	recShort	=	otherLen1
	recLong		=	commonLen	
	elevShort	=	getElevShorterDim(elevWidth,elevLength)[0]
	numRects	=	1	
	approx_numElevs	=	int(math.floor(recLong/elevShort))

	#Added to make total num of Elevs always even
	if approx_numElevs%2 > 0: approx_numElevs += 1
	#-----------------------------------------------		
	elevShort 	=	recLong/approx_numElevs		
	while approx_numElevs > maxElevs:
		numRects += 1
		approx_numElevs = int(approx_numElevs/2)	
	return int(numRects)
#------------------------------------------------------------------------------------------num,mainRec



#to subdivide given rect to num of rects based on a num------------------------------------
def subDivRect(num,mainRec):	
	numRects = getNumRects()
	numRects = num
	if numRects < 2 : 
		return "no need to split"
	
	recList = []
	length1 = commonLen
	length2 = otherLen1
	
	dimension = length1/numRects

	startRec = mainRec
	for i in range(numRects):		
		try:
			rec = splitBox(startRec,dimension,length2)
		except:
			recList.append(rec[1])
			return recList			
		recList.append(rec[0])		
		startRec = rec[1]			
	return recList
#------------------------------------------------------------------------------------------



#function to scale rectangles to add in corridors in between elevators-------------------------------------------------------------
def scaledRects(recLists):
	#make new recLists
	newRecs = recLists[:]
	del newRecs[0]
	del newRecs[-1]
	
	
	endRecs = [recLists[0],recLists[-1]]
	
	outRec=[]
	for rec in newRecs:
		pts = rec.Points
		basePt = pts[0]
		wid = rec.Width
		length = rec.Height
		
		l1 = Line.ByStartPointEndPoint(pts[0],pts[1])
		l2 = Line.ByStartPointEndPoint(pts[0],pts[3])
		
		len1 = l1.Length
		len2 = l2.Length
		fac = 0.75 # hardcoded
		
		#prepare basept, p1 and p2 from Scale1D
		if wid == len1: 
			fromPt = pts[1]
			toPt = l1.PointAtParameter(fac)
			midPt = l1.PointAtParameter(0.5)
		else: 
			fromPt = pts[3]
			toPt = l2.PointAtParameter(fac)
			midPt = l2.PointAtParameter(0.5)
		
		#find the vector to translate the scaled rect		
		pCrv = rec.Scale1D(basePt,fromPt,toPt)
		crv = pCrv.Curves()
		ptsNew = [x.StartPoint for x in crv]
			
		lNew1 = Line.ByStartPointEndPoint(ptsNew[0],ptsNew[1])
		lNew2 = Line.ByStartPointEndPoint(ptsNew[0],ptsNew[3])
			
		if wid == len1: midPtNew = lNew1.PointAtParameter(0.5)
		else: midPtNew = lNew2.PointAtParameter(0.5)
			
			
		#make the vec for translation
		vec= Vector.ByTwoPoints(midPtNew,midPt)
		pCrv = pCrv.Translate(vec)
		
		#block to make rectangle
		crv = pCrv.Curves()
		ptsNew = [x.StartPoint for x in crv]		
		rec = Rectangle.ByCornerPoints(ptsNew[0],ptsNew[3],ptsNew[2],ptsNew[1])
		outRec.append(rec)
			
		
	#code to work on the first and last rectangles.	
	for i in range(len(endRecs)):
		if (i==0):pass
		rec = endRecs[i]
		
		pts = rec.Points
		basePt = pts[0]
		wid = rec.Width
		length = rec.Height
		
		l1 = Line.ByStartPointEndPoint(pts[0],pts[1])
		l2 = Line.ByStartPointEndPoint(pts[0],pts[3])
		
		len1 = l1.Length
		len2 = l2.Length
		fac = 0.9 # hardcoded
		
		#prepare basept, p1 and p2 from Scale1D
		if wid == len1: 
			fromPt = pts[1]
			toPt = l1.PointAtParameter(fac)
			midPt = l1.PointAtParameter(0.5)
		else: 
			fromPt = pts[3]
			toPt = l2.PointAtParameter(fac)
			midPt = l2.PointAtParameter(0.5)
		
		
		
		#find the vector to translate the scaled rect		
		pCrv = rec.Scale1D(basePt,fromPt,toPt)
		crv = pCrv.Curves()
		if(i>0):
			ptsNew = [x.StartPoint for x in crv]
			
			lNew1 = Line.ByStartPointEndPoint(ptsNew[0],ptsNew[1])
			lNew2 = Line.ByStartPointEndPoint(ptsNew[0],ptsNew[3])
			
			if wid == len1: midPtNew = lNew1.PointAtParameter(fac/2)
			else: midPtNew = lNew2.PointAtParameter(fac/2)
		
			#make the vec for translation
			vec= Vector.ByTwoPoints(midPtNew,midPt)
			pCrv = pCrv.Translate(vec)

		#block to make rectangle
		crv = pCrv.Curves()
		ptsNew = [x.StartPoint for x in crv]		
		rec = Rectangle.ByCornerPoints(ptsNew[0],ptsNew[3],ptsNew[2],ptsNew[1])
		
		endRecs[i] = rec
		#break	
		
		
	#finally merge all components
	finList=[]		
	finList.extend([endRecs[0]])
	finList.extend(outRec)
	finList.extend([endRecs[-1]])
		
	return finList
#-----------------------------------------------------------------------------------------------------------------------------------
#FIRST CALLS **********************************************************************************************************************************FIRST CALLS

#get the shorter dimension---------------------------------------------------------------
def getShorterDim(rec):
	width	=	rec.Width
	length	=	rec.Height
	if(width<=length): 
		shortEdge	= width
		longEdge	= length
	else: 
		shortEdge 	= length
		longEdge  	= width
	return shortEdge,longEdge
	#return longEdge,shortEdge
# END OF FUNCTION ------------------------------------------------------------------------

#get the shorter dimension---------------------------------------------------------------
def getElevShorterDim(width,length):
	if(width<length): 
		shortEdge	= width
		longEdge	= length
	else: 
		shortEdge = length
		longEdge  = width
	return shortEdge,longEdge
	#return longEdge,shortEdge
# END OF FUNCTION ------------------------------------------------------------------------

#====================================================================================================================================================================================
#make rects based on dimension given------------------------------------------------------------------------
def splitBox(rec,dim,length):
	recPts	=	rec.Points
	#make four lines for the input rectangles
	lin0		=	Line.ByStartPointEndPoint(recPts[0],recPts[1])#0
	lin1		=	Line.ByStartPointEndPoint(recPts[1],recPts[2])#1
	lin2 		=	Line.ByStartPointEndPoint(recPts[2],recPts[3])#2
	lin3		=	Line.ByStartPointEndPoint(recPts[3],recPts[0])#3
	# get the first point of first line
	firstPt		=	lin0.StartPoint
	
	# get the length and lines for those edges whose length matches input length
	if lin0.Length >= length-0.005 and lin0.Length <= length+0.005: 
		bigDimension = lin1.Length
		lineShort1 = lin1
		lineShort2 = lin3				
	if lin1.Length >= length-0.005 and lin1.Length <= length+0.005: 
		bigDimension = lin0.Length
		lineShort1 = lin0
		lineShort2 = lin2
	
	#get the points to make the two rectangles
	f1 		=	dim/bigDimension
	ptOut1	=	lineShort1.PointAtParameter(f1)
	ptOut2	=	lineShort2.PointAtParameter(1-f1)
	stPt1	=	lineShort1.StartPoint
	endPt1	=	lineShort1.EndPoint
	stPt2	=	lineShort2.StartPoint
	endPt2	=	lineShort2.EndPoint
	
	# make the new rectangle by corner points !! SEQUENCE OF CORNER POINTS MIGHT BE AN ISSUE
	rec1	=	Rectangle.ByCornerPoints(stPt1,endPt2,ptOut2,ptOut1)
	rec2	=	Rectangle.ByCornerPoints(ptOut1,ptOut2,stPt2,endPt1)
	#get the center points for two rects
	rec1Cen	=	rec1.Center()
	rec2Cen = 	rec2.Center()
	#get the vectors from the first pt
	vec1	=	Vector.ByTwoPoints(firstPt,rec1Cen)
	vec2	=	Vector.ByTwoPoints(firstPt,rec2Cen)
	#compare the length of the vectors to get how far are they from start pt
	vcLen1 	=	vec1.Length
	vcLen2 	=	vec2.Length
	#finally set them as the final ouput rect
	if vcLen1 < vcLen2 :
		outRec1 = 	rec1
		outRec2 = 	rec2
	else:
		outRec1 = 	rec2
		outRec2 = 	rec1	
			
	return outRec1,outRec2
#---------------------------------------------------------------------------------------------------------------	
	
#main function making the elevator packings------------------------------------------------
def makeElevBox(bkRec,commonLen,otherLen1):
	inpRec = []
	inpRec.append(bkRec)

	elevDims	=	getElevShorterDim(elevWidth,elevLength)
	elevShort	=	elevDims[0]
	elevLong	=	elevDims[1]
	
	longCounter = 	0
	listDims	=	[]
	frstPtList	=	[]
	count		=	0
	
	#very imp transition@@@@@@@@@@@
	recShort	=	otherLen1
	recLong		=	commonLen
		
	numElevs	=	int(math.floor(recLong/elevShort))
	#"""
	#Added to make total num of Elevs always even
	if numElevs%2 > 0: 
		numElevs += 1
		#elevShort = recLong/numElevs
	#-----------------------------------------------

	elevShort 	=	recLong/numElevs	
	areaElev 	=	elevShort*commonLen

	
	
	cap = 5		
	#BLOCK TO MAKE LIST OF DIMENSIONS TO PREPARE ELEV ROWS AND LOBBY PLACEMENTS
	#@@@@@@@@@@@@@@@@@@@@@@@@@@@@@@@@@@@@@@@@@@@@@@@@@@@@@@@@@@@@@@@@@@@@@@@@@@@@@@@@@@@@@@@@@@@@@@@@@@@@@@@@@@@@@@@@@@@@@@@@@@@@@@@@@@@@@@@@	
	#loop till you catch up with the dimension longitudinally
	while (cap>0):
		longCounter += elevLong
		if (longCounter > recShort): # recShort replaced by otherLen   +++ longCounter > recShort-0.005 and longCounter < recShort+0.005
			break
		listDims.append(elevLong)
		if (count%2 ==0):
			longCounter += lobbyWidth	
			if (longCounter > recShort):# recShort replaced by otherLen
				break
			listDims.append(lobbyWidth)			
		count		+= 1
	ct = 0
	lobbies = 0
	# test to check whole length added
	for i in range(len(listDims)):
		ct += listDims[i]
		if (listDims[i] == lobbyWidth):
			lobbies += 1
	#if lobbies == 0: lobbies =1
	#get the left over space
	leftOver =  recShort - ct
	perBayAdd=  leftOver/lobbies
	perBayAdd+=	0.002
	
	# distribute it to the lift lobbies
	if (perBayAdd > 0):
		for i in range(len(listDims)):
			if (listDims[i] == lobbyWidth):
				listDims[i] += perBayAdd + 0.002
	
	#added to make sure the total dimension not exceeding
	if sum(listDims)>otherLen1:
		extra = sum(listDims)-otherLen1
		listDims[-1] -= extra
	
	recLists = []
	stRec	 = bkRec

	index1 = 0
	index2 = 1
	longDim = getShorterDim(servicRec)[1]
	#@@@@@@@@@@@@@@@@@@@@@@@@@@@@@@@@@@@@@@@@@@@@@@@@@@@@@@@@@@@@@@@@@@@@@@@@@@@@@@@@@@@@@@@@@@@@@@@@@@@@@@@@@@@@@@@@@@@@@@@@@@@@@@@@@@@@@@@@	
	
	str =""
	prnList=[]
	#BLOCK TO MAKE ELEVATOR ROWS
	#@@@@@@@@@@@@@@@@@@@@@@@@@@@@@@@@@@@@@@@@@@@@@@@@@@@@@@@@@@@@@@@@@@@@@@@@@@@@@@@@@@@@@@@@@@@@@@@@	
	for i in range(len(listDims)-1):		
		try:
			rec = splitBox(stRec,listDims[i],commonLen)		
			prnList.append("DID IT")
		except:
			#nRec = stRec.Reverse
			#rec = splitBox(nRec,listDims[i],commonLen)	
			str =  "Not Done"
			prnList.append("FAILED")
			#continue
		recLists.append(rec[0])
		#frstPtList.append(rec[2])
		stRec = rec[1]
		if (i==len(listDims)-2): 
			recLists.append(rec[1])
			prnList.append("LAST CASE")
			#break
	
	#make the list of elevator row first
	elevRowLists = []
	copRecLists =  []
	str = "dont know"
	strN= ""
	for i in range(len(recLists)):
		if i ==0: dimA = listDims[i+1]		
		#if dimA != listDims[i]: copRecLists.append(recLists[i])		

		if i != 0 and dimA !=listDims[i-1] and i == len(recLists)-1 : 
			pass
		elif dimA != listDims[i]: copRecLists.append(recLists[i])
			
		#copRecLists = list(recLists[i] if dimA == listDims[i]:)
	
	#@@@@@@@@@@@@@@@@@@@@@@@@@@@@@@@@@@@@@@@@@@@@@@@@@@@@@@@@@@@@@@@@@@@@@@@@@@@@@@@@@@@@@@@@@@@@@@@@
	
	#BLOCK TO PLACE ELEVATOR BOXES IN THE ROWS
	#@@@@@@@@@@@@@@@@@@@@@@@@@@@@@@@@@@@@@@@@@@@@@@@@@@@@@@@@@@@@@@@@@@@@@@@@@@@@@@@@@@@@@@@@@@@@@@@@
	str2 = ""
	recElevs=[]
	recElevsRow=[]
	for i in range(len(copRecLists)):
		stRec = copRecLists[i]
		elevRow=[]
		shorter = getShorterDim(stRec)[0]
		for j in range(int(numElevs)-1):		
			try:
				rec = splitBox(stRec,elevShort+0.0002,shorter)				
			except:
				#continue
				stt = ""
			stRec = rec[1]
			elevRow.append(rec[0])
			if j==int(numElevs)-2: 
				elevRow.append(rec[1])
			
			#frstPtList.append(rec[2])
			recElevs.append(rec)
			str2 =  " all added" 
		recElevsRow.append(elevRow)
	#@@@@@@@@@@@@@@@@@@@@@@@@@@@@@@@@@@@@@@@@@@@@@@@@@@@@@@@@@@@@@@@@@@@@@@@@@@@@@@@@@@@@@@@@@@@@@@@@	
	totalElev = [len(x) for x in recElevsRow]
	sumtotalElev = sum(totalElev)
	#return recLists,listDims,recDims[0],copRecLists,recElevs,len(recElevs)
	return recElevsRow


def mainCode(mainRec):
	numRc = getNumRects()
	if numRc >=2:
		aRects = subDivRect(getNumRects(),mainRec)
		subRects = scaledRects(aRects)
	else:
		subRects = [mainRec]
	outL = []
	strList=[]
	for i in range(numRc):
		
		bankRec = subRects[i]
		comLen = interLine.Length/numRc
		
		# set commonLength and otherLength
		if (comLen == bankRec.Width): 
			otrLen = bankRec.Height
		elif (comLen == bankRec.Height): 
			otrLen = bankRec.Width
		elif (bankRec.Width<bankRec.Height):
			comLen = bankRec.Width
			otrLen = bankRec.Height
		else:
			comLen = bankRec.Height
			otrLen = bankRec.Width
				
		out = makeElevBox(bankRec,comLen,otrLen)
		outL.append(out)
	return outL
	
#function to see rectangle size ---------------------------------------------------------------------------------------------
def sizeChecker(rec,dim):
	wid = rec.Width
	ht = rec.Height	
	if wid < dim or ht < dim:
		return False
	else: return True
#----------------------------------------------------------------------------------------------------------------------------

"""
mainRecL	=	IN[0]
elevWidthL	=	IN[1][0]
elevLengthL	=	IN[1][1]
totElevL	=	IN[2]
lobbyWidth	=	IN[3]
servicRecL	=	IN[4]
interLineL	=	IN[5][0]
maxElevs	=	IN[6]

"""

outF=[]
interLine  = interLineL[0]
testLen=[]
for i in range(len(mainRecL)):
	#1st Block lev handling each rect block
	coreInside = mainRecL[i]
	#outF.append(len(coreInside))
	interLine  = interLineL[i][0][0]
	
	"""
	if len(coreInside) <1:
		out ="More Than One Cores , Cant Handle"
		#pass
	else:
	"""
	out1=[]
	for j in range(len(coreInside)):
		interLine  = interLineL[i][j][0]
		commonLen	=	float(interLine.Length)
		otherLen1	=	0
		mainRec 	= 	coreInside[j]
		bankRec 	= 	mainRec
		servicRec 	=	servicRecL[i][j]
			
		#if sizeChecker(mainRec,8) == False: break
			
		if (commonLen > mainRec.Width-0.005 and commonLen < mainRec.Width+0.005): otherLen1 = float(mainRec.Height)
		if (commonLen > mainRec.Height-0.005 and commonLen < mainRec.Height+0.005): otherLen1 = float(mainRec.Width)
		out = mainCode(mainRec)
		testLen.append(otherLen1)
		out1.append(out)
	outF.append(out1)
		

		
	










#Assign your output to the OUT variable
#OUT = out,numRc,subRects,bankRec
OUT = outF
# ----------------------------------------
oneList_2 = Python(IN[0]=latest_new_elevator_packings_2, IN[1]=intersect_2)
# ---------- oneList_2.python (164 lines) ----------
import clr
clr.AddReference('ProtoGeometry')
from Autodesk.DesignScript.Geometry import *
#The inputs to this node will be stored as a list in the IN variable.
dataEnteringNode = IN

listElevsList = IN[0]
interLineList = IN[1]





#make one list of the whole elev sublists---------------------------------
def oneList():
	return [z for x in listElevs for y in x for z in y]
#-------------------------------------------------------------------------


#to get the sorted elevs based on distance from closest point to the intersect line---------------------------------------------------------------------
def newSortElevs():
	sortedRect=[]
	avgRecList=[]
	recList = oneList()
	closePtList =[]	
	distList = []
	for i in range(len(recList)):
		recPt = recList[i].Center()		
		closePt = Geometry.ClosestPointTo(interLine[0],recList[i])
		closePtList.append(closePt)
		dist = Line.ByStartPointEndPoint(closePt,recPt).Length
		distList.append(dist)
	
	copyRecList = recList[:]
	sortedDistList = distList[:]
	sortedDistList.sort()
	
	for i in range(len(recList)):
		sortDis = sortedDistList[i]
		for j in range(len(copyRecList)):
			if sortDis == distList[j]:
				found = copyRecList[j]
				del copyRecList[j]
				del distList[j]
				break
		sortedRect.append(found)
	#return distList,sortedDistList,recList,sortedRect,copyRecList
	return sortedRect
#-----------------------------------------------------------------------------------------------------------------------------------------------------------

#calc number of elev per row---------------------------------------------------------------------------------------------------------------------------------
def numElevsperRow():
	for i in range(len(listElevs)):
		x = len(listElevs)
		y = len(listElevs[0][0])
		val = x*y
		break
	return val
#-----------------------------------------------------------------------------------------------------------------------------------------------------------

#make one list into lists as per rows of elev----------------------------------------------------------------------------------------------------------------
def makeListRow():
	numElevsRow = numElevsperRow()
	sortedElevList = newSortElevs()
	
	#create list of elevators who are combined together per row.
	num = int(len(oneList())/numElevsRow)
	megaList=[]	
	for i in range(num):
		x = i*numElevsRow
		alist = []
		for j in range(x,x+numElevsRow):			
			alist.append(sortedElevList[j])
		megaList.append(alist)
	return megaList
#-----------------------------------------------------------------------------------------------------------------------------------------------------------

#sort the rows based on the start point of instersect line--------------------------------------------------------------------------------------------------
def sortSecondRun():
	rowElevList = makeListRow()
	stPoint = interLine[0].PointAtParameter(0)

	# get the distance list for each row
	fullDistance=[]
	for i in range(len(rowElevList)):
		recList = rowElevList[i]
		disList=[]		
		for j in range(len(recList)):
			rec = recList[j]
			dist = Line.ByStartPointEndPoint(stPoint,rec.Center()).Length
			disList.append(dist)
		fullDistance.append(disList)
	
	
	#sort the distance list
	sortedDistList = fullDistance[:]
	copyElevs = rowElevList[:]
	for i in range(len(sortedDistList)):
		sortedDistList[i] = fullDistance[i][:]
		copyElevs[i] = rowElevList[i][:]
		sortedDistList[i].sort()
	
	#make the new recLists sorted
	for i in range(len(rowElevList)):
		recList = rowElevList[i]
		sortList = sortedDistList[i]
		distList1 = fullDistance[i]
				
		for j in range(len(sortList)):
			rec = recList[j]
			sortdis = sortList[j]
			newRec=[]
			for k in range(len(sortList)):
				if float(sortdis) == float(distList1[k]):
					rowElevList[i][j] = copyElevs[i][k]					
					break
	rev = []
	for i in range(len(rowElevList)):
		rev.append(rowElevList[-i])
	#return fullDistance,rowElevList,distList1,sortedDistList
	return rowElevList
#-----------------------------------------------------------------------------------------------------------------------------------------------------------




"""
listElevsList = IN[0]
interLineList = IN[1]
"""



fin = []
for i in range(len(listElevsList)):
	listElevL = listElevsList[i]
	interLineL = interLineList[i]
	newL=[]
	for j in range(len(listElevL)):
		listElevs = listElevL[j]
		interLine = interLineL[j]
		result = sortSecondRun()
		newL.append(result)
	fin.append(newL)
















#Assign your output to the OUT variable
#OUT = oneList(),out,makePts(),scaleVals(),newSortElevs(),numElevsperRow(),sortSecondRun()
#OUT = sortSecondRun()
OUT = fin
# ----------------------------------------
separate_bank_maker_2 = Python(IN[0]=oneList_2, IN[1]=building_sections_per_volume)
# ---------- separate_bank_maker_2.python (160 lines) ----------
import clr
clr.AddReference('ProtoGeometry')
from Autodesk.DesignScript.Geometry import *
import math
#The inputs to this node will be stored as a list in the IN variable.
dataEnteringNode = IN

elevBoxesList = IN[0]
buildSectionsList=IN[1]





#to fix the sequence of elevators in the elv boxes----------------------------------------------------------------------		
def reverseList():
	global elevBoxes	
	cnt =0
	for i in range(len(elevBoxes)-1):	
		if (i)%2 == 0:
			cnt += 1
			if cnt%2==0:
				str =""
				elevBoxes[i].reverse()
				elevBoxes[i+1].reverse()
#-----------------------------------------------------------------------------------------------------------------------	


#to make one list of input elev lists-----------------------------------------------------------------------------------
def totalElevList():
	newElevBoxes=[]	
	for i in range(len(elevBoxes)):
		elev = elevBoxes[i]
		for j in range(len(elev)):
			newElevBoxes.append(elev[j])
	return newElevBoxes
#-----------------------------------------------------------------------------------------------------------------------	


#to distribute number of elevators per bank based on number elev per row------------------------------------------------
def bankNumbers():
	listElevBoxes=totalElevList()
	totalElevNum = len(listElevBoxes)
	bankNum=[]
	
	perDivision = int(math.floor(totalElevNum/buildSections))
	if (perDivision >= numElevRow): perDivision = numElevRow
	if (perDivision < numElevRow): perDivision = int(numElevRow/2)
	diff = totalElevNum - (perDivision*buildSections)
	
	#perDivision = [numElevRow if perDivision >= numElevRow]
	#perDivision = [numElevRow/2 if perDivision < numElevRow]
	
	if perDivision >=1:
		for i in range(buildSections):
			bankNum.append(perDivision)
		bankNum[-1] += diff
	
	
	#to make all if they all are even numbers
	surplus =0
	for i in range(len(bankNum)):
		if bankNum[i]%2 !=0:
			bankNum[i] -= 1
			surplus	+= 1
	if surplus > 0 : bankNum[-1] += surplus	
	bankNum.sort()
	bankNum.reverse()

	return bankNum
#-----------------------------------------------------------------------------------------------------------------------

#to make separate banks of elevs based on number of building sections---------------------------------------------------
def makePairs():
	str = []
	newElevsList =[]
	for i in range(0,numRows,2): 
		if i == numRows-1:			
			newElevsList.extend(elevBoxes[-1])
			str.append("entered here")
		else:		
			listA = elevBoxes[i]
			listB = elevBoxes[i+1]
			newList = crossLists(listA,listB)
			newElevsList.extend(newList)
			str.append("may be")				
	return newElevsList
#-----------------------------------------------------------------------------------------------------------------------

#to cross two lists togthr and return one list out----------------------------------------------------------------------
def crossLists(listA,listB):
	crossedList = []
	for i in range(len(listA)):
		crossedList.append(listA[i])
		crossedList.append(listB[i])
	return crossedList
#-----------------------------------------------------------------------------------------------------------------------


#to make separate banks of elevs based on number of building sections---------------------------------------------------
def makeBanks():
	#listElevBoxes=totalElevList()
	#totalElevNum = len(listElevBoxes)
	
	listElevBoxes=makePairs()
	totalElevNum = len(listElevBoxes)
	
	elevperBank = bankNumbers()
	elevCount   = 0
	perRowCount = 0
	listBanks=[]
	temp =0	
	for i in range(buildSections):
		elevAtBank =[]
		xVal = elevperBank[i]		
		for j in range(xVal):
			try:
				elevAtBank.append(listElevBoxes[temp+j])
			except:
				print "some error"
			#elevAtBank.append(listElevBoxes[temp+j])
			if ( j == xVal-1): temp = temp + xVal
		listBanks.append(elevAtBank)
	return listBanks
#------------------------------------------------------------------------------------------------------------------------

"""
elevBoxesList = IN[0]
buildSectionsList=IN[1]
"""

outN1=[]
outN2=[]
outTots=[]
for i in range(len(elevBoxesList)):
	elevBoxesL= elevBoxesList[i]
	buildSections = buildSectionsList[i]
	getL1=[]
	getL2=[]
	sum=0
	for j in range(len(elevBoxesL)):
		elevBoxes = elevBoxesL[j]
		numElevRow = len(elevBoxes[0])
		numRows = len(elevBoxes)
		#reverseList()
		out = makeBanks()
		out2 = bankNumbers()
		#crossed = makePairs()
		getL1.append(out)
		getL2.append(out2)
		sum += len(totalElevList())
	outN1.append(getL1)
	outN2.append(getL2)
	outTots.append(sum)



#Assign your output to the OUT variable
OUT = outN1,outN2,outTots
#OUT = out
# ----------------------------------------
number_of_elev_per_bank_2 = CodeBlock(numberElevPerBank=separate_bank_maker_2) { numberElevPerBank[1]; }
boundary_factor_2 = CodeBlock { boundaryFactor = 0.9; }
num_floors_each_block = Python(IN[0]=floor_maker)
# ---------- num_floors_each_block.python (15 lines) ----------
import clr
clr.AddReference('ProtoGeometry')
from Autodesk.DesignScript.Geometry import *
#The inputs to this node will be stored as a list in the IN variable.
dataEnteringNode = IN

flrList = IN[0]

out=[]
for i in range(len(flrList)):
	out.append(flrList[i].Count)


#Assign your output to the OUT variable
OUT = out
# ----------------------------------------
key_floor_finder_2 = Python(IN[0]=building_sections_per_volume, IN[1]=GBA, IN[2]=number_of_elev_per_bank_2, IN[3]=boundary_factor_2, IN[4]=area_tech_rooms_final, IN[5]=area_per_elevator, IN[6]=num_floors_each_block)
# ---------- key_floor_finder_2.python (108 lines) ----------
import clr
clr.AddReference('ProtoGeometry')
from Autodesk.DesignScript.Geometry import *
#The inputs to this node will be stored as a list in the IN variable.
dataEnteringNode = IN

buildSectionsList 	= 	IN[0]
grossBuildAreaList	=	IN[1]
elevPerbankListL	=	IN[2]
boundaryFactor		=	IN[3]
servModAreaList		=	IN[4]
elevArea			=	IN[5]
numFloorsList		=	IN[6]



#compute target area for each bank of elev serving each building section--------------------------------------------------------------------
def targetAreaCalculator(uba,buildSections):
	#output target area list for each bank of elev for each building section
	tarAreaList = []	
	#make the uba array
	totalBuildArea = 0
	for i in range(len(uba)):
		totalBuildArea += uba[i]		
	# compute the fraction
	frac 	=	totalBuildArea/buildSections
	
	#compute the target areas by iterating
	for i in range(1,buildSections+1):
		tarAreaList.append(frac*i)	
	return tarAreaList
#-------------------------------------------------------------------------------------------------------------------------------------------

#ccompute the key floors where the banks of elevators needs to be dropped-------------------------------------------------------------------
def keyFloorFinder():
	currentFloor = 1 # current floor counter
	#computer bank Area for each bank ( from elev Area )
	bankArea = [x*elevArea for x in elevPerbankList] 
	#bankArea = [10000 for x in elevPerbankList] 
	
	# iterate to find usable Build Area first
	ubaList = []
	for i in range(len(grossBuildArea)):
		ubaList.append(grossBuildArea[i]-servModArea)
	#compute the targetAreaList
	tarAreaList = targetAreaCalculator(ubaList,buildSections)
	
	#make the served areas list and key floor list and set as 0 values
	servedAreaList = [0 for x in range(buildSections)]		
	key = [0 for x in range(buildSections)]
	
	while currentFloor <= len(ubaList)-1:
		#iterate to check if target is reached
		for i in range(buildSections):
			if servedAreaList[i] < tarAreaList[i] and tarAreaList[i] - servedAreaList[i] >= ubaList[currentFloor]*boundaryFactor:
				ubaList[currentFloor] = ubaList[currentFloor] - bankArea[i] 
		#iterate to check if target is reached	
		for i in range(buildSections):
			if servedAreaList[i] < tarAreaList[i] and tarAreaList[i] - servedAreaList[i] >= ubaList[currentFloor]*boundaryFactor:
				# update served areas and the key floors
				servedAreaList[i] = servedAreaList[i] + ubaList[currentFloor] 
				key[i]	=	key[i] + 1		
		#still checking if target has been reached
		for i in range(buildSections):
			if servedAreaList[i] > tarAreaList[i] and servedAreaList[i] - tarAreaList[i] >= ubaList[currentFloor] - ubaList[currentFloor]*boundaryFactor:
				servedAreaList[i] = servedAreaList[i] - ubaList[key[i]]
				ubaList[key[i]] = ubaList[key[i]] + bankArea[i] 
				for j in range(i+1,buildSections):
					servedAreaList[j] = servedAreaList[j] + bankArea[i] 
					key[i] = key[i] - 1
		tarAreaList = targetAreaCalculator(ubaList,buildSections)
		currentFloor += 1
	return [key,servedAreaList,tarAreaList,ubaList]
#-------------------------------------------------------------------------------------------------------------------------------------------



finalOut =[]
for i in range(len(grossBuildAreaList)):
	grossBuildArea = grossBuildAreaList[i]
	buildSections = buildSectionsList[i]
	elevL = elevPerbankListL[i]
	servModAreaL = servModAreaList[i]
	keyF=[]
	for j in range(len(servModAreaL)):
		elevPerbankList = elevL[j]		
		servModArea = servModAreaL[j]
		tarAreaList = 	targetAreaCalculator(grossBuildArea,buildSections)
		keyFloors	=	keyFloorFinder()
		
		keysTest = keyFloors[0]
		
		count =0
		for i in range(len(keysTest)):
			if keysTest[i] ==0: count += 1
		if count > len(keysTest)/2:
			for i in range(len(keysTest)):
				keysTest[i] = numFloors
		
		keyFloors[0]	= 	keysTest
		keyF.append(keyFloors)
	finalOut.append(keyF)
		
		

#Assign your output to the OUT variable
#OUT = keysTest#
OUT = finalOut
# ----------------------------------------
key_outputgenerator = Python(IN[0]=key_floor_finder_2)
# ---------- key_outputgenerator.python (35 lines) ----------
import clr
clr.AddReference('ProtoGeometry')
from Autodesk.DesignScript.Geometry import *
#The inputs to this node will be stored as a list in the IN variable.
dataEnteringNode = IN

keyList = IN[0]



#[key,servedAreaList,tarAreaList,ubaList]
finKeyList=[]
finServedAreaList = []
fintarAreaList = []
finubaList = []
for i in range(len(keyList)):
	keyL = keyList[i]
	finKeyL=[]
	finServedAreaL= []
	fintarAreaL = []
	finubaL = []
	for j in range(len(keyL)):
		key = keyL[j]
		finKeyL.append(key[0])
		finServedAreaL.append(key[1])
		fintarAreaL.append(key[2])
		finubaL.append(key[3])
	finKeyList.append(finKeyL)
	finServedAreaList.append(finServedAreaL)
	fintarAreaList.append(fintarAreaL)
	finubaList.append(finubaL)

out = finKeyList,finServedAreaList,fintarAreaList,finubaList
#Assign your output to the OUT variable
OUT = out
# ----------------------------------------
target_areas_for_banks_2 = CodeBlock(targetAreas=key_outputgenerator) { targetAreas[2]; }
updated_uba_2 = CodeBlock(updatedUBA=key_outputgenerator) { updatedUBA[3]; }
served_areas_by_banks_2 = CodeBlock(servedAreas=key_outputgenerator) { servedAreas[1]; }
ecap_2 = CodeBlock { ecap= 1000; }
feedback_function_2 = Python(IN[0]=updated_uba_2, IN[1]=served_areas_by_banks_2, IN[2]=number_of_elev_per_bank_2, IN[3]=ecap_2, IN[4]=building_sections_per_volume)
# ---------- feedback_function_2.python (69 lines) ----------
import clr
clr.AddReference('ProtoGeometry')
from Autodesk.DesignScript.Geometry import *
#The inputs to this node will be stored as a list in the IN variable.
dataEnteringNode = IN

ubaListList 			= 	IN[0]
servedAreaListList		=	IN[1]
numElevPerBankList		=	IN[2]
ecap					=	IN[3]
buildSectionsList		=	IN[4]

#--------------------------------------------------------------------------------------------------------------------

# to compute the efficiency of set elevator layouts------------------------------------------------------------------
def feedBack():
	#make a list of area for building sections
	sections	= [0 for x in range(buildSections)]
	sections[0] = servedAreaList[0] # first building section area
	#isolated building section areas  
	totBankCap = 0
	for i in range(1,buildSections):
		sections[i] = servedAreaList[i] - servedAreaList[i-1]
		# total elevator bank capacity
		totBankCap  +=numElevPerBank[i]*ecap	
	#total UBA
	ubaTotal = 0
	for i in range(len(ubaList)):
		ubaTotal 	+=ubaList[i]
	
	#percentage of uba served by every bank
	percentUBA_Bank	= [0 for x in range(buildSections)]
	#used capacity of the banks
	ucap			= [0 for x in range(buildSections)]
	# added to test errors
	if totBankCap ==0 : totBankCap  =1
	for i in range(buildSections):
		percentUBA_Bank[i] = (sections[i]*100)/ubaTotal
		ucap[i] = (sections[i]*100)/totBankCap
	
	return percentUBA_Bank,ucap	
#--------------------------------------------------------------------------------------------------------------------	

"""
ubaListList 			= 	IN[0]
servedAreaListList		=	IN[1]
numElevPerBankList		=	IN[2]
ecap					=	IN[3]
buildSectionsList		=	IN[4]
"""
outF=[]
for i in range(len(ubaListList)):
	ubaL = ubaListList[i]
	buildSections = buildSectionsList[i]
	
	for j in range(len(ubaL)):
		ubaList = ubaL [j]
		servedAreaList = servedAreaListList[i][j]
		numElevPerBank = numElevPerBankList[i][j]		
		out = feedBack()
	outF.append(out)






#Assign your output to the OUT variable
OUT = outF
# ----------------------------------------
final_num_elevators_2 = Python(IN[0]=oneList_2)
# ---------- final_num_elevators_2.python (20 lines) ----------
import clr
clr.AddReference('ProtoGeometry')
from Autodesk.DesignScript.Geometry import *
#The inputs to this node will be stored as a list in the IN variable.
dataEnteringNode = IN

rectListList = IN[0]

finX = []

for i in range(len(rectListList)):# big blocks
	rectL = rectListList[i]
	x=0
	for j in range(len(rectL)):# num cores
		rec = rectL[j]
		x += len(rec[0])*len(rec)
	finX.append(x)

#Assign your output to the OUT variable
OUT = finX
# ----------------------------------------
total_elevator_expected_2 = CodeBlock(totElev_Expected=total_elevs_per_block) { totElev_Expected; }
translated_floors = CodeBlock(FLOORS=floor_maker) { FLOORS; }
key_floors_2 = CodeBlock(keyFloors=key_outputgenerator) { keyFloors[0]; }
elevators_2 = CodeBlock(a=separate_bank_maker_2) { a[0]; }
variable_height_elevators_2 = Python(IN[0]=translated_floors, IN[1]=key_floors_2, IN[2]=elevators_2)
# ---------- variable_height_elevators_2.python (45 lines) ----------
import clr
clr.AddReference('ProtoGeometry')
from Autodesk.DesignScript.Geometry import *

#The inputs to this node will be stored as a list in the IN variable.
dataEnteringNode = IN

floorsList		=	IN[0]
keyFloorsList	=	IN[1]
elevListList	=	IN[2]

def elevExtruder():
	extruded=[]
	keyFloors.reverse()
	p1		=	Point.ByCoordinates(0,0,0);
	p2		=	Point.ByCoordinates(0,0,100);
	vec		=	Vector.ByTwoPoints(p1,p2)
	for i in range(len(elevList)):
		flr = floors[keyFloors[i]]
		cen = flr.EndPoint
		zVal= cen.Z
		crv = elevList[i]
		geom=[]
		for j in range(len(crv)):
			ext	=	Curve.Extrude(crv[j],vec,zVal)		
			geom.append(ext)		
		extruded.append(geom)
	return extruded

finExt=[]
for i in range(len(elevListList)):
	floors = floorsList[i]	
	keyFloors = keyFloorsList[i]
	elevList = elevListList[i]
	extL=[]
	for j in range(len(elevList)):	
		keyFloors = keyFloorsList[i][j]
		elevList = elevListList[i][j]	
		ext = elevExtruder()
		extL.append(ext)
	finExt.append(extL)


#Assign your output to the OUT variable
OUT = finExt#finExt
# ----------------------------------------
edges_2 = Face.Edges(variable_height_elevators_2)
curveGeometry_2 = Edge.CurveGeometry(edges_2)
vertices_3 = Face.Vertices(variable_height_elevators_2)
elev_points_2 = CodeBlock(a=vertices_3) { a.PointGeometry; }
file_location_3 = CodeBlock { a={"c:\write_Elevators.csv"}; }
pointFinder_3 = Python(IN[0]=vertices_3)  # same code as pointFinder
writeToFile_3 = CSV.WriteToFile(file_location_3, pointFinder_3)
file_location_4 = CodeBlock { a={"c:\write_ServiceModule.csv"}; }
vertices_4 = Face.Vertices(variable_height_elevators_2)
pointFinder_4 = Python(IN[0]=vertices_4)  # same code as pointFinder_2
writeToFile_4 = CSV.WriteToFile(file_location_4, pointFinder_4)
techrooms_restrooms = CodeBlock(TECHRMS_RESTRMS=technical_rooms_restrooms_2) { TECHRMS_RESTRMS; }
transpose_2 = List.Transpose(techrooms_restrooms)
extruded_tech_rooms_2 = Python(IN[0]=translated_floors, IN[1]=transpose_2)
# ---------- extruded_tech_rooms_2.python (60 lines) ----------
import clr
clr.AddReference('ProtoGeometry')
from Autodesk.DesignScript.Geometry import *
#The inputs to this node will be stored as a list in the IN variable.
dataEnteringNode = IN

floorsList		=	IN[0]
techRoomsList	=	IN[1]



def extruder():
	extruded=[]
	for i in range(len(techRooms)):
		flr = floors[-1]
		cen = flr.EndPoint
		zVal= cen.Z
		crv = techRooms[i]
		extN = crv.Extrude(zVal)
		extruded.append(extN)
	return extruded

finExt = []
for i in range(len(techRoomsList)):
	techRoomsL = techRoomsList[i]
	floors = floorsList[i]
	flr = floors[-1]	
	cen = flr.EndPoint
	zVal= cen.Z
	for j in range(len(techRoomsL)):		
		techRooms = techRoomsL[j]
		extruded=[]
		for k in range(len(techRooms)):
			techR = techRooms[k]		
			extN = techR.Extrude(zVal)
			extruded.append(extN)
		finExt.append(extruded)
		
		
#Assign your output to the OUT variable
OUT = finExt






"""
finExt=[]
for i in range(len(elevListList)):
	floors = floorsList[i]	
	elevList = elevListList[i]
	extL=[]
	for j in range(len(elevList)):	
		keyFloors = keyFloorsList[i][j]
		elevList = elevListList[i][j]	
		ext = elevExtruder()
		extL.append(ext)
	finExt.append(extL)
"""
# ----------------------------------------
floor_plates = CodeBlock(floorSurface=floor_surface_2) { floorSurface; }
python_script = Python()
# ---------- python_script.python (15 lines) ----------
import clr
clr.AddReference('ProtoGeometry')
from Autodesk.DesignScript.Geometry import *
#The inputs to this node will be stored as a list in the IN variable.
dataEnteringNode = IN


class div(object):
	pass
	
a = div()

a.X =10
#Assign your output to the OUT variable
OUT = div.__class__
# ----------------------------------------
code_block = CodeBlock(a=box_maker) { a[1]; }
edge_picker = Python(IN[0]=box_maker, IN[1]=TYPE, IN[2]=core_freq, IN[3]=core_dimension)
# ---------- edge_picker.python (222 lines) ----------
import clr
clr.AddReference('ProtoGeometry')
from Autodesk.DesignScript.Geometry import *
import math
#The inputs to this node will be stored as a list in the IN variable.
dataEnteringNode = IN

emptyBox = IN[0]
type = IN[1]
inputLen = IN[2]
coreDim = IN[3]


#finds number of closest rectangle pieces to find---------------------------------------------------------------------------------------------
def adjacencyList(type):
	adjList = []
	if type ==1: adjList = [0]
	if type ==2: adjList = [1,1]
	if type ==3: adjList = [1,2,1]
	if type ==4: adjList = [2,2,2,2]	
	return adjList
#---------------------------------------------------------------------------------------------------------------------------------------------



#find the common edges between two boxes------------------------------------------------------------------------------------------------------
def findCloseRects(boxList,type):
	indexList = []
	adjList = adjacencyList(type)
	distList=[]
	sortDistList = []
	for i in range(len(boxList)):
		rec = boxList[i]
		recCen = rec.Center()
		distL =[]
		sortL =[]
		indexL=[]		
		for j in range(len(boxList)):
			rec2 = boxList[j]
			recCen2 = rec2.Center()		
			dist = recCen.DistanceTo(recCen2)
			distL.append(dist)
		sortList = distL[:]
		sortList.sort()
		sortL.Add(sortList)
		sortDistList.Add(sortList)
		distList.Add(distL)
		
	indexList=[]
	for i in range(len(distList)):
		distL = distList[i]
		sortL = sortDistList[i]
		numAdj = adjList[i]
		indexL=[]
		for k in range(numAdj):			
			for j in range(len(distL)):			
				if sortL[k+1] == distL[j]:
					index = j
					indexL.append(index)
					break
		indexList.append(indexL)	
	return indexList
#---------------------------------------------------------------------------------------------------------------------------------------------
#finds the closest point from a list of points------------------------------------------------------------------------------------------------
def closestPoint(ptA,ptBList):
	distList=[]
	for i in range(len(ptBList)):
		ptB = ptBList[i]
		dist = ptA.DistanceTo(ptB)
		distList.append(dist)

	sortDistList = distList[:]
	sortDistList.sort()
	
	for i in range(len(sortDistList)):
		for j in range(len(sortDistList)):
			if sortDistList[0] == distList[j]: closePtList = ptBList[j]
		break
	return closePtList
#---------------------------------------------------------------------------------------------------------------------------------------------

def edgePicker(boxList,type):
	str = "did not enter"
	edgeList = findCommonEdges(boxList,type)
	finalRecLines=[]
	for i in range(len(boxList)):
		rec = boxList[i]
		recPts = rec.Points
		recLines = rec.Curves()
		list=[]		
		coprecLines = recLines[:]
		list.extend(coprecLines)
		edgeL = edgeList[i]
		pickedLines = []
		for k in range(len(edgeL)):			
			for j in range(len(list)):
				recL = recLines[j]
				rcStart = recL.StartPoint
				rcEnd	= recL.EndPoint
				rLine1 = Line.ByStartPointEndPoint(rcStart,rcEnd)
				rLine2 = Line.ByStartPointEndPoint(rcEnd,rcStart)
				#if rLine1.Length == edgeL[k].Length or rLine2.Length == edgeL[k].Length:
				if rLine1.Length == edgeL[k].Length and rLine1.PointAtParameter(0.5) == edgeL[k].PointAtParameter(0.5):
				#if edge1.PointAtParameter(0.5) == edge2.PointAtParameter(0.5) and edge1.Length == edge2.Length : 
				#if rLine1.PointAtParameter(0.5) == edgeL.PointAtParameter(0.5) and rLine1.Length == edgeL.Length : 
					str = "it entered"
					del list[j]	
					break
				else: pickedLines.Add(recL)
						
		finalRecLines.Add(list)
	if type == 4: del finalRecLines[3][-1]
	finalRecLines = convToLine(finalRecLines)
	return finalRecLines


#finds common edges between neighboring rect pieces---------------------------------------------------------------------------------------------
def findCommonEdges(boxList,type):
	TAG = 0
	edgeList = []
	closePtList = []
	indexList = findCloseRects(boxList,type)
	for i in range(len(boxList)):
		rec = boxList[i]
		recCen = rec.Center()
		recPts = rec.Points
		indexL = indexList[i]
		edgeL =[]
		closeL =[]
		for j in range(len(indexL)):
			ind = indexL[j]
			recSide = boxList[ind]
			recSideCen = recSide.Center()
			lin = Line.ByStartPointEndPoint(recCen,recSideCen)
			midPt = lin.PointAtParameter(0.5)
			recSidePts = recSide.Points
			closePt1 = closestPoint(midPt,recSidePts)
			closePt2 = closestPoint(midPt,recPts)
			closePt3 = closestPoint(closePt1,recPts)
			if closePt3 == closePt2 : 
				edge = Line.ByStartPointEndPoint(closePt1,closePt2)
				edge = edgeRedo(rec,edge)				
			else : 
				edge = Line.ByStartPointEndPoint(closePt3,closePt2)
			edgeL.Add(edge)
			closeL.Add([closePt1,closePt2])
		closePtList.Add(closeL)
		edgeL = edgeCleaner(edgeL)		
		edgeList.Add(edgeL)
		
	return edgeList
#----------------------------------------------------------------------------------------------------------------------------------------------

#to clean duplicate items in a list------------------------------------------------------------------------------------------------------------
def edgeCleaner(edgeList):
	copEdgeList = edgeList[:]
	if len(edgeList) > 1:
		for i in range(len(edgeList)-1):		
			edge1 = edgeList[i]
			edge2 = edgeList[i+1]			
			if edge1.PointAtParameter(0.5) == edge2.PointAtParameter(0.5) and edge1.Length == edge2.Length : 
				del copEdgeList[i+1]		
	return copEdgeList
#----------------------------------------------------------------------------------------------------------------------------------------------
#to convert curves to lines--------------------------------------------------------------------------------------------------------------------
def convToLine(edgeList):
	lineList=[]
	for i in range(len(edgeList)):
		lineL=[]
		for j in range(len(edgeList[i])):
			lineL.Add(Line.ByStartPointEndPoint(edgeList[i][j].StartPoint,edgeList[i][j].EndPoint))
		lineList.Add(lineL)
	return lineList
#---------------------------------------------------------------------------------------------------------------------------------------------
#to compute the exact edge on the rec which corresponds to the common intersected edge found---------------------------------------------------
def edgeRedo(rec,edge):
	finalEdgeList = []
	recVecList = []
	recLineList = []
	vecEdge = Vector.ByTwoPoints(edge.StartPoint,edge.EndPoint)
	recPts  = rec.Points
	
	midEdge = edge.PointAtParameter(0.5)
	
	recVecList.Add(Vector.ByTwoPoints(recPts[0],recPts[1]))
	recVecList.Add(Vector.ByTwoPoints(recPts[1],recPts[2]))
	recVecList.Add(Vector.ByTwoPoints(recPts[2],recPts[3]))
	recVecList.Add(Vector.ByTwoPoints(recPts[3],recPts[0]))
	
	recLineList.append(Line.ByStartPointEndPoint(recPts[0],recPts[1]))
	recLineList.append(Line.ByStartPointEndPoint(recPts[1],recPts[2]))
	recLineList.append(Line.ByStartPointEndPoint(recPts[2],recPts[3]))
	recLineList.append(Line.ByStartPointEndPoint(recPts[3],recPts[0]))
	
	newLineList=[]
	distList =[]
	for i in range(len(recVecList)):
		recVec = recVecList[i]
		ang = Vector.AngleBetween(vecEdge,recVec)
		finalEdgeList.append(ang)
		if int(ang) == 0 :
			mid = recLineList[i].PointAtParameter(0.5)
			dist = midEdge.DistanceTo(mid)
			distList.Add(dist)
			newLineList.Add(recLineList[i])
			
	checkDist = 10000000000000000000000	
	for i in range(len(newLineList)):
		if distList[i] < checkDist:
			index = i
			checkDist = distList[i]			
	return newLineList[index]
#----------------------------------------------------------------------------------------------------------------------------------------------



#out = placeCoreBox(emptyBox)
out = edgePicker(emptyBox,type)
#out = findCommonEdges(emptyBox,type)
#Assign your output to the OUT variable
OUT = out
#OUT = polytoRect(emptyBox[0])
# ----------------------------------------
core_placer_points_2 = Python(IN[0]=box_maker, IN[1]=TYPE, IN[2]=core_freq, IN[3]=core_dimension, IN[4]=edge_picker)
# ---------- core_placer_points_2.python (134 lines) ----------
import clr
clr.AddReference('ProtoGeometry')
from Autodesk.DesignScript.Geometry import *
import math
#The inputs to this node will be stored as a list in the IN variable.
dataEnteringNode = IN

emptyBox = IN[0]
type     = IN[1]
inputLen = IN[2]
coreDim  = IN[3]
edgeList = IN[4]


#get the shorter dimension---------------------------------------------------------------
def getShorterDim(rec):
	width	=	rec.Width
	length	=	rec.Height
	points = 	rec.Points
	diagDist = Line.ByStartPointEndPoint(points[0],points[2]).Length
	if(width<=length): 
		shortEdge	= width
		longEdge	= length
	else: 
		shortEdge 	= length
		longEdge  	= width
	return shortEdge,longEdge,diagDist
	#return longEdge,shortEdge
# END OF FUNCTION ------------------------------------------------------------------------


#makes the core rectangle based on number of req it has---------------------------------------------------------------------------------------
def makeCoreBox(rec,numCore,wid,ht,longEdge):
	coreList=[]
	cen = rec.Center()
	pts = rec.Points
	ptPlaceList = []
	#when just need to place one core
	if numCore ==1:
		cs = CoordinateSystem.ByOrigin(cen)
		coreRec= Rectangle.ByWidthHeight(cs,wid,ht)
		coreList.append(coreRec)
		ptPlaceList.append(cen)
	#when more than one core needs to be placed
	else:
		len1 = Line.ByStartPointEndPoint(pts[0],pts[1]).Length
		len2 = Line.ByStartPointEndPoint(pts[0],pts[3]).Length
		#find the longer edge and that line
		if len1 == longEdge:
			lin = Line.ByStartPointEndPoint(pts[0],pts[1])
		else:
			lin = Line.ByStartPointEndPoint(pts[0],pts[3])			
		linCen = lin.PointAtParameter(0.5)
		vec = Vector.ByTwoPoints(linCen,cen)
		linNew = lin.Translate(vec)
		#divide the line to get the points to place core		
		linNewLen = linNew.Length
		perDist = linNewLen/(numCore+1)
		
		#prepare the pointlist
		for i in range(numCore):
			pt = linNew.PointAtDistance((i+1)*perDist)
			ptPlaceList.append(pt)
	return ptPlaceList
#---------------------------------------------------------------------------------------------------------------------------------------------

# function which places core boxes into the empty boxes----------------------------------------------------------------------------------------
def getNumCores(boxList):		
	numCoresList=[]
	lenMeasure = inputLen
	wid = coreDim
	ht = coreDim
	for i in range(len(boxList)):
		rec = boxList[i]
		shortEdge = getShorterDim(rec)[0]
		longEdge = getShorterDim(rec)[1]
		diagDist = getShorterDim(rec)[2]
		if longEdge > lenMeasure :
			numCore = int(math.ceil(longEdge/lenMeasure))	
		else :
			numCore=1
		numCoresList.append(numCore)
	return numCoresList
#----------------------------------------------------------------------------------------------------------------------------------------------




def placeCorePoints(boxList,edgeList):
	pointList=[]
	numCoreList = getNumCores(boxList)
	
	finCoreList=[]
	ptFinalList=[]
	for i in range(len(boxList)):
		edgeL = edgeList[i]
		recL = boxList[i]
		numCores = numCoreList[i]
		getCore = 0
		corePlaced =0
		coreList =[]
		count = 0
		while corePlaced < numCores:
			#fill in 0 to initiate the coreList for 1st time
			if count == 0:
				for j in range(len(edgeL)):
					coreList.Add(0)				
			for j in range(len(edgeL)):
				corePlaced += 1
				if corePlaced > numCores : break				
				coreList[j] += 1				
			count += 1
		finCoreList.Add(coreList)
		ptPlaceList = []
		for j in range(len(edgeL)):
			edge = edgeL[j]
			coresEdge = coreList[j]
			perDist = edge.Length/(coresEdge+1)	
			for k in range(coresEdge):
					
				pt = edge.PointAtDistance((k+1)*perDist)
				ptPlaceList.append(pt)
		ptFinalList.Add(ptPlaceList)
			
	 	
	return ptFinalList





out = placeCorePoints(emptyBox,edgeList)
#Assign your output to the OUT variable
OUT = out
# ----------------------------------------
service_core_components_3 = Python(IN[0]=block_width_height.out0, IN[1]=block_width_height.out1, IN[2]=basepoint_maker, IN[3]=number_of_elevators_needed_2, IN[4]=area_per_elevator, IN[5]=tag_switch.A, IN[6]=elevator_dimensions, IN[7]=user_inputs.restroom_Prop, IN[8]=user_inputs.techroom_Prop, IN[9]=lift_lobby_width, IN[10]=core_placer_points_2)
# ---------- service_core_components_3.python (245 lines) ----------
import clr
clr.AddReference('ProtoGeometry')
from Autodesk.DesignScript.Geometry import *
import math
#The inputs to this node will be stored as a list in the IN variable.
dataEnteringNode = IN

flr_WidthList		=	IN[0]
flr_HeightList		=	IN[1]
twr_BaseptList		=	IN[2]
num_passElev		=	IN[3][0]
num_servElev		=	IN[3][1]

passElev_Area		=	IN[4]
servElev_Area		=	IN[4]
tag					=	IN[5]
elevWidth			=	IN[6][0]
elevLength			=	IN[6][1]
restroomProp		=	IN[7]
techrmProp			=	IN[8]
liftLobbyWidth		=	IN[9]
corePtList			=	IN[10]




#compute service core width, length, and serviceCore====================================================================================================
def serviceCoreMaker(ptL):
	global area_banks, area_restroom,area_servmodule
	#calc total area for service core for the tower
	serviceCore_Area 	= area_banks + area_restroom + area_servmodule;
	serviceCore_Area	= serviceCore_Area/len(ptL)
	area_banks			= area_banks/len(ptL)
	area_restroom		= area_restroom/len(ptL)
	area_servmodule		= area_servmodule/len(ptL)
	
	servCore_WidthL = []
	servCore_LengthL = []
	coreVerticesL = []
	b_FacL =[]
	serviceCore_RecL = []
	for i in range(len(ptL)):
		pt = ptL[i]			
		#calc aspect ratio of floor plate
		aspect_Ratio 		= 	flr_Width/flr_Height
		
		#adjust aspectratio
		if aspect_Ratio < 0.65 : aspect_Ratio = 0.75
		if aspect_Ratio > 1.3 : aspect_Ratio = 1.2
		#calc service core length and width
		servCore_Length 	=	math.sqrt(serviceCore_Area/aspect_Ratio)
		servCore_Width		=	serviceCore_Area/servCore_Length	
		
		servCore_Width		=	math.sqrt(serviceCore_Area/aspect_Ratio)
		servCore_Length 	=	serviceCore_Area/servCore_Width	
		
	
		# get the coordinates of center pt
		x,y,z 					= 	pt.X,pt.Y,pt.Z	
		#make the service core rectangle object--------------------------------------------------------------------------------------------------------------1
		cs					= 	CoordinateSystem.ByOrigin(x,y,z)
		serviceCore_Rec 	= 	Rectangle.ByWidthHeight(cs,servCore_Width,servCore_Length)
		serviceCore_Rec 	=	orientFixNEW(serviceCore_Rec,twr_Basept,pt,servCore_Width,servCore_Length)
		
		
		
		coreVertices		=	serviceCore_Rec.Points
		servCore_WidthL.append(servCore_Width)
		servCore_LengthL.append(servCore_Length)
		coreVerticesL.append(coreVertices)
		serviceCore_RecL.append(serviceCore_Rec)
	#comput elev bank factor--------------------------------------------------------------------
	b_Fac				=	area_banks/serviceCore_Area
	#return serviceCore_Rec,b_Fac,coreVertices,area_banks,area_banks,area_servmodule
	return servCore_WidthL,servCore_LengthL,coreVerticesL,b_Fac,serviceCore_RecL



#function to make boxes based off of width, length and vertices===========================================================================================
def makeBox(widthL,lengthL,verticesL,factor,tag):
	new_RecL=[]
	other_RecL=[]
	for i in range(len(widthL)):
		width = widthL[i]
		length = lengthL[i]
		vertices = verticesL[i]
		
		#calculate the shorter of width or height of service core
		if ( tag == 0):
			if (width < length):
				new_Length 		=	length
				new_Width		=	factor*width
				other_Length 	=	length
				other_Width		=	width - new_Width
				index			=	3		
			else:
				new_Width		=	width	
				new_Length		=	factor*length
				other_Width 	=	width
				other_Length	=	length - new_Length
				index			=	2
		else:
			if (width > length):
				new_Length 		=	length
				new_Width		=	factor*width
				other_Length 	=	length
				other_Width		=	width - new_Width
				index			=	3		
			else:
				new_Width		=	width	
				new_Length		=	factor*length
				other_Width 	=	width
				other_Length	=	length - new_Length
				index			=	2		
	
		
		cs1					= 	CoordinateSystem.ByOrigin(vertices[0].X,vertices[0].Y,0)
		cs2					= 	CoordinateSystem.ByOrigin(vertices[index].X,vertices[index].Y,0)
		# to make the primary rectangle ----------------------------------------------------------------------	
		new_Rec 			= 	Rectangle.ByWidthHeight(cs1,new_Width,new_Length)	
		new_Vec				= 	Vector.ByTwoPoints(new_Rec.Points[0],vertices[0])
		new_Rec				=	Geometry.Translate(new_Rec, new_Vec)
		ptsnew_Rec			=	new_Rec.Points
		# to make the secondary rectangle ----------------------------------------------------------------------	
		other_Rec 			= 	Rectangle.ByWidthHeight(cs2,other_Width,other_Length)	
		other_Vec			= 	Vector.ByTwoPoints(other_Rec.Points[index],vertices[index])
		other_Rec			=	Geometry.Translate(other_Rec, other_Vec)
		ptsother_Rec		=	other_Rec.Points
		
		new_RecL.append(new_Rec)
		other_RecL.append(other_Rec)
	
	return [new_RecL,other_RecL]
#============================================================================================================================================================



#make post computations======================================================================================================================================
def coreConfigurator(b_Fac):
	#make the elevator bank rectangle object-----------------------------------------------------1	
	bank_RecL			=	makeBox(servCore_Width,servCore_Length,coreVertices,b_Fac,tag)
	bank_RecLNew = []
	for i in range(len(bank_RecL)):
		bank_Rec = 	bank_RecL[i]
		widtry1				=	bank_Rec[0].Width
		lentry1				=	bank_Rec[0].Height
				
		# code to readjust the bank rectangle piece based on the final tech rooms and restroom blocks
		if ( widtry1<lentry1):
			shortEdge		=	widtry1
			marked			=	0	
		else:
			shortEdge		=	lentry1
			marked			=	1
				
		if (elevWidth<elevLength):elevEdge = elevWidth
		else:elevEdge =	elevLength			
		numE				=	int(shortEdge / elevEdge)
		numE				+=	1
			
		newDim				=	numE*elevEdge
		if ( marked ==0): ratio	= widtry1/newDim
		else: ratio	= lentry1/newDim
		b_Fac				=	ratio*b_Fac
		#bank_RecL			=	makeBox(servCore_Width,servCore_Length,coreVertices,b_Fac,tag)
		
	return bank_RecL
	#-------------------------------------------------------------------------------------------------
#============================================================================================================================================================
#to fix the orientation of the serviceCores-----------------------------------------------------------
def orientFixNEW(servCore,twr_Basept,crPt,wid,ht):
	vecX = Vector.XAxis()
	vecY = Vector.YAxis()
	
	vecMain = Vector.ByTwoPoints(crPt,twr_Basept)
	vecMainNormal = vecMain.Normalized()
	
	valX = vecMainNormal.X * vecX.X
	valY = vecMainNormal.Y * vecX.Y
	
	if valX < 0 or valY < 0:
		vecX = vecX.Reverse()
		vecY = vecY.Reverse()
		
	angX = Vector.AngleBetween(vecMain,vecX) 
	angY = Vector.AngleBetween(vecMain,vecY)
	if angX < 50 and angY > 10:
		vecMain = vecX.Scale(wid/2)		
		servCore = servCore.Translate(vecMain)
	else:
		vecMain = vecY.Scale(ht/2)
		servCore = servCore.Translate(vecMain)
	return servCore
#-----------------------------------------------------------------------------------------------------


#iterate through all the blocks and output lists for each---------------------------------------------
outList=[]
bankRecList= []
otherRecList=[]
areaRestrmList=[]
areaServModList=[]
servCoreList=[]

perc = 1.1

for i in range(len(twr_BaseptList)):

	flr_Width  = flr_WidthList[i]
	flr_Height = flr_HeightList[i]
	twr_Basept = twr_BaseptList[i]
	corePts	   = corePtList[i]
	
	#globals var, computer area banks, area restrm, area techrms--------------------------------------------------------------------------------------------
	cirProp = liftLobbyWidth/1.5
	
	area_banks			= servElev_Area*num_servElev[i]/perc + passElev_Area*num_passElev[i]/perc
	area_banks			+=cirProp*area_banks # added the circulation area
	area_restroom 		= restroomProp*area_banks								
	area_servmodule 	= techrmProp*area_banks
	
	
	#OUTPUT VALUES-------------------------------------------------------
	vals 				= 	serviceCoreMaker(corePts)
	servCore_Width		=	vals[0]
	servCore_Length		=	vals[1]
	coreVertices		=	vals[2]
	b_Fac				=	vals[3]
	serviceCore_Rec		=	vals[4]
	bank_Rec 			= 	coreConfigurator(b_Fac)	
	
	#bankRecList.append(bank_Rec[0])
	#otherRecList.append(bank_Rec[1])
	#areaRestrmList.append(area_restroom)
	#areaServModList.append(area_servmodule)
	servCoreList.append(serviceCore_Rec)
	
	

#out = bankRecList,otherRecList,areaRestrmList,areaServModList,servCoreList

out = servCoreList,flr_WidthList[0]/flr_HeightList[0]
#Assign your output to the OUT variable
OUT = out
#OUT = flr_WidthList,flr_HeightList
# ----------------------------------------
code_block_2 = CodeBlock(a=edge_picker) { a[3]; }
edge_picker_2 = Python(IN[0]=box_maker, IN[1]=TYPE, IN[2]=core_freq, IN[3]=core_dimension)
# ---------- edge_picker_2.python (222 lines) ----------
import clr
clr.AddReference('ProtoGeometry')
from Autodesk.DesignScript.Geometry import *
import math
#The inputs to this node will be stored as a list in the IN variable.
dataEnteringNode = IN

emptyBox = IN[0]
type = IN[1]
inputLen = IN[2]
coreDim = IN[3]


#finds number of closest rectangle pieces to find---------------------------------------------------------------------------------------------
def adjacencyList(type):
	adjList = []
	if type ==1: adjList = [0]
	if type ==2: adjList = [1,1]
	if type ==3: adjList = [1,2,1]
	if type ==4: adjList = [2,2,2,2]	
	return adjList
#---------------------------------------------------------------------------------------------------------------------------------------------



#find the common edges between two boxes------------------------------------------------------------------------------------------------------
def findCloseRects(boxList,type):
	indexList = []
	adjList = adjacencyList(type)
	distList=[]
	sortDistList = []
	for i in range(len(boxList)):
		rec = boxList[i]
		recCen = rec.Center()
		distL =[]
		sortL =[]
		indexL=[]		
		for j in range(len(boxList)):
			rec2 = boxList[j]
			recCen2 = rec2.Center()		
			dist = recCen.DistanceTo(recCen2)
			distL.append(dist)
		sortList = distL[:]
		sortList.sort()
		sortL.Add(sortList)
		sortDistList.Add(sortList)
		distList.Add(distL)
		
	indexList=[]
	for i in range(len(distList)):
		distL = distList[i]
		sortL = sortDistList[i]
		numAdj = adjList[i]
		indexL=[]
		for k in range(numAdj):			
			for j in range(len(distL)):			
				if sortL[k+1] == distL[j]:
					index = j
					indexL.append(index)
					break
		indexList.append(indexL)	
	return indexList
#---------------------------------------------------------------------------------------------------------------------------------------------
#finds the closest point from a list of points------------------------------------------------------------------------------------------------
def closestPoint(ptA,ptBList):
	distList=[]
	for i in range(len(ptBList)):
		ptB = ptBList[i]
		dist = ptA.DistanceTo(ptB)
		distList.append(dist)

	sortDistList = distList[:]
	sortDistList.sort()
	
	for i in range(len(sortDistList)):
		for j in range(len(sortDistList)):
			if sortDistList[0] == distList[j]: closePtList = ptBList[j]
		break
	return closePtList
#---------------------------------------------------------------------------------------------------------------------------------------------

def edgePicker(boxList,type):
	str = "did not enter"
	edgeList = findCommonEdges(boxList,type)
	finalRecLines=[]
	for i in range(len(boxList)):
		rec = boxList[i]
		recPts = rec.Points
		recLines = rec.Curves()
		list=[]		
		coprecLines = recLines[:]
		list.extend(coprecLines)
		edgeL = edgeList[i]
		pickedLines = []
		for k in range(len(edgeL)):			
			for j in range(len(list)):
				recL = recLines[j]
				rcStart = recL.StartPoint
				rcEnd	= recL.EndPoint
				rLine1 = Line.ByStartPointEndPoint(rcStart,rcEnd)
				rLine2 = Line.ByStartPointEndPoint(rcEnd,rcStart)
				#if rLine1.Length == edgeL[k].Length or rLine2.Length == edgeL[k].Length:
				if rLine1.Length == edgeL[k].Length and rLine1.PointAtParameter(0.5) == edgeL[k].PointAtParameter(0.5):
				#if edge1.PointAtParameter(0.5) == edge2.PointAtParameter(0.5) and edge1.Length == edge2.Length : 
				#if rLine1.PointAtParameter(0.5) == edgeL.PointAtParameter(0.5) and rLine1.Length == edgeL.Length : 
					str = "it entered"
					del list[j]	
					break
				else: pickedLines.Add(recL)
						
		finalRecLines.Add(list)
	if type == 4: del finalRecLines[3][-1]
	finalRecLines = convToLine(finalRecLines)
	return finalRecLines


#finds common edges between neighboring rect pieces---------------------------------------------------------------------------------------------
def findCommonEdges(boxList,type):
	TAG = 0
	edgeList = []
	closePtList = []
	indexList = findCloseRects(boxList,type)
	for i in range(len(boxList)):
		rec = boxList[i]
		recCen = rec.Center()
		recPts = rec.Points
		indexL = indexList[i]
		edgeL =[]
		closeL =[]
		for j in range(len(indexL)):
			ind = indexL[j]
			recSide = boxList[ind]
			recSideCen = recSide.Center()
			lin = Line.ByStartPointEndPoint(recCen,recSideCen)
			midPt = lin.PointAtParameter(0.5)
			recSidePts = recSide.Points
			closePt1 = closestPoint(midPt,recSidePts)
			closePt2 = closestPoint(midPt,recPts)
			closePt3 = closestPoint(closePt1,recPts)
			if closePt3 == closePt2 : 
				edge = Line.ByStartPointEndPoint(closePt1,closePt2)
				edge = edgeRedo(rec,edge)				
			else : 
				edge = Line.ByStartPointEndPoint(closePt3,closePt2)
			edgeL.Add(edge)
			closeL.Add([closePt1,closePt2])
		closePtList.Add(closeL)
		edgeL = edgeCleaner(edgeL)		
		edgeList.Add(edgeL)
		
	return edgeList
#----------------------------------------------------------------------------------------------------------------------------------------------

#to clean duplicate items in a list------------------------------------------------------------------------------------------------------------
def edgeCleaner(edgeList):
	copEdgeList = edgeList[:]
	if len(edgeList) > 1:
		for i in range(len(edgeList)-1):		
			edge1 = edgeList[i]
			edge2 = edgeList[i+1]			
			if edge1.PointAtParameter(0.5) == edge2.PointAtParameter(0.5) and edge1.Length == edge2.Length : 
				del copEdgeList[i+1]		
	return copEdgeList
#----------------------------------------------------------------------------------------------------------------------------------------------
#to convert curves to lines--------------------------------------------------------------------------------------------------------------------
def convToLine(edgeList):
	lineList=[]
	for i in range(len(edgeList)):
		lineL=[]
		for j in range(len(edgeList[i])):
			lineL.Add(Line.ByStartPointEndPoint(edgeList[i][j].StartPoint,edgeList[i][j].EndPoint))
		lineList.Add(lineL)
	return lineList
#---------------------------------------------------------------------------------------------------------------------------------------------
#to compute the exact edge on the rec which corresponds to the common intersected edge found---------------------------------------------------
def edgeRedo(rec,edge):
	finalEdgeList = []
	recVecList = []
	recLineList = []
	vecEdge = Vector.ByTwoPoints(edge.StartPoint,edge.EndPoint)
	recPts  = rec.Points
	
	midEdge = edge.PointAtParameter(0.5)
	
	recVecList.Add(Vector.ByTwoPoints(recPts[0],recPts[1]))
	recVecList.Add(Vector.ByTwoPoints(recPts[1],recPts[2]))
	recVecList.Add(Vector.ByTwoPoints(recPts[2],recPts[3]))
	recVecList.Add(Vector.ByTwoPoints(recPts[3],recPts[0]))
	
	recLineList.append(Line.ByStartPointEndPoint(recPts[0],recPts[1]))
	recLineList.append(Line.ByStartPointEndPoint(recPts[1],recPts[2]))
	recLineList.append(Line.ByStartPointEndPoint(recPts[2],recPts[3]))
	recLineList.append(Line.ByStartPointEndPoint(recPts[3],recPts[0]))
	
	newLineList=[]
	distList =[]
	for i in range(len(recVecList)):
		recVec = recVecList[i]
		ang = Vector.AngleBetween(vecEdge,recVec)
		finalEdgeList.append(ang)
		if int(ang) == 0 :
			mid = recLineList[i].PointAtParameter(0.5)
			dist = midEdge.DistanceTo(mid)
			distList.Add(dist)
			newLineList.Add(recLineList[i])
			
	checkDist = 10000000000000000000000	
	for i in range(len(newLineList)):
		if distList[i] < checkDist:
			index = i
			checkDist = distList[i]			
	return newLineList[index]
#----------------------------------------------------------------------------------------------------------------------------------------------




#out = edgePicker(emptyBox,type)
out = findCommonEdges(emptyBox,type)
#Assign your output to the OUT variable
OUT = out
#OUT = polytoRect(emptyBox[0])
# ----------------------------------------
