# Dynamo graph 5TH AUG_SINGLE_WITHCOLINS_1.dyn (Dynamo 0.8.0.1233)

Y = IntegerSlider(-164, range=-200..-75 step 1)
X = IntegerSlider(100, range=50..200 step 1)
LENX = IntegerSlider(90, range=10..200 step 1)
LENY = IntegerSlider(137, range=10..200 step 1)
TYPE = IntegerSlider(3, range=1..4 step 1)
irregular_shape_maker = Python(IN[0]=Y, IN[1]=X, IN[2]=LENX, IN[3]=LENY, IN[4]=TYPE)
# ---------- irregular_shape_maker.python (175 lines) ----------
import clr
clr.AddReference('ProtoGeometry')
from Autodesk.DesignScript.Geometry import *
#The inputs to this node will be stored as a list in the IN variable.
dataEnteringNode = IN


x = IN[0]
y = IN[1]
lenX = IN[2]
lenY = IN[3]
type = int(IN[4])

pt = Point.ByCoordinates(x,y,0)

#find the closest point from a point-------------------------------------------------------------------------------------	
def closestPoint(ptA,ptList):
	shortLen	=	100000000000000 # set as a really high value
	index		=	0
	for i in range(len(ptList)):
		vec				= 	Vector.ByTwoPoints(ptA,ptList[i])
		vecLen			=	vec.Length
		if ( vecLen < shortLen ):
			shortLen	=	vecLen
			index		=	i
	# returns the closest point to ptA from the list
	return ptList[index]
#------------------------------------------------------------------------------------------------------------------------




def typeListMaker():
	if type == 1:		
		len = [lenX,lenY,lenX,lenY]
		dir = [0,0,1,1]
		sides = 4		
	if type == 2:
		a = int(lenX/2)		
		b = int(lenY/3)			
		len = [lenX,a,b,lenY-a,lenX-b,lenY]
		dir = [0,0,1,0,1,1]
		sides = 6
	if type == 3:		
		a1 = int(lenX/3)
		a2 = int(lenX/4)
		b = int(lenY/2)	
		len = [lenX,lenY,a1,b,a2,b,lenX-a1-a2,lenY]
		dir = [0,0,1,1,1,0,1,1]
		sides = 8
	if type == 4:
		len = [lenX,lenY,lenX,lenY]
		dir = [0,0,1,1]
		sides = 4	
	return len,dir,sides


#function which makes l shaped profile-----------------------------------------------------------------------------------
def shapeGenerator():
	linList = []
	ptList = []
	
	ptX = Point.ByCoordinates(200000,0,0)
	ptY = Point.ByCoordinates(0,200000,0)
	
	xvec = Vector.ByTwoPoints(pt,ptX)
	yvec = Vector.ByTwoPoints(pt,ptY)
	xvecN = xvec.Reverse()
	yvecN = yvec.Reverse()
	a = int(lenX/2)
	b = int(lenY/3)
	 
	len = typeListMaker()[0]
	dir = typeListMaker()[1]
	sides = typeListMaker()[2]
	
	point = pt
	ptList.append(point)
	for i in range(sides):
		#toggle vec values
		if i%2 ==0:
			if dir[i]==0: vec = xvec
			else: vec = xvecN
		else:
			if dir[i]==0: vec = yvec
			else: vec = yvecN	
		l1 = Line.ByStartPointDirectionLength(point,vec,len[i])
		linList.append(l1)
		point = l1.EndPoint
		ptList.append(point)
	polygon = Polygon.ByPoints(ptList)
	polyCenter = polygon.Center()
	closePt = closestPoint(polyCenter,ptList)
	return polygon,closePt
#---------------------------------------------------------------------------------------------------------------------------



#function which makes  shaped profile---------------------------------------------------------------------------------------
def shapeGenType4():
	linList = []
	ptList = []
	
	ptX = Point.ByCoordinates(200000,0,0)
	ptY = Point.ByCoordinates(0,200000,0)
	
	xvec = Vector.ByTwoPoints(pt,ptX)
	yvec = Vector.ByTwoPoints(pt,ptY)
	xvecN = xvec.Reverse()
	yvecN = yvec.Reverse()
		
	 
	len = typeListMaker()[0]
	dir = typeListMaker()[1]
	sides = typeListMaker()[2]
	
	#1st outer polygon===============================================================
	point = pt
	ptList.append(point)
	for i in range(sides):
		#toggle vec values
		if i%2 ==0:
			if dir[i]==0: vec = xvec
			else: vec = xvecN
		else:
			if dir[i]==0: vec = yvec
			else: vec = yvecN	
		l1 = Line.ByStartPointDirectionLength(point,vec,len[i])
		linList.append(l1)
		point = l1.EndPoint
		ptList.append(point)
	polygon = Polygon.ByPoints(ptList)
	polyCenter = polygon.Center()
	closePt = closestPoint(polyCenter,ptList)
	#================================================================================
	a = lenX/1.8
	b = lenY/2.2
	len[0] = len[0] - a
	len[1] = len[1] - b
	len[2] = len[0]
	len[3] = len[1]
	
	linList = []
	ptList = []
	#inner polygon====================================================================
	point = pt
	ptList.append(point)
	for i in range(sides):
		#toggle vec values
		if i%2 ==0:
			if dir[i]==0: vec = xvec
			else: vec = xvecN
		else:
			if dir[i]==0: vec = yvec
			else: vec = yvecN	
		l1 = Line.ByStartPointDirectionLength(point,vec,len[i])
		linList.append(l1)
		point = l1.EndPoint
		ptList.append(point)
	polygon2 = Polygon.ByPoints(ptList)
	ptN = Point.ByCoordinates(pt.X+(a/2),pt.Y+(b/2))
	vecShift = Vector.ByTwoPoints(pt,ptN)
	polygon2 = polygon2.Translate(vecShift)
	#================================================================================
	
	
	return [polygon,polygon2],closePt
#---------------------------------------------------------------------------------------------------------------------------


if type == 4: out = shapeGenType4()
else : out = shapeGenerator()

#Assign your output to the OUT variable
OUT = out
# ----------------------------------------
box_maker = Python(IN[0]=irregular_shape_maker, IN[1]=TYPE)
# ---------- box_maker.python (158 lines) ----------
import clr
clr.AddReference('ProtoGeometry')
from Autodesk.DesignScript.Geometry import *
#The inputs to this node will be stored as a list in the IN variable.
dataEnteringNode = IN

polygon = IN[0][0]
closPt = IN[0][1]
type = IN[1]
if type!=4:
	polyPts = polygon.Points

#finds the opposite point to the closest point-------------------------------------------------
def oppPointFinder(poly,closPt):
	polyPts = poly.Points
	for i in range(len(polyPts)):
		if closPt == polyPts[i]:
			oppPt = polyPts[i-3]
			index = i
			break	
	return oppPt,index
#---------------------------------------------------------------------------------------------


#find the closest point from a point-------------------------------------------------------------------------------------	
def closestPoint(ptA,ptList):
	shortLen	=	100000000000000 # set as a really high value
	index		=	0
	for i in range(len(ptList)):
		vec				= 	Vector.ByTwoPoints(ptA,ptList[i])
		vecLen			=	vec.Length
		if ( vecLen < shortLen ):
			shortLen	=	vecLen
			index		=	i
	# returns the closest point to ptA from the list
	return ptList[index]
#------------------------------------------------------------------------------------------------------------------------




#func to split the type3 polygon to regular rect and l shape rect-----------------------------
def multiRecMaker():
	oppPt = oppPointFinder(polygon,closPt)[0]
	id = oppPointFinder(polygon,closPt)[1]-3
	siz = len(polyPts)
	
	lin = Line.ByStartPointEndPoint(closPt,polyPts[id+4])
	lin = lin.Extend(300,lin.StartPoint)
	
	crvsPoly = polygon.Curves()
	for crvs in crvsPoly:		
		pt = Geometry.Intersect(lin,crvs)
		if pt != None:
			break
	ptListA = [polyPts[0],pt[0],polyPts[id+4],polyPts[id+5]]
	ptListB = [pt[0],polyPts[id-1],polyPts[id],polyPts[id+1],polyPts[id+2],polyPts[id+3]]
	polyA = Polygon.ByPoints(ptListA)	
	polyB = Polygon.ByPoints(ptListB)
	polyNew = recMakers(polyB)
	#return lin,oppPt,polyPts[id],crvsPoly,pt,polyA,polyB
	return polyA,polyNew[0],polyNew[1]
#----------------------------------------------------------------------------------------------	
	
	
def recFromType4():
	poly1 = polygon[0]
	poly2 = polygon[1]
	polyPts1 = poly1.Points
	polyPts2 = poly2.Points
	pt=[]
	
	lin1 = Line.ByStartPointEndPoint(polyPts2[0],polyPts2[1])
	lin1 = lin1.Extend(300,lin1.StartPoint)
	lin1 = lin1.Extend(300,lin1.EndPoint)
	
	lin2 = Line.ByStartPointEndPoint(polyPts2[2],polyPts2[3])
	lin2 = lin2.Extend(300,lin2.StartPoint)
	lin2 = lin2.Extend(300,lin2.EndPoint)
	
	crvsPoly1 = poly1.Curves()
	for crvs in crvsPoly1:
		ptInt = Geometry.Intersect(lin1,crvs)
		if len(ptInt) == 0:	continue
		else: pt.append(ptInt[0])
		
	ptList1 = [pt[0],pt[1],polyPts1[0],polyPts1[1]]
	polyA = Polygon.ByPoints(ptList1)	
	for crvs in crvsPoly1:		
		ptInt = Geometry.Intersect(lin2,crvs)
		if len(ptInt) == 0:	continue
		else: pt.append(ptInt[0])	
		
	ptList2 = [pt[3],pt[2],polyPts1[2],polyPts1[3]]
	polyB = Polygon.ByPoints(ptList2)
	
	ptList3 = [pt[2],pt[0],polyPts2[1],polyPts2[2]]
	polyC = Polygon.ByPoints(ptList3)
	
	ptList4 = [pt[3],pt[1],polyPts2[0],polyPts2[3]]
	polyD = Polygon.ByPoints(ptList4)
	return polyA,polyB,polyC,polyD
	
	
	
	
#func to convert polygon to a rectangle---------------------------------------------------
def polytoRect(poly):
	crvs = poly.Curves()
	polyPts = poly.Points
	polyCen = poly.Center()
	wid = Line.ByStartPointEndPoint(polyPts[0],polyPts[1]).Length
	ht = Line.ByStartPointEndPoint(polyPts[0],polyPts[3]).Length
	
	cs = CoordinateSystem.ByOrigin(polyCen)
	#rec = Rectangle.ByWidthHeight(cs,wid,ht)
	
	ptList=[]
	for i in range(len(crvs)-1):
		pt = crvs[i].StartPoint
		ptList.append(pt)	
	rec = Rectangle.ByCornerPoints(ptList)
	return rec
#-----------------------------------------------------------------------------------------

#makes two polygons for two places in the l shape---------------------------------------------
def recMakers(poly):
	#poly = multiRecMaker()[1]
	polyPts = poly.Points
	polyCen = poly.Center()
	
	closPt = closestPoint(polyCen,polyPts)
	 
	oppPt = oppPointFinder(poly,closPt)[0]
	id = oppPointFinder(poly,closPt)[1]-3
	line1 = Line.ByStartPointEndPoint(polyPts[id],polyPts[id+1])
	line2 = Line.ByStartPointEndPoint(polyPts[id-1],polyPts[id-2])
	dist = line2.Length	
	ptNew = line1.PointAtParameter(dist/line1.Length)
	
	ptListA = [polyPts[id],polyPts[id-1],polyPts[id-2],ptNew]
	ptListB = [ptNew,polyPts[id-3],polyPts[id-4],polyPts[id-5]]
	
	polyA = Polygon.ByPoints(ptListA)
	polyB = Polygon.ByPoints(ptListB)
	
	return polyA,polyB
#---------------------------------------------------------------------------------------------

if type==1: out = [polygon]
if type==2: out = recMakers(polygon)
if type==3: out = multiRecMaker()
if type==4: out = recFromType4()

recListFinal = [polytoRect(out[i]) for i in range(len(out)) ]
#Assign your output to the OUT variable
OUT = recListFinal
#OUT = recMakers()
# ----------------------------------------
file_path = Filename("D:\SUBHAJIT PROJECTS\WORK\00 DYNAMO AUTOMATED STAIRCORE\00 STL FILES\O-Shell4.stl")
fromPath = FileObject(file_path)  # "File.FromPath"
readText = File.ReadText(fromPath)
byASCII = stuffer.STL.ByASCII(readText)
mesh = stuffer.STL.Mesh(byASCII)
byMesh = stuffer.Shell.ByMesh(mesh)
number = DoubleInput(0.5)
number_2 = DoubleInput(3.5)
bySize = stuffer.GridBasis.BySize(number, number_2)
number_3 = DoubleInput(0)
height = stuffer.Shell.Height(byMesh)
level = DoubleInput(1)
floorHeight = stuffer.GridBasis.FloorHeight(bySize, level)
number_range = NumberRange(number_3, height, floorHeight, lacing=Longest)
div = number_range / floorHeight
floorHeight_2 = stuffer.GridBasis.FloorHeight(bySize, div)
getFloorOutline = stuffer.Shell.GetFloorOutline(byMesh, floorHeight_2)
flatten = Flatten(getFloorOutline)
shell_type = Python(IN[0]=file_path)
# ---------- shell_type.python (15 lines) ----------
import clr
clr.AddReference('ProtoGeometry')
from Autodesk.DesignScript.Geometry import *
#The inputs to this node will be stored as a list in the IN variable.
dataEnteringNode = IN


a = IN[0][-5]


a = int(a)


#Assign your output to the OUT variable
OUT = a
# ----------------------------------------
number_slider = DoubleSlider(18.8, range=0..100 step 0.1)
box_maker_new = Python(IN[0]=flatten, IN[1]=shell_type, IN[2]=floorHeight_2, IN[3]=number_slider)
# ---------- box_maker_new.python (302 lines) ----------
import clr
clr.AddReference('ProtoGeometry')
from Autodesk.DesignScript.Geometry import *
import math
#The inputs to this node will be stored as a list in the IN variable.
dataEnteringNode = IN

polygonList = IN[0]
type = IN[1]
heightList = IN[2]
iter = IN[3]

#last polygon is null, so take it off
del polygonList[-1]

srfAreaList=[]
selectedpolyList=[]
zHeightList=[]


#computes for all except type 4-----------------------------------------------------------------------------------------------
def boxFloorMaker4():	
	newpolygonList=[]
	poly1st = polygonList[0]
	srf0 = Surface.ByPatch(poly1st)
	area1st = srf0.Area
	# compute floor areas	
	for i in range(len(polygonList)):
		
		polygon = polygonList[i]
		srf = Surface.ByPatch(polygon)		
		area  = srf.Area
		if math.pow((area1st - area),2) < 5 :continue 
		srfAreaList.append(area)
		newpolygonList.append(polygon)
		
	# select floors where area changes
	for i in range(len(srfAreaList)-1):
		areaCurrent = srfAreaList[i]
		
		areaNext = srfAreaList[i+1]
		areaSubtract = areaNext-areaCurrent
		if math.pow(areaSubtract,2) < 5:
			pass
		else:
			selectedpolyList.append(newpolygonList[i])	
	selectedpolyList.append(newpolygonList[-1])
	
	#translate the selected floors to ground lvl
	newPolyList=[]
	zHeightList=[]
	
	for i in range(len(selectedpolyList)):
		selPolygon = selectedpolyList[i]
		pCenter = selPolygon.Center()
		pOrigin = Point.ByCoordinates(pCenter.X,pCenter.Y,0)		 
		vec = Vector.ByTwoPoints(pCenter,pOrigin)
		newPoly = selPolygon.Translate(vec)
					
		newPolyList.append(newPoly)
		zHeightList.append(pCenter.Z)	
		
	#trim the floors polygons to make individual blocks
	trimmedSrfList=[]
	perimeterList = []
	for i in range(len(newPolyList)-1):
		polyA = newPolyList[i]
		polyB = newPolyList[i+1]
		polyBSolid = polyB.ExtrudeAsSolid(Vector.ZAxis(),5)
		polyASrf = Surface.ByPatch(polyA)
		trimmedSurf = Surface.SubtractFrom(polyASrf,polyBSolid)
		trimmedSrfList.append(trimmedSurf)
		pass	
	trimmedSrfList.append(Surface.ByPatch(newPolyList[-1]))
	
	#just for type4
	polyBSolid = poly1st.ExtrudeAsSolid(Vector.ZAxis(),-5)
	polyASrf = trimmedSrfList[0][0]
	trimmedSurf = Surface.SubtractFrom(polyASrf,polyBSolid)
	trimmedSrfList[0] = trimmedSurf	
	
	newtrimmedList=[]
	newperimeterList = []
	
	
	# flatten the list
	for i in range(len(trimmedSrfList)):
		crv = trimmedSrfList[i]
		try :
			for j in range(len(crv)):
				newtrimmedList.append(crv[j])
				perim = crv[j].Perimeter
				newperimeterList.append(perim)
		except:
			newtrimmedList.append(crv)
			perim = crv.Perimeter
			newperimeterList.append(perim)
			
	#make floor curves for the individual blocks		
	trimmedCurvesList=[]
	ptList=[]
	rectangleList = []
	testL=[]
	for i in range(len(newtrimmedList)):
		srf = newtrimmedList[i]
		crvs = srf.PerimeterCurves()
		crvs = PolyCurve.ByJoinedCurves(crvs)
		testL.append(crvs)		

		#IF ERROR TRIGGER THESE DIST VALUES, BOTH WORKS
		dist= crvs.Length/4
		#dist= float(newperimeterList[i]/4)
		
		#pt1 = crvs.PointAtDistance(dist)
		pt2 = crvs.PointAtDistance(dist*2)
		pt4 = crvs.PointAtDistance(dist*3.999)
		pt1 = Point.ByCoordinates(pt2.X,pt4.Y)
		pt3 = Point.ByCoordinates(pt4.X,pt2.Y)
		#pt3 = crvs.PointAtDistance(dist*3)
		
		# make rectangles for the floor curves
		ptList.append((pt1,pt2,pt3,pt4))
		"""
		if type == 3:
			rec = Rectangle.ByCornerPoints(pt3,pt4,pt1,pt2)
		else:
		"""
		rec = Rectangle.ByCornerPoints(pt1,pt2,pt3,pt4)
		rectangleList.append(rec)
		trimmedCurvesList.append(crvs)
		
	if type == 3:
		tmp = rectangleList[1]
		tmp1 = zHeightList[1]
		zHeightList[1] = zHeightList[2]
		zHeightList[2] = tmp1
		rectangleList[1] = rectangleList[2]
		rectangleList[2] = tmp
	
	# make floor curves as rectangle objects
	newRecList = []
	boxRecList = []
	for i in range(len(rectangleList)):
		rec = rectangleList[i]
		boxRecList.append(rec)
		zHeight = zHeightList[i]
		newRecL=[]
		for j in range(len(heightList)):
			
			heightVal =  heightList[j]
			if zHeight < heightVal : break		 
			vec = Vector.ZAxis()
			newRecs = rec.Translate(vec,heightVal)
			newRecL.append(newRecs)
		newRecList.append(newRecL)
	#return testL
	return boxRecList,newRecList
#-------------------------------------------------------------------------------------------------------------------------------------------------------



	
	
	

	
	
#computes for all except type 4-----------------------------------------------------------------------------------------------
def boxFloorMakerAll():	
	# compute floor areas	
	for i in range(len(polygonList)):
		polygon = polygonList[i]
		srf = Surface.ByPatch(polygon)
		area  = srf.Area
		srfAreaList.append(area)
		
	# select floors where area changes
	for i in range(len(srfAreaList)-1):
		areaCurrent = srfAreaList[i]
		areaNext = srfAreaList[i+1]
		areaSubtract = areaNext-areaCurrent
		if math.pow(areaSubtract,2) < 5:
			pass
		else:
			selectedpolyList.append(polygonList[i])	
	selectedpolyList.append(polygonList[-1])
	
	#translate the selected floors to ground lvl
	newPolyList=[]
	zHeightList=[]
	for i in range(len(selectedpolyList)):
		selPolygon = selectedpolyList[i]
		pCenter = selPolygon.Center()
		pOrigin = Point.ByCoordinates(pCenter.X,pCenter.Y,0)		 
		vec = Vector.ByTwoPoints(pCenter,pOrigin)
		newPoly = selPolygon.Translate(vec)		
		newPolyList.append(newPoly)
		zHeightList.append(pCenter.Z)	
		
	#trim the floors polygons to make individual blocks
	trimmedSrfList=[]
	perimeterList = []
	for i in range(len(newPolyList)-1):
		polyA = newPolyList[i]
		polyB = newPolyList[i+1]
		polyBSolid = polyB.ExtrudeAsSolid(Vector.ZAxis(),5)
		polyASrf = Surface.ByPatch(polyA)
		trimmedSurf = Surface.SubtractFrom(polyASrf,polyBSolid)
		trimmedSrfList.append(trimmedSurf)
		pass	
	trimmedSrfList.append(Surface.ByPatch(newPolyList[-1]))
		
	newtrimmedList=[]
	newperimeterList = []
	
	# flatten the list
	for i in range(len(trimmedSrfList)):
		crv = trimmedSrfList[i]
		try :
			for j in range(len(crv)):
				newtrimmedList.append(crv[j])
				perim = crv[j].Perimeter
				newperimeterList.append(perim)
		except:
			newtrimmedList.append(crv)
			perim = crv.Perimeter
			newperimeterList.append(perim)
			
	#make floor curves for the individual blocks		
	trimmedCurvesList=[]
	ptList=[]
	rectangleList = []
	for i in range(len(newtrimmedList)):
		srf = newtrimmedList[i]
		crvs = srf.PerimeterCurves()
		crvs = PolyCurve.ByJoinedCurves(crvs)
	
		#IF ERROR TRIGGER THESE DIST VALUES, BOTH WORKS
		#dist= crvs.Length/4
		dist= float(newperimeterList[i]/4)
		
		#pt1 = crvs.PointAtDistance(dist)
		pt2 = crvs.PointAtDistance(dist*0)
		pt4 = crvs.PointAtDistance(dist*2)
		pt1 = Point.ByCoordinates(pt2.X,pt4.Y)
		pt3 = Point.ByCoordinates(pt4.X,pt2.Y)
		#pt3 = crvs.PointAtDistance(dist*3)
		
		# make rectangles for the floor curves
		ptList.append((pt1,pt2,pt3,pt4))
		"""
		if type == 3:
			rec = Rectangle.ByCornerPoints(pt3,pt4,pt1,pt2)
		else:
		"""
		rec = Rectangle.ByCornerPoints(pt1,pt2,pt3,pt4)
		rectangleList.append(rec)
		trimmedCurvesList.append(crvs)
		
	if type == 3:
		tmp = rectangleList[1]
		tmp1 = zHeightList[1]
		zHeightList[1] = zHeightList[2]
		zHeightList[2] = tmp1
		rectangleList[1] = rectangleList[2]
		rectangleList[2] = tmp
	
	# make floor curves as rectangle objects
	newRecList = []
	boxRecList = []
	for i in range(len(rectangleList)):
		rec = rectangleList[i]
		boxRecList.append(rec)
		zHeight = zHeightList[i]
		newRecL=[]
		for j in range(len(heightList)):
			
			heightVal =  heightList[j]
			if zHeight < heightVal : break		 
			vec = Vector.ZAxis()
			newRecs = rec.Translate(vec,heightVal)
			newRecL.append(newRecs)
		newRecList.append(newRecL)
	
	return boxRecList,newRecList
#-------------------------------------------------------------------------------------------------------------------------------------------------------

# type 4 is O SHELL, so needs different treatment

if type == 4:
	out =boxFloorMaker4()
else :	
	out = boxFloorMakerAll()
	
			
	
	
	
	
#Assign your output to the OUT variable
#OUT = newPolyList,trimmedSrfList,zHeightList,newtrimmedList,newRecList,ptList
OUT = out
# ----------------------------------------
box_low_level = CodeBlock(a=box_maker_new) { a[0]; }
boxMaker = CodeBlock(boxMaker=box_low_level) { boxMaker; }
height_2 = DoubleSlider(150, range=1..600 step 0.1)
user_input_floor_heights = CodeBlock { regularFloorHeight = 5; mechanicalFloorHeight = 7; mechFloor_Frequency = 18; }
generates_floor_plane_heights = Python(IN[0]=height_2, IN[1]=user_input_floor_heights.regularFloorHeight, IN[2]=user_input_floor_heights.mechanicalFloorHeight, IN[3]=user_input_floor_heights.mechFloor_Frequency)
# ---------- generates_floor_plane_heights.python (45 lines) ----------
import clr
clr.AddReference('ProtoGeometry')
from Autodesk.DesignScript.Geometry import *
import math
#The inputs to this node will be stored as a list in the IN variable.
dataEnteringNode = IN

#inputs------------------------------------------------------------
twr_Height = IN[0]
regflr_Ht  = IN[1]
mechflr_Ht = IN[2]
keyflr_Mech= IN[3]
#inputs------------------------------------------------------------

approxNum_Floors  =  twr_Height / regflr_Ht
numberof_MechFloors = math.ceil(approxNum_Floors / keyflr_Mech)
height_Counter = 0
height_List=[]
height = 0
tag = 0

while height<twr_Height:		
	#iterate to add the heights for the regular floors till first mechanical lvl
	for i in range(keyflr_Mech):
		if i == 0 and tag == 0:
			height += 0
			tag = 1
		else:
			height += regflr_Ht
		height_List.append(height)
		
		if ((height + mechflr_Ht + 1) > twr_Height): break
				
	if ((height) > twr_Height):	break		
		
	height += mechflr_Ht
	# add the mechanical floor height to the height list
	height_List.append(height)
 




#Assign your output to the OUT variable
OUT = height_List
# ----------------------------------------
floor_plan_heights = CodeBlock(a=generates_floor_plane_heights) { a; }
random_height_generator = IntegerSlider(92, range=0..100 step 1)
floor_maker = Python(IN[0]=boxMaker, IN[1]=floor_plan_heights, IN[2]=random_height_generator)
# ---------- floor_maker.python (51 lines) ----------
import clr
clr.AddReference('ProtoGeometry')
from Autodesk.DesignScript.Geometry import *
import sys
sys.path.append("C:\Program Files (x86)\IronPython 2.7\Lib")
import random
#The inputs to this node will be stored as a list in the IN variable.
dataEnteringNode = IN

recList=IN[0]
floorHeights = IN[1]

#makes variable length floor height list-------------------------------------------------------------------------------------------
def variableFloorHeight(flrHtList):
	newFlrHtList = []
	for i in range(len(recList)):
		y = len(flrHtList)
		x = y/2
		a = int(random.uniform(x,y))
		flrTest = flrHtList[:a]
		newFlrHtList.append(flrTest)
	return newFlrHtList
#----------------------------------------------------------------------------------------------------------------------------------




#makes floors translate to given height list---------------------------------------------------------------------------------------
def floorTranslator(recList,flrHtList):
	newRecList = []
	ptA = Point.ByCoordinates(0,0,0)
	ptB = Point.ByCoordinates(0,0,100)
	vec = Vector.ByTwoPoints(ptA,ptB)
	for i in range(len(recList)):
		rec = recList[i]
		recNList=[]
		flrHeights = flrHtList[i]
		for j in range(len(flrHeights)):
			dist = flrHeights[j]
			newRec = rec.Translate(vec,dist)
			recNList.append(newRec)
		newRecList.append(recNList)
	return newRecList
#---------------------------------------------------------------------------------------------------------------------------------


flrNewHeights = variableFloorHeight(floorHeights)
out = floorTranslator(recList,flrNewHeights)

#Assign your output to the OUT variable
OUT = out
# ----------------------------------------
basefloor_assets = CodeBlock(a=boxMaker) { {a.Width,a.Height}; }
block_width_height = CodeBlock(width=basefloor_assets, height=basefloor_assets) { width[0]; height[1]; }
basepoint_maker = Python(IN[0]=boxMaker)
# ---------- basepoint_maker.python (10 lines) ----------
import clr
clr.AddReference('ProtoGeometry')
from Autodesk.DesignScript.Geometry import *
#The inputs to this node will be stored as a list in the IN variable.
dataEnteringNode = IN
rectList = IN[0]

ptList= [x.Center() for x in rectList]
#Assign your output to the OUT variable
OUT = ptList
# ----------------------------------------
floor_curves = CodeBlock(a=box_maker_new) { a[1]; }
floor_maker_2 = CodeBlock(floorMaker=floor_curves) { floorMaker; }
floor_surface = Surface.ByPatch(floor_maker_2)
gba_floor_area = Surface.Area(floor_surface)
builtarea_blocks = Python(IN[0]=gba_floor_area)
# ---------- builtarea_blocks.python (17 lines) ----------
import clr
clr.AddReference('ProtoGeometry')
from Autodesk.DesignScript.Geometry import *
#The inputs to this node will be stored as a list in the IN variable.
dataEnteringNode = IN

floor_AreaSrf = IN[0]
totalAREA=[]
for i in range(len(floor_AreaSrf)):
	floor_Area = floor_AreaSrf[i]
	totalBuiltArea = sum(floor_Area)
	totalAREA.append(totalBuiltArea)



#Assign your output to the OUT variable
OUT = totalAREA,sum(totalAREA)
# ----------------------------------------
total_built_area = CodeBlock(a=builtarea_blocks) { a[0]; a[1]; }
user_inputs = CodeBlock { building_sections = 3; area_passElev = 8000; area_servElev = 7000; restroom_Prop = 0.15; techroom_Prop = 0.05; }
number_of_elevators_needed = Python(IN[0]=total_built_area.out0, IN[1]=user_inputs.area_passElev, IN[2]=user_inputs.area_servElev)
# ---------- number_of_elevators_needed.python (30 lines) ----------
import clr
clr.AddReference('ProtoGeometry')
from Autodesk.DesignScript.Geometry import *
import math
#The inputs to this node will be stored as a list in the IN variable.
dataEnteringNode = IN

totalBuiltAreaL	= 	IN[0]
passArea		=	IN[1]
servArea		=	IN[2]

passElevList=[]
servElevList=[]
for i in range(len(totalBuiltAreaL)):
	totalBuiltArea = totalBuiltAreaL[i]
	passElev = math.ceil(totalBuiltArea/passArea)
	servElev = math.ceil(totalBuiltArea/servArea)
	
	#make sure elevator counts are even
	if (passElev % 2 == 1): passElev += 1
	if (servElev % 2 == 1): servElev += 1
	
	passElevList.append(passElev)
	servElevList.append(servElev)




#Assign your output to the OUT variable
OUT = [passElevList, servElevList]
# ----------------------------------------
area_per_elevator = DoubleSlider(4, range=1..100 step 0.1)
tag_switch = CodeBlock { A=1; B="EITHER 0 OR 1"; }
ratio_dimelevator = DoubleSlider(1.1, range=0.1..3 step 0.1)
elevator_dimensions = Python(IN[0]=area_per_elevator, IN[1]=ratio_dimelevator)
# ---------- elevator_dimensions.python (15 lines) ----------
import clr
clr.AddReference('ProtoGeometry')
from Autodesk.DesignScript.Geometry import *
import math
#The inputs to this node will be stored as a list in the IN variable.
dataEnteringNode = IN
elevArea	=	IN[0]
ratio		=	IN[1]


len			=	math.sqrt(elevArea/ratio)
wid			=	elevArea/len
#Assign your output to the OUT variable
OUT = wid,len
#OUT = len,wid
# ----------------------------------------
lift_lobby_width = DoubleSlider(2, range=0.5..11 step 0.1)
shell_type_2 = CodeBlock(type=shell_type) { type; }
core_freq = IntegerSlider(58, range=5..609 step 1)
core_dimension = CodeBlock(a=LENX, b=LENY) { (a+b)/15; }
core_placer_points_strat_1 = Python(IN[0]=boxMaker, IN[1]=shell_type_2, IN[2]=core_freq, IN[3]=core_dimension)
# ---------- core_placer_points_strat_1.python (90 lines) ----------
import clr
clr.AddReference('ProtoGeometry')
from Autodesk.DesignScript.Geometry import *
import math
#The inputs to this node will be stored as a list in the IN variable.
dataEnteringNode = IN

emptyBox = IN[0]
type = IN[1]
inputLen = IN[2]
coreDim = IN[3]

#get the shorter dimension---------------------------------------------------------------
def getShorterDim(rec):
	width	=	rec.Width
	length	=	rec.Height
	points = 	rec.Points
	diagDist = Line.ByStartPointEndPoint(points[0],points[2]).Length
	if(width<=length): 
		shortEdge	= width
		longEdge	= length
	else: 
		shortEdge 	= length
		longEdge  	= width
	return shortEdge,longEdge,diagDist
	#return longEdge,shortEdge
# END OF FUNCTION ------------------------------------------------------------------------


#makes the core rectangle based on number of req it has---------------------------------------------------------------------------------------
def makeCoreBox(rec,numCore,wid,ht,longEdge):
	coreList=[]
	cen = rec.Center()
	pts = rec.Points
	ptPlaceList = []
	#when just need to place one core
	if numCore ==1:
		cs = CoordinateSystem.ByOrigin(cen)
		coreRec= Rectangle.ByWidthHeight(cs,wid,ht)
		coreList.append(coreRec)
		ptPlaceList.append(cen)
	#when more than one core needs to be placed
	else:
		len1 = Line.ByStartPointEndPoint(pts[0],pts[1]).Length
		len2 = Line.ByStartPointEndPoint(pts[0],pts[3]).Length
		#find the longer edge and that line
		if len1 == longEdge:
			lin = Line.ByStartPointEndPoint(pts[0],pts[1])
		else:
			lin = Line.ByStartPointEndPoint(pts[0],pts[3])			
		linCen = lin.PointAtParameter(0.5)
		vec = Vector.ByTwoPoints(linCen,cen)
		linNew = lin.Translate(vec)
		#divide the line to get the points to place core		
		linNewLen = linNew.Length
		perDist = linNewLen/(numCore+1)
		
		#prepare the pointlist
		for i in range(numCore):
			pt = linNew.PointAtDistance((i+1)*perDist)
			ptPlaceList.append(pt)
	return ptPlaceList
#---------------------------------------------------------------------------------------------------------------------------------------------

# function which places core boxes into the empty boxes----------------------------------------------------------------------------------------
def placeCoreBox(boxList):		
	allCores=[]
	lenMeasure = inputLen
	wid = coreDim
	ht = coreDim
	for i in range(len(boxList)):
		rec = boxList[i]
		shortEdge = getShorterDim(rec)[0]
		longEdge = getShorterDim(rec)[1]
		diagDist = getShorterDim(rec)[2]
		if longEdge > lenMeasure :
			numCore = int(math.ceil(longEdge/lenMeasure))	
		else :
			numCore=1
		coreRecs = makeCoreBox(rec,numCore,wid,ht,longEdge)
		allCores.append(coreRecs)
	return allCores
#----------------------------------------------------------------------------------------------------------------------------------------------



out = placeCoreBox(emptyBox)
#Assign your output to the OUT variable
OUT = out
#OUT = polytoRect(emptyBox[0])
# ----------------------------------------
service_core_components_strat_1 = Python(IN[0]=block_width_height.out0, IN[1]=block_width_height.out1, IN[2]=basepoint_maker, IN[3]=number_of_elevators_needed, IN[4]=area_per_elevator, IN[5]=tag_switch.A, IN[6]=elevator_dimensions, IN[7]=user_inputs.restroom_Prop, IN[8]=user_inputs.techroom_Prop, IN[9]=lift_lobby_width, IN[10]=core_placer_points_strat_1)
# ---------- service_core_components_strat_1.python (230 lines) ----------
import clr
clr.AddReference('ProtoGeometry')
from Autodesk.DesignScript.Geometry import *
import math
import sys
sys.path.append("C:\Program Files (x86)\IronPython 2.7\Lib")
import random

#The inputs to this node will be stored as a list in the IN variable.
dataEnteringNode = IN

flr_WidthList		=	IN[0]
flr_HeightList		=	IN[1]
twr_BaseptList		=	IN[2]
num_passElev		=	IN[3][0]
num_servElev		=	IN[3][1]

passElev_Area		=	IN[4]
servElev_Area		=	IN[4]
tag					=	IN[5]
elevWidth			=	IN[6][0]
elevLength			=	IN[6][1]
restroomProp		=	IN[7]
techrmProp			=	IN[8]
liftLobbyWidth		=	IN[9]
corePtList			=	IN[10]



#compute service core width, length, and serviceCore====================================================================================================
def serviceCoreMaker(ptL):
	global area_banks, area_restroom,area_servmodule
	rd = random.uniform(0,1)
	#calc total area for service core for the tower
	serviceCore_Area 	= area_banks + area_restroom + area_servmodule;
	serviceCore_Area	= serviceCore_Area/len(ptL)
	area_banks			= area_banks/len(ptL)
	area_restroom		= area_restroom/len(ptL)
	area_servmodule		= area_servmodule/len(ptL)
	
	servCore_WidthL = []
	servCore_LengthL = []
	coreVerticesL = []
	b_FacL =[]
	serviceCore_RecL = []
	for i in range(len(ptL)):
		pt = ptL[i]			
		#calc aspect ratio of floor plate
		aspect_Ratio 		= 	flr_Width/flr_Height
		
		#adjust aspectratio
		if aspect_Ratio < 0.65 : aspect_Ratio = 0.75
		if aspect_Ratio > 1.3 : aspect_Ratio = 1.2
		
		
		#calc service core length and width
		if rd<0.5:
			servCore_Length 	=	math.sqrt(serviceCore_Area/aspect_Ratio)
			servCore_Width		=	serviceCore_Area/servCore_Length	
		else:
			servCore_Width		=	math.sqrt(serviceCore_Area/aspect_Ratio)
			servCore_Length 	=	serviceCore_Area/servCore_Width	
		
		"""LATER MAKE AN ORIENT FUNCTION
		if len(ptL) == 1:
			#flipped width and length
			tm = servCore_Length
			servCore_Length = servCore_Width  
			servCore_Width = tm
		"""
		# get the coordinates of center pt
		x,y,z 					= 	pt.X,pt.Y,pt.Z	
		#make the service core rectangle object--------------------------------------------------------------------------------------------------------------1
		cs					= 	CoordinateSystem.ByOrigin(x,y,z)
		serviceCore_Rec 	= 	Rectangle.ByWidthHeight(cs,servCore_Width,servCore_Length)
		coreVertices		=	serviceCore_Rec.Points
		servCore_WidthL.append(servCore_Width)
		servCore_LengthL.append(servCore_Length)
		coreVerticesL.append(coreVertices)
		serviceCore_RecL.append(serviceCore_Rec)
	#comput elev bank factor--------------------------------------------------------------------
	b_Fac				=	area_banks/serviceCore_Area
	#return serviceCore_Rec,b_Fac,coreVertices,area_banks,area_banks,area_servmodule
	return servCore_WidthL,servCore_LengthL,coreVerticesL,b_Fac,serviceCore_RecL



#function to make boxes based off of width, length and vertices===========================================================================================
def makeBox(widthL,lengthL,verticesL,factor,tag):
	new_RecL=[]
	other_RecL=[]
	for i in range(len(widthL)):
		width = widthL[i]
		length = lengthL[i]
		vertices = verticesL[i]
		
		#calculate the shorter of width or height of service core
		if ( tag == 0):
			if (width < length):
				new_Length 		=	length
				new_Width		=	factor*width
				other_Length 	=	length
				other_Width		=	width - new_Width
				index			=	3		
			else:
				new_Width		=	width	
				new_Length		=	factor*length
				other_Width 	=	width
				other_Length	=	length - new_Length
				index			=	2
		else:
			if (width > length):
				new_Length 		=	length
				new_Width		=	factor*width
				other_Length 	=	length
				other_Width		=	width - new_Width
				index			=	3		
			else:
				new_Width		=	width	
				new_Length		=	factor*length
				other_Width 	=	width
				other_Length	=	length - new_Length
				index			=	2		
	
		
		cs1					= 	CoordinateSystem.ByOrigin(vertices[0].X,vertices[0].Y,0)
		cs2					= 	CoordinateSystem.ByOrigin(vertices[index].X,vertices[index].Y,0)
		# to make the primary rectangle ----------------------------------------------------------------------	
		new_Rec 			= 	Rectangle.ByWidthHeight(cs1,new_Width,new_Length)	
		new_Vec				= 	Vector.ByTwoPoints(new_Rec.Points[0],vertices[0])
		new_Rec				=	Geometry.Translate(new_Rec, new_Vec)
		ptsnew_Rec			=	new_Rec.Points
		# to make the secondary rectangle ----------------------------------------------------------------------	
		other_Rec 			= 	Rectangle.ByWidthHeight(cs2,other_Width,other_Length)	
		other_Vec			= 	Vector.ByTwoPoints(other_Rec.Points[index],vertices[index])
		other_Rec			=	Geometry.Translate(other_Rec, other_Vec)
		ptsother_Rec		=	other_Rec.Points
		
		new_RecL.append(new_Rec)
		other_RecL.append(other_Rec)
	
	return [new_RecL,other_RecL]
#============================================================================================================================================================



#make post computations======================================================================================================================================
def coreConfigurator(b_Fac):
	#make the elevator bank rectangle object-----------------------------------------------------1	
	bank_RecL			=	makeBox(servCore_Width,servCore_Length,coreVertices,b_Fac,tag)
	bank_RecLNew = []
	for i in range(len(bank_RecL)):
		bank_Rec = 	bank_RecL[i]
		widtry1				=	bank_Rec[0].Width
		lentry1				=	bank_Rec[0].Height
				
		# code to readjust the bank rectangle piece based on the final tech rooms and restroom blocks
		if ( widtry1<lentry1):
			shortEdge		=	widtry1
			marked			=	0	
		else:
			shortEdge		=	lentry1
			marked			=	1
				
		if (elevWidth<elevLength):elevEdge = elevWidth
		else:elevEdge =	elevLength			
		numE				=	int(shortEdge / elevEdge)
		numE				+=	1
			
		newDim				=	numE*elevEdge
		if ( marked ==0): ratio	= widtry1/newDim
		else: ratio	= lentry1/newDim
		b_Fac				=	ratio*b_Fac
		#COMMENT THE FOLLOWING IF THE PROPORTION IS ABNORMAL
		bank_RecL			=	makeBox(servCore_Width,servCore_Length,coreVertices,b_Fac,tag)
		
	return bank_RecL
	#-------------------------------------------------------------------------------------------------
#============================================================================================================================================================


#iterate through all the blocks and output lists for each---------------------------------------------
outList=[]
bankRecList= []
otherRecList=[]
areaRestrmList=[]
areaServModList=[]
servCoreList=[]

perc = 1.1

for i in range(len(twr_BaseptList)):

	flr_Width  = flr_WidthList[i]
	flr_Height = flr_HeightList[i]
	twr_Basept = twr_BaseptList[i]
	corePts	   = corePtList[i]
	
	#globals var, computer area banks, area restrm, area techrms--------------------------------------------------------------------------------------------
	cirProp = liftLobbyWidth/1.5
	
	area_banks			= servElev_Area*num_servElev[i]/perc + passElev_Area*num_passElev[i]/perc
	area_banks			+=cirProp*area_banks # added the circulation area
	area_restroom 		= restroomProp*area_banks								
	area_servmodule 	= techrmProp*area_banks
	
	
	#OUTPUT VALUES-------------------------------------------------------
	vals 				= 	serviceCoreMaker(corePts)
	servCore_Width		=	vals[0]
	servCore_Length		=	vals[1]
	coreVertices		=	vals[2]
	b_Fac				=	vals[3]
	serviceCore_Rec		=	vals[4]
	bank_Rec 			= 	coreConfigurator(b_Fac)	
	
	bankRecList.append(bank_Rec[0])
	otherRecList.append(bank_Rec[1])
	areaRestrmList.append(area_restroom)
	areaServModList.append(area_servmodule)
	servCoreList.append(serviceCore_Rec)
	
	

out = bankRecList,otherRecList,areaRestrmList,areaServModList,servCoreList


#Assign your output to the OUT variable
OUT = out
#OUT = flr_WidthList,flr_HeightList
# ----------------------------------------
edge_picker_strat2 = Python(IN[0]=boxMaker, IN[1]=shell_type_2, IN[2]=core_freq, IN[3]=core_dimension)
# ---------- edge_picker_strat2.python (254 lines) ----------
import clr
clr.AddReference('ProtoGeometry')
from Autodesk.DesignScript.Geometry import *
import math
#The inputs to this node will be stored as a list in the IN variable.
dataEnteringNode = IN

emptyBox = IN[0]
type = IN[1]
inputLen = IN[2]
coreDim = IN[3]


#finds number of closest rectangle pieces to find---------------------------------------------------------------------------------------------
def adjacencyList(type):
	adjList = []
	if type ==1: adjList = [0]
	if type ==2: adjList = [1,1]
	if type ==3: adjList = [1,2,1]
	if type ==4: adjList = [2,2,2,2]	
	return adjList
#---------------------------------------------------------------------------------------------------------------------------------------------



#find the common edges between two boxes------------------------------------------------------------------------------------------------------
def findCloseRects(boxList,type):
	indexList = []
	adjList = adjacencyList(type)
	distList=[]
	sortDistList = []
	for i in range(len(boxList)):
		rec = boxList[i]
		recCen = rec.Center()
		distL =[]
		sortL =[]
		indexL=[]		
		for j in range(len(boxList)):
			rec2 = boxList[j]
			recCen2 = rec2.Center()
			dist = recCen.DistanceTo(recCen2)
			#done to make sure further away rectangles dont counted as being close
			v1 = Vector.ByTwoPoints(recCen,recCen2)
			if v1.Length != 0:
				str = "1st enetered"
				vangX = v1.AngleBetween(Vector.XAxis())
				vangY = v1.AngleBetween(Vector.YAxis())
				if type == 4:				
					if int(vangX) == 0 or int(vangY) == 0:
						str ="2nd entered"
						dist = 900000000000000000000000000	
				if type == 5:
					if int(vangX) <30 or int(vangY) <30:
						str ="2nd entered"
						dist = 1		
			
			distL.append(dist)
			
		sortList = distL[:]
		sortList.sort()
		sortL.Add(sortList)
		sortDistList.Add(sortList)
		distList.Add(distL)
		
	indexList=[]
	for i in range(len(distList)):
		distL = distList[i]
		sortL = sortDistList[i]
		numAdj = adjList[i]
		indexL=[]
		for k in range(numAdj):			
			for j in range(len(distL)):			
				if sortL[k+1] == distL[j]:
					index = j
					indexL.append(index)
					#break
		indexList.append(indexL)
	"""
	indexList=[]
	#hardcode it
	indexList.append([2,3])
	indexList.append([3,2])
	indexList.append([1,0])
	indexList.append([1,0])	
	"""	
	return indexList
#---------------------------------------------------------------------------------------------------------------------------------------------
#finds the closest point from a list of points------------------------------------------------------------------------------------------------
def closestPoint(ptA,ptBList):
	distList=[]
	for i in range(len(ptBList)):
		ptB = ptBList[i]
		dist = ptA.DistanceTo(ptB)
		distList.append(dist)

	sortDistList = distList[:]
	sortDistList.sort()
	
	for i in range(len(sortDistList)):
		for j in range(len(sortDistList)):
			if sortDistList[0] == distList[j]: closePtList = ptBList[j]
		break
	return closePtList
#---------------------------------------------------------------------------------------------------------------------------------------------

def edgePicker(boxList,type):
	str = "did not enter"
	edgeList = findCommonEdges(boxList,type)
	finalRecLines=[]
	for i in range(len(boxList)):
		rec = boxList[i]
		recPts = rec.Points
		recLines = rec.Curves()
		list=[]		
		coprecLines = recLines[:]
		list.extend(coprecLines)
		edgeL = edgeList[i]
		pickedLines = []
		for k in range(len(edgeL)):			
			for j in range(len(list)):
				recL = recLines[j]
				rcStart = recL.StartPoint
				rcEnd	= recL.EndPoint
				rLine1 = Line.ByStartPointEndPoint(rcStart,rcEnd)
				rLine2 = Line.ByStartPointEndPoint(rcEnd,rcStart)
				"""
				if rLine1.Length == edgeL[k].Length and rLine1.PointAtParameter(0.5) == edgeL[k].PointAtParameter(0.5): 
					str = "it entered"
					del list[j]	
					break
				else: pickedLines.Add(recL)
				"""
				if rLine1.Length == edgeL[k].Length:
					if	rLine1.PointAtParameter(0.5) == edgeL[k].PointAtParameter(0.5) or rLine2.PointAtParameter(0.5) == edgeL[k].PointAtParameter(0.5):
						str = "it entered"
						del list[j]	
						break
				else: pickedLines.Add(recL)
				
				
						
		finalRecLines.Add(list)
	if type == 4: del finalRecLines[3][-1]
	finalRecLines = convToLine(finalRecLines)
	return finalRecLines


#finds common edges between neighboring rect pieces---------------------------------------------------------------------------------------------
def findCommonEdges(boxList,type):
	TAG = 0
	edgeList = []
	closePtList = []
	indexList = findCloseRects(boxList,type)
	for i in range(len(boxList)):
		rec = boxList[i]
		recCen = rec.Center()
		recPts = rec.Points
		indexL = indexList[i]
		edgeL =[]
		closeL =[]
		for j in range(len(indexL)):
			ind = indexL[j]
			recSide = boxList[ind]
			recSideCen = recSide.Center()
			lin = Line.ByStartPointEndPoint(recCen,recSideCen)
			midPt = lin.PointAtParameter(0.5)
			recSidePts = recSide.Points
			closePt1 = closestPoint(midPt,recSidePts)
			closePt2 = closestPoint(midPt,recPts)
			closePt3 = closestPoint(closePt1,recPts)
			if closePt3 == closePt2 : 
				edge = Line.ByStartPointEndPoint(closePt1,closePt2)
				edge = edgeRedo(rec,edge)				
			else : 
				edge = Line.ByStartPointEndPoint(closePt3,closePt2)
			edgeL.Add(edge)
			closeL.Add([closePt1,closePt2])
		closePtList.Add(closeL)
		edgeL = edgeCleaner(edgeL)		
		edgeList.Add(edgeL)
		
	return edgeList
#----------------------------------------------------------------------------------------------------------------------------------------------

#to clean duplicate items in a list------------------------------------------------------------------------------------------------------------
def edgeCleaner(edgeList):
	copEdgeList = edgeList[:]
	if len(edgeList) > 1:
		for i in range(len(edgeList)-1):		
			edge1 = edgeList[i]
			edge2 = edgeList[i+1]			
			if edge1.PointAtParameter(0.5) == edge2.PointAtParameter(0.5) and edge1.Length == edge2.Length : 
				del copEdgeList[i+1]		
	return copEdgeList
#----------------------------------------------------------------------------------------------------------------------------------------------
#to convert curves to lines--------------------------------------------------------------------------------------------------------------------
def convToLine(edgeList):
	lineList=[]
	for i in range(len(edgeList)):
		lineL=[]
		for j in range(len(edgeList[i])):
			lineL.Add(Line.ByStartPointEndPoint(edgeList[i][j].StartPoint,edgeList[i][j].EndPoint))
		lineList.Add(lineL)
	return lineList
#---------------------------------------------------------------------------------------------------------------------------------------------
#to compute the exact edge on the rec which corresponds to the common intersected edge found---------------------------------------------------
def edgeRedo(rec,edge):
	finalEdgeList = []
	recVecList = []
	recLineList = []
	vecEdge = Vector.ByTwoPoints(edge.StartPoint,edge.EndPoint)
	recPts  = rec.Points
	
	midEdge = edge.PointAtParameter(0.5)
	
	recVecList.Add(Vector.ByTwoPoints(recPts[0],recPts[1]))
	recVecList.Add(Vector.ByTwoPoints(recPts[1],recPts[2]))
	recVecList.Add(Vector.ByTwoPoints(recPts[2],recPts[3]))
	recVecList.Add(Vector.ByTwoPoints(recPts[3],recPts[0]))
	
	recLineList.append(Line.ByStartPointEndPoint(recPts[0],recPts[1]))
	recLineList.append(Line.ByStartPointEndPoint(recPts[1],recPts[2]))
	recLineList.append(Line.ByStartPointEndPoint(recPts[2],recPts[3]))
	recLineList.append(Line.ByStartPointEndPoint(recPts[3],recPts[0]))
	
	newLineList=[]
	distList =[]
	for i in range(len(recVecList)):
		recVec = recVecList[i]
		ang = Vector.AngleBetween(vecEdge,recVec)
		finalEdgeList.append(ang)
		if int(ang) == 0 :
			mid = recLineList[i].PointAtParameter(0.5)
			dist = midEdge.DistanceTo(mid)
			distList.Add(dist)
			newLineList.Add(recLineList[i])
			
	checkDist = 10000000000000000000000	
	for i in range(len(newLineList)):
		if distList[i] < checkDist:
			index = i
			checkDist = distList[i]			
	return newLineList[index]
#----------------------------------------------------------------------------------------------------------------------------------------------




out = edgePicker(emptyBox,type)
#out = findCommonEdges(emptyBox,type)
#out = findCloseRects(emptyBox,type)
#Assign your output to the OUT variable
OUT = out
#OUT = polytoRect(emptyBox[0])
# ----------------------------------------
core_placer_points_strat_2 = Python(IN[0]=boxMaker, IN[1]=shell_type_2, IN[2]=core_freq, IN[3]=core_dimension, IN[4]=edge_picker_strat2)
# ---------- core_placer_points_strat_2.python (134 lines) ----------
import clr
clr.AddReference('ProtoGeometry')
from Autodesk.DesignScript.Geometry import *
import math
#The inputs to this node will be stored as a list in the IN variable.
dataEnteringNode = IN

emptyBox = IN[0]
type     = IN[1]
inputLen = IN[2]
coreDim  = IN[3]
edgeList = IN[4]


#get the shorter dimension---------------------------------------------------------------
def getShorterDim(rec):
	width	=	rec.Width
	length	=	rec.Height
	points = 	rec.Points
	diagDist = Line.ByStartPointEndPoint(points[0],points[2]).Length
	if(width<=length): 
		shortEdge	= width
		longEdge	= length
	else: 
		shortEdge 	= length
		longEdge  	= width
	return shortEdge,longEdge,diagDist
	#return longEdge,shortEdge
# END OF FUNCTION ------------------------------------------------------------------------


#makes the core rectangle based on number of req it has---------------------------------------------------------------------------------------
def makeCoreBox(rec,numCore,wid,ht,longEdge):
	coreList=[]
	cen = rec.Center()
	pts = rec.Points
	ptPlaceList = []
	#when just need to place one core
	if numCore ==1:
		cs = CoordinateSystem.ByOrigin(cen)
		coreRec= Rectangle.ByWidthHeight(cs,wid,ht)
		coreList.append(coreRec)
		ptPlaceList.append(cen)
	#when more than one core needs to be placed
	else:
		len1 = Line.ByStartPointEndPoint(pts[0],pts[1]).Length
		len2 = Line.ByStartPointEndPoint(pts[0],pts[3]).Length
		#find the longer edge and that line
		if len1 == longEdge:
			lin = Line.ByStartPointEndPoint(pts[0],pts[1])
		else:
			lin = Line.ByStartPointEndPoint(pts[0],pts[3])			
		linCen = lin.PointAtParameter(0.5)
		vec = Vector.ByTwoPoints(linCen,cen)
		linNew = lin.Translate(vec)
		#divide the line to get the points to place core		
		linNewLen = linNew.Length
		perDist = linNewLen/(numCore+1)
		
		#prepare the pointlist
		for i in range(numCore):
			pt = linNew.PointAtDistance((i+1)*perDist)
			ptPlaceList.append(pt)
	return ptPlaceList
#---------------------------------------------------------------------------------------------------------------------------------------------

# function which places core boxes into the empty boxes----------------------------------------------------------------------------------------
def getNumCores(boxList):		
	numCoresList=[]
	lenMeasure = inputLen
	wid = coreDim
	ht = coreDim
	for i in range(len(boxList)):
		rec = boxList[i]
		shortEdge = getShorterDim(rec)[0]
		longEdge = getShorterDim(rec)[1]
		diagDist = getShorterDim(rec)[2]
		if longEdge > lenMeasure :
			numCore = int(math.ceil(longEdge/lenMeasure))	
		else :
			numCore=1
		numCoresList.append(numCore)
	return numCoresList
#----------------------------------------------------------------------------------------------------------------------------------------------




def placeCorePoints(boxList,edgeList):
	pointList=[]
	numCoreList = getNumCores(boxList)
	
	finCoreList=[]
	ptFinalList=[]
	for i in range(len(boxList)):
		edgeL = edgeList[i]
		recL = boxList[i]
		numCores = numCoreList[i]
		getCore = 0
		corePlaced =0
		coreList =[]
		count = 0
		while corePlaced < numCores:
			#fill in 0 to initiate the coreList for 1st time
			if count == 0:
				for j in range(len(edgeL)):
					coreList.Add(0)				
			for j in range(len(edgeL)):
				corePlaced += 1
				if corePlaced > numCores : break				
				coreList[j] += 1				
			count += 1
		finCoreList.Add(coreList)
		ptPlaceList = []
		for j in range(len(edgeL)):
			edge = edgeL[j]
			coresEdge = coreList[j]
			perDist = edge.Length/(coresEdge+1)	
			for k in range(coresEdge):
					
				pt = edge.PointAtDistance((k+1)*perDist)
				ptPlaceList.append(pt)
		ptFinalList.Add(ptPlaceList)
			
	 	
	return ptFinalList





out = placeCorePoints(emptyBox,edgeList)
#Assign your output to the OUT variable
OUT = out
# ----------------------------------------
service_core_components_strat_2 = Python(IN[0]=block_width_height.out0, IN[1]=block_width_height.out1, IN[2]=basepoint_maker, IN[3]=number_of_elevators_needed, IN[4]=area_per_elevator, IN[5]=tag_switch.A, IN[6]=elevator_dimensions, IN[7]=user_inputs.restroom_Prop, IN[8]=user_inputs.techroom_Prop, IN[9]=lift_lobby_width, IN[10]=core_placer_points_strat_2)
# ---------- service_core_components_strat_2.python (263 lines) ----------
import clr
clr.AddReference('ProtoGeometry')
from Autodesk.DesignScript.Geometry import *
import math
import sys
sys.path.append("C:\Program Files (x86)\IronPython 2.7\Lib")
import random
#The inputs to this node will be stored as a list in the IN variable.
dataEnteringNode = IN

flr_WidthList		=	IN[0]
flr_HeightList		=	IN[1]
twr_BaseptList		=	IN[2]
num_passElev		=	IN[3][0]
num_servElev		=	IN[3][1]

passElev_Area		=	IN[4]
servElev_Area		=	IN[4]
tag					=	IN[5]
elevWidth			=	IN[6][0]
elevLength			=	IN[6][1]
restroomProp		=	IN[7]
techrmProp			=	IN[8]
liftLobbyWidth		=	IN[9]
corePtList			=	IN[10]




#compute service core width, length, and serviceCore====================================================================================================
def serviceCoreMaker(ptL):
	global area_banks, area_restroom,area_servmodule
	rd = random.uniform(0,1)
	#calc total area for service core for the tower
	serviceCore_Area 	= area_banks + area_restroom + area_servmodule;
	serviceCore_Area	= serviceCore_Area/len(ptL)
	area_banks			= area_banks/len(ptL)
	area_restroom		= area_restroom/len(ptL)
	area_servmodule		= area_servmodule/len(ptL)
	
	servCore_WidthL = []
	servCore_LengthL = []
	coreVerticesL = []
	b_FacL =[]
	serviceCore_RecL = []
	for i in range(len(ptL)):
		pt = ptL[i]			
		#calc aspect ratio of floor plate
		aspect_Ratio 		= 	flr_Width/flr_Height
		
		#adjust aspectratio
		if aspect_Ratio < 0.65 : aspect_Ratio = 0.75
		if aspect_Ratio > 1.3 : aspect_Ratio = 1.2
		#calc service core length and width
		if rd>0.5:
			servCore_Length 	=	math.sqrt(serviceCore_Area/aspect_Ratio)
			servCore_Width		=	serviceCore_Area/servCore_Length	
		else:
			servCore_Width		=	math.sqrt(serviceCore_Area/aspect_Ratio)
			servCore_Length 	=	serviceCore_Area/servCore_Width	
		
	
		# get the coordinates of center pt
		x,y,z 					= 	pt.X,pt.Y,pt.Z	
		#make the service core rectangle object--------------------------------------------------------------------------------------------------------------1
		cs					= 	CoordinateSystem.ByOrigin(x,y,z)
		serviceCore_Rec 	= 	Rectangle.ByWidthHeight(cs,servCore_Width,servCore_Length)
		serviceCore_Rec 	=	orientFixNEW(serviceCore_Rec,twr_Basept,pt,servCore_Width,servCore_Length)
		
		
		
		coreVertices		=	serviceCore_Rec.Points
		servCore_WidthL.append(servCore_Width)
		servCore_LengthL.append(servCore_Length)
		coreVerticesL.append(coreVertices)
		serviceCore_RecL.append(serviceCore_Rec)
	#comput elev bank factor--------------------------------------------------------------------
	b_Fac				=	area_banks/serviceCore_Area
	#return serviceCore_Rec,b_Fac,coreVertices,area_banks,area_banks,area_servmodule
	return servCore_WidthL,servCore_LengthL,coreVerticesL,b_Fac,serviceCore_RecL



#function to make boxes based off of width, length and vertices===========================================================================================
def makeBox(widthL,lengthL,verticesL,factor,tag):
	new_RecL=[]
	other_RecL=[]
	for i in range(len(widthL)):
		width = widthL[i]
		length = lengthL[i]
		vertices = verticesL[i]
		
		#calculate the shorter of width or height of service core
		if ( tag == 0):
			if (width < length):
				new_Length 		=	length
				new_Width		=	factor*width
				other_Length 	=	length
				other_Width		=	width - new_Width
				index			=	3		
			else:
				new_Width		=	width	
				new_Length		=	factor*length
				other_Width 	=	width
				other_Length	=	length - new_Length
				index			=	2
		else:
			if (width > length):
				new_Length 		=	length
				new_Width		=	factor*width
				other_Length 	=	length
				other_Width		=	width - new_Width
				index			=	3		
			else:
				new_Width		=	width	
				new_Length		=	factor*length
				other_Width 	=	width
				other_Length	=	length - new_Length
				index			=	2		
	
		
		cs1					= 	CoordinateSystem.ByOrigin(vertices[0].X,vertices[0].Y,0)
		cs2					= 	CoordinateSystem.ByOrigin(vertices[index].X,vertices[index].Y,0)
		# to make the primary rectangle ----------------------------------------------------------------------	
		new_Rec 			= 	Rectangle.ByWidthHeight(cs1,new_Width,new_Length)	
		new_Vec				= 	Vector.ByTwoPoints(new_Rec.Points[0],vertices[0])
		new_Rec				=	Geometry.Translate(new_Rec, new_Vec)
		ptsnew_Rec			=	new_Rec.Points
		# to make the secondary rectangle ----------------------------------------------------------------------	
		other_Rec 			= 	Rectangle.ByWidthHeight(cs2,other_Width,other_Length)	
		other_Vec			= 	Vector.ByTwoPoints(other_Rec.Points[index],vertices[index])
		other_Rec			=	Geometry.Translate(other_Rec, other_Vec)
		ptsother_Rec		=	other_Rec.Points
		
		new_RecL.append(new_Rec)
		other_RecL.append(other_Rec)
	
	return [new_RecL,other_RecL]
#============================================================================================================================================================



#make post computations======================================================================================================================================
def coreConfigurator(b_Fac):
	#make the elevator bank rectangle object-----------------------------------------------------1	
	bank_RecL			=	makeBox(servCore_Width,servCore_Length,coreVertices,b_Fac,tag)
	bank_RecLNew = []
	for i in range(len(bank_RecL)):
		bank_Rec = 	bank_RecL[i]
		widtry1				=	bank_Rec[0].Width
		lentry1				=	bank_Rec[0].Height
				
		# code to readjust the bank rectangle piece based on the final tech rooms and restroom blocks
		if ( widtry1<lentry1):
			shortEdge		=	widtry1
			marked			=	0	
		else:
			shortEdge		=	lentry1
			marked			=	1
				
		if (elevWidth<elevLength):elevEdge = elevWidth
		else:elevEdge =	elevLength			
		numE				=	int(shortEdge / elevEdge)
		numE				+=	1
			
		newDim				=	numE*elevEdge
		if ( marked ==0): ratio	= widtry1/newDim
		else: ratio	= lentry1/newDim
		b_Fac				=	ratio*b_Fac
		#bank_RecL			=	makeBox(servCore_Width,servCore_Length,coreVertices,b_Fac,tag)
		
	return bank_RecL
	#-------------------------------------------------------------------------------------------------
#============================================================================================================================================================
#to fix the orientation of the serviceCores-----------------------------------------------------------
def orientFixNEW(servCore,twr_Basept,crPt,wid,ht):
	vecX = Vector.XAxis()
	vecY = Vector.YAxis()
	
	vecMain = Vector.ByTwoPoints(crPt,twr_Basept)
	vecMainNormal = vecMain.Normalized()
	
	valX = vecMainNormal.X * vecX.X
	valY = vecMainNormal.Y * vecY.Y
	
	if valX < 0:
		vecX = vecX.Reverse()
		pass
	if valY < 0:
		vecY = vecY.Reverse()
		pass

		
	angX = Vector.AngleBetween(vecMain,vecX) 
	angY = Vector.AngleBetween(vecMain,vecY)
	if angX <= 80 and angX >= 0: # 50 & 10 .... 100 & 10
		vecMain = vecX.Scale(wid/2)		
		servCore = servCore.Translate(vecMain)
	if angY <= 80 and angY >= 0:
		vecMain = vecY.Scale(ht/2)
		servCore = servCore.Translate(vecMain)
	"""
	if angX == 0: # 50 & 10 .... 100 & 10
		vecMain = vecX.Scale(wid/2)		
		servCore = servCore.Translate(vecMain)
	if angY == 0:
		vecMain = vecY.Scale(ht/2)
		servCore = servCore.Translate(vecMain)
		
	"""	
	return servCore
#-----------------------------------------------------------------------------------------------------


#iterate through all the blocks and output lists for each---------------------------------------------
outList=[]
bankRecList= []
otherRecList=[]
areaRestrmList=[]
areaServModList=[]
servCoreList=[]

perc = 1.1

for i in range(len(twr_BaseptList)):

	flr_Width  = flr_WidthList[i]
	flr_Height = flr_HeightList[i]
	twr_Basept = twr_BaseptList[i]
	corePts	   = corePtList[i]
	
	#globals var, computer area banks, area restrm, area techrms--------------------------------------------------------------------------------------------
	cirProp = liftLobbyWidth/1.5
	
	area_banks			= servElev_Area*num_servElev[i]/perc + passElev_Area*num_passElev[i]/perc
	area_banks			+=cirProp*area_banks # added the circulation area
	area_restroom 		= restroomProp*area_banks								
	area_servmodule 	= techrmProp*area_banks
	
	
	#OUTPUT VALUES-------------------------------------------------------
	vals 				= 	serviceCoreMaker(corePts)
	servCore_Width		=	vals[0]
	servCore_Length		=	vals[1]
	coreVertices		=	vals[2]
	b_Fac				=	vals[3]
	serviceCore_Rec		=	vals[4]
	bank_Rec 			= 	coreConfigurator(b_Fac)	
	
	bankRecList.append(bank_Rec[0])
	otherRecList.append(bank_Rec[1])
	areaRestrmList.append(area_restroom)
	areaServModList.append(area_servmodule)
	servCoreList.append(serviceCore_Rec)
	
	

out = bankRecList,otherRecList,areaRestrmList,areaServModList,servCoreList

#out = servCoreList,flr_WidthList[0]/flr_HeightList[0]
#Assign your output to the OUT variable
OUT = out
#OUT = flr_WidthList,flr_HeightList
# ----------------------------------------
edge_picker_strat3 = Python(IN[0]=boxMaker, IN[1]=shell_type_2, IN[2]=core_freq, IN[3]=core_dimension)
# ---------- edge_picker_strat3.python (250 lines) ----------
import clr
clr.AddReference('ProtoGeometry')
from Autodesk.DesignScript.Geometry import *
import math
#The inputs to this node will be stored as a list in the IN variable.
dataEnteringNode = IN

emptyBox = IN[0]
type = IN[1]
inputLen = IN[2]
coreDim = IN[3]

#finds number of closest rectangle pieces to find---------------------------------------------------------------------------------------------
def adjacencyList(type):
	adjList = []
	if type ==1: adjList = [0]
	if type ==2: adjList = [1,1]
	if type ==3: adjList = [1,2,1]
	if type ==4: adjList = [2,2,2,2]	
	return adjList
#---------------------------------------------------------------------------------------------------------------------------------------------

#finds the closest point from a list of points------------------------------------------------------------------------------------------------
def closestPoint(ptA,ptBList):
	distList=[]
	for i in range(len(ptBList)):
		ptB = ptBList[i]
		dist = ptA.DistanceTo(ptB)
		distList.append(dist)

	sortDistList = distList[:]
	sortDistList.sort()
	
	for i in range(len(sortDistList)):
		for j in range(len(sortDistList)):
			if sortDistList[0] == distList[j]: closePtList = ptBList[j]
		break
	return closePtList
#---------------------------------------------------------------------------------------------------------------------------------------------
#to convert curves to lines--------------------------------------------------------------------------------------------------------------------
def convToLine(edgeList):
	lineList=[]
	for i in range(len(edgeList)):
		lineL=[]
		for j in range(len(edgeList[i])):
			lineL.Add(Line.ByStartPointEndPoint(edgeList[i][j].StartPoint,edgeList[i][j].EndPoint))
		lineList.Add(lineL)
	return lineList
#---------------------------------------------------------------------------------------------------------------------------------------------

#find the common edges between two boxes------------------------------------------------------------------------------------------------------
def findCloseRects(boxList,type):
	indexList = []
	adjList = adjacencyList(type)
	distList=[]
	sortDistList = []
	for i in range(len(boxList)):
		rec = boxList[i]
		recCen = rec.Center()
		distL =[]
		sortL =[]
		indexL=[]		
		for j in range(len(boxList)):
			rec2 = boxList[j]
			recCen2 = rec2.Center()
			dist = recCen.DistanceTo(recCen2)
			#done to make sure further away rectangles dont counted as being close
			v1 = Vector.ByTwoPoints(recCen,recCen2)
			if v1.Length != 0:
				str = "1st enetered"
				vangX = v1.AngleBetween(Vector.XAxis())
				vangY = v1.AngleBetween(Vector.YAxis())
				if type == 4:				
					if int(vangX) == 0 or int(vangY) == 0:
						str ="2nd entered"
						dist = 900000000000000000000000000	
				if type == 5:
					if int(vangX) <30 or int(vangY) <30:
						str ="2nd entered"
						dist = 1		
			
			distL.append(dist)
			
		sortList = distL[:]
		sortList.sort()
		sortL.Add(sortList)
		sortDistList.Add(sortList)
		distList.Add(distL)
		
	indexList=[]
	for i in range(len(distList)):
		distL = distList[i]
		sortL = sortDistList[i]
		numAdj = adjList[i]
		indexL=[]
		for k in range(numAdj):			
			for j in range(len(distL)):			
				if sortL[k+1] == distL[j]:
					index = j
					indexL.append(index)
					#break
		indexList.append(indexL)
	
	return indexList
#---------------------------------------------------------------------------------------------------------------------------------------------



#finds common edges between neighboring rect pieces---------------------------------------------------------------------------------------------
def findCommonEdges(boxList,type):
	TAG = 0
	edgeList = []
	closePtList = []
	indexList = findCloseRects(boxList,type)
	for i in range(len(boxList)):
		rec = boxList[i]
		recCen = rec.Center()
		recPts = rec.Points
		indexL = indexList[i]
		edgeL =[]
		closeL =[]
		for j in range(len(indexL)):
			ind = indexL[j]
			recSide = boxList[ind]
			recSideCen = recSide.Center()
			lin = Line.ByStartPointEndPoint(recCen,recSideCen)
			midPt = lin.PointAtParameter(0.5)
			recSidePts = recSide.Points
			closePt1 = closestPoint(midPt,recSidePts)
			closePt2 = closestPoint(midPt,recPts)
			closePt3 = closestPoint(closePt1,recPts)
			if closePt3 == closePt2 : 
				edge = Line.ByStartPointEndPoint(closePt1,closePt2)
				edge = edgeRedo(rec,edge)				
			else : 
				edge = Line.ByStartPointEndPoint(closePt3,closePt2)
			edgeL.Add(edge)
			closeL.Add([closePt1,closePt2])
		closePtList.Add(closeL)
		edgeL = edgeCleaner(edgeL)		
		edgeList.Add(edgeL)
		
	return edgeList
#----------------------------------------------------------------------------------------------------------------------------------------------

#adds more edges to the list which are not common----------------------------------------------------------------------------------------------
def addEdge(boxList,type):
	finalEdgeList = []
	commonEdgeList = findCommonEdges(emptyBox,type)
	
	for i in range(len(boxList)):
		rec = boxList[i]
		recPts = rec.Points
		
		l1 = Line.ByStartPointEndPoint(recPts[0],recPts[1])
		l2 = Line.ByStartPointEndPoint(recPts[1],recPts[2])
		l3 = Line.ByStartPointEndPoint(recPts[2],recPts[3])
		l4 = Line.ByStartPointEndPoint(recPts[3],recPts[0])
		
		l1Mid = l1.PointAtParameter(0.5)
		l2Mid = l2.PointAtParameter(0.5)
		l3Mid = l3.PointAtParameter(0.5)
		l4Mid = l4.PointAtParameter(0.5)
		
		commonEdgeL = commonEdgeList[i]
		copiedEdgesL = commonEdgeL[:]
		if len(commonEdgeL) > 1: 
			finalEdgeList.append(copiedEdgesL)	
			continue		
		for j in range(len(commonEdgeL)):
			edge = commonEdgeL[j]
			edgeMid = edge.PointAtParameter(0.5)
			if edgeMid.X == l1Mid.X and edgeMid.Y == l1Mid.Y :
				copiedEdgesL.append(l3)
				break
				pass
			if edgeMid.X == l2Mid.X and edgeMid.Y == l2Mid.Y :
				copiedEdgesL.append(l4)
				break
				pass
			if edgeMid.X == l3Mid.X and edgeMid.Y == l3Mid.Y :
				copiedEdgesL.append(l1)
				break
				pass
			if edgeMid.X == l4Mid.X and edgeMid.Y == l4Mid.Y :
				copiedEdgesL.append(l2)
				break
				pass
		finalEdgeList.append(copiedEdgesL)	
	
	return finalEdgeList
#----------------------------------------------------------------------------------------------------------------------------------------------

#to clean duplicate items in a list------------------------------------------------------------------------------------------------------------
def edgeCleaner(edgeList):
	copEdgeList = edgeList[:]
	if len(edgeList) > 1:
		for i in range(len(edgeList)-1):		
			edge1 = edgeList[i]
			edge2 = edgeList[i+1]			
			if edge1.PointAtParameter(0.5) == edge2.PointAtParameter(0.5) and edge1.Length == edge2.Length : 
				del copEdgeList[i+1]		
	return copEdgeList
#----------------------------------------------------------------------------------------------------------------------------------------------

#to compute the exact edge on the rec which corresponds to the common intersected edge found---------------------------------------------------
def edgeRedo(rec,edge):
	finalEdgeList = []
	recVecList = []
	recLineList = []
	vecEdge = Vector.ByTwoPoints(edge.StartPoint,edge.EndPoint)
	recPts  = rec.Points
	
	midEdge = edge.PointAtParameter(0.5)
	
	recVecList.Add(Vector.ByTwoPoints(recPts[0],recPts[1]))
	recVecList.Add(Vector.ByTwoPoints(recPts[1],recPts[2]))
	recVecList.Add(Vector.ByTwoPoints(recPts[2],recPts[3]))
	recVecList.Add(Vector.ByTwoPoints(recPts[3],recPts[0]))
	
	recLineList.append(Line.ByStartPointEndPoint(recPts[0],recPts[1]))
	recLineList.append(Line.ByStartPointEndPoint(recPts[1],recPts[2]))
	recLineList.append(Line.ByStartPointEndPoint(recPts[2],recPts[3]))
	recLineList.append(Line.ByStartPointEndPoint(recPts[3],recPts[0]))
	
	newLineList=[]
	distList =[]
	for i in range(len(recVecList)):
		recVec = recVecList[i]
		ang = Vector.AngleBetween(vecEdge,recVec)
		finalEdgeList.append(ang)
		if int(ang) == 0 :
			mid = recLineList[i].PointAtParameter(0.5)
			dist = midEdge.DistanceTo(mid)
			distList.Add(dist)
			newLineList.Add(recLineList[i])
			
	checkDist = 10000000000000000000000	
	for i in range(len(newLineList)):
		if distList[i] < checkDist:
			index = i
			checkDist = distList[i]			
	return newLineList[index]
#----------------------------------------------------------------------------------------------------------------------------------------------



out = addEdge(emptyBox,type)
#Assign your output to the OUT variable
OUT = out
# ----------------------------------------
core_placer_points_strat_3 = Python(IN[0]=boxMaker, IN[1]=shell_type_2, IN[2]=core_freq, IN[3]=core_dimension, IN[4]=edge_picker_strat3)
# ---------- core_placer_points_strat_3.python (139 lines) ----------
import clr
clr.AddReference('ProtoGeometry')
from Autodesk.DesignScript.Geometry import *
import math
import sys
sys.path.append("C:\Program Files (x86)\IronPython 2.7\Lib")
import random
#The inputs to this node will be stored as a list in the IN variable.
dataEnteringNode = IN

emptyBox = IN[0]
type     = IN[1]
inputLen = IN[2]
coreDim  = IN[3]
edgeList = IN[4]


#get the shorter dimension---------------------------------------------------------------
def getShorterDim(rec):
	width	=	rec.Width
	length	=	rec.Height
	points = 	rec.Points
	diagDist = Line.ByStartPointEndPoint(points[0],points[2]).Length
	if(width<=length): 
		shortEdge	= width
		longEdge	= length
	else: 
		shortEdge 	= length
		longEdge  	= width
	return shortEdge,longEdge,diagDist
	#return longEdge,shortEdge
# END OF FUNCTION ------------------------------------------------------------------------


#makes the core rectangle based on number of req it has---------------------------------------------------------------------------------------
def makeCoreBox(rec,numCore,wid,ht,longEdge):
	coreList=[]
	cen = rec.Center()
	pts = rec.Points
	ptPlaceList = []
	#when just need to place one core
	if numCore ==1:
		cs = CoordinateSystem.ByOrigin(cen)
		coreRec= Rectangle.ByWidthHeight(cs,wid,ht)
		coreList.append(coreRec)
		ptPlaceList.append(cen)
	#when more than one core needs to be placed
	else:
		len1 = Line.ByStartPointEndPoint(pts[0],pts[1]).Length
		len2 = Line.ByStartPointEndPoint(pts[0],pts[3]).Length
		#find the longer edge and that line
		if len1 == longEdge:
			lin = Line.ByStartPointEndPoint(pts[0],pts[1])
		else:
			lin = Line.ByStartPointEndPoint(pts[0],pts[3])			
		linCen = lin.PointAtParameter(0.5)
		vec = Vector.ByTwoPoints(linCen,cen)
		linNew = lin.Translate(vec)
		#divide the line to get the points to place core		
		linNewLen = linNew.Length
		perDist = linNewLen/(numCore+1)
		
		#prepare the pointlist
		for i in range(numCore):
			pt = linNew.PointAtDistance((i+1)*perDist)
			ptPlaceList.append(pt)
	return ptPlaceList
#---------------------------------------------------------------------------------------------------------------------------------------------

# function which places core boxes into the empty boxes----------------------------------------------------------------------------------------
def getNumCores(boxList):		
	numCoresList=[]
	lenMeasure = inputLen
	wid = coreDim
	ht = coreDim
	for i in range(len(boxList)):
		rec = boxList[i]
		shortEdge = getShorterDim(rec)[0]
		longEdge = getShorterDim(rec)[1]
		diagDist = getShorterDim(rec)[2]
		if longEdge > lenMeasure :
			numCore = int(math.ceil(longEdge/lenMeasure))	
		else :
			numCore=1
		numCoresList.append(numCore)
	return numCoresList
#----------------------------------------------------------------------------------------------------------------------------------------------




def placeCorePoints(boxList,edgeList):
	pointList=[]
	numCoreList = getNumCores(boxList)
	
	finCoreList=[]
	ptFinalList=[]
	for i in range(len(boxList)):
		edgeL = edgeList[i]
		recL = boxList[i]
		numCores = numCoreList[i]
		getCore = 0
		corePlaced =0
		coreList =[]
		count = 0
		while corePlaced < numCores:
			#fill in 0 to initiate the coreList for 1st time
			if count == 0:
				for j in range(len(edgeL)):
					coreList.Add(0)				
			for j in range(len(edgeL)):
				corePlaced += 1
				if corePlaced > numCores : break				
				coreList[j] += 1				
			count += 1
		finCoreList.Add(coreList)
		ptPlaceList = []
		for j in range(len(edgeL)):
			edge = edgeL[j]
			coresEdge = coreList[j]
			perDist = edge.Length/(coresEdge+1)	
			for k in range(coresEdge):
				if coresEdge == 1:
					pt = edge.PointAtParameter(random.uniform(0.2,0.8))
				else:					
					pt = edge.PointAtDistance((k+1)*perDist)
				ptPlaceList.append(pt)
		ptFinalList.Add(ptPlaceList)
			
	 	
	return ptFinalList





out = placeCorePoints(emptyBox,edgeList)
#Assign your output to the OUT variable
OUT = out
# ----------------------------------------
service_core_components_strat_3 = Python(IN[0]=block_width_height.out0, IN[1]=block_width_height.out1, IN[2]=basepoint_maker, IN[3]=number_of_elevators_needed, IN[4]=area_per_elevator, IN[5]=tag_switch.A, IN[6]=elevator_dimensions, IN[7]=user_inputs.restroom_Prop, IN[8]=user_inputs.techroom_Prop, IN[9]=lift_lobby_width, IN[10]=core_placer_points_strat_3)  # same code as service_core_components_strat_2
integer_slider = IntegerSlider(53, range=0..100 step 1)
random_strategies = Python(IN[0]=service_core_components_strat_1, IN[1]=service_core_components_strat_2, IN[2]=service_core_components_strat_3, IN[3]=integer_slider)
# ---------- random_strategies.python (42 lines) ----------
import clr
clr.AddReference('ProtoGeometry')
from Autodesk.DesignScript.Geometry import *

import sys
sys.path.append("C:\Program Files (x86)\IronPython 2.7\Lib")
import random
#The inputs to this node will be stored as a list in the IN variable.
dataEnteringNode = IN


strat1 = IN[0]
strat2 = IN[1]
strat3 = IN[2]


randInp = random.randint(1,15)
if randInp <= int(7) : 
	out = strat1
	strat = "Strategy 1"
elif randInp > 7 and randInp <= 10  : 
	out = strat2
	strat = "Strategy 2"
else : 
	out = strat3
	strat = "Strategy 3"
	
	
"""
if randInp <= 0.6 : 
	out = strat1
	strat = "Strategy 1"
if randInp > 0.6 and randInp <= 0.85  : 
	out = strat2
	strat = "Strategy 2"
else : 
	out = strat3
	strat = "Strategy 3"
"""

#Assign your output to the OUT variable
OUT = out,randInp,strat
# ----------------------------------------
code_block = CodeBlock(a=random_strategies) { a[0]; }
servicecore_types = CodeBlock(serviceCore_Types=code_block) { serviceCore_Types; }
other_part_service_area = CodeBlock(a=servicecore_types) { a[1]; }
area_RestRooms = CodeBlock(a=servicecore_types) { a[2]; }
area_service_module_tech_rooms = CodeBlock(a=servicecore_types) { a[3]; }
area_generator_restroom_techroom = Python(IN[0]=other_part_service_area, IN[1]=area_RestRooms, IN[2]=area_service_module_tech_rooms)
# ---------- area_generator_restroom_techroom.python (55 lines) ----------
import clr
clr.AddReference('ProtoGeometry')
from Autodesk.DesignScript.Geometry import *
#The inputs to this node will be stored as a list in the IN variable.
dataEnteringNode = IN

otherRecList = IN[0]
restRmAreaL  = IN[1]
techRmAreaL  = IN[2]



#proportion generator for restrm Area and Techroom Area---------------------------------------------------
def propGenerator():
	propTechL=[]
	propRestL = []
	for i in range(len(otherRecList)):
		techArea = techRmAreaL[i]
		restrmArea = restRmAreaL[i]
		propTechArea = techArea/(techArea+restrmArea)
		propRestArea = 1-propTechArea
		propTechL.append(propTechArea)
		propRestL.append(propRestArea)
	return propTechL,propRestL
#---------------------------------------------------------------------------------------------------------

#main Code called and run---------------------------------------------------------------------------------
def mainCode():
	areaRestrmList=[]
	areaTechrmList=[]
	propL = propGenerator()
	for i in range(len(otherRecList)):
		otherRecL = otherRecList[i]	
		propTech = propL[0][i]	
		propRest = propL[1][i]
		restAreaL = []
		techAreaL = []
		for j in range(len(otherRecL)):
			rec = otherRecL[j]
			recArea = rec.Width * rec.Height
			techArea = propTech * recArea
			restArea = propRest * recArea
			techAreaL.append(techArea)
			restAreaL.append(restArea)
		areaTechrmList.append(techAreaL)
		areaRestrmList.append(restAreaL)			

	return areaTechrmList, areaRestrmList
#--------------------------------------------------------------------------------------------------------


out = mainCode()
#Assign your output to the OUT variable
#OUT = [areaTechrmList, areaRestrmList]
OUT = out
# ----------------------------------------
area_tech_rooms_final = CodeBlock(a=area_generator_restroom_techroom) { a[0]; }
area_RestRooms_Final = CodeBlock(a=area_generator_restroom_techroom) { a[1]; }
technical_rooms_restrooms = Python(IN[0]=other_part_service_area, IN[1]=area_tech_rooms_final, IN[2]=area_RestRooms_Final)
# ---------- technical_rooms_restrooms.python (170 lines) ----------
import clr
clr.AddReference('ProtoGeometry')
from Autodesk.DesignScript.Geometry import *
#The inputs to this node will be stored as a list in the IN variable.
dataEnteringNode = IN

import sys
sys.path.append("C:\Program Files (x86)\IronPython 2.7\Lib")
import random

wrapperRectL		=	IN[0]
areaTechnicalL		=	IN[1]
areaRestrmL			=	IN[2]







#function to make three rectangle pieces for tech rooms and restroom----------------------------------
def makeThreePiece(width,length,pts,f1,f2):
	if (width > length):
		rec1Length 		=	f1*length
		rec1Width		=	width
		
		rec2Length 		=	f2*length
		rec2Width		=	width
		
		rec3Length 		=	length - rec1Length - rec2Length
		rec3Width		=	width
		
		index			=	1		
	else:
		rec1Length 		=	length
		rec1Width		=	f1*width
		
		rec2Length 		=	length
		rec2Width		=	f2*width
		
		rec3Length 		=	length
		rec3Width		=	width - rec1Width - rec2Width
		
		index			=	3
	
	cs1					= 	CoordinateSystem.ByOrigin(pts[0].X,pts[0].Y,0) 
	
	# to make the 1st rectangle ----------------------------------------------------------------------	
	rec1 				= 	Rectangle.ByWidthHeight(cs1,rec1Width,rec1Length)	
	rec1Vec				= 	Vector.ByTwoPoints(rec1.Points[0],pts[0])
	rec1				=	Geometry.Translate(rec1, rec1Vec)
	rec1Pt				=	rec1.Points	
	cs1					= 	CoordinateSystem.ByOrigin(rec1Pt[0].X,rec1Pt[0].Y,0)
	
	# to make the 2nd rectangle ----------------------------------------------------------------------	
	rec2 				= 	Rectangle.ByWidthHeight(cs1,rec2Width,rec2Length)	
	rec2Vec				= 	Vector.ByTwoPoints(rec2.Points[0],rec1Pt[index])
	rec2				=	Geometry.Translate(rec2, rec2Vec)
	rec2Pt				=	rec2.Points	
	cs1					= 	CoordinateSystem.ByOrigin(rec2Pt[0].X,rec2Pt[0].Y,0)
	
	# to make the 2nd rectangle ----------------------------------------------------------------------	
	rec3 				= 	Rectangle.ByWidthHeight(cs1,rec3Width,rec3Length)	
	rec3Vec				= 	Vector.ByTwoPoints(rec3.Points[0],rec2Pt[index])
	rec3				=	Geometry.Translate(rec3, rec3Vec)
	
	return rec1,rec2,rec3
#END OF FUNCTION#-------------------------------------------------------------------------------------


#function to make three rectangle pieces for tech rooms and restroom----------------------------------
def makeTwoPiece(width,length,pts,f1,f2,flip):
	if flip ==0:
		if (width > length):
			rec1Length 		=	f1*length
			rec1Width		=	width
			
			rec2Length 		=	length-rec1Length#f2*length
			rec2Width		=	width
					
			index			=	1		
		else:
			rec1Length 		=	length
			rec1Width		=	f1*width
			
			rec2Length 		=	length
			rec2Width		=	width-rec1Width#f2*width
				
			index			=	3
	else:
		if (width < length):
			rec1Length 		=	f1*length
			rec1Width		=	width
			
			rec2Length 		=	length-rec1Length#f2*length
			rec2Width		=	width
					
			index			=	1		
		else:
			rec1Length 		=	length
			rec1Width		=	f1*width
			
			rec2Length 		=	length
			rec2Width		=	width-rec1Width#f2*width
				
			index			=	3
	
	cs1					= 	CoordinateSystem.ByOrigin(pts[0].X,pts[0].Y,0) 
	
	# to make the 1st rectangle ----------------------------------------------------------------------	
	rec1 				= 	Rectangle.ByWidthHeight(cs1,rec1Width,rec1Length)	
	rec1Vec				= 	Vector.ByTwoPoints(rec1.Points[0],pts[0])
	rec1				=	Geometry.Translate(rec1, rec1Vec)
	rec1Pt				=	rec1.Points	
	cs1					= 	CoordinateSystem.ByOrigin(rec1Pt[0].X,rec1Pt[0].Y,0)
	
	# to make the 2nd rectangle ----------------------------------------------------------------------	
	rec2 				= 	Rectangle.ByWidthHeight(cs1,rec2Width,rec2Length)	
	rec2Vec				= 	Vector.ByTwoPoints(rec2.Points[0],rec1Pt[index])
	rec2				=	Geometry.Translate(rec2, rec2Vec)
	rec2Pt				=	rec2.Points	
	
	return rec1,rec2
#END OF FUNCTION#-------------------------------------------------------------------------------------
#main function called and executed----------------------------------------------------------------------
def mainCode():
	outT = []
	outR1 = []
	outR2 = []
	
	for i in range(len(wrapperRectL)):
		#tag = random.randint(0,1)
		# incoming rectangle specifications
		wrapR = wrapperRectL[i]
		recListTech=[]
		recListRest1=[]
		recListRest2=[]
		for j in range(len(wrapR)):
			wrapPts			=	wrapR[j].Points
			wrapWidth		=	wrapR[j].Width
			wrapLength		=	wrapR[j].Height
			#added to make the cut direction------------------------------
			if wrapWidth > wrapLength : ratio = wrapLength/wrapWidth
			else : ratio = wrapWidth/wrapLength			
			if ratio < 0.4 : tag = 1
			else: tag = 0 
			
			#----------------------------------------------------------------------------------------
				
			totArea			=	wrapWidth * wrapLength
			facT			=	areaTechnicalL[i][j] / totArea
			facR			=	areaRestrmL[i][j] / totArea
			
			
			
			recA = makeTwoPiece(wrapWidth,wrapLength,wrapPts,0.6,0.4,tag)
			recB = makeTwoPiece(recA[1].Width,recA[1].Height,recA[1].Points,0.5,0.5,1)
			recListTech.append(recA[0])
			recListRest1.append(recB[0])
			recListRest2.append(recB[1])
			
		outT.append(recListTech)
		outR1.append(recListRest1)
		outR2.append(recListRest2)
	return outT,outR1,outR2
#-------------------------------------------------------------------------------------------------------

#Assign your output to the OUT variable
#OUT = [techRec1,otherRec]
OUT = mainCode()
# ----------------------------------------
toilets = CodeBlock(Toilet=technical_rooms_restrooms) { Toilet[1]; }
technical_rooms = CodeBlock(Toilet=technical_rooms_restrooms) { Toilet[0]; Toilet[2]; }
technical_room_arrangements = Python(IN[0]=technical_rooms.out0)
# ---------- technical_room_arrangements.python (94 lines) ----------
import clr
clr.AddReference('ProtoGeometry')
from Autodesk.DesignScript.Geometry import *
import math
#import random
#The inputs to this node will be stored as a list in the IN variable.
dataEnteringNode = IN

mainRecList		=	IN[0]

#---------------------------------------------------------------



# 1 = LONGITUDINAL CUT		0 = TRAVERSAL CUT
#make boxes inside--------------------------------------------------------------------------------
def splitRec(rec,f1,tag):
	recPoints	=	rec.Points
	width		=	rec.Width
	length		=	rec.Height
	#make the four edges of the input rectangle
	lineList	=	[]
	for i in range(len(recPoints)):
		if(i== len(recPoints)-1):
			k = 0
		else:
			k = i+1
		ptA		=	recPoints[i]
		ptB		=	recPoints[k]
		lin		=	Line.ByStartPointEndPoint(ptA,ptB)
		lineList.append(lin)
		
	#pick two points on the shorter lines
	len1	=	lineList[0].Length
	len2	=	lineList[1].Length
	if (tag == 1):
		if (len1<len2):
			lineShort1	=	lineList[0]
			lineShort2	=	lineList[2]
		else:
			lineShort1	=	lineList[1]
			lineShort2	=	lineList[3]
	else:
		if (len1>len2):
			lineShort1	=	lineList[0]
			lineShort2	=	lineList[2]
		else:
			lineShort1	=	lineList[1]
			lineShort2	=	lineList[3]
		
		
	ptOut1	=	lineShort1.PointAtParameter(f1)
	ptOut2	=	lineShort2.PointAtParameter(1-f1)
	stPt1	=	lineShort1.StartPoint
	endPt1	=	lineShort1.EndPoint
	stPt2	=	lineShort2.StartPoint
	endPt2	=	lineShort2.EndPoint
	# make the new rectangle by corner points !! SEQUENCE OF CORNER POINTS MIGHT BE AN ISSUE
	outRec1	=	Rectangle.ByCornerPoints(stPt1,endPt2,ptOut2,ptOut1)
	outRec2	=	Rectangle.ByCornerPoints(stPt2,endPt1,ptOut1,ptOut2)
		
	#return lineShort1,lineShort2,ptOut1,ptOut2,width,length,outRec1,outRec2
	return outRec1,outRec2
	#return lineList
#END OF FUNCTION# --------------------------------------------------------------------------------


finalList=[]
for i in range(len(mainRecList)):
	mainRecL = mainRecList[i]
	getList = []
	for j in range(len(mainRecL)):
		mainRec 		= 	mainRecL[j]
		outList			=	[]
		twoLinearRecs	=	splitRec(mainRec,0.60,0)
		rec1			=	twoLinearRecs[0]
		rec2			=	twoLinearRecs[1]
		for k in range(3):
			#fac		=	random.random()
			fac 	=	0.35
			out1 	=	splitRec(rec1,fac,0)
			outList.append(out1)
			rec1	=	out1[1]			
			out2 	=	splitRec(rec2,fac,0)
			outList.append(out2)
			rec2	=	out2[1]		
		getList.append(outList)
	finalList.append(getList)
	
	

#Assign your output to the OUT variable
#OUT = lineStoreList,lineList,restrmPoints,shortLine,finalPoint
OUT = finalList
# ----------------------------------------
floor_curve = CodeBlock(floorcrv=boxMaker) { floorcrv; }
buildSections = CodeBlock { buildSections = 3; }
building_sections_per_volume = Python(IN[0]=floor_curve, IN[1]=buildSections)
# ---------- building_sections_per_volume.python (16 lines) ----------
import clr
clr.AddReference('ProtoGeometry')
from Autodesk.DesignScript.Geometry import *
#The inputs to this node will be stored as a list in the IN variable.
dataEnteringNode = IN

spaceList = IN[0]
buildSec = IN[1]

buildSecs = []
for i in range(len(spaceList)):
	buildSecs.append(buildSec)
	

#Assign your output to the OUT variable
OUT = buildSecs
# ----------------------------------------
GBA = CodeBlock(grossBuildingArea=gba_floor_area) { grossBuildingArea; }
bank_rectangle_piece = CodeBlock(Bank_Rectangle=servicecore_types) { Bank_Rectangle[0]; }
transpose = List.Transpose(number_of_elevators_needed)
total_elevs_per_block = Python(IN[0]=transpose)
# ---------- total_elevs_per_block.python (19 lines) ----------
import clr
clr.AddReference('ProtoGeometry')
from Autodesk.DesignScript.Geometry import *
#The inputs to this node will be stored as a list in the IN variable.
dataEnteringNode = IN


elevLists = IN[0]

num = len(elevLists)
finLists=[]
for i in range(num):
	finLists.append(sum(elevLists[i]))


	

#Assign your output to the OUT variable
OUT = finLists
# ----------------------------------------
intersect = Geometry.Intersect(geometry=bank_rectangle_piece, other=other_part_service_area)
max_elevators = IntegerSlider(5, range=2..33 step 1)
latest_new_elevator_packings = Python(IN[0]=bank_rectangle_piece, IN[1]=elevator_dimensions, IN[2]=total_elevs_per_block, IN[3]=lift_lobby_width, IN[4]=other_part_service_area, IN[5]=intersect, IN[6]=max_elevators)
# ---------- latest_new_elevator_packings.python (518 lines) ----------
import clr
clr.AddReference('ProtoGeometry')
from Autodesk.DesignScript.Geometry import *
import math
#The inputs to this node will be stored as a list in the IN variable.
dataEnteringNode = IN

mainRecL	=	IN[0]
elevWidth	=	IN[1][0]
elevLength	=	IN[1][1]
totElev		=	IN[2]
lobbyWidth	=	IN[3]
servicRecL	=	IN[4]
interLineL	=	IN[5]
maxElevs	=	IN[6]





#FIRST CALLS **********************************************************************************************************************************FIRST CALLS
#to calc how many sub rectangles the elevbankrect needs to be split-------------------------
def getNumRects():
	#very imp transition@@@@@@@@@@@
	recShort	=	otherLen1
	recLong		=	commonLen	
	elevShort	=	getElevShorterDim(elevWidth,elevLength)[0]
	numRects	=	1	
	approx_numElevs	=	int(math.floor(recLong/elevShort))

	#Added to make total num of Elevs always even
	if approx_numElevs%2 > 0: approx_numElevs += 1
	#-----------------------------------------------		
	elevShort 	=	recLong/approx_numElevs		
	while approx_numElevs > maxElevs:
		numRects += 1
		approx_numElevs = int(approx_numElevs/2)	
	return int(numRects)
#------------------------------------------------------------------------------------------num,mainRec



#to subdivide given rect to num of rects based on a num------------------------------------
def subDivRect(num,mainRec):	
	numRects = getNumRects()
	numRects = num
	if numRects < 2 : 
		return "no need to split"
	
	recList = []
	length1 = commonLen
	length2 = otherLen1
	
	dimension = length1/numRects

	startRec = mainRec
	for i in range(numRects):		
		try:
			rec = splitBox(startRec,dimension,length2)
		except:
			recList.append(rec[1])
			return recList			
		recList.append(rec[0])		
		startRec = rec[1]			
	return recList
#------------------------------------------------------------------------------------------



#function to scale rectangles to add in corridors in between elevators-------------------------------------------------------------
def scaledRects(recLists):
	#make new recLists
	newRecs = recLists[:]
	del newRecs[0]
	del newRecs[-1]
	
	
	endRecs = [recLists[0],recLists[-1]]
	
	outRec=[]
	for rec in newRecs:
		pts = rec.Points
		basePt = pts[0]
		wid = rec.Width
		length = rec.Height
		
		l1 = Line.ByStartPointEndPoint(pts[0],pts[1])
		l2 = Line.ByStartPointEndPoint(pts[0],pts[3])
		
		len1 = l1.Length
		len2 = l2.Length
		fac = 0.75 # hardcoded
		
		#prepare basept, p1 and p2 from Scale1D
		if wid == len1: 
			fromPt = pts[1]
			toPt = l1.PointAtParameter(fac)
			midPt = l1.PointAtParameter(0.5)
		else: 
			fromPt = pts[3]
			toPt = l2.PointAtParameter(fac)
			midPt = l2.PointAtParameter(0.5)
		
		#find the vector to translate the scaled rect		
		pCrv = rec.Scale1D(basePt,fromPt,toPt)
		crv = pCrv.Curves()
		ptsNew = [x.StartPoint for x in crv]
			
		lNew1 = Line.ByStartPointEndPoint(ptsNew[0],ptsNew[1])
		lNew2 = Line.ByStartPointEndPoint(ptsNew[0],ptsNew[3])
			
		if wid == len1: midPtNew = lNew1.PointAtParameter(0.5)
		else: midPtNew = lNew2.PointAtParameter(0.5)
			
			
		#make the vec for translation
		vec= Vector.ByTwoPoints(midPtNew,midPt)
		pCrv = pCrv.Translate(vec)
		
		#block to make rectangle
		crv = pCrv.Curves()
		ptsNew = [x.StartPoint for x in crv]		
		rec = Rectangle.ByCornerPoints(ptsNew[0],ptsNew[3],ptsNew[2],ptsNew[1])
		outRec.append(rec)
			
		
	#code to work on the first and last rectangles.	
	for i in range(len(endRecs)):
		if (i==0):pass
		rec = endRecs[i]
		
		pts = rec.Points
		basePt = pts[0]
		wid = rec.Width
		length = rec.Height
		
		l1 = Line.ByStartPointEndPoint(pts[0],pts[1])
		l2 = Line.ByStartPointEndPoint(pts[0],pts[3])
		
		len1 = l1.Length
		len2 = l2.Length
		fac = 0.9 # hardcoded
		
		#prepare basept, p1 and p2 from Scale1D
		if wid == len1: 
			fromPt = pts[1]
			toPt = l1.PointAtParameter(fac)
			midPt = l1.PointAtParameter(0.5)
		else: 
			fromPt = pts[3]
			toPt = l2.PointAtParameter(fac)
			midPt = l2.PointAtParameter(0.5)
		
		
		
		#find the vector to translate the scaled rect		
		pCrv = rec.Scale1D(basePt,fromPt,toPt)
		crv = pCrv.Curves()
		if(i>0):
			ptsNew = [x.StartPoint for x in crv]
			
			lNew1 = Line.ByStartPointEndPoint(ptsNew[0],ptsNew[1])
			lNew2 = Line.ByStartPointEndPoint(ptsNew[0],ptsNew[3])
			
			if wid == len1: midPtNew = lNew1.PointAtParameter(fac/2)
			else: midPtNew = lNew2.PointAtParameter(fac/2)
		
			#make the vec for translation
			vec= Vector.ByTwoPoints(midPtNew,midPt)
			pCrv = pCrv.Translate(vec)

		#block to make rectangle
		crv = pCrv.Curves()
		ptsNew = [x.StartPoint for x in crv]		
		rec = Rectangle.ByCornerPoints(ptsNew[0],ptsNew[3],ptsNew[2],ptsNew[1])
		
		endRecs[i] = rec
		#break	
		
		
	#finally merge all components
	finList=[]		
	finList.extend([endRecs[0]])
	finList.extend(outRec)
	finList.extend([endRecs[-1]])
		
	return finList
#-----------------------------------------------------------------------------------------------------------------------------------
#FIRST CALLS **********************************************************************************************************************************FIRST CALLS

#get the shorter dimension---------------------------------------------------------------
def getShorterDim(rec):
	width	=	rec.Width
	length	=	rec.Height
	if(width<=length): 
		shortEdge	= width
		longEdge	= length
	else: 
		shortEdge 	= length
		longEdge  	= width
	return shortEdge,longEdge
	#return longEdge,shortEdge
# END OF FUNCTION ------------------------------------------------------------------------

#get the shorter dimension---------------------------------------------------------------
def getElevShorterDim(width,length):
	if(width<length): 
		shortEdge	= width
		longEdge	= length
	else: 
		shortEdge = length
		longEdge  = width
	return shortEdge,longEdge
	#return longEdge,shortEdge
# END OF FUNCTION ------------------------------------------------------------------------

#====================================================================================================================================================================================
#make rects based on dimension given------------------------------------------------------------------------
def splitBox(rec,dim,length):
	recPts	=	rec.Points
	#make four lines for the input rectangles
	lin0		=	Line.ByStartPointEndPoint(recPts[0],recPts[1])#0
	lin1		=	Line.ByStartPointEndPoint(recPts[1],recPts[2])#1
	lin2 		=	Line.ByStartPointEndPoint(recPts[2],recPts[3])#2
	lin3		=	Line.ByStartPointEndPoint(recPts[3],recPts[0])#3
	# get the first point of first line
	firstPt		=	lin0.StartPoint
	
	# get the length and lines for those edges whose length matches input length
	if lin0.Length >= length-0.005 and lin0.Length <= length+0.005: 
		bigDimension = lin1.Length
		lineShort1 = lin1
		lineShort2 = lin3				
	if lin1.Length >= length-0.005 and lin1.Length <= length+0.005: 
		bigDimension = lin0.Length
		lineShort1 = lin0
		lineShort2 = lin2
	
	#get the points to make the two rectangles
	f1 		=	dim/bigDimension
	ptOut1	=	lineShort1.PointAtParameter(f1)
	ptOut2	=	lineShort2.PointAtParameter(1-f1)
	stPt1	=	lineShort1.StartPoint
	endPt1	=	lineShort1.EndPoint
	stPt2	=	lineShort2.StartPoint
	endPt2	=	lineShort2.EndPoint
	
	# make the new rectangle by corner points !! SEQUENCE OF CORNER POINTS MIGHT BE AN ISSUE
	rec1	=	Rectangle.ByCornerPoints(stPt1,endPt2,ptOut2,ptOut1)
	rec2	=	Rectangle.ByCornerPoints(ptOut1,ptOut2,stPt2,endPt1)
	#get the center points for two rects
	rec1Cen	=	rec1.Center()
	rec2Cen = 	rec2.Center()
	#get the vectors from the first pt
	vec1	=	Vector.ByTwoPoints(firstPt,rec1Cen)
	vec2	=	Vector.ByTwoPoints(firstPt,rec2Cen)
	#compare the length of the vectors to get how far are they from start pt
	vcLen1 	=	vec1.Length
	vcLen2 	=	vec2.Length
	#finally set them as the final ouput rect
	if vcLen1 < vcLen2 :
		outRec1 = 	rec1
		outRec2 = 	rec2
	else:
		outRec1 = 	rec2
		outRec2 = 	rec1	
			
	return outRec1,outRec2
#---------------------------------------------------------------------------------------------------------------	
	
#main function making the elevator packings------------------------------------------------
def makeElevBox(bkRec,commonLen,otherLen1):
	inpRec = []
	inpRec.append(bkRec)

	elevDims	=	getElevShorterDim(elevWidth,elevLength)
	elevShort	=	elevDims[0]
	elevLong	=	elevDims[1]
	
	longCounter = 	0
	listDims	=	[]
	frstPtList	=	[]
	count		=	0
	
	#very imp transition@@@@@@@@@@@
	recShort	=	otherLen1
	recLong		=	commonLen
		
	numElevs	=	int(math.floor(recLong/elevShort))
	#"""
	#Added to make total num of Elevs always even
	if numElevs%2 > 0: 
		numElevs += 1
		#elevShort = recLong/numElevs
	#-----------------------------------------------

	elevShort 	=	recLong/numElevs	
	areaElev 	=	elevShort*commonLen

	
	
	cap = 5		
	#BLOCK TO MAKE LIST OF DIMENSIONS TO PREPARE ELEV ROWS AND LOBBY PLACEMENTS
	#@@@@@@@@@@@@@@@@@@@@@@@@@@@@@@@@@@@@@@@@@@@@@@@@@@@@@@@@@@@@@@@@@@@@@@@@@@@@@@@@@@@@@@@@@@@@@@@@@@@@@@@@@@@@@@@@@@@@@@@@@@@@@@@@@@@@@@@@	
	#loop till you catch up with the dimension longitudinally
	while (cap>0):
		longCounter += elevLong
		if (longCounter > recShort): # recShort replaced by otherLen   +++ longCounter > recShort-0.005 and longCounter < recShort+0.005
			break
		listDims.append(elevLong)
		if (count%2 ==0):
			longCounter += lobbyWidth	
			if (longCounter > recShort):# recShort replaced by otherLen
				break
			listDims.append(lobbyWidth)			
		count		+= 1
	ct = 0
	lobbies = 0
	# test to check whole length added
	for i in range(len(listDims)):
		ct += listDims[i]
		if (listDims[i] == lobbyWidth):
			lobbies += 1
	#if lobbies == 0: lobbies =1
	#get the left over space
	leftOver =  recShort - ct
	perBayAdd=  leftOver/lobbies
	perBayAdd+=	0.002
	
	# distribute it to the lift lobbies
	if (perBayAdd > 0):
		for i in range(len(listDims)):
			if (listDims[i] == lobbyWidth):
				listDims[i] += perBayAdd + 0.002
	
	#added to make sure the total dimension not exceeding
	if sum(listDims)>otherLen1:
		extra = sum(listDims)-otherLen1
		listDims[-1] -= extra
	
	recLists = []
	stRec	 = bkRec

	index1 = 0
	index2 = 1
	longDim = getShorterDim(servicRec)[1]
	#@@@@@@@@@@@@@@@@@@@@@@@@@@@@@@@@@@@@@@@@@@@@@@@@@@@@@@@@@@@@@@@@@@@@@@@@@@@@@@@@@@@@@@@@@@@@@@@@@@@@@@@@@@@@@@@@@@@@@@@@@@@@@@@@@@@@@@@@	
	
	str =""
	prnList=[]
	#BLOCK TO MAKE ELEVATOR ROWS
	#@@@@@@@@@@@@@@@@@@@@@@@@@@@@@@@@@@@@@@@@@@@@@@@@@@@@@@@@@@@@@@@@@@@@@@@@@@@@@@@@@@@@@@@@@@@@@@@@	
	for i in range(len(listDims)-1):		
		try:
			rec = splitBox(stRec,listDims[i],commonLen)		
			prnList.append("DID IT")
		except:
			#nRec = stRec.Reverse
			#rec = splitBox(nRec,listDims[i],commonLen)	
			str =  "Not Done"
			prnList.append("FAILED")
			#continue
		recLists.append(rec[0])
		#frstPtList.append(rec[2])
		stRec = rec[1]
		if (i==len(listDims)-2): 
			recLists.append(rec[1])
			prnList.append("LAST CASE")
			#break
	
	#make the list of elevator row first
	elevRowLists = []
	copRecLists =  []
	str = "dont know"
	strN= ""
	for i in range(len(recLists)):
		if i ==0: dimA = listDims[i+1]		
		#if dimA != listDims[i]: copRecLists.append(recLists[i])		

		if i != 0 and dimA !=listDims[i-1] and i == len(recLists)-1 : 
			pass
		elif dimA != listDims[i]: copRecLists.append(recLists[i])
			
		#copRecLists = list(recLists[i] if dimA == listDims[i]:)
	
	#@@@@@@@@@@@@@@@@@@@@@@@@@@@@@@@@@@@@@@@@@@@@@@@@@@@@@@@@@@@@@@@@@@@@@@@@@@@@@@@@@@@@@@@@@@@@@@@@
	
	#BLOCK TO PLACE ELEVATOR BOXES IN THE ROWS
	#@@@@@@@@@@@@@@@@@@@@@@@@@@@@@@@@@@@@@@@@@@@@@@@@@@@@@@@@@@@@@@@@@@@@@@@@@@@@@@@@@@@@@@@@@@@@@@@@
	str2 = ""
	recElevs=[]
	recElevsRow=[]
	for i in range(len(copRecLists)):
		stRec = copRecLists[i]
		elevRow=[]
		shorter = getShorterDim(stRec)[0]
		for j in range(int(numElevs)-1):		
			try:
				rec = splitBox(stRec,elevShort+0.0002,shorter)				
			except:
				#continue
				stt = ""
			stRec = rec[1]
			elevRow.append(rec[0])
			if j==int(numElevs)-2: 
				elevRow.append(rec[1])
			
			#frstPtList.append(rec[2])
			recElevs.append(rec)
			str2 =  " all added" 
		recElevsRow.append(elevRow)
	#@@@@@@@@@@@@@@@@@@@@@@@@@@@@@@@@@@@@@@@@@@@@@@@@@@@@@@@@@@@@@@@@@@@@@@@@@@@@@@@@@@@@@@@@@@@@@@@@	
	totalElev = [len(x) for x in recElevsRow]
	sumtotalElev = sum(totalElev)
	#return recLists,listDims,recDims[0],copRecLists,recElevs,len(recElevs)
	return recElevsRow


def mainCode(mainRec):
	numRc = getNumRects()
	if numRc >=2:
		aRects = subDivRect(getNumRects(),mainRec)
		subRects = scaledRects(aRects)
	else:
		subRects = [mainRec]
	outL = []
	strList=[]
	for i in range(numRc):
		
		bankRec = subRects[i]
		comLen = interLine.Length/numRc
		
		# set commonLength and otherLength
		if (comLen == bankRec.Width): 
			otrLen = bankRec.Height
		elif (comLen == bankRec.Height): 
			otrLen = bankRec.Width
		elif (bankRec.Width<bankRec.Height):
			comLen = bankRec.Width
			otrLen = bankRec.Height
		else:
			comLen = bankRec.Height
			otrLen = bankRec.Width
				
		out = makeElevBox(bankRec,comLen,otrLen)
		outL.append(out)
	return outL
	
#function to see rectangle size ---------------------------------------------------------------------------------------------
def sizeChecker(rec,dim):
	wid = rec.Width
	ht = rec.Height	
	if wid < dim or ht < dim:
		return False
	else: return True
#----------------------------------------------------------------------------------------------------------------------------

"""
mainRecL	=	IN[0]
elevWidthL	=	IN[1][0]
elevLengthL	=	IN[1][1]
totElevL	=	IN[2]
lobbyWidth	=	IN[3]
servicRecL	=	IN[4]
interLineL	=	IN[5][0]
maxElevs	=	IN[6]

"""

outF=[]
interLine  = interLineL[0]
testLen=[]
for i in range(len(mainRecL)):
	#1st Block lev handling each rect block
	coreInside = mainRecL[i]
	#outF.append(len(coreInside))
	interLine  = interLineL[i][0][0]
	
	"""
	if len(coreInside) <1:
		out ="More Than One Cores , Cant Handle"
		#pass
	else:
	"""
	out1=[]
	for j in range(len(coreInside)):
		interLine  = interLineL[i][j][0]
		commonLen	=	float(interLine.Length)
		otherLen1	=	0
		mainRec 	= 	coreInside[j]
		bankRec 	= 	mainRec
		servicRec 	=	servicRecL[i][j]
			
		#if sizeChecker(mainRec,8) == False: break
			
		if (commonLen > mainRec.Width-0.005 and commonLen < mainRec.Width+0.005): otherLen1 = float(mainRec.Height)
		if (commonLen > mainRec.Height-0.005 and commonLen < mainRec.Height+0.005): otherLen1 = float(mainRec.Width)
		out = mainCode(mainRec)
		testLen.append(otherLen1)
		out1.append(out)
	outF.append(out1)
		

		
	










#Assign your output to the OUT variable
#OUT = out,numRc,subRects,bankRec
OUT = outF
# ----------------------------------------
oneList = Python(IN[0]=latest_new_elevator_packings, IN[1]=intersect)
# ---------- oneList.python (164 lines) ----------
import clr
clr.AddReference('ProtoGeometry')
from Autodesk.DesignScript.Geometry import *
#The inputs to this node will be stored as a list in the IN variable.
dataEnteringNode = IN

listElevsList = IN[0]
interLineList = IN[1]





#make one list of the whole elev sublists---------------------------------
def oneList():
	return [z for x in listElevs for y in x for z in y]
#-------------------------------------------------------------------------


#to get the sorted elevs based on distance from closest point to the intersect line---------------------------------------------------------------------
def newSortElevs():
	sortedRect=[]
	avgRecList=[]
	recList = oneList()
	closePtList =[]	
	distList = []
	for i in range(len(recList)):
		recPt = recList[i].Center()		
		closePt = Geometry.ClosestPointTo(interLine[0],recList[i])
		closePtList.append(closePt)
		dist = Line.ByStartPointEndPoint(closePt,recPt).Length
		distList.append(dist)
	
	copyRecList = recList[:]
	sortedDistList = distList[:]
	sortedDistList.sort()
	
	for i in range(len(recList)):
		sortDis = sortedDistList[i]
		for j in range(len(copyRecList)):
			if sortDis == distList[j]:
				found = copyRecList[j]
				del copyRecList[j]
				del distList[j]
				break
		sortedRect.append(found)
	#return distList,sortedDistList,recList,sortedRect,copyRecList
	return sortedRect
#-----------------------------------------------------------------------------------------------------------------------------------------------------------

#calc number of elev per row---------------------------------------------------------------------------------------------------------------------------------
def numElevsperRow():
	for i in range(len(listElevs)):
		x = len(listElevs)
		y = len(listElevs[0][0])
		val = x*y
		break
	return val
#-----------------------------------------------------------------------------------------------------------------------------------------------------------

#make one list into lists as per rows of elev----------------------------------------------------------------------------------------------------------------
def makeListRow():
	numElevsRow = numElevsperRow()
	sortedElevList = newSortElevs()
	
	#create list of elevators who are combined together per row.
	num = int(len(oneList())/numElevsRow)
	megaList=[]	
	for i in range(num):
		x = i*numElevsRow
		alist = []
		for j in range(x,x+numElevsRow):			
			alist.append(sortedElevList[j])
		megaList.append(alist)
	return megaList
#-----------------------------------------------------------------------------------------------------------------------------------------------------------

#sort the rows based on the start point of instersect line--------------------------------------------------------------------------------------------------
def sortSecondRun():
	rowElevList = makeListRow()
	stPoint = interLine[0].PointAtParameter(0)

	# get the distance list for each row
	fullDistance=[]
	for i in range(len(rowElevList)):
		recList = rowElevList[i]
		disList=[]		
		for j in range(len(recList)):
			rec = recList[j]
			dist = Line.ByStartPointEndPoint(stPoint,rec.Center()).Length
			disList.append(dist)
		fullDistance.append(disList)
	
	
	#sort the distance list
	sortedDistList = fullDistance[:]
	copyElevs = rowElevList[:]
	for i in range(len(sortedDistList)):
		sortedDistList[i] = fullDistance[i][:]
		copyElevs[i] = rowElevList[i][:]
		sortedDistList[i].sort()
	
	#make the new recLists sorted
	for i in range(len(rowElevList)):
		recList = rowElevList[i]
		sortList = sortedDistList[i]
		distList1 = fullDistance[i]
				
		for j in range(len(sortList)):
			rec = recList[j]
			sortdis = sortList[j]
			newRec=[]
			for k in range(len(sortList)):
				if float(sortdis) == float(distList1[k]):
					rowElevList[i][j] = copyElevs[i][k]					
					break
	rev = []
	for i in range(len(rowElevList)):
		rev.append(rowElevList[-i])
	#return fullDistance,rowElevList,distList1,sortedDistList
	return rowElevList
#-----------------------------------------------------------------------------------------------------------------------------------------------------------




"""
listElevsList = IN[0]
interLineList = IN[1]
"""



fin = []
for i in range(len(listElevsList)):
	listElevL = listElevsList[i]
	interLineL = interLineList[i]
	newL=[]
	for j in range(len(listElevL)):
		listElevs = listElevL[j]
		interLine = interLineL[j]
		result = sortSecondRun()
		newL.append(result)
	fin.append(newL)
















#Assign your output to the OUT variable
#OUT = oneList(),out,makePts(),scaleVals(),newSortElevs(),numElevsperRow(),sortSecondRun()
#OUT = sortSecondRun()
OUT = fin
# ----------------------------------------
separate_bank_maker = Python(IN[0]=oneList, IN[1]=building_sections_per_volume)
# ---------- separate_bank_maker.python (160 lines) ----------
import clr
clr.AddReference('ProtoGeometry')
from Autodesk.DesignScript.Geometry import *
import math
#The inputs to this node will be stored as a list in the IN variable.
dataEnteringNode = IN

elevBoxesList = IN[0]
buildSectionsList=IN[1]





#to fix the sequence of elevators in the elv boxes----------------------------------------------------------------------		
def reverseList():
	global elevBoxes	
	cnt =0
	for i in range(len(elevBoxes)-1):	
		if (i)%2 == 0:
			cnt += 1
			if cnt%2==0:
				str =""
				elevBoxes[i].reverse()
				elevBoxes[i+1].reverse()
#-----------------------------------------------------------------------------------------------------------------------	


#to make one list of input elev lists-----------------------------------------------------------------------------------
def totalElevList():
	newElevBoxes=[]	
	for i in range(len(elevBoxes)):
		elev = elevBoxes[i]
		for j in range(len(elev)):
			newElevBoxes.append(elev[j])
	return newElevBoxes
#-----------------------------------------------------------------------------------------------------------------------	


#to distribute number of elevators per bank based on number elev per row------------------------------------------------
def bankNumbers():
	listElevBoxes=totalElevList()
	totalElevNum = len(listElevBoxes)
	bankNum=[]
	
	perDivision = int(math.floor(totalElevNum/buildSections))
	if (perDivision >= numElevRow): perDivision = numElevRow
	if (perDivision < numElevRow): perDivision = int(numElevRow/2)
	diff = totalElevNum - (perDivision*buildSections)
	
	#perDivision = [numElevRow if perDivision >= numElevRow]
	#perDivision = [numElevRow/2 if perDivision < numElevRow]
	
	if perDivision >=1:
		for i in range(buildSections):
			bankNum.append(perDivision)
		bankNum[-1] += diff
	
	
	#to make all if they all are even numbers
	surplus =0
	for i in range(len(bankNum)):
		if bankNum[i]%2 !=0:
			bankNum[i] -= 1
			surplus	+= 1
	if surplus > 0 : bankNum[-1] += surplus	
	bankNum.sort()
	bankNum.reverse()

	return bankNum
#-----------------------------------------------------------------------------------------------------------------------

#to make separate banks of elevs based on number of building sections---------------------------------------------------
def makePairs():
	str = []
	newElevsList =[]
	for i in range(0,numRows,2): 
		if i == numRows-1:			
			newElevsList.extend(elevBoxes[-1])
			str.append("entered here")
		else:		
			listA = elevBoxes[i]
			listB = elevBoxes[i+1]
			newList = crossLists(listA,listB)
			newElevsList.extend(newList)
			str.append("may be")				
	return newElevsList
#-----------------------------------------------------------------------------------------------------------------------

#to cross two lists togthr and return one list out----------------------------------------------------------------------
def crossLists(listA,listB):
	crossedList = []
	for i in range(len(listA)):
		crossedList.append(listA[i])
		crossedList.append(listB[i])
	return crossedList
#-----------------------------------------------------------------------------------------------------------------------


#to make separate banks of elevs based on number of building sections---------------------------------------------------
def makeBanks():
	#listElevBoxes=totalElevList()
	#totalElevNum = len(listElevBoxes)
	
	listElevBoxes=makePairs()
	totalElevNum = len(listElevBoxes)
	
	elevperBank = bankNumbers()
	elevCount   = 0
	perRowCount = 0
	listBanks=[]
	temp =0	
	for i in range(buildSections):
		elevAtBank =[]
		xVal = elevperBank[i]		
		for j in range(xVal):
			try:
				elevAtBank.append(listElevBoxes[temp+j])
			except:
				print "some error"
			#elevAtBank.append(listElevBoxes[temp+j])
			if ( j == xVal-1): temp = temp + xVal
		listBanks.append(elevAtBank)
	return listBanks
#------------------------------------------------------------------------------------------------------------------------

"""
elevBoxesList = IN[0]
buildSectionsList=IN[1]
"""

outN1=[]
outN2=[]
outTots=[]
for i in range(len(elevBoxesList)):
	elevBoxesL= elevBoxesList[i]
	buildSections = buildSectionsList[i]
	getL1=[]
	getL2=[]
	sum=0
	for j in range(len(elevBoxesL)):
		elevBoxes = elevBoxesL[j]
		numElevRow = len(elevBoxes[0])
		numRows = len(elevBoxes)
		#reverseList()
		out = makeBanks()
		out2 = bankNumbers()
		#crossed = makePairs()
		getL1.append(out)
		getL2.append(out2)
		sum += len(totalElevList())
	outN1.append(getL1)
	outN2.append(getL2)
	outTots.append(sum)



#Assign your output to the OUT variable
OUT = outN1,outN2,outTots
#OUT = out
# ----------------------------------------
number_of_elev_per_bank = CodeBlock(numberElevPerBank=separate_bank_maker) { numberElevPerBank[1]; }
boundary_factor = CodeBlock { boundaryFactor = 0.9; }
num_floors_each_block = Python(IN[0]=floor_maker_2)
# ---------- num_floors_each_block.python (15 lines) ----------
import clr
clr.AddReference('ProtoGeometry')
from Autodesk.DesignScript.Geometry import *
#The inputs to this node will be stored as a list in the IN variable.
dataEnteringNode = IN

flrList = IN[0]

out=[]
for i in range(len(flrList)):
	out.append(flrList[i].Count)


#Assign your output to the OUT variable
OUT = out
# ----------------------------------------
key_floor_finder = Python(IN[0]=building_sections_per_volume, IN[1]=GBA, IN[2]=number_of_elev_per_bank, IN[3]=boundary_factor, IN[4]=area_tech_rooms_final, IN[5]=area_per_elevator, IN[6]=num_floors_each_block)
# ---------- key_floor_finder.python (108 lines) ----------
import clr
clr.AddReference('ProtoGeometry')
from Autodesk.DesignScript.Geometry import *
#The inputs to this node will be stored as a list in the IN variable.
dataEnteringNode = IN

buildSectionsList 	= 	IN[0]
grossBuildAreaList	=	IN[1]
elevPerbankListL	=	IN[2]
boundaryFactor		=	IN[3]
servModAreaList		=	IN[4]
elevArea			=	IN[5]
numFloorsList		=	IN[6]



#compute target area for each bank of elev serving each building section--------------------------------------------------------------------
def targetAreaCalculator(uba,buildSections):
	#output target area list for each bank of elev for each building section
	tarAreaList = []	
	#make the uba array
	totalBuildArea = 0
	for i in range(len(uba)):
		totalBuildArea += uba[i]		
	# compute the fraction
	frac 	=	totalBuildArea/buildSections
	
	#compute the target areas by iterating
	for i in range(1,buildSections+1):
		tarAreaList.append(frac*i)	
	return tarAreaList
#-------------------------------------------------------------------------------------------------------------------------------------------

#ccompute the key floors where the banks of elevators needs to be dropped-------------------------------------------------------------------
def keyFloorFinder():
	currentFloor = 1 # current floor counter
	#computer bank Area for each bank ( from elev Area )
	bankArea = [x*elevArea for x in elevPerbankList] 
	#bankArea = [10000 for x in elevPerbankList] 
	
	# iterate to find usable Build Area first
	ubaList = []
	for i in range(len(grossBuildArea)):
		ubaList.append(grossBuildArea[i]-servModArea)
	#compute the targetAreaList
	tarAreaList = targetAreaCalculator(ubaList,buildSections)
	
	#make the served areas list and key floor list and set as 0 values
	servedAreaList = [0 for x in range(buildSections)]		
	key = [0 for x in range(buildSections)]
	
	while currentFloor <= len(ubaList)-1:
		#iterate to check if target is reached
		for i in range(buildSections):
			if servedAreaList[i] < tarAreaList[i] and tarAreaList[i] - servedAreaList[i] >= ubaList[currentFloor]*boundaryFactor:
				ubaList[currentFloor] = ubaList[currentFloor] - bankArea[i] 
		#iterate to check if target is reached	
		for i in range(buildSections):
			if servedAreaList[i] < tarAreaList[i] and tarAreaList[i] - servedAreaList[i] >= ubaList[currentFloor]*boundaryFactor:
				# update served areas and the key floors
				servedAreaList[i] = servedAreaList[i] + ubaList[currentFloor] 
				key[i]	=	key[i] + 1		
		#still checking if target has been reached
		for i in range(buildSections):
			if servedAreaList[i] > tarAreaList[i] and servedAreaList[i] - tarAreaList[i] >= ubaList[currentFloor] - ubaList[currentFloor]*boundaryFactor:
				servedAreaList[i] = servedAreaList[i] - ubaList[key[i]]
				ubaList[key[i]] = ubaList[key[i]] + bankArea[i] 
				for j in range(i+1,buildSections):
					servedAreaList[j] = servedAreaList[j] + bankArea[i] 
					key[i] = key[i] - 1
		tarAreaList = targetAreaCalculator(ubaList,buildSections)
		currentFloor += 1
	return [key,servedAreaList,tarAreaList,ubaList]
#-------------------------------------------------------------------------------------------------------------------------------------------



finalOut =[]
for i in range(len(grossBuildAreaList)):
	grossBuildArea = grossBuildAreaList[i]
	buildSections = buildSectionsList[i]
	elevL = elevPerbankListL[i]
	servModAreaL = servModAreaList[i]
	keyF=[]
	for j in range(len(servModAreaL)):
		elevPerbankList = elevL[j]		
		servModArea = servModAreaL[j]
		tarAreaList = 	targetAreaCalculator(grossBuildArea,buildSections)
		keyFloors	=	keyFloorFinder()
		
		keysTest = keyFloors[0]
		
		count =0
		for i in range(len(keysTest)):
			if keysTest[i] ==0: count += 1
		if count > len(keysTest)/2:
			for i in range(len(keysTest)):
				keysTest[i] = numFloors
		
		keyFloors[0]	= 	keysTest
		keyF.append(keyFloors)
	finalOut.append(keyF)
		
		

#Assign your output to the OUT variable
#OUT = keysTest#
OUT = finalOut
# ----------------------------------------
key_outputgenerator = Python(IN[0]=key_floor_finder)
# ---------- key_outputgenerator.python (35 lines) ----------
import clr
clr.AddReference('ProtoGeometry')
from Autodesk.DesignScript.Geometry import *
#The inputs to this node will be stored as a list in the IN variable.
dataEnteringNode = IN

keyList = IN[0]



#[key,servedAreaList,tarAreaList,ubaList]
finKeyList=[]
finServedAreaList = []
fintarAreaList = []
finubaList = []
for i in range(len(keyList)):
	keyL = keyList[i]
	finKeyL=[]
	finServedAreaL= []
	fintarAreaL = []
	finubaL = []
	for j in range(len(keyL)):
		key = keyL[j]
		finKeyL.append(key[0])
		finServedAreaL.append(key[1])
		fintarAreaL.append(key[2])
		finubaL.append(key[3])
	finKeyList.append(finKeyL)
	finServedAreaList.append(finServedAreaL)
	fintarAreaList.append(fintarAreaL)
	finubaList.append(finubaL)

out = finKeyList,finServedAreaList,fintarAreaList,finubaList
#Assign your output to the OUT variable
OUT = out
# ----------------------------------------
target_areas_for_banks = CodeBlock(targetAreas=key_outputgenerator) { targetAreas[2]; }
updated_uba = CodeBlock(updatedUBA=key_outputgenerator) { updatedUBA[3]; }
served_areas_by_banks = CodeBlock(servedAreas=key_outputgenerator) { servedAreas[1]; }
ecap = CodeBlock { ecap= 1000; }
feedback_function = Python(IN[0]=updated_uba, IN[1]=served_areas_by_banks, IN[2]=number_of_elev_per_bank, IN[3]=ecap, IN[4]=building_sections_per_volume)
# ---------- feedback_function.python (69 lines) ----------
import clr
clr.AddReference('ProtoGeometry')
from Autodesk.DesignScript.Geometry import *
#The inputs to this node will be stored as a list in the IN variable.
dataEnteringNode = IN

ubaListList 			= 	IN[0]
servedAreaListList		=	IN[1]
numElevPerBankList		=	IN[2]
ecap					=	IN[3]
buildSectionsList		=	IN[4]

#--------------------------------------------------------------------------------------------------------------------

# to compute the efficiency of set elevator layouts------------------------------------------------------------------
def feedBack():
	#make a list of area for building sections
	sections	= [0 for x in range(buildSections)]
	sections[0] = servedAreaList[0] # first building section area
	#isolated building section areas  
	totBankCap = 0
	for i in range(1,buildSections):
		sections[i] = servedAreaList[i] - servedAreaList[i-1]
		# total elevator bank capacity
		totBankCap  +=numElevPerBank[i]*ecap	
	#total UBA
	ubaTotal = 0
	for i in range(len(ubaList)):
		ubaTotal 	+=ubaList[i]
	
	#percentage of uba served by every bank
	percentUBA_Bank	= [0 for x in range(buildSections)]
	#used capacity of the banks
	ucap			= [0 for x in range(buildSections)]
	# added to test errors
	if totBankCap ==0 : totBankCap  =1
	for i in range(buildSections):
		percentUBA_Bank[i] = (sections[i]*100)/ubaTotal
		ucap[i] = (sections[i]*100)/totBankCap
	
	return percentUBA_Bank,ucap	
#--------------------------------------------------------------------------------------------------------------------	

"""
ubaListList 			= 	IN[0]
servedAreaListList		=	IN[1]
numElevPerBankList		=	IN[2]
ecap					=	IN[3]
buildSectionsList		=	IN[4]
"""
outF=[]
for i in range(len(ubaListList)):
	ubaL = ubaListList[i]
	buildSections = buildSectionsList[i]
	
	for j in range(len(ubaL)):
		ubaList = ubaL [j]
		servedAreaList = servedAreaListList[i][j]
		numElevPerBank = numElevPerBankList[i][j]		
		out = feedBack()
	outF.append(out)






#Assign your output to the OUT variable
OUT = outF
# ----------------------------------------
final_num_elevators = Python(IN[0]=oneList)
# ---------- final_num_elevators.python (20 lines) ----------
import clr
clr.AddReference('ProtoGeometry')
from Autodesk.DesignScript.Geometry import *
#The inputs to this node will be stored as a list in the IN variable.
dataEnteringNode = IN

rectListList = IN[0]

finX = []

for i in range(len(rectListList)):# big blocks
	rectL = rectListList[i]
	x=0
	for j in range(len(rectL)):# num cores
		rec = rectL[j]
		x += len(rec[0])*len(rec)
	finX.append(x)

#Assign your output to the OUT variable
OUT = finX
# ----------------------------------------
total_elevator_expected = CodeBlock(totElev_Expected=total_elevs_per_block) { totElev_Expected; }
file_location = CodeBlock { a={"c:\write_Elevators.csv"}; }
translated_floors = CodeBlock(FLOORS=floor_maker_2) { FLOORS; }
techrooms_restrooms = CodeBlock(TECHRMS_RESTRMS=technical_rooms_restrooms) { TECHRMS_RESTRMS; }
code_block_2 = CodeBlock(a=techrooms_restrooms) { b = {a[0]}; }
transpose_2 = List.Transpose(code_block_2)
extruded_tech_rooms = Python(IN[0]=translated_floors, IN[1]=transpose_2)
# ---------- extruded_tech_rooms.python (46 lines) ----------
import clr
clr.AddReference('ProtoGeometry')
from Autodesk.DesignScript.Geometry import *
#The inputs to this node will be stored as a list in the IN variable.
dataEnteringNode = IN

floorsList		=	IN[0]
techRoomsList	=	IN[1]



def extruder():
	extruded=[]
	for i in range(len(techRooms)):
		flr = floors[-1]
		cen = flr.EndPoint
		zVal= cen.Z
		crv = techRooms[i]
		extN = crv.Extrude(zVal)
		extruded.append(extN)
	return extruded

finExt = []
heightlist=[]
for i in range(len(techRoomsList)):
	techRoomsL = techRoomsList[i]
	floors = floorsList[i]
	flr = floors[-1]	
	cen = flr.EndPoint
	zVal= cen.Z
	heightL=[]
	for j in range(len(techRoomsL)):		
		techRooms = techRoomsL[j]
		extruded=[]
		for k in range(len(techRooms)):
			techR = techRooms[k]
			
			extN = techR.ExtrudeAsSolid(zVal)
			extruded.append(extN)
			heightL.append(zVal)
		finExt.append(extruded)
	heightlist.append(heightL)
		
		
#Assign your output to the OUT variable
OUT = finExt,heightlist
# ----------------------------------------
code_block_3 = CodeBlock(a=extruded_tech_rooms) { a[0]; }
vertices = Face.Vertices(code_block_3)
pointFinder = Python(IN[0]=vertices)
# ---------- pointFinder.python (22 lines) ----------
import clr
clr.AddReference('ProtoGeometry')
from Autodesk.DesignScript.Geometry import *
#The inputs to this node will be stored as a list in the IN variable.
dataEnteringNode = IN

vertexList = IN[0]
tupleList = []
for i in range(len(vertexList)):
	ver = vertexList[i]
	for j in range(len(vertexList[i])):
		ver2 = ver[j]
		for k in range(len(ver2)):
			tup = (ver2[k].PointGeometry.X,ver2[k].PointGeometry.Y,ver2[k].PointGeometry.Z)
			tupleList.append(tup)


		


#Assign your output to the OUT variable
OUT = tupleList
# ----------------------------------------
writeToFile = CSV.WriteToFile(file_location, pointFinder)
file_location_2 = CodeBlock { a={"c:\write_ServiceModule.csv"}; }
service_core_full_block = CodeBlock(a=servicecore_types) { a[4]; }
code_block_4 = CodeBlock { A=2; }
offset = Curve.Offset(curve=service_core_full_block, distance=code_block_4)
code_block_5 = CodeBlock { Vector.ZAxis(); h=100; }
code_block_6 = CodeBlock(a=extruded_tech_rooms) { a[1]; }
extrudeAsSolid = Curve.ExtrudeAsSolid(curve=offset, direction=code_block_5.out0, distance=code_block_6)
vertices_2 = Face.Vertices(extrudeAsSolid)
pointFinder_2 = Python(IN[0]=vertices_2)
# ---------- pointFinder_2.python (22 lines) ----------
import clr
clr.AddReference('ProtoGeometry')
from Autodesk.DesignScript.Geometry import *
#The inputs to this node will be stored as a list in the IN variable.
dataEnteringNode = IN

vertexList = IN[0]
tupleList = []
for i in range(len(vertexList)):
	ver = vertexList[i]
	for j in range(len(ver)):
		verO = ver[j]
		for k in range(len(verO)):
			tup = (verO[k].PointGeometry.X,verO[k].PointGeometry.Y,verO[k].PointGeometry.Z)
			tupleList.append(tup)


		


#Assign your output to the OUT variable
OUT = tupleList
# ----------------------------------------
writeToFile_2 = CSV.WriteToFile(file_location_2, pointFinder_2)
floor_plates = CodeBlock(floorSurface=floor_surface) { floorSurface; }
key_floors = CodeBlock(keyFloors=key_outputgenerator) { keyFloors[0]; }
code_block_7 = CodeBlock(a=techrooms_restrooms) { a[1..2]; }
lowlevel_restrms_extruder = Python(IN[0]=key_floors, IN[1]=code_block_7, IN[2]=translated_floors)
# ---------- lowlevel_restrms_extruder.python (42 lines) ----------
import clr
clr.AddReference('ProtoGeometry')
from Autodesk.DesignScript.Geometry import *
#The inputs to this node will be stored as a list in the IN variable.
dataEnteringNode = IN

keyFloorList = IN[0]
restrmList = IN[1]
floorList = IN[2]


#to compute the lower lvl restrm spaces------------------------------
def restrmLowLvlExtruder(keyFloorList,restrmL,floorList):
	extruded = []
	p1		=	Point.ByCoordinates(0,0,0);
	p2		=	Point.ByCoordinates(0,0,100);
	vec		=	Vector.ByTwoPoints(p1,p2)
	for i in range(len(keyFloorList)):
		key1 = keyFloorList[i]
		floorL = floorList[i]
		rest1 = restrmL[i]
		extF=[]
		for j in range(len(key1)):
			key2 = key1[j]
			rest2 = rest1[j]
			floor = floorL[key2[0]]
			zVal = floor.Center().Z
			ext1 = Curve.ExtrudeAsSolid(rest2,vec,zVal)
			extF.append(ext1)
			#extF.append(ext2)
		extruded.append(extF)			
			
	return extruded
#--------------------------------------------------------------------
extF=[]
for i in range(len(restrmList)):
	restrmL = restrmList[i]
	ext = restrmLowLvlExtruder(keyFloorList,restrmL,floorList)
	extF.append(ext)

#Assign your output to the OUT variable
OUT =extF
# ----------------------------------------
code_block_8 = CodeBlock(A=random_strategies) { A[1]; }
code_block_9 = CodeBlock(A=random_strategies) { A[2]; }
elevators = CodeBlock(a=separate_bank_maker) { a[0]; }
variable_height_elevators = Python(IN[0]=translated_floors, IN[1]=key_floors, IN[2]=elevators)
# ---------- variable_height_elevators.python (45 lines) ----------
import clr
clr.AddReference('ProtoGeometry')
from Autodesk.DesignScript.Geometry import *

#The inputs to this node will be stored as a list in the IN variable.
dataEnteringNode = IN

floorsList		=	IN[0]
keyFloorsList	=	IN[1]
elevListList	=	IN[2]

def elevExtruder():
	extruded=[]
	keyFloors.reverse()
	p1		=	Point.ByCoordinates(0,0,0);
	p2		=	Point.ByCoordinates(0,0,100);
	vec		=	Vector.ByTwoPoints(p1,p2)
	for i in range(len(elevList)):
		flr = floors[keyFloors[i]]
		cen = flr.EndPoint
		zVal= cen.Z
		crv = elevList[i]
		geom=[]
		for j in range(len(crv)):
			ext	=	Curve.ExtrudeAsSolid(crv[j],vec,zVal)		
			geom.append(ext)		
		extruded.append(geom)
	return extruded

finExt=[]
for i in range(len(elevListList)):
	floors = floorsList[i]	
	keyFloors = keyFloorsList[i]
	elevList = elevListList[i]
	extL=[]
	for j in range(len(elevList)):	
		keyFloors = keyFloorsList[i][j]
		elevList = elevListList[i][j]	
		ext = elevExtruder()
		extL.append(ext)
	finExt.append(extL)


#Assign your output to the OUT variable
OUT = finExt#finExt
# ----------------------------------------
vertices_3 = Face.Vertices(variable_height_elevators)
all_points = Python(IN[0]=vertices_3)
# ---------- all_points.python (26 lines) ----------
import clr
clr.AddReference('ProtoGeometry')
from Autodesk.DesignScript.Geometry import *
#The inputs to this node will be stored as a list in the IN variable.
dataEnteringNode = IN

vertexList = IN[0]
tupleList = []
for i in range(len(vertexList)):
	ver = vertexList[i]
	for j in range(len(ver)):
		verO = ver[j]
		for k in range(len(verO)):
			verN = verO[k]
			for l in range(len(verN)):
				verM = verN[l]
				for m in range(len(verM)):				
					tup = (verM[m].PointGeometry.X,verM[m].PointGeometry.Y,verM[m].PointGeometry.Z)
					tupleList.append(tup)


		


#Assign your output to the OUT variable
OUT = tupleList
# ----------------------------------------
two_diagonal_point_finder = Python(IN[0]=vertices_3)
# ---------- two_diagonal_point_finder.python (27 lines) ----------
import clr
clr.AddReference('ProtoGeometry')
from Autodesk.DesignScript.Geometry import *
#The inputs to this node will be stored as a list in the IN variable.
dataEnteringNode = IN

vertexList = IN[0]
tupleList = []
for i in range(len(vertexList)):
	ver = vertexList[i]
	for j in range(len(ver)):
		verO = ver[j]
		for k in range(len(verO)):
			verN = verO[k]
			for l in range(len(verN)):
				verM = verN[l]				
				tup = (verM[0].PointGeometry.X,verM[0].PointGeometry.Y,verM[0].PointGeometry.Z)
				tupleList.append(tup)
				tup = (verM[7].PointGeometry.X,verM[7].PointGeometry.Y,verM[7].PointGeometry.Z)
				tupleList.append(tup)


		


#Assign your output to the OUT variable
OUT = tupleList
# ----------------------------------------
point_creator = Python(IN[0]=two_diagonal_point_finder)
# ---------- point_creator.python (15 lines) ----------
import clr
clr.AddReference('ProtoGeometry')
from Autodesk.DesignScript.Geometry import *
#The inputs to this node will be stored as a list in the IN variable.
dataEnteringNode = IN

units = IN[0]
ptList = []
for i in range(len(units)):
	cod = units[i]
	pt = Point.ByCoordinates(cod[0],cod[1],cod[2])
	ptList.append(pt)

#Assign your output to the OUT variable
OUT = ptList
# ----------------------------------------
code_block_10 = CodeBlock(a=point_creator) { a[2..3]; }
edges = Face.Edges(variable_height_elevators)
curveGeometry = Edge.CurveGeometry(edges)
all_points_2 = Python(IN[0]=vertices)
# ---------- all_points_2.python (22 lines) ----------
import clr
clr.AddReference('ProtoGeometry')
from Autodesk.DesignScript.Geometry import *
#The inputs to this node will be stored as a list in the IN variable.
dataEnteringNode = IN

vertexList = IN[0]
tupleList = []
for i in range(len(vertexList)):
	ver = vertexList[i]
	for j in range(len(ver)):
		verM = ver[j]
		for m in range(len(verM)):							
			tup = (verM[m].PointGeometry.X,verM[m].PointGeometry.Y,verM[m].PointGeometry.Z)
			tupleList.append(tup)


		


#Assign your output to the OUT variable
OUT = tupleList
# ----------------------------------------
two_diagonal_point_finder_2 = Python(IN[0]=vertices)
# ---------- two_diagonal_point_finder_2.python (24 lines) ----------
import clr
clr.AddReference('ProtoGeometry')
from Autodesk.DesignScript.Geometry import *
#The inputs to this node will be stored as a list in the IN variable.
dataEnteringNode = IN

vertexList = IN[0]
tupleList = []
for i in range(len(vertexList)):
	ver = vertexList[i]
	for j in range(len(ver)):
		verM = ver[j]
		for k in range(len(verM)):						
			tup = (verM[0].PointGeometry.X,verM[0].PointGeometry.Y,verM[0].PointGeometry.Z)
			tupleList.append(tup)
			tup = (verM[7].PointGeometry.X,verM[7].PointGeometry.Y,verM[7].PointGeometry.Z)
			tupleList.append(tup)


		


#Assign your output to the OUT variable
OUT = tupleList
# ----------------------------------------
point_creator_2 = Python(IN[0]=two_diagonal_point_finder_2)  # same code as point_creator
code_block_11 = CodeBlock(a=point_creator_2) { a[2..3]; }
