# Dynamo graph SHELL_GENERATOR_ToMesh.dyn (Dynamo 0.8.2.2392)

# group: FOOTPRINT DIMENSIONS
width = IntegerSlider(30, range=0..200 step 1)  # "akaba.input.requirements.site.width"
height = IntegerSlider(30, range=10..200 step 1)  # "akaba.input.requirements.site.height"

totalUsableArea = DoubleSlider(32312.2, range=0..100000 step 0.1)  # "akaba.input.requirements.totalUsableArea"
user_input_floor_heights = CodeBlock { regularFloorHeight = 3.5; mechanicalFloorHeight = 7; mechFloorFrequency = 18; hasMechFloor = false; }
getShellHeight = MeshTools.MeshTools.GetShellHeight(width, height, totalUsableArea, user_input_floor_heights.regularFloorHeight)
getFloorHeights = MeshTools.MeshTools.GetFloorHeights(getShellHeight, user_input_floor_heights.regularFloorHeight, user_input_floor_heights.mechanicalFloorHeight, user_input_floor_heights.mechFloorFrequency, user_input_floor_heights.hasMechFloor)
adjusted_total_shell_height = Watch(getFloorHeights.out1)
floor_maker = Python()
# ---------- floor_maker.python (38 lines) ----------
import clr
clr.AddReference('ProtoGeometry')
from Autodesk.DesignScript.Geometry import *
import sys
sys.path.append("C:\Program Files (x86)\IronPython 2.7\Lib")
import random
#The inputs to this node will be stored as a list in the IN variable.
dataEnteringNode = IN

recList=IN[0]
floorHeights = IN[1]


#makes floors translate to given height list---------------------------------------------------------------------------------------
def floorTranslator(recList,flrHtList):
	outlines = []
	#define the translation vector
	ptA = Point.ByCoordinates(0,0,0)
	ptB = Point.ByCoordinates(0,0,100)
	vec = Vector.ByTwoPoints(ptA,ptB)
	
	for j in range(len(flrHtList)):
		dist = flrHtList[j]
		tempList = []
		
		for i in range(len(recList)):
			rec = recList[i]
			newRec = rec.Translate(vec,dist)
			tempList.append(newRec)
		outlines.append(tempList)
	return outlines
#---------------------------------------------------------------------------------------------------------------------------------


out = floorTranslator(recList,floorHeights)

#Assign your output to the OUT variable
OUT = out
# ----------------------------------------
generates_floor_plane_heights = Python()
# ---------- generates_floor_plane_heights.python (46 lines) ----------
import clr
clr.AddReference('ProtoGeometry')
from Autodesk.DesignScript.Geometry import *
import math
#The inputs to this node will be stored as a list in the IN variable.
dataEnteringNode = IN

#inputs------------------------------------------------------------
twr_Height = IN[0]
regflr_Ht  = IN[1]
mechflr_Ht = IN[2]
keyflr_Mech= IN[3]
hasMechFloor = IN[4]
#inputs------------------------------------------------------------

approxNum_Floors  =  twr_Height / regflr_Ht
numberof_MechFloors = math.ceil(approxNum_Floors / keyflr_Mech)
height_Counter = 0
height_List=[]
height = 0
tag = 0

while height<twr_Height:		
	#iterate to add the heights for the regular floors till first mechanical lvl
	for i in range(keyflr_Mech):
		if i == 0 and tag == 0:
			height += 0
			tag = 1
		else:
			height += regflr_Ht
		height_List.append(height)
		
		if (hasMechFloor and (height + mechflr_Ht + 1) > twr_Height): break
		if (not hasMechFloor) and height > twr_Height: break			
				
	if ((height) > twr_Height):	break	

	if hasMechFloor:	
		height += mechflr_Ht
		# add the mechanical floor height to the height list
		height_List.append(height)
 
new_shell_height = height

#Assign your output to the OUT variable
OUT = height_List, new_shell_height
# ----------------------------------------
code_block = CodeBlock(list=generates_floor_plane_heights) { list[0]; list[1]; }

# group: 1: Rectangular 2: L-Shape 3: U-Shape 4: O-Shape
shell_type = IntegerSlider(1, range=1..4 step 1)

# group: SHELL POSITION
pos_x = IntegerSlider(0, range=-200..0 step 1)
pos_y = IntegerSlider(0, range=0..200 step 1)

# group: GENERATES THE BASE OUTLINE FOR THE GIVEN SHELL TYPE
irregular_shape_maker = Python(IN[0]=pos_x, IN[1]=pos_y, IN[2]=width, IN[3]=height, IN[4]=shell_type)
# ---------- irregular_shape_maker.python (175 lines) ----------
import clr
clr.AddReference('ProtoGeometry')
from Autodesk.DesignScript.Geometry import *
#The inputs to this node will be stored as a list in the IN variable.
dataEnteringNode = IN


x = IN[0]
y = IN[1]
lenX = IN[2]
lenY = IN[3]
type = int(IN[4])

pt = Point.ByCoordinates(x,y,0)

#find the closest point from a point-------------------------------------------------------------------------------------	
def closestPoint(ptA,ptList):
	shortLen	=	100000000000000 # set as a really high value
	index		=	0
	for i in range(len(ptList)):
		vec				= 	Vector.ByTwoPoints(ptA,ptList[i])
		vecLen			=	vec.Length
		if ( vecLen < shortLen ):
			shortLen	=	vecLen
			index		=	i
	# returns the closest point to ptA from the list
	return ptList[index]
#------------------------------------------------------------------------------------------------------------------------




def typeListMaker():
	if type == 1:		
		len = [lenX,lenY,lenX,lenY]
		dir = [0,0,1,1]
		sides = 4		
	if type == 2:
		a = int(lenX/2)		
		b = int(lenY/3)			
		len = [lenX,a,b,lenY-a,lenX-b,lenY]
		dir = [0,0,1,0,1,1]
		sides = 6
	if type == 3:		
		a1 = int(lenX/3)
		a2 = int(lenX/4)
		b = int(lenY/2)	
		len = [lenX,lenY,a1,b,a2,b,lenX-a1-a2,lenY]
		dir = [0,0,1,1,1,0,1,1]
		sides = 8
	if type == 4:
		len = [lenX,lenY,lenX,lenY]
		dir = [0,0,1,1]
		sides = 4	
	return len,dir,sides


#function which makes l shaped profile-----------------------------------------------------------------------------------
def shapeGenerator():
	linList = []
	ptList = []
	
	ptX = Point.ByCoordinates(200000,0,0)
	ptY = Point.ByCoordinates(0,200000,0)
	
	xvec = Vector.ByTwoPoints(pt,ptX)
	yvec = Vector.ByTwoPoints(pt,ptY)
	xvecN = xvec.Reverse()
	yvecN = yvec.Reverse()
	a = int(lenX/2)
	b = int(lenY/3)
	 
	len = typeListMaker()[0]
	dir = typeListMaker()[1]
	sides = typeListMaker()[2]
	
	point = pt
	ptList.append(point)
	for i in range(sides):
		#toggle vec values
		if i%2 ==0:
			if dir[i]==0: vec = xvec
			else: vec = xvecN
		else:
			if dir[i]==0: vec = yvec
			else: vec = yvecN	
		l1 = Line.ByStartPointDirectionLength(point,vec,len[i])
		linList.append(l1)
		point = l1.EndPoint
		ptList.append(point)
	polygon = Polygon.ByPoints(ptList)
	polyCenter = polygon.Center()
	closePt = closestPoint(polyCenter,ptList)
	return [polygon],closePt
#---------------------------------------------------------------------------------------------------------------------------



#function which makes  shaped profile---------------------------------------------------------------------------------------
def shapeGenType4():
	linList = []
	ptList = []
	
	ptX = Point.ByCoordinates(200000,0,0)
	ptY = Point.ByCoordinates(0,200000,0)
	
	xvec = Vector.ByTwoPoints(pt,ptX)
	yvec = Vector.ByTwoPoints(pt,ptY)
	xvecN = xvec.Reverse()
	yvecN = yvec.Reverse()
		
	 
	len = typeListMaker()[0]
	dir = typeListMaker()[1]
	sides = typeListMaker()[2]
	
	#1st outer polygon===============================================================
	point = pt
	ptList.append(point)
	for i in range(sides):
		#toggle vec values
		if i%2 ==0:
			if dir[i]==0: vec = xvec
			else: vec = xvecN
		else:
			if dir[i]==0: vec = yvec
			else: vec = yvecN	
		l1 = Line.ByStartPointDirectionLength(point,vec,len[i])
		linList.append(l1)
		point = l1.EndPoint
		ptList.append(point)
	polygon = Polygon.ByPoints(ptList)
	polyCenter = polygon.Center()
	closePt = closestPoint(polyCenter,ptList)
	#================================================================================
	a = lenX/1.8
	b = lenY/2.2
	len[0] = len[0] - a
	len[1] = len[1] - b
	len[2] = len[0]
	len[3] = len[1]
	
	linList = []
	ptList = []
	#inner polygon====================================================================
	point = pt
	ptList.append(point)
	for i in range(sides):
		#toggle vec values
		if i%2 ==0:
			if dir[i]==0: vec = xvec
			else: vec = xvecN
		else:
			if dir[i]==0: vec = yvec
			else: vec = yvecN	
		l1 = Line.ByStartPointDirectionLength(point,vec,len[i])
		linList.append(l1)
		point = l1.EndPoint
		ptList.append(point)
	polygon2 = Polygon.ByPoints(ptList)
	ptN = Point.ByCoordinates(pt.X+(a/2),pt.Y+(b/2))
	vecShift = Vector.ByTwoPoints(pt,ptN)
	polygon2 = polygon2.Translate(vecShift)
	#================================================================================
	
	
	return [polygon,polygon2],closePt
#---------------------------------------------------------------------------------------------------------------------------


if type == 4: out = shapeGenType4()
else : out = shapeGenerator()

#Assign your output to the OUT variable
OUT = out
# ----------------------------------------
split_output = CodeBlock(list=irregular_shape_maker) { list[0]; list[1]; }

extrudeAsSolid = Curve.ExtrudeAsSolid(split_output.out0, getFloorHeights.out1)
getSolidDifference = Python(IN[0]=extrudeAsSolid)
# ---------- getSolidDifference.python (16 lines) ----------
import clr
clr.AddReference('ProtoGeometry')
from Autodesk.DesignScript.Geometry import *
#The inputs to this node will be stored as a list in the IN variables.
dataEnteringNode = IN

solidList = IN[0]

if len(solidList)>1:
	outerSolid = solidList[0]
	for i in range(1, len(solidList)):
		result = Solid.Difference(outerSolid, solidList[i])
		outerSolid = result
		OUT = [outerSolid]
else:
	OUT = solidList
# ----------------------------------------

# group: GET TRIANGULAR FACETS FROM THE SURFACES COMPOSING THE SHELL EVERY FACET IS REPRESENTED BY THE 3 POINTS FORMING THE TRIANGLE
explode = Geometry.Explode(getSolidDifference)
flatten = Flatten(explode)
code_block_2 = CodeBlock { 0.001; }
code_block_3 = CodeBlock { 10; }
tessellate = MeshTools.MeshTools.Tessellate(flatten, code_block_2, code_block_3)

transpose = List.Transpose(tessellate)

# group: CONVERSION OF GEOMETRY (3D-POINTS) TO 3D-POINT OBJECTS READ BY SHELLTOOL DLL
X = Point.X(transpose)
code_block_4 = CodeBlock(list=X) { list[0]; list[1]; list[2]; }
Y = Point.Y(transpose)
code_block_5 = CodeBlock(list=Y) { list[0]; list[1]; list[2]; }
Z = Point.Z(transpose)
code_block_6 = CodeBlock(list=Z) { list[0]; list[1]; list[2]; }
byCoordinates = stuffer.Point3d.ByCoordinates(code_block_4.out0, code_block_5.out0, code_block_6.out0)
byCoordinates_2 = stuffer.Point3d.ByCoordinates(code_block_4.out1, code_block_5.out1, code_block_6.out1)
byCoordinates_3 = stuffer.Point3d.ByCoordinates(code_block_4.out2, code_block_5.out2, code_block_6.out2)

# group: GET STL FROM TRIANGLES
byPoints = stuffer.Facet3d.ByPoints(byCoordinates, byCoordinates_2, byCoordinates_3)
byFacets = stuffer.STL.ByFacets(byPoints)

# group: GET STL TO ASCII FORMAT
toASCII = stuffer.STL.ToASCII(byFacets)

height_list = CodeBlock(list=getFloorHeights.out0) { list; }
bySTL = stuffer.Shell.BySTL(byFacets)

# group: GET FLOOR OUTLINES IN ASCII FORMAT
getFloorOutline = stuffer.Shell.GetFloorOutline(bySTL, height_list)
byHeightAndOutline2d = stuffer.STLxOutlines.ByHeightAndOutline2d(height_list, getFloorOutline)
toASCII_2 = stuffer.STLxOutlines.ToASCII(byHeightAndOutline2d)

# group: GET GRIDS IN ASCII FORMAT
code_block_7 = CodeBlock { 0.5; 3.5; }
bySize = stuffer.GridBasis.BySize(code_block_7.out0, code_block_7.out1)
byOutline = stuffer.Grid2d.ByOutline(getFloorOutline, bySize)
byHeightAndGrid2d = stuffer.STLxGrids.ByHeightAndGrid2d(height_list, byOutline)
toASCII_3 = stuffer.STLxGrids.ToASCII(byHeightAndGrid2d)

# group: CREATE OUTPUT MESH
shell_type_2 = CodeBlock(shellType=shell_type) { shellType+""; }
concat = String.Concat(toASCII, toASCII_2, toASCII_3)
origin = stuffer.Point3d.Origin()
byInlineData = stuffer.Mesh.ByInlineData(shell_type_2, concat, origin)

# group: ADD MESH TO A DESIGN OBJECT
empty = stuffer.Design.Empty()
result = stuffer.Design.AddMesh(empty, byInlineData)  # "akaba.result"

# group: VISUALIZE FLOOR OUTLINES - DEBUGGING
ZAxis = Vector.ZAxis()
translate = Geometry.Translate(geometry=split_output.out0, direction=ZAxis, distance=getFloorHeights.out0, lacing=Longest)

box_maker = Python()
# ---------- box_maker.python (158 lines) ----------
import clr
clr.AddReference('ProtoGeometry')
from Autodesk.DesignScript.Geometry import *
#The inputs to this node will be stored as a list in the IN variable.
dataEnteringNode = IN

polygon = IN[0][0]
closPt = IN[0][1]
type = IN[1]
if type!=4:
	polyPts = polygon.Points

#finds the opposite point to the closest point-------------------------------------------------
def oppPointFinder(poly,closPt):
	polyPts = poly.Points
	for i in range(len(polyPts)):
		if closPt == polyPts[i]:
			oppPt = polyPts[i-3]
			index = i
			break	
	return oppPt,index
#---------------------------------------------------------------------------------------------


#find the closest point from a point-------------------------------------------------------------------------------------	
def closestPoint(ptA,ptList):
	shortLen	=	100000000000000 # set as a really high value
	index		=	0
	for i in range(len(ptList)):
		vec				= 	Vector.ByTwoPoints(ptA,ptList[i])
		vecLen			=	vec.Length
		if ( vecLen < shortLen ):
			shortLen	=	vecLen
			index		=	i
	# returns the closest point to ptA from the list
	return ptList[index]
#------------------------------------------------------------------------------------------------------------------------




#func to split the type3 polygon to regular rect and l shape rect-----------------------------
def multiRecMaker():
	oppPt = oppPointFinder(polygon,closPt)[0]
	id = oppPointFinder(polygon,closPt)[1]-3
	siz = len(polyPts)
	
	lin = Line.ByStartPointEndPoint(closPt,polyPts[id+4])
	lin = lin.Extend(300,lin.StartPoint)
	
	crvsPoly = polygon.Curves()
	for crvs in crvsPoly:		
		pt = Geometry.Intersect(lin,crvs)
		if pt != None:
			break
	ptListA = [polyPts[0],pt[0],polyPts[id+4],polyPts[id+5]]
	ptListB = [pt[0],polyPts[id-1],polyPts[id],polyPts[id+1],polyPts[id+2],polyPts[id+3]]
	polyA = Polygon.ByPoints(ptListA)	
	polyB = Polygon.ByPoints(ptListB)
	polyNew = recMakers(polyB)
	#return lin,oppPt,polyPts[id],crvsPoly,pt,polyA,polyB
	return polyA,polyNew[0],polyNew[1]
#----------------------------------------------------------------------------------------------	
	
	
def recFromType4():
	poly1 = polygon[0]
	poly2 = polygon[1]
	polyPts1 = poly1.Points
	polyPts2 = poly2.Points
	pt=[]
	
	lin1 = Line.ByStartPointEndPoint(polyPts2[0],polyPts2[1])
	lin1 = lin1.Extend(300,lin1.StartPoint)
	lin1 = lin1.Extend(300,lin1.EndPoint)
	
	lin2 = Line.ByStartPointEndPoint(polyPts2[2],polyPts2[3])
	lin2 = lin2.Extend(300,lin2.StartPoint)
	lin2 = lin2.Extend(300,lin2.EndPoint)
	
	crvsPoly1 = poly1.Curves()
	for crvs in crvsPoly1:
		ptInt = Geometry.Intersect(lin1,crvs)
		if len(ptInt) == 0:	continue
		else: pt.append(ptInt[0])
		
	ptList1 = [pt[0],pt[1],polyPts1[0],polyPts1[1]]
	polyA = Polygon.ByPoints(ptList1)	
	for crvs in crvsPoly1:		
		ptInt = Geometry.Intersect(lin2,crvs)
		if len(ptInt) == 0:	continue
		else: pt.append(ptInt[0])	
		
	ptList2 = [pt[3],pt[2],polyPts1[2],polyPts1[3]]
	polyB = Polygon.ByPoints(ptList2)
	
	ptList3 = [pt[2],pt[0],polyPts2[1],polyPts2[2]]
	polyC = Polygon.ByPoints(ptList3)
	
	ptList4 = [pt[3],pt[1],polyPts2[0],polyPts2[3]]
	polyD = Polygon.ByPoints(ptList4)
	return polyA,polyB,polyC,polyD
	
	
	
	
#func to convert polygon to a rectangle---------------------------------------------------
def polytoRect(poly):
	crvs = poly.Curves()
	polyPts = poly.Points
	polyCen = poly.Center()
	wid = Line.ByStartPointEndPoint(polyPts[0],polyPts[1]).Length
	ht = Line.ByStartPointEndPoint(polyPts[0],polyPts[3]).Length
	
	cs = CoordinateSystem.ByOrigin(polyCen)
	#rec = Rectangle.ByWidthHeight(cs,wid,ht)
	
	ptList=[]
	for i in range(len(crvs)-1):
		pt = crvs[i].StartPoint
		ptList.append(pt)	
	rec = Rectangle.ByCornerPoints(ptList)
	return rec
#-----------------------------------------------------------------------------------------

#makes two polygons for two places in the l shape---------------------------------------------
def recMakers(poly):
	#poly = multiRecMaker()[1]
	polyPts = poly.Points
	polyCen = poly.Center()
	
	closPt = closestPoint(polyCen,polyPts)
	 
	oppPt = oppPointFinder(poly,closPt)[0]
	id = oppPointFinder(poly,closPt)[1]-3
	line1 = Line.ByStartPointEndPoint(polyPts[id],polyPts[id+1])
	line2 = Line.ByStartPointEndPoint(polyPts[id-1],polyPts[id-2])
	dist = line2.Length	
	ptNew = line1.PointAtParameter(dist/line1.Length)
	
	ptListA = [polyPts[id],polyPts[id-1],polyPts[id-2],ptNew]
	ptListB = [ptNew,polyPts[id-3],polyPts[id-4],polyPts[id-5]]
	
	polyA = Polygon.ByPoints(ptListA)
	polyB = Polygon.ByPoints(ptListB)
	
	return polyA,polyB
#---------------------------------------------------------------------------------------------

if type==1: out = [polygon]
if type==2: out = recMakers(polygon)
if type==3: out = multiRecMaker()
if type==4: out = recFromType4()

recListFinal = [polytoRect(out[i]) for i in range(len(out)) ]
#Assign your output to the OUT variable
OUT = recListFinal
#OUT = recMakers()
# ----------------------------------------
