# Dynamo graph CORE_DAP_W_CUSTOM.dyn (Dynamo 0.8.0.1233)

file_path = Filename("C:\Users\Colin\Documents\GitHub\Akaba\services\generators\hoover\3-4Floor-L_2.stl")
shellSlicerFromSTL = Custom[ShellSlicerFromSTL](STLPath=file_path)  # Slices an input shell object from an STL file
floor_maker = CodeBlock(floorMaker=shellSlicerFromSTL.floorCurves) { floorMaker; }
area_one_elevator_can_serve = DoubleSlider(5259, range=200..10000 step 1)
lift_lobby_width = DoubleSlider(2, range=0.5..11 step 0.1)
max_distance_from_nearest_core = IntegerSlider(60, range=5..609 step 1)
max_elevators = IntegerSlider(5, range=2..33 step 1)
servicecoremaker_analyzer = Custom[ServiceCoreMaker + Analyzer](floorCurves=floor_maker, lowLevelBoxes=shellSlicerFromSTL.lowLevelBoxes, areaServedPerElev=area_one_elevator_can_serve, liftLobbyWidth=lift_lobby_width, shellType=shellSlicerFromSTL.shellTypes, maxDistanceToCore=max_distance_from_nearest_core, maxElevatorPerBank=max_elevators)  # Computes the service core configuration and analyzes its efficiency
bank_rectangle_piece = CodeBlock(Bank_Rectangle=servicecoremaker_analyzer.elevBankSpace) { Bank_Rectangle[0]; }
elev_banks = CodeBlock(a=servicecoremaker_analyzer.elevatorBanks) { a[0]; }
elev_bank_converter = Python(IN[0]=elev_banks)
# ---------- elev_bank_converter.python (23 lines) ----------
import clr
clr.AddReference('ProtoGeometry')
from Autodesk.DesignScript.Geometry import *
#The inputs to this node will be stored as a list in the IN variable.
dataEnteringNode = IN

elevBanksList = IN[0]

finalNew = []
for i in range(len(elevBanksList)):
	elevL = elevBanksList[i]
	newL1=[]
	for j in range(len(elevL)):
		newL2=[]
		elev = elevL[j]
		for k in range(len(elev)):	
			newL2.extend(elev[k])
		newL1.append(newL2)			
	finalNew.append(newL1)
	

#Assign your output to the OUT variable
OUT = finalNew
# ----------------------------------------
lobby_corridor_finder = Python(IN[0]=servicecoremaker_analyzer.elevBankSpace, IN[1]=elev_bank_converter)
# ---------- lobby_corridor_finder.python (48 lines) ----------
import clr
clr.AddReference('ProtoGeometry')
from Autodesk.DesignScript.Geometry import *
#The inputs to this node will be stored as a list in the IN variable.
dataEnteringNode = IN

bankRecList = IN[0]
elevBanksList= IN[1]


"""
polyBSolid = polyB.ExtrudeAsSolid(Vector.ZAxis(),5)
		polyASrf = Surface.ByPatch(polyA)
		trimmedSurf = Surface.SubtractFrom(polyASrf,polyBSolid)
		trimmedSrfList.append(trimmedSurf)
		
		
"""


# to make the 


trimmedList = []
solidN = []
for i in range(len(bankRecList)):
	bankRecL = bankRecList[i]
	elevBankL = elevBanksList[i]
	trimmedL=[]
	solidListAll = []
	for j in range(len(bankRecL)):
		bankRec = bankRecL[j]
		elevB = elevBankL[j]
		solidList = []
		for k in range(len(elevB)):
			elev = elevB[k]
			polySolid = elev.ExtrudeAsSolid(Vector.ZAxis(),-5)
			solidList.append(polySolid)
		solidListAll.append(solidList)
		polyBSolid = Solid.ByUnion(solidList)
		polyASrf = Surface.ByPatch(bankRec)
		trimmedSurf = Surface.SubtractFrom(polyASrf,polyBSolid)
		trimmedL.append(trimmedSurf)
	trimmedList.append(trimmedL)
	solidN.append(solidListAll)

#Assign your output to the OUT variable
OUT = trimmedList
# ----------------------------------------
corridorSystem = CodeBlock(corridorSystem=lobby_corridor_finder) { corridorSystem; }
coregeometry_pointextraction = Custom[CoreGeometry + PointExtraction](techRoomsRestRooms=servicecoremaker_analyzer.techRooms_restRooms, floorCurves=floor_maker, keyFloors=servicecoremaker_analyzer.keyFloors, elevBankLists=servicecoremaker_analyzer.elevatorBanks, serviceCoreCurve=servicecoremaker_analyzer.serviceCoreCurve)  # Builds the 3d core geometries and exports the two opposite diagonal points of relevant core elements
corridor_extruded = Python(IN[0]=corridorSystem, IN[1]=coregeometry_pointextraction.heightCores)
# ---------- corridor_extruded.python (21 lines) ----------
import clr
clr.AddReference('ProtoGeometry')
from Autodesk.DesignScript.Geometry import *
#The inputs to this node will be stored as a list in the IN variable.
dataEnteringNode = IN

corridorList = IN[0]
zValList = IN[1]

corVolList = []
for i in range(len(corridorList)):
	corL = corridorList[i]
	zValL = zValList[i]
	corVolL=[]
	for j in range(len(corL)):
		coridorVol = Surface.Thicken(corL[j][0],zValL[j])
		corVolL.append(coridorVol)
	corVolList.append(corVolL)

#Assign your output to the OUT variable
OUT = corVolList
# ----------------------------------------
flatten = Flatten(corridor_extruded)
byUnion = Solid.ByUnion(flatten)
create = List.Create(coregeometry_pointextraction.lowLevelRestroomModel, coregeometry_pointextraction.relocatedRestroomsModel, coregeometry_pointextraction.elevatorsModel, coregeometry_pointextraction.techRoomsModel)
flatten_2 = Flatten(create)
byUnion_2 = Solid.ByUnion(flatten_2)
difference = Solid.Difference(solid=coregeometry_pointextraction.fullServiceCoreModel, other=byUnion_2)
flatten_3 = Flatten(difference)
byUnion_3 = Solid.ByUnion(flatten_3)
difference_2 = Solid.Difference(solid=byUnion, other=byUnion_3)
intersect = Geometry.Intersect(geometry=byUnion_3, other=byUnion)
watch = Watch(coregeometry_pointextraction.elevatorsModel)
code_block = CodeBlock { a={"C:\Users\Colin\Documents\GitHub\Akaba\services\generators\ExeBridge\ExeBridge\Generator\Vision\Dynamo\output.csv"}; }
vertices = Face.Vertices(coregeometry_pointextraction.elevatorsModel)
two_diagonal_point_finder = Python(IN[0]=vertices)
# ---------- two_diagonal_point_finder.python (27 lines) ----------
import clr
clr.AddReference('ProtoGeometry')
from Autodesk.DesignScript.Geometry import *
#The inputs to this node will be stored as a list in the IN variable.
dataEnteringNode = IN

vertexList = IN[0]
tupleList = []
for i in range(len(vertexList)):
	ver = vertexList[i]
	for j in range(len(ver)):
		verO = ver[j]
		for k in range(len(verO)):
			verN = verO[k]
			for l in range(len(verN)):
				verM = verN[l]				
				tup = (verM[0].PointGeometry.X,verM[0].PointGeometry.Y,verM[0].PointGeometry.Z)
				tupleList.append(tup)
				tup = (verM[7].PointGeometry.X,verM[7].PointGeometry.Y,verM[7].PointGeometry.Z)
				tupleList.append(tup)


		


#Assign your output to the OUT variable
OUT = tupleList
# ----------------------------------------
writeToFile = CSV.WriteToFile(code_block, two_diagonal_point_finder)
code_block_2 = CodeBlock { a={"C:\Users\Colin\Documents\GitHub\Akaba\services\generators\ExeBridge\ExeBridge\Generator\Vision\Dynamo\shell.stl"}; }
writeText = File.WriteText(code_block_2, shellSlicerFromSTL.shell)
code_block_3 = CodeBlock { a={"C:\Users\Colin\Documents\GitHub\Akaba\services\generators\ExeBridge\ExeBridge\Generator\Vision\Dynamo\outlines.stlx"}; }
byHeightAndOutline2d = stuffer.STLxOutlines.ByHeightAndOutline2d(shellSlicerFromSTL.floorHeight, shellSlicerFromSTL.floorOutline)
toASCII = stuffer.STLxOutlines.ToASCII(byHeightAndOutline2d)
writeText_2 = File.WriteText(code_block_3, toASCII)
code_block_4 = CodeBlock { a={"C:\Users\Colin\Documents\GitHub\Akaba\services\generators\ExeBridge\ExeBridge\Generator\Vision\Dynamo\grids.stlx"}; }
code_block_5 = CodeBlock { 0.5; 3.5; }
bySize = stuffer.GridBasis.BySize(code_block_5.out0, code_block_5.out1)
byOutline = stuffer.Grid2d.ByOutline(shellSlicerFromSTL.floorOutline, bySize)
byHeightAndGrid2d = stuffer.STLxGrids.ByHeightAndGrid2d(shellSlicerFromSTL.floorHeight, byOutline)
toASCII_2 = stuffer.STLxGrids.ToASCII(byHeightAndGrid2d)
writeText_3 = File.WriteText(code_block_4, toASCII_2)
range2dByRectangle = stuffer.DynamoGeometry.Range2dByRectangle(shellSlicerFromSTL.lowLevelBoxes)
positions = stuffer.Core.Positions(range2dByRectangle, max_distance_from_nearest_core)
watch_2 = Watch(positions)
