# Dynamo graph CubeTest.dyn (Dynamo 0.8.0.1233)

code_block = CodeBlock { 0; 10; }
byCoordinates = Point.ByCoordinates(x=code_block.out0, y=code_block.out0, z=code_block.out0)
byCoordinates_2 = Point.ByCoordinates(x=code_block.out1, y=code_block.out1, z=code_block.out1)
byCorners = Cuboid.ByCorners(lowPoint=byCoordinates, highPoint=byCoordinates_2)
