# Dynamo graph 20x20.dyn (Dynamo 0.8.0.1233)

code_block = CodeBlock { 10; -10; 0; 3.5; }
byCoordinates = Point.ByCoordinates(x=code_block.out0, y=code_block.out0, z=code_block.out2)
byCoordinates_2 = Point.ByCoordinates(x=code_block.out1, y=code_block.out1, z=code_block.out3)
byCorners = Cuboid.ByCorners(lowPoint=byCoordinates, highPoint=byCoordinates_2)
file_path = Filename("C:\Users\Colin\Documents\GitHub\Akaba\services\generators\hoover\20x20.stl")
fromPath = FileObject(file_path)  # "File.FromPath"
readText = File.ReadText(fromPath)
watch = Watch(readText)
