# Dynamo graph L-Shell.dyn (Dynamo 0.8.0.1233)

byCoordinates = Point.ByCoordinates()
integer_slider = IntegerSlider(65, range=60..75 step 5)
integer_slider_2 = IntegerSlider(35, range=30..45 step 5)
integer_slider_3 = IntegerSlider(3, range=1..10 step 1)
number = DoubleInput(3.5)
mul = integer_slider_3 * number
byCoordinates_2 = Point.ByCoordinates(x=integer_slider, y=integer_slider_2, z=mul)
byCorners = Cuboid.ByCorners(lowPoint=byCoordinates, highPoint=byCoordinates_2)
byCoordinates_3 = Point.ByCoordinates(x=integer_slider, y=integer_slider_2)
integer_slider_4 = IntegerSlider(38, range=20..45 step 1)
sub = integer_slider - integer_slider_4
integer_slider_5 = IntegerSlider(20, range=20..45 step 1)
add = integer_slider_2 + integer_slider_5
integer_slider_6 = IntegerSlider(4, range=1..10 step 1)
number_2 = DoubleInput(3.5)
mul_2 = integer_slider_6 * number_2
byCoordinates_4 = Point.ByCoordinates(x=sub, y=add, z=mul_2)
byCorners_2 = Cuboid.ByCorners(lowPoint=byCoordinates_3, highPoint=byCoordinates_4)
union = Solid.Union(byCorners, byCorners_2)
