# Dynamo graph RectShell.dyn (Dynamo 0.8.0.1233)

byCoordinates = Point.ByCoordinates()
integer_slider = IntegerSlider(70, range=60..75 step 5)
integer_slider_2 = IntegerSlider(40, range=30..45 step 5)
integer_slider_3 = IntegerSlider(20, range=20..45 step 1)
number = DoubleInput(3.5)
mul = integer_slider_3 * number
byCoordinates_2 = Point.ByCoordinates(x=integer_slider, y=integer_slider_2, z=mul)
byCorners = Cuboid.ByCorners(lowPoint=byCoordinates, highPoint=byCoordinates_2)
