# Dynamo graph SurfaceArea.dyn (Dynamo 0.8.0.1233)

integer_slider = IntegerSlider(-3, range=-25..25 step 1)
integer_slider_2 = IntegerSlider(13, range=-25..25 step 1)
byOrigin = CoordinateSystem.ByOrigin(x=integer_slider, y=integer_slider_2)
code_block = CodeBlock { 16; }
byWidthHeight = Rectangle.ByWidthHeight(byOrigin, code_block, code_block)
byOrigin_2 = CoordinateSystem.ByOrigin()
code_block_2 = CodeBlock { 10; }
byWidthHeight_2 = Rectangle.ByWidthHeight(byOrigin_2, code_block_2, code_block_2)
code_block_3 = CodeBlock(rect1=byWidthHeight, rect2=byWidthHeight_2)
# ---------- code_block_3.designscript (11 lines) ----------
rect1;
rect2;
s1 = Surface.ByPatch(rect1);
t1 = s1.Thicken(1.0, 1.0);
s2 = Surface.ByPatch(rect2);
t2 = s2.Thicken(1.0, 1.0);
d1 = t1.Difference(t2);
d2 = t2.Difference(t1);
ds = Solid.ByUnion({d1, d2});
pxy = Plane.XY();
geom = pxy.Intersect(ds);
# ----------------------------------------
area = Surface.Area(code_block_3.geom)
watch = Watch(area)
sum = Math.Sum(watch)
watch_2 = Watch(sum)
code_block_4 = CodeBlock(sdiff=code_block_3.geom) { sdiff; }
watch_3 = Watch(code_block_4)
