# Dynamo graph TrimTest.dyn (Dynamo 0.8.0.1233)

code_block = CodeBlock()
# ---------- code_block.designscript (6 lines) ----------
Point2d.ByCoordinates(-5, -5);
Point2d.ByCoordinates(5, -5);
Point2d.ByCoordinates(5, 5);
Point2d.ByCoordinates(0, 5);
Point2d.ByCoordinates(0, 0);
Point2d.ByCoordinates(-5, 0);
# ----------------------------------------
create = List.Create(code_block.out0, code_block.out1, code_block.out2, code_block.out3, code_block.out4, code_block.out5)
byPoints = stuffer.Polygon2d.ByPoints(create)
byPolygons = stuffer.Outline2d.ByPolygons(byPoints)
rectFloorPlates = stuffer.Core.RectFloorPlates(byPolygons)
simpleJoin = stuffer.Core.SimpleJoin(rectFloorPlates)
BBox = stuffer.Polygon2d.BBox(simpleJoin)
center = stuffer.Range2d.Center(BBox)
watch = Watch(center)
code_block_2 = CodeBlock { Point2d.ByCoordinates(-5, -5); Point2d.ByCoordinates(5, -5); Point2d.ByCoordinates(5, 5); Point2d.ByCoordinates(-5, 5); }
create_2 = List.Create(code_block_2.out0, code_block_2.out1, code_block_2.out2, code_block_2.out3)
code_block_3 = CodeBlock { 0; }
pointByPoint2d = stuffer.DynamoGeometry.PointByPoint2d(center, code_block_3)
polygonByPolygon2d = stuffer.DynamoGeometry.PolygonByPolygon2d(simpleJoin, code_block_3)
points = Polygon.Points(polygonByPolygon2d)
