# Dynamo graph TwoBlocks.dyn (Dynamo 0.8.0.1233)

code_block = CodeBlock { -7; -2; 2; 7; }
code_block_2 = CodeBlock { -5; 5; }
byCoordinates = Point.ByCoordinates(x=code_block.out0, y=code_block_2.out0)
code_block_3 = CodeBlock { 3.5; }
byCoordinates_2 = Point.ByCoordinates(x=code_block.out1, y=code_block_2.out1, z=code_block_3)
byCorners = Cuboid.ByCorners(lowPoint=byCoordinates, highPoint=byCoordinates_2)
byCoordinates_3 = Point.ByCoordinates(x=code_block.out2, y=code_block_2.out0)
byCoordinates_4 = Point.ByCoordinates(x=code_block.out3, y=code_block_2.out1, z=code_block_3)
byCorners_2 = Cuboid.ByCorners(lowPoint=byCoordinates_3, highPoint=byCoordinates_4)
