# Dynamo graph U-Shell3.dyn (Dynamo 0.8.0.1233)

byCoordinates = Point.ByCoordinates()
integer_slider = IntegerSlider(70, range=60..75 step 5)
integer_slider_2 = IntegerSlider(40, range=30..45 step 5)
integer_slider_3 = IntegerSlider(29, range=20..45 step 1)
number = DoubleInput(3.5)
mul = integer_slider_3 * number
byCoordinates_2 = Point.ByCoordinates(x=integer_slider, y=integer_slider_2, z=mul)
byCorners = Cuboid.ByCorners(lowPoint=byCoordinates, highPoint=byCoordinates_2)
byCoordinates_3 = Point.ByCoordinates(x=integer_slider, y=integer_slider_2)
integer_slider_4 = IntegerSlider(40, range=20..45 step 1)
sub = integer_slider - integer_slider_4
integer_slider_5 = IntegerSlider(20, range=20..45 step 1)
add = integer_slider_2 + integer_slider_5
integer_slider_6 = IntegerSlider(45, range=20..45 step 1)
mul_2 = integer_slider_6 * number
byCoordinates_4 = Point.ByCoordinates(x=sub, y=add, z=mul_2)
byCorners_2 = Cuboid.ByCorners(lowPoint=byCoordinates_3, highPoint=byCoordinates_4)
byCoordinates_5 = Point.ByCoordinates(x=integer_slider, y=add)
integer_slider_7 = IntegerSlider(-28, range=-30..45 step 1)
integer_slider_8 = IntegerSlider(37, range=20..45 step 1)
add_2 = integer_slider_8 + add
integer_slider_9 = IntegerSlider(21, range=20..45 step 1)
mul_3 = integer_slider_9 * number
byCoordinates_6 = Point.ByCoordinates(x=integer_slider_7, y=add_2, z=mul_3)
byCorners_3 = Cuboid.ByCorners(lowPoint=byCoordinates_5, highPoint=byCoordinates_6)
create = List.Create(byCorners_2, byCorners_3)
unionAll = Solid.UnionAll(byCorners, create)
sub_2 = _ - _
