# Dynamo graph 01 MAR_ABRIDGED_TEST SORT_1.dyn (Dynamo 0.9.1.4054)

code_block = CodeBlock { a=-1000; b=-500; }

# group: a
code_block_2 = CodeBlock { a=-1000; x=-300; b=-500; y=-800; }
code_block_3 = CodeBlock(a=code_block_2.a, b=code_block_2.b, y=code_block_2.y, x=code_block_2.x) { Point.ByCoordinates(a,b+y); Point.ByCoordinates(a+x,b); Point.ByCoordinates(a+x,b+y); Point.ByCoordinates(a,b); }
code_block_4 = CodeBlock { Point.ByCoordinates(0,0); 500; }
byCenterPointRadius = Circle.ByCenterPointRadius(centerPoint=code_block_3.out0, radius=code_block_4.out1)
regularPolygon = Polygon.RegularPolygon(circle=byCenterPointRadius)
byPolygon = stuffer.Polygon2d.ByPolygon(regularPolygon)
ratio = DoubleSlider(1, range=0..1 step 0.05)
dir = DoubleSlider(0, range=0..1 step 1)
basicSplitPolyIntoTwo = SpacePlanning.SplitObject.BasicSplitPolyIntoTwo(byPolygon, ratio, dir)
code_block_5 = CodeBlock(a=basicSplitPolyIntoTwo.out1) { a.StartPoint; a.EndPoint; }
recompute = DoubleSlider(0, range=0..100 step 0.1)
pointByPoint2d = stuffer.DynamoGeometry.PointByPoint2d(code_block_5.out0, recompute)
pointByPoint2d_2 = stuffer.DynamoGeometry.PointByPoint2d(code_block_5.out1, recompute)
code_block_6 = CodeBlock(a=pointByPoint2d, b=pointByPoint2d_2) { Line.ByStartPointEndPoint(a,b); }
recursiveSplitPoly = SpacePlanning.SplitObject.RecursiveSplitPoly(arg1=ratio, arg2=recompute)
code_block_7 = CodeBlock(A=code_block_2.a, B=code_block_2.x) { A*B; }
byWidthLength = Rectangle.ByWidthLength(width=code_block.a, length=code_block.b)
create = List.Create(code_block_3.out0, code_block_3.out2, code_block_3.out1, code_block_3.out3)
distance = DoubleSlider(200, range=0..2000 step 0.1)
polygonByPolygon2d = stuffer.DynamoGeometry.PolygonByPolygon2d(basicSplitPolyIntoTwo.out0, dir)

code_block_8 = CodeBlock(a=polygonByPolygon2d) { a[1]; }
code_block_9 = CodeBlock { a; }
