# Dynamo graph 01 MAR_BETTER SORT_1.dyn (Dynamo 0.9.1.4054)

# group: USER INPUTS
program_data_info_csv_file_path = StringInput("D:\SUBHAJIT PROJECTS\00 DUKE PROJECT\08 EXCEL\01 FEB PROGRAM.csv")  # "Program Data Info CSV File Path String"
building_outline_file_path = StringInput("D:\SUBHAJIT WORKS\01 DUKE BED TOWER AUTOMATION\08 EXCEL\OUTLINE.SAT")  # "Building Outline File Path String"
iteration = DoubleSlider(100, range=0..1000 step 1)
include_quantity_of_program = BoolSelector(false)
scale = DoubleSlider(200, range=0..200 step 0.1)
building_outline_file_path_2 = StringInput("D:\SUBHAJIT PROJECTS\00 DUKE PROJECT\08 EXCEL\OUTLINEDK.SAT")  # "Building Outline File Path String"
building_outline_file_path_3 = StringInput("D:\SUBHAJIT PROJECTS\00 DUKE PROJECT\08 EXCEL\OUTLINEDKtest.SAT")  # "Building Outline File Path String"
dimX = DoubleSlider(10, range=0..200 step 0.1)
dimY = DoubleSlider(10, range=0..200 step 0.1)
building_outline_file_path_4 = StringInput("D:\SUBHAJIT PROJECTS\00 DUKE PROJECT\08 EXCEL\OUTLINESCALEDDK.SAT")  # "Building Outline File Path String"

building_outline_file_path_5 = StringInput("D:\SUBHAJIT WORKS\01 DUKE BED TOWER AUTOMATION\08 EXCEL\OUTLINESCALEDDK.SAT")  # "Building Outline File Path String"
ratio = DoubleSlider(0.35, range=0..1.2 step 0.05)
dir = DoubleSlider(0, range=0..1 step 1)
height = DoubleSlider(0, range=0..50 step 1)
code_block = CodeBlock { a.StartPoint; a.EndPoint; }
recompute = DoubleSlider(30, range=0..100 step 0.1)
pointByPoint2d = stuffer.DynamoGeometry.PointByPoint2d(code_block.out0, recompute)
pointByPoint2d_2 = stuffer.DynamoGeometry.PointByPoint2d(code_block.out1, recompute)
code_block_2 = CodeBlock(a=pointByPoint2d, b=pointByPoint2d_2) { Line.ByStartPointEndPoint(a,b); }
program_data_info_csv_file_path_2 = StringInput("D:\SUBHAJIT WORKS\01 DUKE BED TOWER AUTOMATION\08 EXCEL\01 FEB PROGRAM.csv")  # "Program Data Info CSV File Path String"
factor = DoubleSlider(1, range=0..6 step 1)

# group: MAKE DATA STACK
readBuildingOutline = SpacePlanning.ReadData.ReadBuildingOutline(building_outline_file_path_5)
fromOutlineGetPoints = SpacePlanning.ReadData.FromOutlineGetPoints(readBuildingOutline)
fromPointsGetBoundingPoly = SpacePlanning.ReadData.FromPointsGetBoundingPoly(fromOutlineGetPoints)
factor_2 = DoubleSlider(1, range=0..40 step 0.5)
pointFromPoint2dList = stuffer.DynamoGeometry.pointFromPoint2dList(fromOutlineGetPoints)
num = DoubleSlider(34, range=0..34 step 1)
makeDataStack = SpacePlanning.ReadData.MakeDataStack(program_data_info_csv_file_path_2, dimX, dimY, factor)

# group: CELL OBJECTS FROM POINTS
fromPointsGetBoundingPoly_2 = SpacePlanning.ReadData.FromPointsGetBoundingPoly(fromOutlineGetPoints)
gridPointsInsideOutline = SpacePlanning.GridObject.GridPointsInsideOutline(fromPointsGetBoundingPoly_2, fromOutlineGetPoints, dimX, dimY)
convexHullFromPoint2D = SpacePlanning.GridObject.ConvexHullFromPoint2D(gridPointsInsideOutline)
pointFromPoint2dList_2 = stuffer.DynamoGeometry.pointFromPoint2dList(convexHullFromPoint2D)
byPoints = Polygon.ByPoints(pointFromPoint2dList_2)

# group: GRID CELLS ON SITE
pointFromPoint2dList_3 = stuffer.DynamoGeometry.pointFromPoint2dList(gridPointsInsideOutline)
makeCellsFromGridPoints = SpacePlanning.GridObject.MakeCellsFromGridPoints(pointFromPoint2dList_3, dimX, dimY)
opacity = DoubleSlider(10.7, range=0..255 step 0.1)
val = DoubleSlider(164.6, range=0..255 step 0.1)
val_2 = DoubleSlider(183.1, range=0..255 step 0.1)
val_3 = DoubleSlider(165.4, range=0..255 step 0.1)
byARGB = Color.ByARGB(a=opacity, r=val, g=val_2, b=val_3)
byGeometryColor = Display.Display.ByGeometryColor(makeCellsFromGridPoints, byARGB)

code_block_3 = CodeBlock(pointsInside=gridPointsInsideOutline) { pointsInside; }

# group: CELL NUMBER TEXTS
pointFromPoint2dList_4 = stuffer.DynamoGeometry.pointFromPoint2dList(code_block_3)
python_script = Python(IN[0]=pointFromPoint2dList_4)
# ---------- python_script.python (13 lines) ----------
import clr
clr.AddReference('ProtoGeometry')
from Autodesk.DesignScript.Geometry import *
#The inputs to this node will be stored as a list in the IN variables.
dataEnteringNode = IN

ptList = IN[0]
txt=[]
for i in range(len(ptList)):
	txt.append(i.ToString())

#Assign your output to the OUT variable.
OUT = txt
# ----------------------------------------
code_block_4 = CodeBlock { scale =4; SCALE2 = 4; }
fromStringOriginAndScale = DynamoText.Text.FromStringOriginAndScale(python_script, pointFromPoint2dList_4, code_block_4.scale)

code_block_5 = CodeBlock(outlinePts=fromOutlineGetPoints) { Polygon2d.ByPoints(outlinePts); outlinePts; }
basicSplitPolyIntoTwo = SpacePlanning.SplitObject.BasicSplitPolyIntoTwo(code_block_5.out0, ratio, dir)
code_block_6 = CodeBlock(a=basicSplitPolyIntoTwo) { a[1].Points; }
pointByPoint2d_3 = stuffer.DynamoGeometry.PointByPoint2d(code_block_6, height)
code_block_7 = CodeBlock(a=pointByPoint2d_3) { Polygon.ByPoints(a); }
byPoints_2 = stuffer.Polygon2d.ByPoints(code_block_5.outlinePts)
code_block_8 = CodeBlock(outlinePts=fromOutlineGetPoints) { Polygon2d.ByPoints(outlinePts); outlinePts; }
dept_data = CodeBlock(deptData=makeDataStack.out3) { deptData; }
recompute_2 = DoubleSlider(30, range=0..50 step 1)
deptSplitRefined = SpacePlanning.SplitObject.DeptSplitRefined(code_block_8.out0, dept_data, recompute_2)
code_block_9 = CodeBlock(A=deptSplitRefined.out0) { A[0]; }
ratio_2 = DoubleSlider(0.15, range=0..1 step 0.05)
recompute_3 = DoubleSlider(4, range=0..5 step 1)
recursiveSplitPoly = SpacePlanning.SplitObject.RecursiveSplitPoly(code_block_9, ratio_2, recompute_3)
polygonByPolygon2d = stuffer.DynamoGeometry.PolygonByPolygon2d(recursiveSplitPoly, height)
code_block_10 = CodeBlock { a.StartPoint; a.EndPoint; }
pointByPoint2d_4 = stuffer.DynamoGeometry.PointByPoint2d(code_block_10.out0, recompute)
pointByPoint2d_5 = stuffer.DynamoGeometry.PointByPoint2d(code_block_10.out1, recompute)
code_block_11 = CodeBlock(a=pointByPoint2d_4, b=pointByPoint2d_5) { Line.ByStartPointEndPoint(a,b); }
byPoints_3 = stuffer.Polygon2d.ByPoints(code_block_5.outlinePts)
dept_data_2 = CodeBlock(deptData=makeDataStack.out3) { deptData; }
recompute_4 = DoubleSlider(2, range=0..5 step 1)
deptSplitMake = SpacePlanning.SplitObject.DeptSplitMake(code_block_5.out0, dept_data_2, recompute_4)
watch = Watch(deptSplitMake.out2)
building_outline_file_path_6 = StringInput("D:\SUBHAJIT WORKS\01 DUKE BED TOWER AUTOMATION\08 EXCEL\OUTLINEDKtest.SAT")  # "Building Outline File Path String"
building_outline_file_path_7 = StringInput("D:\SUBHAJIT WORKS\01 DUKE BED TOWER AUTOMATION\08 EXCEL\OUTLINEDK.SAT")  # "Building Outline File Path String"
building_outline_file_path_8 = StringInput("D:\SUBHAJIT WORKS\01 DUKE BED TOWER AUTOMATION\08 EXCEL\OUTLINE.SAT")  # "Building Outline File Path String"
autoMakeDataStack = SpacePlanning.ReadData.AutoMakeDataStack(dimX, dimY, factor)
autoMakeBuildingOutline = SpacePlanning.ReadData.AutoMakeBuildingOutline()
ratio_3 = DoubleSlider(1, range=0..1 step 0.05)
recursiveSplitPoly_2 = SpacePlanning.SplitObject.RecursiveSplitPoly(arg1=ratio_3, arg2=recompute)
code_block_12 = CodeBlock { a=-1000; x=-300; b=-500; y=-800; }
code_block_13 = CodeBlock(A=code_block_12.a, B=code_block_12.x) { A*B; }
code_block_14 = CodeBlock(a=code_block_12.a, b=code_block_12.b, y=code_block_12.y, x=code_block_12.x) { Point.ByCoordinates(a,b+y); Point.ByCoordinates(a+x,b); Point.ByCoordinates(a+x,b+y); Point.ByCoordinates(a,b); }
create = List.Create(code_block_14.out0, code_block_14.out2, code_block_14.out1, code_block_14.out3)
distance = DoubleSlider(200, range=0..2000 step 0.1)
code_block_15 = CodeBlock { 500; }
byCenterPointRadius = Circle.ByCenterPointRadius(centerPoint=code_block_14.out0, radius=code_block_15)
regularPolygon = Polygon.RegularPolygon(circle=byCenterPointRadius)
byPolygon = stuffer.Polygon2d.ByPolygon(regularPolygon)
dir_2 = DoubleSlider(0, range=0..1 step 1)
basicSplitPolyIntoTwo_2 = SpacePlanning.SplitObject.BasicSplitPolyIntoTwo(byPolygon, ratio_3, dir_2)
polygonByPolygon2d_2 = stuffer.DynamoGeometry.PolygonByPolygon2d(basicSplitPolyIntoTwo_2, dir_2)
distance_2 = DoubleSlider(50, range=0..2000 step 0.05)
recursiveSplitOneDirByDistance = SpacePlanning.SplitObject.RecursiveSplitOneDirByDistance(code_block_5.out0, distance_2, recompute_3)
polygonByPolygon2d_3 = stuffer.DynamoGeometry.PolygonByPolygon2d(deptSplitMake.out0, height)
areaCheckPolygon = stuffer.Polygon2d.AreaCheckPolygon(code_block_5.out0)
number_slider = DoubleSlider(0.95, range=0..1 step 0.05)
code_block_16 = CodeBlock(A=areaCheckPolygon, B=number_slider) { A*B; }
height_2 = DoubleSlider(0, range=0..50 step 1)
recursiveSplitByArea = SpacePlanning.SplitObject.RecursiveSplitByArea(code_block_5.out0, code_block_16, height_2)
code_block_17 = CodeBlock(a=recursiveSplitByArea) { a[0]; }
areaCheckPolygon_2 = stuffer.Polygon2d.AreaCheckPolygon(code_block_17)
code_block_18 = CodeBlock(a=recursiveSplitByArea) { a[1]; }
areaCheckPolygon_3 = stuffer.Polygon2d.AreaCheckPolygon(code_block_18)
polygonByPolygon2d_4 = stuffer.DynamoGeometry.PolygonByPolygon2d(code_block_9, dir_2)
areaCheckPolygon_4 = stuffer.Polygon2d.AreaCheckPolygon(code_block_5.out0)
polygonByPolygon2d_5 = stuffer.DynamoGeometry.PolygonByPolygon2d(deptSplitRefined.out1, dir_2)
code_block_19 = CodeBlock(A=deptSplitRefined.out0) { A[1]; }
polygonByPolygon2d_6 = stuffer.DynamoGeometry.PolygonByPolygon2d(code_block_19, dir_2)
code_block_20 = CodeBlock(A=deptSplitRefined.out0) { A[2]; }
polygonByPolygon2d_7 = stuffer.DynamoGeometry.PolygonByPolygon2d(code_block_20, dir_2)
code_block_21 = CodeBlock(A=deptSplitRefined.out0) { A[3]; }
polygonByPolygon2d_8 = stuffer.DynamoGeometry.PolygonByPolygon2d(code_block_21, dir_2)
code_block_22 = CodeBlock(a=basicSplitPolyIntoTwo) { a[0].Points; }
pointByPoint2d_6 = stuffer.DynamoGeometry.PointByPoint2d(code_block_22, height)
code_block_23 = CodeBlock(a=pointByPoint2d_6) { Polygon.ByPoints(a); }
code_block_24 = CodeBlock { a=-200; x=-100; }
byWidthLength = Rectangle.ByWidthLength(width=code_block_24.a, length=code_block_24.x)
byPolygon_2 = stuffer.Polygon2d.ByPolygon(byWidthLength)
areaCheckPolygon_5 = stuffer.Polygon2d.AreaCheckPolygon(byPolygon_2)
dir_3 = DoubleSlider(1, range=0..1 step 1)
polygonByPolygon2d_9 = stuffer.DynamoGeometry.PolygonByPolygon2d(recursiveSplitByArea, dir_3)
code_block_25 = CodeBlock(A=polygonByPolygon2d_9) { A[1]; }
recursiveSplitByAreaUse = SpacePlanning.SplitObject.RecursiveSplitByAreaUse(code_block_5.out0, code_block_16, dir_3)
polygonByPolygon2d_10 = stuffer.DynamoGeometry.PolygonByPolygon2d(recursiveSplitByAreaUse, dir_2)
areaCheckPolygon_6 = stuffer.Polygon2d.AreaCheckPolygon(recursiveSplitByAreaUse)
areaCheckPolygon_7 = stuffer.Polygon2d.AreaCheckPolygon(code_block_19)
areaCheckPolygon_8 = stuffer.Polygon2d.AreaCheckPolygon(code_block_9)
areaCheckPolygon_9 = stuffer.Polygon2d.AreaCheckPolygon(code_block_20)
areaCheckPolygon_10 = stuffer.Polygon2d.AreaCheckPolygon(code_block_21)
code_block_26 = CodeBlock(dept_data) { Dep.DepartmentName; }
code_block_27 = CodeBlock(dept_data) { Dep.DeptAreaNeeded; }
recursiveSplitPoly_3 = SpacePlanning.SplitObject.RecursiveSplitPoly(code_block_19, ratio_2, recompute_3)
polygonByPolygon2d_11 = stuffer.DynamoGeometry.PolygonByPolygon2d(recursiveSplitPoly_3, height)
recursiveSplitPoly_4 = SpacePlanning.SplitObject.RecursiveSplitPoly(code_block_20, ratio_2, recompute_3)
polygonByPolygon2d_12 = stuffer.DynamoGeometry.PolygonByPolygon2d(recursiveSplitPoly_4, height)
recursiveSplitPoly_5 = SpacePlanning.SplitObject.RecursiveSplitPoly(code_block_21, ratio_2, recompute_3)
polygonByPolygon2d_13 = stuffer.DynamoGeometry.PolygonByPolygon2d(recursiveSplitPoly_5, height)
ratio_4 = DoubleSlider(0.75, range=0..1 step 0.03)
dir_4 = DoubleSlider(0, range=0..1 step 1)
basicSplitPolyIntoTwoUse = SpacePlanning.SplitObject.BasicSplitPolyIntoTwoUse(code_block_19, ratio_4, dir_4)
polygonByPolygon2d_14 = stuffer.DynamoGeometry.PolygonByPolygon2d(basicSplitPolyIntoTwoUse, dir_2)
offset = DoubleSlider(24, range=0..60 step 0.5)
recompute_5 = DoubleSlider(1, range=0..1 step 1)
deptSplitRefineChange = SpacePlanning.SplitObject.DeptSplitRefineChange(code_block_8.out0, dept_data, offset, recompute_5)
code_block_28 = CodeBlock(A=deptSplitRefineChange.out0) { A[3]; }
areaCheckPolygon_11 = stuffer.Polygon2d.AreaCheckPolygon(code_block_28)
code_block_29 = CodeBlock(A=deptSplitRefineChange.out0) { A[1]; }
areaCheckPolygon_12 = stuffer.Polygon2d.AreaCheckPolygon(code_block_29)
code_block_30 = CodeBlock(A=deptSplitRefineChange.out0) { A[0]; }
areaCheckPolygon_13 = stuffer.Polygon2d.AreaCheckPolygon(code_block_30)
code_block_31 = CodeBlock(A=deptSplitRefineChange.out0) { A[2]; }
areaCheckPolygon_14 = stuffer.Polygon2d.AreaCheckPolygon(code_block_31)
polygonByPolygon2d_15 = stuffer.DynamoGeometry.PolygonByPolygon2d(deptSplitRefineChange.out1, dir_2)
byPoints_4 = stuffer.Polygon2d.ByPoints(code_block_5.outlinePts)
ratio_5 = DoubleSlider(0.35, range=0..1 step 0.05)
recompute_6 = DoubleSlider(2, range=0..5 step 1)
recursiveSplitPoly_6 = SpacePlanning.SplitObject.RecursiveSplitPoly(arg1=ratio_5, arg2=recompute_6)
polygonByPolygon2d_16 = stuffer.DynamoGeometry.PolygonByPolygon2d(arg1=height)
distance_3 = DoubleSlider(12.1, range=0..30 step 0.1)
recursiveSplitOneDirByDistance_2 = SpacePlanning.SplitObject.RecursiveSplitOneDirByDistance(code_block_30, distance_3, recompute_6)
polygonByPolygon2d_17 = stuffer.DynamoGeometry.PolygonByPolygon2d(recursiveSplitOneDirByDistance_2, height)
opacity_2 = DoubleSlider(1, range=0..255 step 0.1)
val_4 = DoubleSlider(213, range=0..255 step 0.1)
val_5 = DoubleSlider(0, range=0..255 step 0.1)
val_6 = DoubleSlider(0, range=0..255 step 0.1)
byARGB_2 = Color.ByARGB(a=opacity_2, r=val_4, g=val_5, b=val_6)
byGeometryColor_2 = Display.Display.ByGeometryColor(polygonByPolygon2d_17, byARGB_2)
recursiveSplitPoly_7 = SpacePlanning.SplitObject.RecursiveSplitPoly(code_block_29, ratio_5, recompute_6)
polygonByPolygon2d_18 = stuffer.DynamoGeometry.PolygonByPolygon2d(recursiveSplitPoly_7, height)
opacity_3 = DoubleSlider(109, range=0..255 step 0.1)
val_7 = DoubleSlider(54.2, range=0..255 step 0.1)
val_8 = DoubleSlider(253.1, range=0..255 step 0.1)
val_9 = DoubleSlider(169.2, range=0..255 step 0.1)
byARGB_3 = Color.ByARGB(a=opacity_3, r=val_7, g=val_8, b=val_9)
byGeometryColor_3 = Display.Display.ByGeometryColor(polygonByPolygon2d_18, byARGB_3)
recursiveSplitPoly_8 = SpacePlanning.SplitObject.RecursiveSplitPoly(code_block_31, ratio_5, recompute_6)
polygonByPolygon2d_19 = stuffer.DynamoGeometry.PolygonByPolygon2d(recursiveSplitPoly_8, height)
opacity_4 = DoubleSlider(109, range=0..255 step 0.1)
val_10 = DoubleSlider(0, range=0..255 step 0.1)
val_11 = DoubleSlider(19.6, range=0..255 step 0.1)
val_12 = DoubleSlider(255, range=0..255 step 0.1)
byARGB_4 = Color.ByARGB(a=opacity_4, r=val_10, g=val_11, b=val_12)
byGeometryColor_4 = Display.Display.ByGeometryColor(polygonByPolygon2d_19, byARGB_4)
recursiveSplitPoly_9 = SpacePlanning.SplitObject.RecursiveSplitPoly(code_block_28, ratio_5, recompute_6)
polygonByPolygon2d_20 = stuffer.DynamoGeometry.PolygonByPolygon2d(recursiveSplitPoly_9, height)
opacity_5 = DoubleSlider(109, range=0..255 step 0.1)
val_13 = DoubleSlider(255, range=0..255 step 0.1)
val_14 = DoubleSlider(255, range=0..255 step 0.1)
val_15 = DoubleSlider(87.9, range=0..255 step 0.1)
byARGB_5 = Color.ByARGB(a=opacity_5, r=val_13, g=val_14, b=val_15)
byGeometryColor_5 = Display.Display.ByGeometryColor(polygonByPolygon2d_20, byARGB_5)
watch_2 = Watch(deptSplitRefineChange.out2)
polygonByPolygon2d_21 = stuffer.DynamoGeometry.PolygonByPolygon2d(code_block_30, dir_2)
byARGB_6 = Color.ByARGB(a=opacity_2, r=val_4, g=val_5, b=val_6)
byGeometryColor_6 = Display.Display.ByGeometryColor(polygonByPolygon2d_21, byARGB_6)
polygonByPolygon2d_22 = stuffer.DynamoGeometry.PolygonByPolygon2d(code_block_29, dir_2)
byARGB_7 = Color.ByARGB(a=opacity_3, r=val_7, g=val_8, b=val_9)
byGeometryColor_7 = Display.Display.ByGeometryColor(polygonByPolygon2d_22, byARGB_7)
polygonByPolygon2d_23 = stuffer.DynamoGeometry.PolygonByPolygon2d(code_block_31, dir_2)
byARGB_8 = Color.ByARGB(a=opacity_4, r=val_10, g=val_11, b=val_12)
byGeometryColor_8 = Display.Display.ByGeometryColor(polygonByPolygon2d_23, byARGB_8)
polygonByPolygon2d_24 = stuffer.DynamoGeometry.PolygonByPolygon2d(code_block_28, dir_2)
byARGB_9 = Color.ByARGB(a=opacity_5, r=val_13, g=val_14, b=val_15)
byGeometryColor_9 = Display.Display.ByGeometryColor(polygonByPolygon2d_24, byARGB_9)
dir_5 = DoubleSlider(0, range=0..1 step 1)
basicSplitPolyIntoTwo_3 = SpacePlanning.SplitObject.BasicSplitPolyIntoTwo(code_block_8.out0, ratio_5, dir_5)
polygonByPolygon2d_25 = stuffer.DynamoGeometry.PolygonByPolygon2d(basicSplitPolyIntoTwo_3, dir_2)
code_block_32 = CodeBlock(a=polygonByPolygon2d_25) { a[1]; }
