# Dynamo graph 07 MAR SPACEPLAN_LIL_SD1.dyn (Dynamo 0.9.1.4054)

# group: Other Inputs
dimx_cell_width = DoubleSlider(8, range=0..200 step 0.1)
dimy_cell_length = DoubleSlider(8, range=0..200 step 0.1)
circulation_add_on_factor = DoubleSlider(1.4, range=1..3 step 0.2)
patient_bed_depth_ideal_val_32 = DoubleSlider(31.5, range=0..60 step 0.5)
height_of_space_plan = DoubleSlider(5, range=0..50 step 1)
example_proportion_to_start = DoubleSlider(0.35, range=0..1 step 0.05)  # "Example Proportion to Start Splitting Programs"
patient_bed_width_ideal_val_16 = DoubleSlider(15, range=0..30 step 0.5)

# group: Make Data Stack
autoMakeBuildingOutline = SpacePlanning.ReadData.AutoMakeBuildingOutline()
autoMakeDataStack = SpacePlanning.ReadData.AutoMakeDataStack(dimx_cell_width, dimy_cell_length, circulation_add_on_factor)
code_block = CodeBlock(a=autoMakeDataStack.out3) { a; }

# group: Slide to Generate New Design
recompute_dept_arrangement = DoubleSlider(8, range=0..10 step 1)
recompute_prog_arrangement = DoubleSlider(1, range=0..5 step 1)

# group: Regular Poly
regular_poly_inputs = CodeBlock { cen = Point.ByCoordinates(-3000,-1500); radius = 150; sides = 8; }
byCenterPointRadius = Circle.ByCenterPointRadius(centerPoint=regular_poly_inputs.cen, radius=regular_poly_inputs.radius)
regularPolygon = Polygon.RegularPolygon(circle=byCenterPointRadius, numberSides=regular_poly_inputs.sides)
regular_poly_inputs_2 = CodeBlock()
# ---------- regular_poly_inputs_2.designscript (4 lines) ----------
a = Point.ByCoordinates(-3600,-1100);
b = Point.ByCoordinates(-3800,-1100);
c = Point.ByCoordinates(-3800,-1300);
d = Point.ByCoordinates(-3600,-1300);
# ----------------------------------------
create = List.Create(regular_poly_inputs_2.a, regular_poly_inputs_2.b, regular_poly_inputs_2.c, regular_poly_inputs_2.d)
byPoints = Polygon.ByPoints(create)

# group: Points For Poly
# note: Connect one of the three nodes below with outlinePts Code Block
fromOutlineGetPoints = SpacePlanning.ReadData.FromOutlineGetPoints(autoMakeBuildingOutline)
point2dFromRegularPolygon = stuffer.DynamoGeometry.Point2dFromRegularPolygon(regularPolygon)
point2dFromPointList = stuffer.DynamoGeometry.Point2dFromPointList(create)

# group (continued): Make Data Stack
outline_poly = CodeBlock(outlinePts=fromOutlineGetPoints) { Polygon2d.ByPoints(outlinePts); outlinePts; }

# group: Cells From Outline
fromPointsGetBoundingPoly = SpacePlanning.ReadData.FromPointsGetBoundingPoly(outline_poly.outlinePts)
gridPointsInsideOutline = SpacePlanning.GridObject.GridPointsInsideOutline(fromPointsGetBoundingPoly, outline_poly.outlinePts, dimx_cell_width, dimy_cell_length)
convexHullFromPoint2D = SpacePlanning.GridObject.ConvexHullFromPoint2D(gridPointsInsideOutline.out0)
pointFromPoint2dList = stuffer.DynamoGeometry.pointFromPoint2dList(convexHullFromPoint2D)
byPoints_2 = Polygon.ByPoints(pointFromPoint2dList)

# group: Cell Polys
pointFromPoint2dList_2 = stuffer.DynamoGeometry.pointFromPoint2dList(gridPointsInsideOutline.out0)
makeCellsFromGridPoints = SpacePlanning.GridObject.MakeCellsFromGridPoints(pointFromPoint2dList_2, dimx_cell_width, dimy_cell_length)
opacity = DoubleSlider(10.7, range=0..255 step 0.1)
val = DoubleSlider(164.6, range=0..255 step 0.1)
val_2 = DoubleSlider(183.1, range=0..255 step 0.1)
val_3 = DoubleSlider(165.4, range=0..255 step 0.1)
byARGB = Color.ByARGB(a=opacity, r=val, g=val_2, b=val_3)
byGeometryColor = Display.Display.ByGeometryColor(makeCellsFromGridPoints, byARGB)

# group: Cell No. Texts
pointFromPoint2dList_3 = stuffer.DynamoGeometry.pointFromPoint2dList(gridPointsInsideOutline.out0)
python_script = Python(IN[0]=pointFromPoint2dList_3)
# ---------- python_script.python (13 lines) ----------
import clr
clr.AddReference('ProtoGeometry')
from Autodesk.DesignScript.Geometry import *
#The inputs to this node will be stored as a list in the IN variables.
dataEnteringNode = IN

ptList = IN[0]
txt=[]
for i in range(len(ptList)):
	txt.append(i.ToString())

#Assign your output to the OUT variable.
OUT = txt
# ----------------------------------------
code_block_2 = CodeBlock { scale =2; SCALE2 = 4; }
fromStringOriginAndScale = DynamoText.Text.FromStringOriginAndScale(python_script, pointFromPoint2dList_3, code_block_2.scale)

# group: Generator
deptSplitRefineChange = SpacePlanning.SplitObject.DeptSplitRefineChange(outline_poly.out0, gridPointsInsideOutline.out1, code_block, patient_bed_depth_ideal_val_32, recompute_dept_arrangement)
code_block_3 = CodeBlock(A=deptSplitRefineChange.out0) { A[3]; }
areaCheckPolygon = stuffer.Polygon2d.AreaCheckPolygon(code_block_3)
code_block_4 = CodeBlock(A=deptSplitRefineChange.out0) { A[1]; }
areaCheckPolygon_2 = stuffer.Polygon2d.AreaCheckPolygon(code_block_4)
code_block_5 = CodeBlock(A=deptSplitRefineChange.out0) { A[0]; }
areaCheckPolygon_3 = stuffer.Polygon2d.AreaCheckPolygon(code_block_5)
code_block_6 = CodeBlock(A=deptSplitRefineChange.out0) { A[2]; }
areaCheckPolygon_4 = stuffer.Polygon2d.AreaCheckPolygon(code_block_6)
polygonByPolygon2d = stuffer.DynamoGeometry.PolygonByPolygon2d(deptSplitRefineChange.out1, height_of_space_plan)
recursiveSplitPoly = SpacePlanning.SplitObject.RecursiveSplitPoly(arg1=example_proportion_to_start, arg2=recompute_prog_arrangement)
polygonByPolygon2d_2 = stuffer.DynamoGeometry.PolygonByPolygon2d(arg1=height_of_space_plan)
recursiveSplitOneDirByDistance = SpacePlanning.SplitObject.RecursiveSplitOneDirByDistance(code_block_5, patient_bed_width_ideal_val_16, recompute_prog_arrangement)
polygonByPolygon2d_3 = stuffer.DynamoGeometry.PolygonByPolygon2d(recursiveSplitOneDirByDistance, height_of_space_plan)
recursiveSplitPoly_2 = SpacePlanning.SplitObject.RecursiveSplitPoly(code_block_4, example_proportion_to_start, recompute_prog_arrangement)
polygonByPolygon2d_4 = stuffer.DynamoGeometry.PolygonByPolygon2d(recursiveSplitPoly_2, height_of_space_plan)
recursiveSplitPoly_3 = SpacePlanning.SplitObject.RecursiveSplitPoly(code_block_6, example_proportion_to_start, recompute_prog_arrangement)
polygonByPolygon2d_5 = stuffer.DynamoGeometry.PolygonByPolygon2d(recursiveSplitPoly_3, height_of_space_plan)
recursiveSplitPoly_4 = SpacePlanning.SplitObject.RecursiveSplitPoly(code_block_3, example_proportion_to_start, recompute_prog_arrangement)
polygonByPolygon2d_6 = stuffer.DynamoGeometry.PolygonByPolygon2d(recursiveSplitPoly_4, height_of_space_plan)
polygonByPolygon2d_7 = stuffer.DynamoGeometry.PolygonByPolygon2d(code_block_5, height_of_space_plan)
polygonByPolygon2d_8 = stuffer.DynamoGeometry.PolygonByPolygon2d(code_block_4, height_of_space_plan)
polygonByPolygon2d_9 = stuffer.DynamoGeometry.PolygonByPolygon2d(code_block_6, height_of_space_plan)
polygonByPolygon2d_10 = stuffer.DynamoGeometry.PolygonByPolygon2d(code_block_3, height_of_space_plan)

# group: Program Polys
opacity_2 = DoubleSlider(1, range=0..255 step 0.1)
val_4 = DoubleSlider(213, range=0..255 step 0.1)
val_5 = DoubleSlider(0, range=0..255 step 0.1)
val_6 = DoubleSlider(0, range=0..255 step 0.1)
byARGB_2 = Color.ByARGB(a=opacity_2, r=val_4, g=val_5, b=val_6)
byGeometryColor_2 = Display.Display.ByGeometryColor(polygonByPolygon2d_3, byARGB_2)

# group: Program Polys
opacity_3 = DoubleSlider(255, range=0..255 step 0.1)
val_7 = DoubleSlider(220.1, range=0..255 step 0.1)
val_8 = DoubleSlider(85.5, range=0..255 step 0.1)
val_9 = DoubleSlider(182.6, range=0..255 step 0.1)
byARGB_3 = Color.ByARGB(a=opacity_3, r=val_7, g=val_8, b=val_9)
byGeometryColor_3 = Display.Display.ByGeometryColor(polygonByPolygon2d_4, byARGB_3)

# group: Program Polys
opacity_4 = DoubleSlider(109, range=0..255 step 0.1)
val_10 = DoubleSlider(0, range=0..255 step 0.1)
val_11 = DoubleSlider(19.6, range=0..255 step 0.1)
val_12 = DoubleSlider(255, range=0..255 step 0.1)
byARGB_4 = Color.ByARGB(a=opacity_4, r=val_10, g=val_11, b=val_12)
byGeometryColor_4 = Display.Display.ByGeometryColor(polygonByPolygon2d_5, byARGB_4)

# group: Program Polys
opacity_5 = DoubleSlider(109, range=0..255 step 0.1)
val_13 = DoubleSlider(0, range=0..255 step 0.1)
val_14 = DoubleSlider(0, range=0..255 step 0.1)
val_15 = DoubleSlider(72.5, range=0..255 step 0.1)
byARGB_5 = Color.ByARGB(a=opacity_5, r=val_13, g=val_14, b=val_15)
byGeometryColor_5 = Display.Display.ByGeometryColor(polygonByPolygon2d_6, byARGB_5)

# group: Dept Analytics
deptAnalytics = SpacePlanning.PlaceSpace.DeptAnalytics(deptSplitRefineChange.out3)
department_placed_sorted = Watch(deptAnalytics.out0)
num_cells_taken = Watch(deptAnalytics.out1)
area_satisfied = Watch(deptAnalytics.out2)
area_needed = Watch(deptAnalytics.out3)
areaProvided = Watch(deptAnalytics.out4)
code_block_7 = CodeBlock(prog=deptAnalytics.out5) { prog.ProgramName; }
programs_in_dept = Watch(code_block_7)

# group: Dept Polys
byARGB_6 = Color.ByARGB(a=opacity_2, r=val_4, g=val_5, b=val_6)
byGeometryColor_6 = Display.Display.ByGeometryColor(polygonByPolygon2d_7, byARGB_6)
byARGB_7 = Color.ByARGB(a=opacity_3, r=val_7, g=val_8, b=val_9)
byGeometryColor_7 = Display.Display.ByGeometryColor(polygonByPolygon2d_8, byARGB_7)
byARGB_8 = Color.ByARGB(a=opacity_4, r=val_10, g=val_11, b=val_12)
byGeometryColor_8 = Display.Display.ByGeometryColor(polygonByPolygon2d_9, byARGB_8)
byARGB_9 = Color.ByARGB(a=opacity_5, r=val_13, g=val_14, b=val_15)
byGeometryColor_9 = Display.Display.ByGeometryColor(polygonByPolygon2d_10, byARGB_9)
