# Dynamo graph 08 MAR_TEST BOUDING_1.dyn (Dynamo 0.9.1.4054)

# group: Other Inputs
dimx_cell_width = DoubleSlider(40, range=0..200 step 0.1)
dimy_cell_length = DoubleSlider(40, range=0..200 step 0.1)
circulation_add_on_factor = DoubleSlider(1.5, range=1..3 step 0.2)
patient_bed_depth_ideal_val_32 = DoubleSlider(31.5, range=0..60 step 0.5)
height_of_space_plan = DoubleSlider(0, range=0..50 step 1)
example_proportion_to_start = DoubleSlider(0.35, range=0..1 step 0.05)  # "Example Proportion to Start Splitting Programs"
patient_bed_width_ideal_val_16 = DoubleSlider(15, range=0..30 step 0.5)

# group: Make Data Stack
autoMakeBuildingOutline = SpacePlanning.ReadData.AutoMakeBuildingOutline()
autoMakeDataStack = SpacePlanning.ReadData.AutoMakeDataStack(dimx_cell_width, dimy_cell_length, circulation_add_on_factor)
code_block = CodeBlock(a=autoMakeDataStack.out3) { a; }

# group: Slide to Generate New Design
recompute_dept_arrangement = DoubleSlider(4, range=0..10 step 1)
recompute_prog_arrangement = DoubleSlider(2, range=0..5 step 1)

# group: Make Regular Poly
regular_poly_inputs = CodeBlock()
# ---------- regular_poly_inputs.designscript (4 lines) ----------
a = Point.ByCoordinates(-3600,-1100);
b = Point.ByCoordinates(-3800,-1100);
c = Point.ByCoordinates(-3800,-1300);
d = Point.ByCoordinates(-3600,-1300);
# ----------------------------------------
create = List.Create(regular_poly_inputs.a, regular_poly_inputs.b, regular_poly_inputs.c, regular_poly_inputs.d)
regular_polygon_inp = CodeBlock { cen = Point.ByCoordinates(-3000,-1500); radius = 150; sides = 8; }
byCenterPointRadius = Circle.ByCenterPointRadius(centerPoint=regular_polygon_inp.cen, radius=regular_polygon_inp.radius)
regularPolygon = Polygon.RegularPolygon(circle=byCenterPointRadius, numberSides=regular_polygon_inp.sides)

# group: Input Poly Pts
# note: Connect one of the three nodes below with outlinePts Code Block
fromOutlineGetPoints = SpacePlanning.ReadData.FromOutlineGetPoints(autoMakeBuildingOutline)
point2dFromPointList = stuffer.DynamoGeometry.Point2dFromPointList(create)
point2dFromRegularPolygon = stuffer.DynamoGeometry.Point2dFromRegularPolygon(regularPolygon)

# group (continued): Make Data Stack
outline_poly = CodeBlock(outlinePts=fromOutlineGetPoints) { Polygon2d.ByPoints(outlinePts); outlinePts; }

# group: Cells From Outline
fromPointsGetBoundingPoly = SpacePlanning.ReadData.FromPointsGetBoundingPoly(outline_poly.outlinePts)
gridPointsInsideOutline = SpacePlanning.GridObject.GridPointsInsideOutline(fromPointsGetBoundingPoly, outline_poly.outlinePts, dimx_cell_width, dimy_cell_length)
convexHullFromPoint2D = SpacePlanning.GridObject.ConvexHullFromPoint2D(gridPointsInsideOutline.out0)
pointFromPoint2dList = stuffer.DynamoGeometry.pointFromPoint2dList(convexHullFromPoint2D)
byPoints = Polygon.ByPoints(pointFromPoint2dList)

# group: Generator
deptArrangeOnSite = SpacePlanning.BuildLayout.DeptArrangeOnSite(outline_poly.out0, code_block, gridPointsInsideOutline.out1, patient_bed_depth_ideal_val_32, recompute_dept_arrangement)
code_block_2 = CodeBlock(deptPolys=deptArrangeOnSite.out0) { deptPolys; }
code_block_3 = CodeBlock(A=code_block_2) { A[0]; }
polygonByPolygon2d = stuffer.DynamoGeometry.PolygonByPolygon2d(code_block_3, height_of_space_plan)
code_block_4 = CodeBlock(A=code_block_2) { A[1]; }
polygonByPolygon2d_2 = stuffer.DynamoGeometry.PolygonByPolygon2d(code_block_4, height_of_space_plan)
code_block_5 = CodeBlock(A=code_block_2) { A[2]; }
polygonByPolygon2d_3 = stuffer.DynamoGeometry.PolygonByPolygon2d(code_block_5, height_of_space_plan)
code_block_6 = CodeBlock(A=code_block_2) { A[3]; }
polygonByPolygon2d_4 = stuffer.DynamoGeometry.PolygonByPolygon2d(code_block_6, height_of_space_plan)
areaCheckPolygon = stuffer.Polygon2d.AreaCheckPolygon(code_block_6)
areaCheckPolygon_2 = stuffer.Polygon2d.AreaCheckPolygon(code_block_4)
areaCheckPolygon_3 = stuffer.Polygon2d.AreaCheckPolygon(code_block_3)
areaCheckPolygon_4 = stuffer.Polygon2d.AreaCheckPolygon(code_block_5)
polygonByPolygon2d_5 = stuffer.DynamoGeometry.PolygonByPolygon2d(deptArrangeOnSite.out1, height_of_space_plan)
programs_in_each_dept = CodeBlock(deptArrangeOnSite.out3) { Dept.ProgramsInDept; }
code_block_7 = CodeBlock(program=programs_in_each_dept) { program[3]; }
recursiveSplitPolyPrograms = SpacePlanning.BuildLayout.RecursiveSplitPolyPrograms(code_block_6, code_block_7, example_proportion_to_start, recompute_prog_arrangement)
polygonByPolygon2d_6 = stuffer.DynamoGeometry.PolygonByPolygon2d(recursiveSplitPolyPrograms, height_of_space_plan)
programs_in_each_dept_2 = CodeBlock(deptArrangeOnSite.out3) { Dept.ProgramsInDept; }
code_block_8 = CodeBlock(program=programs_in_each_dept_2) { program[0]; }
recursiveSplitOneDirByDistance = SpacePlanning.BuildLayout.RecursiveSplitOneDirByDistance(code_block_3, patient_bed_width_ideal_val_16, recompute_prog_arrangement)
deptSplitRefineChange = SpacePlanning.SplitObject.DeptSplitRefineChange(outline_poly.out0, gridPointsInsideOutline.out1, code_block, patient_bed_depth_ideal_val_32, recompute_dept_arrangement)
polygonByPolygon2d_7 = stuffer.DynamoGeometry.PolygonByPolygon2d(deptSplitRefineChange, height_of_space_plan)
programs_in_each_dept_3 = CodeBlock(deptArrangeOnSite.out3) { Dept.ProgramsInDept; }
code_block_9 = CodeBlock(program=programs_in_each_dept_3) { program[2]; }
recursiveSplitPolyPrograms_2 = SpacePlanning.BuildLayout.RecursiveSplitPolyPrograms(code_block_5, code_block_9, example_proportion_to_start, recompute_prog_arrangement)
polygonByPolygon2d_8 = stuffer.DynamoGeometry.PolygonByPolygon2d(recursiveSplitPolyPrograms_2, height_of_space_plan)
programs_in_each_dept_4 = CodeBlock(deptArrangeOnSite.out3) { Dept.ProgramsInDept; }
code_block_10 = CodeBlock(program=programs_in_each_dept_4) { program[1]; }
recursiveSplitPolyPrograms_3 = SpacePlanning.BuildLayout.RecursiveSplitPolyPrograms(code_block_4, code_block_10, example_proportion_to_start, recompute_prog_arrangement)
polygonByPolygon2d_9 = stuffer.DynamoGeometry.PolygonByPolygon2d(recursiveSplitPolyPrograms_3, height_of_space_plan)

recursiveSplitProgramsOneDirByDistance = SpacePlanning.BuildLayout.RecursiveSplitProgramsOneDirByDistance(code_block_3, code_block_8, patient_bed_width_ideal_val_16, recompute_prog_arrangement)

# group (continued): Generator
polygonByPolygon2d_10 = stuffer.DynamoGeometry.PolygonByPolygon2d(recursiveSplitProgramsOneDirByDistance, height_of_space_plan)

code_block_11 = CodeBlock(a=code_block) { a.ProgramsInDept.UnitArea; }
watch = Watch(code_block_11)
flatten = Flatten(code_block_3)
number_slider = DoubleSlider(1000, range=1000..2000 step 1)
number_slider_2 = DoubleSlider(700, range=300..2000 step 1)
code_block_12 = CodeBlock(a=number_slider, b=number_slider_2)
# ---------- code_block_12.designscript (4 lines) ----------
Point2d.ByCoordinates(-a,-500);
Point2d.ByCoordinates(-a+b,-500);
Point2d.ByCoordinates(-a+b,-1200);
Point2d.ByCoordinates(-a,-1200);
# ----------------------------------------
create_2 = List.Create(code_block_12.out0, code_block_12.out1, code_block_12.out2, code_block_12.out3)
byPoints_2 = stuffer.Polygon2d.ByPoints(create_2)
number_slider_3 = DoubleSlider(0, range=0..2000 step 1)
polygonByPolygon2d_11 = stuffer.DynamoGeometry.PolygonByPolygon2d(byPoints_2, number_slider_3)
number_slider_4 = DoubleSlider(1000, range=-1000..2000 step 1)
number_slider_5 = DoubleSlider(500, range=500..2000 step 1)
number_slider_6 = DoubleSlider(-500, range=-500..2000 step 1)
number_slider_7 = DoubleSlider(1200, range=300..2000 step 1)
code_block_13 = CodeBlock(a=number_slider_4, c=number_slider_5, b=number_slider_6, d=number_slider_7)
# ---------- code_block_13.designscript (4 lines) ----------
Point2d.ByCoordinates(-a,-c);
Point2d.ByCoordinates(-a+b,-c);
Point2d.ByCoordinates(-a+b,-d);
Point2d.ByCoordinates(-a,-d);
# ----------------------------------------
create_3 = List.Create(code_block_13.out0, code_block_13.out1, code_block_13.out2, code_block_13.out3)
byPoints_3 = stuffer.Polygon2d.ByPoints(create_3)
polygonByPolygon2d_12 = stuffer.DynamoGeometry.PolygonByPolygon2d(byPoints_3, number_slider_3)
polygonPolygonCommonEdge = SpacePlanning.BuildLayout.PolygonPolygonCommonEdge(byPoints_2, byPoints_3)
watch_2 = Watch(polygonPolygonCommonEdge)
code_block_14 = CodeBlock(a=polygonByPolygon2d_8) { a[4]; }
code_block_15 = CodeBlock(a=code_block_14) { a.Points; }
point2dFromPointList_2 = stuffer.DynamoGeometry.Point2dFromPointList(code_block_15)
code_block_16 = CodeBlock(a=point2dFromPointList_2) { Polygon2d.ByPoints(a); }
code_block_17 = CodeBlock(a=polygonByPolygon2d_9) { a[3]; }
code_block_18 = CodeBlock(a=code_block_17) { a.Points; }
point2dFromPointList_3 = stuffer.DynamoGeometry.Point2dFromPointList(code_block_18)
code_block_19 = CodeBlock(a=point2dFromPointList_3) { Polygon2d.ByPoints(a); }
polygonPolygonCommonEdge_2 = SpacePlanning.BuildLayout.PolygonPolygonCommonEdge(code_block_16, code_block_19)
code_block_20 = CodeBlock(a=polygonPolygonCommonEdge_2) { a.StartPoint; a.EndPoint; }
pointByPoint2d = stuffer.DynamoGeometry.PointByPoint2d(code_block_20.out0, number_slider_3)
pointByPoint2d_2 = stuffer.DynamoGeometry.PointByPoint2d(code_block_20.out1, number_slider_3)
code_block_21 = CodeBlock(a=pointByPoint2d, b=pointByPoint2d_2) { Line.ByStartPointEndPoint(a,b); }
code_block_22 = CodeBlock(a=polygonByPolygon2d_8) { a[2]; }
code_block_23 = CodeBlock { Li; }
code_block_24 = CodeBlock()
# ---------- code_block_24.designscript (5 lines) ----------
Point.ByCoordinates(-2000,100);
Point.ByCoordinates(5000, 800);
Point2d.ByCoordinates(-300,400);
0;
Point.ByCoordinates(-100,400);
# ----------------------------------------
code_block_25 = CodeBlock(a=code_block_24.out0, b=code_block_24.out1) { Line.ByStartPointEndPoint(a,b); }
perpProjectionPointOnLine = SpacePlanning.GraphicsUtility.PerpProjectionPointOnLine(code_block_25, code_block_24.out2)
pointByPoint2d_3 = stuffer.DynamoGeometry.PointByPoint2d(perpProjectionPointOnLine, code_block_24.out3)
code_block_26 = CodeBlock(a=pointByPoint2d_3, b=code_block_24.out4) { Line.ByStartPointEndPoint(a,b); }
byTwoPoints = Vector.ByTwoPoints(start=code_block_24.out0, end=code_block_24.out1)
byTwoPoints_2 = Vector.ByTwoPoints(start=code_block_24.out4, end=pointByPoint2d_3)
angleBetween = Vector.AngleBetween(byTwoPoints, byTwoPoints_2)
code_block_27 = CodeBlock(a=code_block_24.out0, b=code_block_24.out1) { Vector.ByCoordinates(a,b); }
getClosestPointOnLineSegment = SpacePlanning.GraphicsUtility.GetClosestPointOnLineSegment(code_block_25, code_block_24.out2)
code_block_28 = CodeBlock { Point2d.ByCoordinates(-5000,200); }
closestPointOnLine = SpacePlanning.GraphicsUtility.ClosestPointOnLine(code_block_25, code_block_28)
pointByPoint2d_4 = stuffer.DynamoGeometry.PointByPoint2d(closestPointOnLine, code_block_24.out3)
pointByPoint2d_5 = stuffer.DynamoGeometry.PointByPoint2d(code_block_28, code_block_24.out3)
code_block_29 = CodeBlock(a=pointByPoint2d_4, b=pointByPoint2d_5) { Line.ByStartPointEndPoint(a,b); }
