# Dynamo graph 11 MAR _ FULL GRAPH _1.dyn (Dynamo 0.9.1.4054)

# group: Other Inputs
dimx_cell_width = DoubleSlider(40, range=0..200 step 0.1)
dimy_cell_length = DoubleSlider(40, range=0..200 step 0.1)
circulation_add_on_factor = DoubleSlider(1.5, range=1..3 step 0.2)
patient_bed_depth_ideal_val_32 = DoubleSlider(31.5, range=0..60 step 0.5)
height_of_space_plan = DoubleSlider(0, range=0..50 step 1)
patient_bed_width_ideal_val_16 = DoubleSlider(15, range=0..30 step 0.5)
example_proportion_to_start = DoubleSlider(0.35, range=0..1 step 0.05)  # "Example Proportion to Start Splitting Programs"

# group: Make Data Stack
autoMakeBuildingOutline = SpacePlanning.ReadData.AutoMakeBuildingOutline()
autoMakeDataStack = SpacePlanning.ReadData.AutoMakeDataStack(dimx_cell_width, dimy_cell_length, circulation_add_on_factor)
code_block = CodeBlock(a=autoMakeDataStack.out3) { a; }

# group: Slide to Generate New Design
recompute_dept_arrangement = DoubleSlider(4, range=0..10 step 1)
recompute_prog_arrangement = DoubleSlider(2, range=0..5 step 1)

# group: Make Regular Poly
regular_poly_inputs = CodeBlock()
# ---------- regular_poly_inputs.designscript (4 lines) ----------
a = Point.ByCoordinates(-3600,-1100);
b = Point.ByCoordinates(-3800,-1100);
c = Point.ByCoordinates(-3800,-1300);
d = Point.ByCoordinates(-3600,-1300);
# ----------------------------------------
create = List.Create(regular_poly_inputs.a, regular_poly_inputs.b, regular_poly_inputs.c, regular_poly_inputs.d)
regular_polygon_inp = CodeBlock { cen = Point.ByCoordinates(-3000,-1500); radius = 150; sides = 8; }
byCenterPointRadius = Circle.ByCenterPointRadius(centerPoint=regular_polygon_inp.cen, radius=regular_polygon_inp.radius)
regularPolygon = Polygon.RegularPolygon(circle=byCenterPointRadius, numberSides=regular_polygon_inp.sides)

# group: Input Poly Pts
# note: Connect one of the three nodes below with outlinePts Code Block
fromOutlineGetPoints = SpacePlanning.ReadData.FromOutlineGetPoints(autoMakeBuildingOutline)
point2dFromPointList = stuffer.DynamoGeometry.Point2dFromPointList(create)
point2dFromRegularPolygon = stuffer.DynamoGeometry.Point2dFromRegularPolygon(regularPolygon)

# group (continued): Make Data Stack
outline_poly = CodeBlock(outlinePts=fromOutlineGetPoints) { Polygon2d.ByPoints(outlinePts); outlinePts; }

# group: Cells From Outline
fromPointsGetBoundingPoly = SpacePlanning.ReadData.FromPointsGetBoundingPoly(outline_poly.outlinePts)
gridPointsInsideOutline = SpacePlanning.GridObject.GridPointsInsideOutline(fromPointsGetBoundingPoly, outline_poly.outlinePts, dimx_cell_width, dimy_cell_length)
convexHullFromPoint2D = SpacePlanning.GridObject.ConvexHullFromPoint2D(gridPointsInsideOutline.out0)
pointFromPoint2dList = stuffer.DynamoGeometry.pointFromPoint2dList(convexHullFromPoint2D)
byPoints = Polygon.ByPoints(pointFromPoint2dList)

# group: Cell Polys
makeCellsFromGridPoints = SpacePlanning.GridObject.MakeCellsFromGridPoints(arg1=dimx_cell_width, arg2=dimy_cell_length)
pointFromPoint2dList_2 = stuffer.DynamoGeometry.pointFromPoint2dList(gridPointsInsideOutline.out0)
opacity = DoubleSlider(10.7, range=0..255 step 0.1)
val = DoubleSlider(164.6, range=0..255 step 0.1)
val_2 = DoubleSlider(183.1, range=0..255 step 0.1)
val_3 = DoubleSlider(165.4, range=0..255 step 0.1)
byARGB = Color.ByARGB(a=opacity, r=val, g=val_2, b=val_3)
byGeometryColor = Display.Display.ByGeometryColor(arg1=byARGB)

# group: Cell No. Texts
pointFromPoint2dList_3 = stuffer.DynamoGeometry.pointFromPoint2dList(gridPointsInsideOutline.out0)
python_script = Python(IN[0]=pointFromPoint2dList_3)
# ---------- python_script.python (13 lines) ----------
import clr
clr.AddReference('ProtoGeometry')
from Autodesk.DesignScript.Geometry import *
#The inputs to this node will be stored as a list in the IN variables.
dataEnteringNode = IN

ptList = IN[0]
txt=[]
for i in range(len(ptList)):
	txt.append(i.ToString())

#Assign your output to the OUT variable.
OUT = txt
# ----------------------------------------
code_block_2 = CodeBlock { scale =2; SCALE2 = 4; }
fromStringOriginAndScale = DynamoText.Text.FromStringOriginAndScale(python_script, pointFromPoint2dList_3, code_block_2.scale)

# group: Generator
deptArrangeOnSite = SpacePlanning.BuildLayout.DeptArrangeOnSite(outline_poly.out0, code_block, gridPointsInsideOutline.out1, patient_bed_depth_ideal_val_32, recompute_dept_arrangement)
code_block_3 = CodeBlock(deptPolys=deptArrangeOnSite.out0) { deptPolys; }
code_block_4 = CodeBlock(A=code_block_3) { A[3]; }
areaCheckPolygon = stuffer.Polygon2d.AreaCheckPolygon(code_block_4)
code_block_5 = CodeBlock(A=code_block_3) { A[1]; }
areaCheckPolygon_2 = stuffer.Polygon2d.AreaCheckPolygon(code_block_5)
code_block_6 = CodeBlock(A=code_block_3) { A[0]; }
areaCheckPolygon_3 = stuffer.Polygon2d.AreaCheckPolygon(code_block_6)
code_block_7 = CodeBlock(A=code_block_3) { A[2]; }
areaCheckPolygon_4 = stuffer.Polygon2d.AreaCheckPolygon(code_block_7)
polygonByPolygon2d = stuffer.DynamoGeometry.PolygonByPolygon2d(deptArrangeOnSite.out1, height_of_space_plan)
programs_in_each_dept = CodeBlock(deptArrangeOnSite.out3) { Dept.ProgramsInDept; }
code_block_8 = CodeBlock(program=programs_in_each_dept) { program[0]; }
programs_in_each_dept_2 = CodeBlock(deptArrangeOnSite.out3) { Dept.ProgramsInDept; }
code_block_9 = CodeBlock(program=programs_in_each_dept_2) { program[1]; }
recursiveSplitPolyPrograms = SpacePlanning.BuildLayout.RecursiveSplitPolyPrograms(code_block_5, code_block_9, example_proportion_to_start, recompute_prog_arrangement)
polygonByPolygon2d_2 = stuffer.DynamoGeometry.PolygonByPolygon2d(recursiveSplitPolyPrograms.out0, height_of_space_plan)
programs_in_each_dept_3 = CodeBlock(deptArrangeOnSite.out3) { Dept.ProgramsInDept; }
code_block_10 = CodeBlock(program=programs_in_each_dept_3) { program[2]; }
recursiveSplitPolyPrograms_2 = SpacePlanning.BuildLayout.RecursiveSplitPolyPrograms(code_block_7, code_block_10, example_proportion_to_start, recompute_prog_arrangement)
polygonByPolygon2d_3 = stuffer.DynamoGeometry.PolygonByPolygon2d(recursiveSplitPolyPrograms_2.out0, height_of_space_plan)
programs_in_each_dept_4 = CodeBlock(deptArrangeOnSite.out3) { Dept.ProgramsInDept; }
code_block_11 = CodeBlock(program=programs_in_each_dept_4) { program[3]; }
recursiveSplitPolyPrograms_3 = SpacePlanning.BuildLayout.RecursiveSplitPolyPrograms(code_block_4, code_block_11, example_proportion_to_start, recompute_prog_arrangement)
polygonByPolygon2d_4 = stuffer.DynamoGeometry.PolygonByPolygon2d(recursiveSplitPolyPrograms_3.out0, height_of_space_plan)
polygonByPolygon2d_5 = stuffer.DynamoGeometry.PolygonByPolygon2d(code_block_6, height_of_space_plan)
polygonByPolygon2d_6 = stuffer.DynamoGeometry.PolygonByPolygon2d(code_block_5, height_of_space_plan)
polygonByPolygon2d_7 = stuffer.DynamoGeometry.PolygonByPolygon2d(code_block_7, height_of_space_plan)
polygonByPolygon2d_8 = stuffer.DynamoGeometry.PolygonByPolygon2d(code_block_4, height_of_space_plan)
deptSplitRefineChange = SpacePlanning.SplitObject.DeptSplitRefineChange(outline_poly.out0, gridPointsInsideOutline.out1, code_block, patient_bed_depth_ideal_val_32, recompute_dept_arrangement)
polygonByPolygon2d_9 = stuffer.DynamoGeometry.PolygonByPolygon2d(deptSplitRefineChange, height_of_space_plan)

recursiveSplitProgramsOneDirByDistance = SpacePlanning.BuildLayout.RecursiveSplitProgramsOneDirByDistance(code_block_6, code_block_8, patient_bed_width_ideal_val_16, recompute_prog_arrangement)

# group (continued): Generator
polygonByPolygon2d_10 = stuffer.DynamoGeometry.PolygonByPolygon2d(recursiveSplitProgramsOneDirByDistance.out0, height_of_space_plan)

# group: Program Polys
opacity_2 = DoubleSlider(1, range=0..255 step 0.1)
val_4 = DoubleSlider(213, range=0..255 step 0.1)
val_5 = DoubleSlider(0, range=0..255 step 0.1)
val_6 = DoubleSlider(0, range=0..255 step 0.1)
byARGB_2 = Color.ByARGB(a=opacity_2, r=val_4, g=val_5, b=val_6)
byGeometryColor_2 = Display.Display.ByGeometryColor(polygonByPolygon2d_10, byARGB_2)

# group: Program Polys
opacity_3 = DoubleSlider(255, range=0..255 step 0.1)
val_7 = DoubleSlider(220.1, range=0..255 step 0.1)
val_8 = DoubleSlider(85.5, range=0..255 step 0.1)
val_9 = DoubleSlider(182.6, range=0..255 step 0.1)
byARGB_3 = Color.ByARGB(a=opacity_3, r=val_7, g=val_8, b=val_9)
byGeometryColor_3 = Display.Display.ByGeometryColor(polygonByPolygon2d_2, byARGB_3)

# group: Program Polys
opacity_4 = DoubleSlider(109, range=0..255 step 0.1)
val_10 = DoubleSlider(0, range=0..255 step 0.1)
val_11 = DoubleSlider(19.6, range=0..255 step 0.1)
val_12 = DoubleSlider(255, range=0..255 step 0.1)
byARGB_4 = Color.ByARGB(a=opacity_4, r=val_10, g=val_11, b=val_12)
byGeometryColor_4 = Display.Display.ByGeometryColor(polygonByPolygon2d_3, byARGB_4)

# group: Program Polys
opacity_5 = DoubleSlider(109, range=0..255 step 0.1)
val_13 = DoubleSlider(0, range=0..255 step 0.1)
val_14 = DoubleSlider(0, range=0..255 step 0.1)
val_15 = DoubleSlider(72.5, range=0..255 step 0.1)
byARGB_5 = Color.ByARGB(a=opacity_5, r=val_13, g=val_14, b=val_15)
byGeometryColor_5 = Display.Display.ByGeometryColor(polygonByPolygon2d_4, byARGB_5)

# group: Dept Analytics
deptAnalytics = SpacePlanning.PlaceSpace.DeptAnalytics(deptArrangeOnSite.out3)
department_placed_sorted = Watch(deptAnalytics.out0)
num_cells_taken = Watch(deptAnalytics.out1)
area_satisfied = Watch(deptAnalytics.out2)
area_needed = Watch(deptAnalytics.out3)
areaProvided = Watch(deptAnalytics.out4)
code_block_12 = CodeBlock(prog=deptAnalytics.out5) { prog.ProgramName; }
programs_in_dept = Watch(code_block_12)

# group: Dept Polys
byARGB_6 = Color.ByARGB(a=opacity_2, r=val_4, g=val_5, b=val_6)
byGeometryColor_6 = Display.Display.ByGeometryColor(polygonByPolygon2d_5, byARGB_6)
byARGB_7 = Color.ByARGB(a=opacity_3, r=val_7, g=val_8, b=val_9)
byGeometryColor_7 = Display.Display.ByGeometryColor(polygonByPolygon2d_6, byARGB_7)
byARGB_8 = Color.ByARGB(a=opacity_4, r=val_10, g=val_11, b=val_12)
byGeometryColor_8 = Display.Display.ByGeometryColor(polygonByPolygon2d_7, byARGB_8)
byARGB_9 = Color.ByARGB(a=opacity_5, r=val_13, g=val_14, b=val_15)
byGeometryColor_9 = Display.Display.ByGeometryColor(polygonByPolygon2d_8, byARGB_9)

code_block_13 = CodeBlock(updatedProgramData=recursiveSplitProgramsOneDirByDistance.out3) { updatedProgramData; }
code_block_14 = CodeBlock(updatedProgramData=recursiveSplitPolyPrograms.out3) { updatedProgramData; }
code_block_15 = CodeBlock(updatedProgramData=recursiveSplitPolyPrograms_2.out3) { updatedProgramData; }
code_block_16 = CodeBlock(updatedProgramData=recursiveSplitPolyPrograms_3.out3) { updatedProgramData; }

# group: Program Analytics
programAnalytics = SpacePlanning.PlaceSpace.ProgramAnalytics(code_block_13)
programs_in_dept_2 = Watch(programAnalytics.out0)
cells_occupied = Watch(programAnalytics.out1)
is_area_satisfied = Watch(programAnalytics.out2)
area_needed_2 = Watch(programAnalytics.out3)
area_provided = Watch(programAnalytics.out4)
quantity = Watch(programAnalytics.out5)
code_block_17 = CodeBlock(updatedProgramData=recursiveSplitProgramsOneDirByDistance.out3) { updatedProgramData[0]; }
code_block_18 = CodeBlock(updatedProgramData=recursiveSplitPolyPrograms.out3) { updatedProgramData[0]; }
programAnalytics_2 = SpacePlanning.PlaceSpace.ProgramAnalytics(code_block_14)
programs_in_dept_3 = Watch(programAnalytics_2.out0)
cells_occupied_2 = Watch(programAnalytics_2.out1)
is_area_satisfied_2 = Watch(programAnalytics_2.out2)
area_needed_3 = Watch(programAnalytics_2.out3)
area_provided_2 = Watch(programAnalytics_2.out4)
quantity_2 = Watch(programAnalytics_2.out5)
code_block_19 = CodeBlock(updatedProgramData=recursiveSplitPolyPrograms_2.out3) { updatedProgramData[0]; }
programAnalytics_3 = SpacePlanning.PlaceSpace.ProgramAnalytics(code_block_15)
programs_in_dept_4 = Watch(programAnalytics_3.out0)
cells_occupied_3 = Watch(programAnalytics_3.out1)
is_area_satisfied_3 = Watch(programAnalytics_3.out2)
area_needed_4 = Watch(programAnalytics_3.out3)
area_provided_3 = Watch(programAnalytics_3.out4)
quantity_3 = Watch(programAnalytics_3.out5)
code_block_20 = CodeBlock(updatedProgramData=recursiveSplitPolyPrograms_3.out3) { updatedProgramData[0]; }
programAnalytics_4 = SpacePlanning.PlaceSpace.ProgramAnalytics(code_block_16)
programs_in_dept_5 = Watch(programAnalytics_4.out0)
cells_occupied_4 = Watch(programAnalytics_4.out1)
is_area_satisfied_4 = Watch(programAnalytics_4.out2)
area_needed_5 = Watch(programAnalytics_4.out3)
area_provided_4 = Watch(programAnalytics_4.out4)
quantity_4 = Watch(programAnalytics_4.out5)

code_block_21 = CodeBlock(a=code_block) { a.ProgramsInDept.UnitArea; }
watch = Watch(code_block_21)
watch_2 = Watch(recursiveSplitPolyPrograms_2.out0)
flatten = Flatten(code_block_6)
poly_assigned_to_depts = Watch(deptAnalytics.out6)
poly_assigned_to_progs = Watch(programAnalytics_4.out6)
poly_assigned_to_progs_2 = Watch(programAnalytics_3.out6)
poly_assigned_to_progs_3 = Watch(programAnalytics_2.out6)
poly_assigned_to_progs_4 = Watch(programAnalytics.out6)
makeDeptTopologyChart = SpacePlanning.BuildLayout.MakeDeptTopologyChart(deptArrangeOnSite.out3)
code_block_22 = CodeBlock { 3; }
boolean = BoolSelector(false)
circulationMake = SpacePlanning.BuildLayout.CirculationMake(deptArrangeOnSite.out3, makeDeptTopologyChart.out3, makeDeptTopologyChart.out4, code_block_22, boolean)
lineByLine2d = stuffer.DynamoGeometry.LineByLine2d(circulationMake.out0)
code_block_23 = CodeBlock { 0; }
lineByLine2d_2 = stuffer.DynamoGeometry.LineByLine2d(makeDeptTopologyChart.out3, code_block_23)
lineByLine2d_3 = stuffer.DynamoGeometry.LineByLine2d(makeDeptTopologyChart.out4, code_block_23)
create_2 = List.Create(lineByLine2d_2, lineByLine2d_3)
code_block_24 = CodeBlock { 3; }
polygonByPolygon2d_11 = stuffer.DynamoGeometry.PolygonByPolygon2d(code_block_7, code_block_24)
code_block_25 = CodeBlock(a=circulationMake.out0) { a[0]; }
distance = DoubleSlider(8, range=0..100 step 0.1)
splitByLine = SpacePlanning.BuildLayout.SplitByLine(code_block_7, code_block_25, distance)
lineByLine2d_4 = stuffer.DynamoGeometry.LineByLine2d(splitByLine.out1)
polygonByPolygon2d_12 = stuffer.DynamoGeometry.PolygonByPolygon2d(splitByLine.out0, code_block_24)
code_block_26 = CodeBlock(a=polygonByPolygon2d_12) { a[0][0]; }
watch_3 = Watch(polygonByPolygon2d_12)
polygonByPolygon2d_13 = stuffer.DynamoGeometry.PolygonByPolygon2d(circulationMake.out3, code_block_24)
code_block_27 = CodeBlock(a=polygonByPolygon2d_13) { a[1]; }
byPatch = Surface.ByPatch(polygonByPolygon2d_13)
watch_4 = Watch(circulationMake.out3)
makeSurfaceForPolygon2d = stuffer.DynamoGeometry.MakeSurfaceForPolygon2d(circulationMake.out3)
