# Dynamo graph 13 MAR _ TEST.dyn (Dynamo 0.9.1.4054)

# group: Other Inputs
dimx_cell_width = DoubleSlider(40, range=0..200 step 0.1)
dimy_cell_length = DoubleSlider(40, range=0..200 step 0.1)
circulation_add_on_factor = DoubleSlider(1.5, range=1..3 step 0.2)
patient_bed_depth_ideal_val_32 = DoubleSlider(31.5, range=0..60 step 0.5)
height_of_space_plan = DoubleSlider(0, range=0..50 step 1)
example_proportion_to_start = DoubleSlider(0.35, range=0..1 step 0.05)  # "Example Proportion to Start Splitting Programs"
patient_bed_width_ideal_val_16 = DoubleSlider(15, range=0..30 step 0.5)

# group: Make Data Stack
autoMakeBuildingOutline = SpacePlanning.ReadData.AutoMakeBuildingOutline()
autoMakeDataStack = SpacePlanning.ReadData.AutoMakeDataStack(dimx_cell_width, dimy_cell_length, circulation_add_on_factor)
code_block = CodeBlock(a=autoMakeDataStack.out3) { a; }

# group: Slide to Generate New Design
recompute_dept_arrangement = DoubleSlider(8, range=0..10 step 1)
recompute_prog_arrangement = DoubleSlider(4, range=0..5 step 1)

# group: Make Regular Poly
regular_poly_inputs = CodeBlock()
# ---------- regular_poly_inputs.designscript (4 lines) ----------
a = Point.ByCoordinates(-3600,-1100);
b = Point.ByCoordinates(-3800,-1100);
c = Point.ByCoordinates(-3800,-1300);
d = Point.ByCoordinates(-3600,-1300);
# ----------------------------------------
create = List.Create(regular_poly_inputs.a, regular_poly_inputs.b, regular_poly_inputs.c, regular_poly_inputs.d)
regular_polygon_inp = CodeBlock { cen = Point.ByCoordinates(-3000,-1500); radius = 150; sides = 8; }
byCenterPointRadius = Circle.ByCenterPointRadius(centerPoint=regular_polygon_inp.cen, radius=regular_polygon_inp.radius)
regularPolygon = Polygon.RegularPolygon(circle=byCenterPointRadius, numberSides=regular_polygon_inp.sides)

# group: Input Poly Pts
# note: Connect one of the three nodes below with outlinePts Code Block
fromOutlineGetPoints = SpacePlanning.ReadData.FromOutlineGetPoints(autoMakeBuildingOutline)
point2dFromPointList = stuffer.DynamoGeometry.Point2dFromPointList(create)
point2dFromRegularPolygon = stuffer.DynamoGeometry.Point2dFromRegularPolygon(regularPolygon)

# group (continued): Make Data Stack
outline_poly = CodeBlock(outlinePts=fromOutlineGetPoints) { Polygon2d.ByPoints(outlinePts); outlinePts; }

# group: Cells From Outline
fromPointsGetBoundingPoly = SpacePlanning.ReadData.FromPointsGetBoundingPoly(outline_poly.outlinePts)
gridPointsInsideOutline = SpacePlanning.GridObject.GridPointsInsideOutline(fromPointsGetBoundingPoly, outline_poly.outlinePts, dimx_cell_width, dimy_cell_length)
convexHullFromPoint2D = SpacePlanning.GridObject.ConvexHullFromPoint2D(gridPointsInsideOutline.out0)
pointFromPoint2dList = stuffer.DynamoGeometry.pointFromPoint2dList(convexHullFromPoint2D)
byPoints = Polygon.ByPoints(pointFromPoint2dList)

# group: Generator
deptArrangeOnSite = SpacePlanning.BuildLayout.DeptArrangeOnSite(outline_poly.out0, code_block, gridPointsInsideOutline.out1, patient_bed_depth_ideal_val_32, recompute_dept_arrangement)
code_block_2 = CodeBlock(deptPolys=deptArrangeOnSite.out0) { deptPolys; }
code_block_3 = CodeBlock(A=code_block_2) { A[0]; }
polygonByPolygon2d = stuffer.DynamoGeometry.PolygonByPolygon2d(code_block_3, height_of_space_plan)
code_block_4 = CodeBlock(A=code_block_2) { A[1]; }
polygonByPolygon2d_2 = stuffer.DynamoGeometry.PolygonByPolygon2d(code_block_4, height_of_space_plan)
code_block_5 = CodeBlock(A=code_block_2) { A[2]; }
polygonByPolygon2d_3 = stuffer.DynamoGeometry.PolygonByPolygon2d(code_block_5, height_of_space_plan)
code_block_6 = CodeBlock(A=code_block_2) { A[3]; }
polygonByPolygon2d_4 = stuffer.DynamoGeometry.PolygonByPolygon2d(code_block_6, height_of_space_plan)
areaCheckPolygon = stuffer.Polygon2d.AreaCheckPolygon(code_block_6)
areaCheckPolygon_2 = stuffer.Polygon2d.AreaCheckPolygon(code_block_4)
areaCheckPolygon_3 = stuffer.Polygon2d.AreaCheckPolygon(code_block_3)
areaCheckPolygon_4 = stuffer.Polygon2d.AreaCheckPolygon(code_block_5)
programs_in_each_dept = CodeBlock(deptArrangeOnSite.out3) { Dept.ProgramsInDept; }
code_block_7 = CodeBlock(program=programs_in_each_dept) { program[1]; }
recursiveSplitPolyPrograms = SpacePlanning.BuildLayout.RecursiveSplitPolyPrograms(code_block_4, code_block_7, example_proportion_to_start, recompute_prog_arrangement)
polygonByPolygon2d_5 = stuffer.DynamoGeometry.PolygonByPolygon2d(recursiveSplitPolyPrograms, height_of_space_plan)
programs_in_each_dept_2 = CodeBlock(deptArrangeOnSite.out3) { Dept.ProgramsInDept; }
code_block_8 = CodeBlock(program=programs_in_each_dept_2) { program[2]; }
recursiveSplitPolyPrograms_2 = SpacePlanning.BuildLayout.RecursiveSplitPolyPrograms(code_block_5, code_block_8, example_proportion_to_start, recompute_prog_arrangement)
polygonByPolygon2d_6 = stuffer.DynamoGeometry.PolygonByPolygon2d(recursiveSplitPolyPrograms_2, height_of_space_plan)
programs_in_each_dept_3 = CodeBlock(deptArrangeOnSite.out3) { Dept.ProgramsInDept; }
code_block_9 = CodeBlock(program=programs_in_each_dept_3) { program[0]; }
recursiveSplitOneDirByDistance = SpacePlanning.BuildLayout.RecursiveSplitOneDirByDistance(code_block_3, patient_bed_width_ideal_val_16, recompute_prog_arrangement)
deptSplitRefineChange = SpacePlanning.SplitObject.DeptSplitRefineChange(outline_poly.out0, gridPointsInsideOutline.out1, code_block, patient_bed_depth_ideal_val_32, recompute_dept_arrangement)
polygonByPolygon2d_7 = stuffer.DynamoGeometry.PolygonByPolygon2d(deptSplitRefineChange, height_of_space_plan)
polygonByPolygon2d_8 = stuffer.DynamoGeometry.PolygonByPolygon2d(deptArrangeOnSite.out1, height_of_space_plan)
programs_in_each_dept_4 = CodeBlock(deptArrangeOnSite.out3) { Dept.ProgramsInDept; }
code_block_10 = CodeBlock(program=programs_in_each_dept_4) { program[3]; }
recursiveSplitPolyPrograms_3 = SpacePlanning.BuildLayout.RecursiveSplitPolyPrograms(code_block_6, code_block_10, example_proportion_to_start, recompute_prog_arrangement)
polygonByPolygon2d_9 = stuffer.DynamoGeometry.PolygonByPolygon2d(recursiveSplitPolyPrograms_3, height_of_space_plan)

recursiveSplitProgramsOneDirByDistance = SpacePlanning.BuildLayout.RecursiveSplitProgramsOneDirByDistance(code_block_3, code_block_9, patient_bed_width_ideal_val_16, recompute_prog_arrangement)

# group (continued): Generator
polygonByPolygon2d_10 = stuffer.DynamoGeometry.PolygonByPolygon2d(recursiveSplitProgramsOneDirByDistance, height_of_space_plan)

code_block_11 = CodeBlock(a=code_block) { a.ProgramsInDept.UnitArea; }
watch = Watch(code_block_11)
flatten = Flatten(code_block_3)
number_slider = DoubleSlider(1000, range=1000..2000 step 1)
number_slider_2 = DoubleSlider(700, range=300..2000 step 1)
code_block_12 = CodeBlock(a=number_slider, b=number_slider_2)
# ---------- code_block_12.designscript (4 lines) ----------
Point2d.ByCoordinates(-a,-500);
Point2d.ByCoordinates(-a+b,-500);
Point2d.ByCoordinates(-a+b,-1200);
Point2d.ByCoordinates(-a,-1200);
# ----------------------------------------
create_2 = List.Create(code_block_12.out0, code_block_12.out1, code_block_12.out2, code_block_12.out3)
byPoints_2 = stuffer.Polygon2d.ByPoints(create_2)
number_slider_3 = DoubleSlider(0, range=0..2000 step 1)
polygonByPolygon2d_11 = stuffer.DynamoGeometry.PolygonByPolygon2d(byPoints_2, number_slider_3)
number_slider_4 = DoubleSlider(1000, range=-1000..2000 step 1)
number_slider_5 = DoubleSlider(500, range=500..2000 step 1)
number_slider_6 = DoubleSlider(-500, range=-500..2000 step 1)
number_slider_7 = DoubleSlider(1200, range=300..2000 step 1)
code_block_13 = CodeBlock(a=number_slider_4, c=number_slider_5, b=number_slider_6, d=number_slider_7)
# ---------- code_block_13.designscript (4 lines) ----------
Point2d.ByCoordinates(-a,-c);
Point2d.ByCoordinates(-a+b,-c);
Point2d.ByCoordinates(-a+b,-d);
Point2d.ByCoordinates(-a,-d);
# ----------------------------------------
create_3 = List.Create(code_block_13.out0, code_block_13.out1, code_block_13.out2, code_block_13.out3)
byPoints_3 = stuffer.Polygon2d.ByPoints(create_3)
polygonByPolygon2d_12 = stuffer.DynamoGeometry.PolygonByPolygon2d(byPoints_3, number_slider_3)
code_block_14 = CodeBlock { Line.ByStartPointEndPoint(a,b); }
code_block_15 = CodeBlock(a=polygonByPolygon2d_8) { a[0]; }
code_block_16 = CodeBlock(a=code_block_15) { a.Points; }
point2dFromPointList_2 = stuffer.DynamoGeometry.Point2dFromPointList(code_block_16)
code_block_17 = CodeBlock(a=point2dFromPointList_2) { Polygon2d.ByPoints(a); }
code_block_18 = CodeBlock(a=polygonByPolygon2d_9) { a[3]; }
code_block_19 = CodeBlock(a=code_block_18) { a.Points; }
point2dFromPointList_3 = stuffer.DynamoGeometry.Point2dFromPointList(code_block_19)
code_block_20 = CodeBlock(a=point2dFromPointList_3) { Polygon2d.ByPoints(a); }
polygonPolygonCommonEdgeDict = SpacePlanning.BuildLayout.PolygonPolygonCommonEdgeDict(code_block_17, code_block_20)
lineByLine2d = stuffer.DynamoGeometry.LineByLine2d(polygonPolygonCommonEdgeDict.out1)
lineByLine2d_2 = stuffer.DynamoGeometry.LineByLine2d(polygonPolygonCommonEdgeDict.out2)
makeDeptTopology = SpacePlanning.BuildLayout.MakeDeptTopology(deptArrangeOnSite.out3)
watch_2 = Watch(makeDeptTopology.out0)
watch_3 = Watch(makeDeptTopology.out1)
code_block_21 = CodeBlock(a=deptArrangeOnSite.out3) { a.DepartmentName; }
watch_4 = Watch(code_block_21)
code_block_22 = CodeBlock(a=makeDeptTopology.out2) { a.DepartmentName; }
watch_5 = Watch(code_block_22)
makeDeptTopologyChart = SpacePlanning.BuildLayout.MakeDeptTopologyChart(deptArrangeOnSite.out3)
watch_6 = Watch(makeDeptTopologyChart)
watch_7 = Watch(polygonPolygonCommonEdgeDict.out0)
lineByLine2d_3 = stuffer.DynamoGeometry.LineByLine2d(polygonPolygonCommonEdgeDict.out3)
lineByLine2d_4 = stuffer.DynamoGeometry.LineByLine2d(polygonPolygonCommonEdgeDict.out4)
centroidInPointLists = SpacePlanning.GraphicsUtility.CentroidInPointLists(point2dFromPointList_3)
linePolygonIntersectionReturnLine = SpacePlanning.GraphicsUtility.LinePolygonIntersectionReturnLine(point2dFromPointList_2, polygonPolygonCommonEdgeDict.out4, centroidInPointLists)
lineByLine2d_5 = stuffer.DynamoGeometry.LineByLine2d(linePolygonIntersectionReturnLine)
centroidInPointLists_2 = SpacePlanning.GraphicsUtility.CentroidInPointLists(point2dFromPointList_2)
linePolygonIntersectionReturnLine_2 = SpacePlanning.GraphicsUtility.LinePolygonIntersectionReturnLine(point2dFromPointList_3, polygonPolygonCommonEdgeDict.out4, centroidInPointLists_2)
lineByLine2d_6 = stuffer.DynamoGeometry.LineByLine2d(linePolygonIntersectionReturnLine_2)
pointByPoint2d = stuffer.DynamoGeometry.PointByPoint2d(polygonPolygonCommonEdgeDict.out5)
pointByPoint2d_2 = stuffer.DynamoGeometry.PointByPoint2d(polygonPolygonCommonEdgeDict.out6)
byPoints_4 = stuffer.Polygon2d.ByPoints(point2dFromPointList_2)
code_block_23 = CodeBlock(a=byPoints_4) { a.Points; }
byPoints_5 = stuffer.Polygon2d.ByPoints(point2dFromPointList_3)
code_block_24 = CodeBlock(a=byPoints_5) { a.Points; }
code_block_25 = CodeBlock(inpatient=code_block_3) { inpatient[0]; }
code_block_26 = CodeBlock(another=code_block_4) { another; }
code_block_27 = CodeBlock(inpatient=code_block_3) { inpatient[1]; }
code_block_28 = CodeBlock(otherdept=code_block_4) { otherdept; }
polygonPolygonCommonEdgeDict_2 = SpacePlanning.BuildLayout.PolygonPolygonCommonEdgeDict(code_block_27, code_block_28)
watch_8 = Watch(polygonPolygonCommonEdgeDict_2.out0)
lineByLine2d_7 = stuffer.DynamoGeometry.LineByLine2d(polygonPolygonCommonEdgeDict_2.out1)
lineByLine2d_8 = stuffer.DynamoGeometry.LineByLine2d(polygonPolygonCommonEdgeDict_2.out2)
lineByLine2d_9 = stuffer.DynamoGeometry.LineByLine2d(polygonPolygonCommonEdgeDict_2.out3)
lineByLine2d_10 = stuffer.DynamoGeometry.LineByLine2d(polygonPolygonCommonEdgeDict_2.out4)
pointByPoint2d_3 = stuffer.DynamoGeometry.PointByPoint2d(polygonPolygonCommonEdgeDict_2.out5)
pointByPoint2d_4 = stuffer.DynamoGeometry.PointByPoint2d(polygonPolygonCommonEdgeDict_2.out6)
number_slider_8 = DoubleSlider(5, range=0..100 step 5)
number_slider_9 = DoubleSlider(5, range=0..100 step 5)
number_slider_10 = DoubleSlider(35, range=0..100 step 5)
horizontal_line = CodeBlock(a=number_slider_8, b=number_slider_9, c=number_slider_10) { Point2d.ByCoordinates(a,b); Point2d.ByCoordinates(c,b); }
code_block_29 = CodeBlock(a=horizontal_line.out0, b=horizontal_line.out1) { Line2d.ByStartPointEndPoint(a,b); }
code_block_30 = CodeBlock { 0; }
lineByLine2d_11 = stuffer.DynamoGeometry.LineByLine2d(code_block_29, code_block_30)
number_slider_11 = DoubleSlider(45, range=0..100 step 5)
number_slider_12 = DoubleSlider(5, range=0..100 step 5)
number_slider_13 = DoubleSlider(30, range=0..100 step 5)
horizontal_line_2 = CodeBlock(a=number_slider_11, b=number_slider_12, c=number_slider_13) { Point2d.ByCoordinates(a,b); Point2d.ByCoordinates(c,b); }
code_block_31 = CodeBlock(a=horizontal_line_2.out0, b=horizontal_line_2.out1) { Line2d.ByStartPointEndPoint(a,b); }
checkLineCollinear = SpacePlanning.GraphicsUtility.CheckLineCollinear(code_block_29, code_block_31)
watch_9 = Watch(checkLineCollinear)
number_slider_14 = DoubleSlider(-20, range=-100..100 step 5)
number_slider_15 = DoubleSlider(-95, range=-100..100 step 5)
number_slider_16 = DoubleSlider(-70, range=-100..100 step 5)
vertical_line = CodeBlock(a=number_slider_14, b=number_slider_15, d=number_slider_16) { Point2d.ByCoordinates(a,b); Point2d.ByCoordinates(a,d); }
lineByLine2d_12 = stuffer.DynamoGeometry.LineByLine2d(code_block_31, code_block_30)
code_block_32 = CodeBlock(a=code_block_31) { a.EndPoint; }
onSegment = SpacePlanning.GraphicsUtility.onSegment(code_block_29, code_block_32)
watch_10 = Watch(onSegment)
pointByPoint2d_5 = stuffer.DynamoGeometry.PointByPoint2d(code_block_32, code_block_30)
lineAdjacencyCheck = SpacePlanning.GraphicsUtility.LineAdjacencyCheck(code_block_29, code_block_31)
watch_11 = Watch(lineAdjacencyCheck)
joinCollinearLines = SpacePlanning.GraphicsUtility.JoinCollinearLines(code_block_29, code_block_31)
lineByLine2d_13 = stuffer.DynamoGeometry.LineByLine2d(joinCollinearLines)
watch_12 = Watch(lineAdjacencyCheck)
number_slider_17 = DoubleSlider(35, range=-7..100 step 5)
number_slider_18 = DoubleSlider(5, range=-100..100 step 5)
number_slider_19 = DoubleSlider(-85, range=-100..100 step 5)
vertical_line_2 = CodeBlock(a=number_slider_17, b=number_slider_18, d=number_slider_19) { Point2d.ByCoordinates(a,b); Point2d.ByCoordinates(a,d); }
findPolyAdjacentEdge = SpacePlanning.Circulation.FindPolyAdjacentEdge(byPoints_2, byPoints_3)
code_block_33 = CodeBlock { 25; }
lineByLine2d_14 = stuffer.DynamoGeometry.LineByLine2d(findPolyAdjacentEdge.out1, code_block_33)
watch_13 = Watch(findPolyAdjacentEdge.out0)
number_slider_20 = DoubleSlider(95, range=-200..200 step 5)
code_block_34 = CodeBlock(cen=number_slider_20) { CoordinateSystem.ByOrigin(0,cen); }
number_slider_21 = DoubleSlider(25, range=0..100 step 5)
number_slider_22 = DoubleSlider(280, range=30..700 step 5)
byWidthLength = Rectangle.ByWidthLength(plane=code_block_34, width=number_slider_21, length=number_slider_22)
byPolygon = stuffer.Polygon2d.ByPolygon(byWidthLength)
code_block_35 = CodeBlock(p=byPolygon) { p.Points; }
number_slider_23 = DoubleSlider(15, range=-50..50 step 5)
code_block_36 = CodeBlock(cen=number_slider_23) { CoordinateSystem.ByOrigin(cen,0); }
number_slider_24 = DoubleSlider(5, range=0..100 step 5)
number_slider_25 = DoubleSlider(65, range=30..100 step 5)
byWidthLength_2 = Rectangle.ByWidthLength(plane=code_block_36, width=number_slider_24, length=number_slider_25)
byPolygon_2 = stuffer.Polygon2d.ByPolygon(byWidthLength_2)
findPolyAdjacentEdge_2 = SpacePlanning.Circulation.FindPolyAdjacentEdge(byPolygon, byPolygon_2)
watch_14 = Watch(findPolyAdjacentEdge_2.out0)
code_block_37 = CodeBlock { 5; }
lineByLine2d_15 = stuffer.DynamoGeometry.LineByLine2d(findPolyAdjacentEdge_2.out1, code_block_37)
