# Dynamo graph 21 MAR_TEST ON SMALLER GRAPH.dyn (Dynamo 0.9.1.4054)

# group: Other Inputs
dimx_cell_width = DoubleSlider(8, range=2..8 step 1)
dimy_cell_length = DoubleSlider(8, range=2..8 step 1)
circulation_add_on_factor = DoubleSlider(1.5, range=1..3 step 0.2)
patient_bed_depth_ideal_val_32 = DoubleSlider(31.5, range=20..45 step 0.5)
example_proportion_to_start = DoubleSlider(0.35, range=0.2..1 step 0.05)  # "Example Proportion to Start Splitting Programs"
patient_bed_width_ideal_val_16 = DoubleSlider(15, range=8..25 step 0.5)
height_of_space_plan = DoubleSlider(1, range=0..3 step 1)

# group: Make Data Stack
autoMakeBuildingOutline = SpacePlanning.ReadData.AutoMakeBuildingOutline()
autoMakeDataStack = SpacePlanning.ReadData.AutoMakeDataStack(dimx_cell_width, dimy_cell_length, circulation_add_on_factor)
code_block = CodeBlock(a=autoMakeDataStack.out3) { a; }

# group: Input Poly Pts
# note: Connect one of the three nodes below with outlinePts Code Block
fromOutlineGetPoints = SpacePlanning.ReadData.FromOutlineGetPoints(autoMakeBuildingOutline)

# group (continued): Make Data Stack
outline_poly = CodeBlock(outlinePts=fromOutlineGetPoints) { Polygon2d.ByPoints(outlinePts); outlinePts; }

# group: Cells From Outline
fromPointsGetBoundingPoly = SpacePlanning.ReadData.FromPointsGetBoundingPoly(outline_poly.outlinePts)
gridPointsInsideOutline = SpacePlanning.GridObject.GridPointsInsideOutline(fromPointsGetBoundingPoly, outline_poly.outlinePts, dimx_cell_width, dimy_cell_length)

# group: Slide to Generate New Design
recompute_dept_arrangement = DoubleSlider(2, range=1..5 step 1)
recompute_prog_arrangement = DoubleSlider(3, range=1..5 step 1)

deptArrangeOnSiteSingleOut = SpacePlanning.BuildLayout.DeptArrangeOnSiteSingleOut(outline_poly.out0, code_block, gridPointsInsideOutline.out1, patient_bed_depth_ideal_val_32, recompute_dept_arrangement)
code_block_2 = CodeBlock(a=deptArrangeOnSiteSingleOut) { a["DeptPolys"]; }
code_block_3 = CodeBlock(deptPolys=code_block_2) { deptPolys; }
code_block_4 = CodeBlock(A=code_block_3) { A[0]; }
code_block_5 = CodeBlock { 25; }
polygonByPolygon2d = stuffer.DynamoGeometry.PolygonByPolygon2d(code_block_4, code_block_5)
code_block_6 = CodeBlock(a=deptArrangeOnSiteSingleOut) { a["UpdatedDeptData"]; }
programs_in_each_dept = CodeBlock(code_block_6) { Dept.ProgramsInDept; }
code_block_7 = CodeBlock(program=programs_in_each_dept) { program[0]; }
recursiveSplitProgramsOneDirByDistance = SpacePlanning.BuildLayout.RecursiveSplitProgramsOneDirByDistance(code_block_4, code_block_7, patient_bed_width_ideal_val_16, recompute_prog_arrangement)
polygonByPolygon2d_2 = stuffer.DynamoGeometry.PolygonByPolygon2d(recursiveSplitProgramsOneDirByDistance, height_of_space_plan)
deptArrangeOnSite = SpacePlanning.BuildLayout.DeptArrangeOnSite(outline_poly.out0, code_block, gridPointsInsideOutline.out1, patient_bed_depth_ideal_val_32, recompute_dept_arrangement)
outline_poly_2 = CodeBlock(outlinePts=fromOutlineGetPoints) { Polygon2d.ByPoints(outlinePts); b = 5; }

# group: Circulation Inputs
dept_corridor_width = DoubleSlider(6, range=5..12 step 1)
frequency_of_corridors = DoubleSlider(0.7, range=0.2..1 step 0.1)
allowed_circulation_ratio_l_w = DoubleSlider(5.3, range=0.5..6 step 0.3)
program_corridor_width = DoubleSlider(6, range=4..12 step 1)

# group: Circulation Between Dept
makeDeptTopology = SpacePlanning.Circulation.MakeDeptTopology(deptArrangeOnSite.out3, outline_poly_2.out0)
height = CodeBlock { 7; }
circulation_network_dept = stuffer.DynamoGeometry.LineByLine2d(makeDeptTopology.out3, height)
makeDeptCirculation = SpacePlanning.Circulation.MakeDeptCirculation(deptArrangeOnSite.out3, makeDeptTopology.out3, dept_corridor_width)
code_block_8 = CodeBlock { 2.5; }

code_block_9 = CodeBlock(updatedDeptPoly=makeDeptCirculation.out1) { updatedDeptPoly; }
code_block_10 = CodeBlock { a["NodeList"].NodeType; }
watch = Watch(code_block_10)
code_block_11 = CodeBlock { a["SpaceTree"].CenterPtNodeList; a["SpaceTree"].RadiusNodeList; }
byCenterPointRadius = Circle.ByCenterPointRadius(centerPoint=code_block_11.out0, radius=code_block_11.out1)
code_block_12 = CodeBlock(a=outline_poly_2.out0) { a; }
polygonByPolygon2d_3 = stuffer.DynamoGeometry.PolygonByPolygon2d(code_block_12, outline_poly_2.b)
code_block_13 = CodeBlock(a=code_block_7) { a.ProgramName; }
watch_2 = Watch(recursiveSplitProgramsOneDirByDistance)
recursiveSplitProgramsOneDirByDistanceSi = SpacePlanning.BuildLayout.RecursiveSplitProgramsOneDirByDistanceSingleOut(code_block_4, code_block_7, patient_bed_width_ideal_val_16, recompute_prog_arrangement)
