# Dynamo graph 24 MAR_TEST GRAPH_1.dyn (Dynamo 0.9.1.4054)

# group: Other Inputs
dimx_cell_width = DoubleSlider(8, range=2..8 step 1)
dimy_cell_length = DoubleSlider(8, range=2..8 step 1)
circulation_add_on_factor = DoubleSlider(1.5, range=1..3 step 0.2)
patient_bed_depth_ideal_val_32 = DoubleSlider(31.5, range=20..45 step 0.5)
height_of_space_plan = DoubleSlider(0, range=0..3 step 1)
example_proportion_to_start = DoubleSlider(0.35, range=0.2..1 step 0.05)  # "Example Proportion to Start Splitting Programs"
patient_bed_width_ideal_val_16 = DoubleSlider(15, range=8..25 step 0.5)

# group: Make Data Stack
autoMakeBuildingOutline = SpacePlanning.ReadData.AutoMakeBuildingOutline()
autoMakeDataStack = SpacePlanning.ReadData.AutoMakeDataStack(dimx_cell_width, dimy_cell_length, circulation_add_on_factor)
code_block = CodeBlock(a=autoMakeDataStack.out3) { a; }

# group: Input Poly Pts
# note: Connect one of the three nodes below with outlinePts Code Block
fromOutlineGetPoints = SpacePlanning.ReadData.FromOutlineGetPoints(autoMakeBuildingOutline)

# group (continued): Make Data Stack
outline_poly = CodeBlock(outlinePts=fromOutlineGetPoints) { Polygon2d.ByPoints(outlinePts); outlinePts; }

# group: Cells From Outline
fromPointsGetBoundingPoly = SpacePlanning.ReadData.FromPointsGetBoundingPoly(outline_poly.outlinePts)
gridPointsInsideOutline = SpacePlanning.GridObject.GridPointsInsideOutline(fromPointsGetBoundingPoly, outline_poly.outlinePts, dimx_cell_width, dimy_cell_length)

# group: Slide to Generate New Design
recompute_dept_arrangement = DoubleSlider(3, range=1..5 step 1)
recompute_prog_arrangement = DoubleSlider(3, range=1..5 step 1)

# group: Generator
deptArrangeOnSite = SpacePlanning.BuildLayout.DeptArrangeOnSite(outline_poly.out0, code_block, gridPointsInsideOutline.out1, patient_bed_depth_ideal_val_32, recompute_dept_arrangement)
code_block_2 = CodeBlock(deptPolys=deptArrangeOnSite.out0) { deptPolys; }
code_block_3 = CodeBlock(A=code_block_2) { A[0]; }
polygonByPolygon2d = stuffer.DynamoGeometry.PolygonByPolygon2d(code_block_3, height_of_space_plan)
code_block_4 = CodeBlock(A=code_block_2) { A[1]; }
polygonByPolygon2d_2 = stuffer.DynamoGeometry.PolygonByPolygon2d(code_block_4, height_of_space_plan)
code_block_5 = CodeBlock(A=code_block_2) { A[2]; }
polygonByPolygon2d_3 = stuffer.DynamoGeometry.PolygonByPolygon2d(code_block_5, height_of_space_plan)
code_block_6 = CodeBlock(A=code_block_2) { A[3]; }
polygonByPolygon2d_4 = stuffer.DynamoGeometry.PolygonByPolygon2d(code_block_6, height_of_space_plan)
dynamogeometry = stuffer.DynamoGeometry.PolygonByPolygon2d(deptArrangeOnSite.out1, height_of_space_plan)  # "DynamoGeometry.PolygonByPolygon2d - Left Over Space"
programs_in_each_dept = CodeBlock(deptArrangeOnSite.out3) { Dept.ProgramsInDept; }
code_block_7 = CodeBlock(program=programs_in_each_dept) { program[1]; }
recursiveSplitPolyPrograms = SpacePlanning.BuildLayout.RecursiveSplitPolyPrograms(code_block_4, code_block_7, example_proportion_to_start, recompute_prog_arrangement)
polygonByPolygon2d_5 = stuffer.DynamoGeometry.PolygonByPolygon2d(recursiveSplitPolyPrograms, height_of_space_plan)
programs_in_each_dept_2 = CodeBlock(deptArrangeOnSite.out3) { Dept.ProgramsInDept; }
code_block_8 = CodeBlock(program=programs_in_each_dept_2) { program[2]; }
recursiveSplitPolyPrograms_2 = SpacePlanning.BuildLayout.RecursiveSplitPolyPrograms(code_block_5, code_block_8, example_proportion_to_start, recompute_prog_arrangement)
polygonByPolygon2d_6 = stuffer.DynamoGeometry.PolygonByPolygon2d(recursiveSplitPolyPrograms_2, height_of_space_plan)
programs_in_each_dept_3 = CodeBlock(deptArrangeOnSite.out3) { Dept.ProgramsInDept; }
code_block_9 = CodeBlock(program=programs_in_each_dept_3) { program[3]; }
recursiveSplitPolyPrograms_3 = SpacePlanning.BuildLayout.RecursiveSplitPolyPrograms(code_block_6, code_block_9, example_proportion_to_start, recompute_prog_arrangement)
polygonByPolygon2d_7 = stuffer.DynamoGeometry.PolygonByPolygon2d(recursiveSplitPolyPrograms_3, height_of_space_plan)
programs_in_each_dept_4 = CodeBlock(deptArrangeOnSite.out3) { Dept.ProgramsInDept; }
code_block_10 = CodeBlock(program=programs_in_each_dept_4) { program[0]; }
recursiveSplitProgramsOneDirByDistance = SpacePlanning.BuildLayout.RecursiveSplitProgramsOneDirByDistance(code_block_3, code_block_10, patient_bed_width_ideal_val_16, recompute_prog_arrangement)
polygonByPolygon2d_8 = stuffer.DynamoGeometry.PolygonByPolygon2d(recursiveSplitProgramsOneDirByDistance, height_of_space_plan)
outline_poly_2 = CodeBlock(outlinePts=fromOutlineGetPoints) { Polygon2d.ByPoints(outlinePts); b = 5; }

# group: Circulation Inputs
frequency_of_corridors = DoubleSlider(0.7, range=0.2..1 step 0.1)
allowed_circulation_ratio_l_w = DoubleSlider(5.3, range=0.5..6 step 0.3)
dept_corridor_width = DoubleSlider(6, range=5..12 step 1)
program_corridor_width = DoubleSlider(6, range=4..12 step 1)

code_block_11 = CodeBlock(a=deptArrangeOnSite.out4) { a["NodeList"].NodeType; }
watch = Watch(code_block_11)
code_block_12 = CodeBlock(a=deptArrangeOnSite.out4) { a["SpaceTree"].CenterPtNodeList; a["SpaceTree"].RadiusNodeList; }
byCenterPointRadius = Circle.ByCenterPointRadius(centerPoint=code_block_12.out0, radius=code_block_12.out1)
code_block_13 = CodeBlock(a=code_block_4) { a; }
number_slider = DoubleSlider(1067.5, range=0..9000 step 0.1)
number_slider_2 = DoubleSlider(1, range=0..1 step 1)
number_slider_3 = DoubleSlider(5, range=0..5 step 1)
recursiveSplitByArea = SpacePlanning.BuildLayout.RecursiveSplitByArea(code_block_13, number_slider, number_slider_2, number_slider_3)  # frozen
watch_2 = Watch(recursiveSplitByArea.out1)
code_block_14 = CodeBlock(a=code_block_4) { a[0]; }
number_slider_4 = DoubleSlider(114, range=0..200 step 1)
dir = DoubleSlider(1, range=0..1 step 1)
splitByDistanceFromPoint = SpacePlanning.BuildLayout.SplitByDistanceFromPoint(code_block_14, number_slider_4, dir)  # frozen
code_block_15 = CodeBlock { 5; }
polygonByPolygon2d_9 = stuffer.DynamoGeometry.PolygonByPolygon2d(splitByDistanceFromPoint, code_block_15)
watch_3 = Watch(recursiveSplitByArea.out0)
dir_2 = DoubleSlider(0, range=0..1 step 1)
splitByDistanceTest = SpacePlanning.BuildLayout.SplitByDistanceTest(code_block_14, number_slider_4, dir_2)  # frozen
lineByLine2d = stuffer.DynamoGeometry.LineByLine2d(splitByDistanceTest.out1)
code_block_16 = CodeBlock(A=code_block_2) { A[1]; }
code_block_17 = CodeBlock(a=code_block_4) { a; }
code_block_18 = CodeBlock { 0; 0; }
polygonByPolygon2d_10 = stuffer.DynamoGeometry.PolygonByPolygon2d(code_block_17, code_block_18.out0)
watch_4 = Watch(polygonByPolygon2d_10)
code_block_19 = CodeBlock(program=programs_in_each_dept) { program[1]; }
acceptableWidth = DoubleSlider(4, range=4..200 step 0.5)
minwidth = DoubleSlider(6.5, range=3..50 step 0.5)
recursivePlaceProgramsSeries = SpacePlanning.BuildLayout.RecursivePlaceProgramsSeries(code_block_17, code_block_19, acceptableWidth, minwidth)
code_block_20 = CodeBlock(a=recursivePlaceProgramsSeries.out1) { a[0]; }
polygonByPolygon2d_11 = stuffer.DynamoGeometry.PolygonByPolygon2d(code_block_20, code_block_18.out0)
watch_5 = Watch(polygonByPolygon2d_11)
code_block_21 = CodeBlock { a[12]; }
watch_6 = Watch(recursivePlaceProgramsSeries.out3)
code_block_22 = CodeBlock(a=code_block_4) { a[0]; }
acceptableWidth_2 = DoubleSlider(26.9, range=2..65 step 0.3)
number_slider_5 = DoubleSlider(70.5, range=0..100 step 0.1)
splitBigPolys = SpacePlanning.BuildLayout.SplitBigPolys(code_block_17, acceptableWidth_2, number_slider_5)  # frozen
polygonByPolygon2d_12 = stuffer.DynamoGeometry.PolygonByPolygon2d(recursivePlaceProgramsSeries.out1, code_block_18.out1)
code_block_23 = CodeBlock(a=polygonByPolygon2d_12) { a[2]; }
integer_slider = IntegerSlider(91, range=2..155 step 1)
integer_slider_2 = IntegerSlider(1, range=0..1 step 1)
splitByDistancePoly = SpacePlanning.BuildLayout.SplitByDistancePoly(code_block_17, integer_slider, integer_slider_2)  # frozen
polygonByPolygon2d_13 = stuffer.DynamoGeometry.PolygonByPolygon2d(splitByDistancePoly.out0, code_block_18.out0)
code_block_24 = CodeBlock(a=polygonByPolygon2d_13) { a[15]; 4; }
code_block_25 = CodeBlock(a=code_block_24.out0) { a.Corners(); }
code_block_26 = CodeBlock(a=code_block_5) { a; }
code_block_27 = CodeBlock(program=programs_in_each_dept) { program[2]; }
polygonByPolygon2d_14 = stuffer.DynamoGeometry.PolygonByPolygon2d(code_block_13, code_block_15)
code_block_28 = CodeBlock { 1; }
polygonByPolygon2d_15 = stuffer.DynamoGeometry.PolygonByPolygon2d(splitByDistanceTest.out0, code_block_28)
code_block_29 = CodeBlock { w = 8; l = 35; dis = 3; ht= 0; }
byWidthLength = Rectangle.ByWidthLength(width=code_block_29.l, length=code_block_29.w)  # frozen
byPolygon = stuffer.Polygon2d.ByPolygon(byWidthLength)
dist = DoubleSlider(5, range=0..500 step 1)
dir_3 = DoubleSlider(0, range=0..1 step 1)
dumy = DoubleSlider(90, range=0..200 step 1)
splitByDistancePoly_2 = SpacePlanning.BuildLayout.SplitByDistancePoly(byPolygon, dist, dir_3, dumy)
polygonByPolygon2d_16 = stuffer.DynamoGeometry.PolygonByPolygon2d(splitByDistancePoly_2.out0, code_block_29.ht)
watch_7 = Watch(polygonByPolygon2d_16)
code_block_30 = CodeBlock { 0; }
lineByLine2d_2 = stuffer.DynamoGeometry.LineByLine2d(splitByDistancePoly_2.out1, code_block_30)
pointByPoint2d = stuffer.DynamoGeometry.PointByPoint2d(splitByDistancePoly_2.out3, code_block_30)
watch_8 = Watch(pointByPoint2d)
polygonByPolygon2d_17 = stuffer.DynamoGeometry.PolygonByPolygon2d(code_block_17, code_block_18.out1)
code_block_31 = CodeBlock { 25; 15; 0; }
byWidthLength_2 = Rectangle.ByWidthLength(width=code_block_31.out0, length=code_block_31.out1)  # frozen
code_block_32 = CodeBlock(a=byWidthLength_2) { Polygon2d.ByPolygon(a); }
number_slider_6 = DoubleSlider(12, range=0..100 step 0.1)
number_slider_7 = DoubleSlider(0, range=0..1 step 1)
splitByDistancePoly_3 = SpacePlanning.BuildLayout.SplitByDistancePoly(code_block_32, number_slider_6, number_slider_7)
lineByLine2d_3 = stuffer.DynamoGeometry.LineByLine2d(splitByDistancePoly_3.out1)
pointByPoint2d_2 = stuffer.DynamoGeometry.PointByPoint2d(splitByDistancePoly_3.out3)
pointByPoint2d_3 = stuffer.DynamoGeometry.PointByPoint2d(splitByDistancePoly_3.out4)
polygonByPolygon2d_18 = stuffer.DynamoGeometry.PolygonByPolygon2d(splitByDistancePoly_3.out0, code_block_31.out2)
watch_9 = Watch(polygonByPolygon2d_18)
code_block_33 = CodeBlock(a=polygonByPolygon2d_12) { a.Points; }
watch_10 = Watch(code_block_33)
lineByLine2d_4 = stuffer.DynamoGeometry.LineByLine2d(splitByDistancePoly.out1, code_block_24.out1)
code_block_34 = CodeBlock(a=polygonByPolygon2d_11) { a.Corners(); }
pointByPoint2d_4 = stuffer.DynamoGeometry.PointByPoint2d(splitByDistancePoly.out2, integer_slider_2)
