# Dynamo graph 27 MAR CHECKDEPTSPLITREFINE_1.dyn (Dynamo 0.9.1.4054)

# group: Other Inputs
example_proportion_to_start = DoubleSlider(0.35, range=0.2..1 step 0.05)  # "Example Proportion to Start Splitting Programs"
patient_bed_width_ideal_val_16 = DoubleSlider(15, range=8..25 step 0.5)
dimx_cell_width = DoubleSlider(6, range=2..8 step 1)
dimy_cell_length = DoubleSlider(6, range=2..8 step 1)
circulation_add_on_factor = DoubleSlider(1.5, range=1..3 step 0.2)
patient_bed_depth_ideal_val_32 = DoubleSlider(40, range=20..45 step 0.5)
height_of_space_plan = DoubleSlider(1, range=0..10 step 1)

# group: Slide to Generate New Design
recompute_prog_arrangement = DoubleSlider(3, range=1..5 step 1)
recompute_dept_arrangement = DoubleSlider(2, range=1..5 step 1)

# group: Make Regular Poly
regular_poly_inputs = CodeBlock()
# ---------- regular_poly_inputs.designscript (4 lines) ----------
a = Point.ByCoordinates(-3600,-1100);
b = Point.ByCoordinates(-3800,-1100);
c = Point.ByCoordinates(-3800,-1300);
d = Point.ByCoordinates(-3600,-1300);
# ----------------------------------------
create = List.Create(regular_poly_inputs.a, regular_poly_inputs.b, regular_poly_inputs.c, regular_poly_inputs.d)
regular_polygon_inp = CodeBlock { cen = Point.ByCoordinates(-3000,-1500); radius = 150; sides = 8; }
byCenterPointRadius = Circle.ByCenterPointRadius(centerPoint=regular_polygon_inp.cen, radius=regular_polygon_inp.radius)
regularPolygon = Polygon.RegularPolygon(circle=byCenterPointRadius, numberSides=regular_polygon_inp.sides)

# group: Make Data Stack
autoMakeBuildingOutline = SpacePlanning.ReadData.AutoMakeBuildingOutline()
autoMakeDataStack = SpacePlanning.ReadData.AutoMakeDataStack(dimx_cell_width, dimy_cell_length, circulation_add_on_factor)
code_block = CodeBlock(a=autoMakeDataStack.out3) { a; }

# group: Input Poly Pts
point2dFromPointList = stuffer.DynamoGeometry.Point2dFromPointList(create)
point2dFromRegularPolygon = stuffer.DynamoGeometry.Point2dFromRegularPolygon(regularPolygon)
# note: Connect one of the three nodes below with outlinePts Code Block
fromOutlineGetPoints = SpacePlanning.ReadData.FromOutlineGetPoints(autoMakeBuildingOutline)

# group (continued): Make Data Stack
outline_poly = CodeBlock(outlinePts=fromOutlineGetPoints) { Polygon2d.ByPoints(outlinePts); outlinePts; }

# group: Cells From Outline
fromPointsGetBoundingPoly = SpacePlanning.ReadData.FromPointsGetBoundingPoly(outline_poly.outlinePts)
gridPointsInsideOutline = SpacePlanning.GridObject.GridPointsInsideOutline(fromPointsGetBoundingPoly, outline_poly.outlinePts, dimx_cell_width, dimy_cell_length)

deptArrangeOnSite = SpacePlanning.BuildLayout.DeptArrangeOnSite(outline_poly.out0, code_block, gridPointsInsideOutline.out1, patient_bed_depth_ideal_val_32, recompute_dept_arrangement)
outline_poly_2 = CodeBlock(outlinePts=fromOutlineGetPoints) { Polygon2d.ByPoints(outlinePts); b = 5; }
limit = DoubleSlider(2, range=0..200 step 0.1)

# group: Circulation Inputs
dept_corridor_width = DoubleSlider(6, range=5..12 step 1)
frequency_of_corridors = DoubleSlider(0.7, range=0.2..1 step 0.1)
allowed_circulation_ratio_l_w = DoubleSlider(5.3, range=0.5..6 step 0.3)
program_corridor_width = DoubleSlider(6, range=4..12 step 1)

# group: Circulation Between Dept
makeDeptTopology = SpacePlanning.Circulation.MakeDeptTopology(deptArrangeOnSite.out3, outline_poly_2.out0, limit)
makeDeptCirculation = SpacePlanning.Circulation.MakeDeptCirculation(deptArrangeOnSite.out3, makeDeptTopology.out3, dept_corridor_width)  # frozen
code_block_2 = CodeBlock { 2.5; }
height = CodeBlock { 7; }
circulation_network_dept = stuffer.DynamoGeometry.LineByLine2d(makeDeptTopology.out3, height)

code_block_3 = CodeBlock(updatedDeptPoly=makeDeptCirculation.out1) { updatedDeptPoly; }
string = StringInput("D:\SUBHAJIT WORKS\01 DUKE BED TOWER AUTOMATION\08 EXCEL\ATORIGINDK.sat")
readBuildingOutline = SpacePlanning.ReadData.ReadBuildingOutline(string)
watch = Watch(deptArrangeOnSite.out1)
code_block_4 = CodeBlock(deptPolys=deptArrangeOnSite.out0) { deptPolys; }
watch_2 = Watch(code_block_4)
code_block_5 = CodeBlock(A=code_block_4) { A[0]; }
polygonByPolygon2d = stuffer.DynamoGeometry.PolygonByPolygon2d(code_block_5, height_of_space_plan)
watch_3 = Watch(polygonByPolygon2d)
code_block_6 = CodeBlock(A=code_block_4) { A[1]; }
polygonByPolygon2d_2 = stuffer.DynamoGeometry.PolygonByPolygon2d(code_block_6, height_of_space_plan)
watch_4 = Watch(polygonByPolygon2d_2)
code_block_7 = CodeBlock(A=code_block_4) { A[2]; }
polygonByPolygon2d_3 = stuffer.DynamoGeometry.PolygonByPolygon2d(code_block_7, height_of_space_plan)
watch_5 = Watch(polygonByPolygon2d_3)
code_block_8 = CodeBlock(A=code_block_4) { A[3]; }
polygonByPolygon2d_4 = stuffer.DynamoGeometry.PolygonByPolygon2d(code_block_8, height_of_space_plan)
watch_6 = Watch(polygonByPolygon2d_4)
areaCheckPolygon = SpacePlanning.PolygonUtility.AreaCheckPolygon(code_block_8)
sum = Math.Sum(areaCheckPolygon)
watch_7 = Watch(sum)
areaCheckPolygon_2 = SpacePlanning.PolygonUtility.AreaCheckPolygon(code_block_7)
sum_2 = Math.Sum(areaCheckPolygon_2)
watch_8 = Watch(sum_2)
areaCheckPolygon_3 = SpacePlanning.PolygonUtility.AreaCheckPolygon(code_block_6)
sum_3 = Math.Sum(areaCheckPolygon_3)
watch_9 = Watch(sum_3)
areaCheckPolygon_4 = SpacePlanning.PolygonUtility.AreaCheckPolygon(code_block_5)
sum_4 = Math.Sum(areaCheckPolygon_4)
watch_10 = Watch(sum_4)
centroidFromPoly = SpacePlanning.PolygonUtility.CentroidFromPoly(outline_poly.outlinePts)
pointByPoint2d = stuffer.DynamoGeometry.PointByPoint2d(centroidFromPoly)
code_block_9 = CodeBlock { {32,34,2.5,65.5}; }
sortIndex = SpacePlanning.BasicUtility.SortIndex(code_block_9)
watch_11 = Watch(sortIndex)
code_block_10 = CodeBlock { a=15; }
polygonByPolygon2d_5 = stuffer.DynamoGeometry.PolygonByPolygon2d(deptArrangeOnSite.out2, code_block_10)
formsCellNeighborMatrix = SpacePlanning.GridObject.FormsCellNeighborMatrix(gridPointsInsideOutline.out1)
watch_12 = Watch(formsCellNeighborMatrix.out1)
cir_lines = CodeBlock(a=circulation_network_dept) { a; }
code_block_11 = CodeBlock(a=polygonByPolygon2d) { a.Corners(); }
watch_13 = Watch(polygonByPolygon2d)
polygonByPolygon2d_6 = stuffer.DynamoGeometry.PolygonByPolygon2d(deptArrangeOnSite.out1, code_block_10)
create_2 = List.Create(polygonByPolygon2d, polygonByPolygon2d_2, polygonByPolygon2d_3, polygonByPolygon2d_4)
code_block_12 = CodeBlock(a=polygonByPolygon2d) { a[3]; }
