# Dynamo graph 28 MAR _ SPACE FULL NEW_1.dyn (Dynamo 0.9.1.4054)

# group: Other Inputs
dimx_cell_width = DoubleSlider(8, range=2..8 step 1)
dimy_cell_length = DoubleSlider(8, range=2..8 step 1)
circulation_add_on_factor = DoubleSlider(1.5, range=1..3 step 0.2)
patient_bed_depth_ideal_val_32 = DoubleSlider(31.5, range=20..45 step 0.5)
height_of_space_plan = DoubleSlider(1, range=0..10 step 1)
patient_bed_width_ideal_val_16 = DoubleSlider(15, range=8..25 step 0.5)
example_proportion_to_start = DoubleSlider(0.35, range=0.2..1 step 0.05)  # "Example Proportion to Start Splitting Programs"

# group: Make Data Stack
autoMakeBuildingOutline = SpacePlanning.ReadData.AutoMakeBuildingOutline()
autoMakeDataStack = SpacePlanning.ReadData.AutoMakeDataStack(dimx_cell_width, dimy_cell_length, circulation_add_on_factor)
code_block = CodeBlock(a=autoMakeDataStack.out3) { a; }

# group: Slide to Generate New Design
recompute_dept_arrangement = DoubleSlider(3, range=1..5 step 1)
recompute_prog_arrangement = DoubleSlider(3, range=1..5 step 1)

# group: Make Regular Poly
regular_poly_inputs = CodeBlock()
# ---------- regular_poly_inputs.designscript (4 lines) ----------
a = Point.ByCoordinates(-3600,-1100);
b = Point.ByCoordinates(-3800,-1100);
c = Point.ByCoordinates(-3800,-1300);
d = Point.ByCoordinates(-3600,-1300);
# ----------------------------------------
create = List.Create(regular_poly_inputs.a, regular_poly_inputs.b, regular_poly_inputs.c, regular_poly_inputs.d)
regular_polygon_inp = CodeBlock { cen = Point.ByCoordinates(-3000,-1500); radius = 150; sides = 8; }
byCenterPointRadius = Circle.ByCenterPointRadius(centerPoint=regular_polygon_inp.cen, radius=regular_polygon_inp.radius)
regularPolygon = Polygon.RegularPolygon(circle=byCenterPointRadius, numberSides=regular_polygon_inp.sides)

# group: Input Poly Pts
# note: Connect one of the three nodes below with outlinePts Code Block
fromOutlineGetPoints = SpacePlanning.ReadData.FromOutlineGetPoints(autoMakeBuildingOutline)
point2dFromPointList = stuffer.DynamoGeometry.Point2dFromPointList(create)
point2dFromRegularPolygon = stuffer.DynamoGeometry.Point2dFromRegularPolygon(regularPolygon)

# group (continued): Make Data Stack
outline_poly = CodeBlock(outlinePts=fromOutlineGetPoints) { Polygon2d.ByPoints(outlinePts); outlinePts; }

# group: Cells From Outline
fromPointsGetBoundingPoly = SpacePlanning.ReadData.FromPointsGetBoundingPoly(outline_poly.outlinePts)
gridPointsInsideOutline = SpacePlanning.GridObject.GridPointsInsideOutline(fromPointsGetBoundingPoly, outline_poly.outlinePts, dimx_cell_width, dimy_cell_length)

# group: Cell Polys
pointFromPoint2dList = stuffer.DynamoGeometry.pointFromPoint2dList(gridPointsInsideOutline.out0)
makeCellsFromGridPoints = SpacePlanning.GridObject.MakeCellsFromGridPoints(pointFromPoint2dList, dimx_cell_width, dimy_cell_length)
opacity = DoubleSlider(10.7, range=0..255 step 0.1)
val = DoubleSlider(164.6, range=0..255 step 1)
val_2 = DoubleSlider(183.1, range=0..255 step 1)
val_3 = DoubleSlider(165.4, range=0..255 step 1)
byARGB = Color.ByARGB(a=opacity, r=val, g=val_2, b=val_3)
byGeometryColor = Display.Display.ByGeometryColor(makeCellsFromGridPoints, byARGB)

# group: Generator
deptArrangeOnSite = SpacePlanning.BuildLayout.DeptArrangeOnSite(outline_poly.out0, code_block, gridPointsInsideOutline.out1, patient_bed_depth_ideal_val_32, recompute_dept_arrangement)
dynamogeometry = stuffer.DynamoGeometry.PolygonByPolygon2d(deptArrangeOnSite.out1, height_of_space_plan)  # "DynamoGeometry.PolygonByPolygon2d - Left Over Space"
code_block_2 = CodeBlock(deptPolys=deptArrangeOnSite.out0) { deptPolys; }
code_block_3 = CodeBlock(A=code_block_2) { A[0]; }
programs_in_each_dept = CodeBlock(deptArrangeOnSite.out3) { Dept.ProgramsInDept; }
code_block_4 = CodeBlock(program=programs_in_each_dept) { program[0]; }
recursiveSplitProgramsOneDirByDistance = SpacePlanning.BuildLayout.RecursiveSplitProgramsOneDirByDistance(code_block_3, code_block_4, patient_bed_width_ideal_val_16, recompute_prog_arrangement)
polygonByPolygon2d = stuffer.DynamoGeometry.PolygonByPolygon2d(recursiveSplitProgramsOneDirByDistance.out0, height_of_space_plan)
code_block_5 = CodeBlock(A=code_block_2) { A[1]; }
programs_in_each_dept_2 = CodeBlock(deptArrangeOnSite.out3) { Dept.ProgramsInDept; }
code_block_6 = CodeBlock(program=programs_in_each_dept_2) { program[1]; }
recursiveSplitPolyPrograms = SpacePlanning.BuildLayout.RecursiveSplitPolyPrograms(code_block_5, code_block_6, example_proportion_to_start, recompute_prog_arrangement)
polygonByPolygon2d_2 = stuffer.DynamoGeometry.PolygonByPolygon2d(recursiveSplitPolyPrograms.out0, height_of_space_plan)
code_block_7 = CodeBlock(A=code_block_2) { A[2]; }
programs_in_each_dept_3 = CodeBlock(deptArrangeOnSite.out3) { Dept.ProgramsInDept; }
code_block_8 = CodeBlock(program=programs_in_each_dept_3) { program[2]; }
recursiveSplitPolyPrograms_2 = SpacePlanning.BuildLayout.RecursiveSplitPolyPrograms(code_block_7, code_block_8, example_proportion_to_start, recompute_prog_arrangement)
polygonByPolygon2d_3 = stuffer.DynamoGeometry.PolygonByPolygon2d(recursiveSplitPolyPrograms_2.out0, height_of_space_plan)
code_block_9 = CodeBlock(A=code_block_2) { A[3]; }
programs_in_each_dept_4 = CodeBlock(deptArrangeOnSite.out3) { Dept.ProgramsInDept; }
code_block_10 = CodeBlock(program=programs_in_each_dept_4) { program[3]; }
recursiveSplitPolyPrograms_3 = SpacePlanning.BuildLayout.RecursiveSplitPolyPrograms(code_block_9, code_block_10, example_proportion_to_start, recompute_prog_arrangement)
polygonByPolygon2d_4 = stuffer.DynamoGeometry.PolygonByPolygon2d(recursiveSplitPolyPrograms_3.out0, height_of_space_plan)
polygonByPolygon2d_5 = stuffer.DynamoGeometry.PolygonByPolygon2d(code_block_3, height_of_space_plan)
polygonByPolygon2d_6 = stuffer.DynamoGeometry.PolygonByPolygon2d(code_block_5, height_of_space_plan)
polygonByPolygon2d_7 = stuffer.DynamoGeometry.PolygonByPolygon2d(code_block_7, height_of_space_plan)
polygonByPolygon2d_8 = stuffer.DynamoGeometry.PolygonByPolygon2d(code_block_9, height_of_space_plan)
outline_poly_2 = CodeBlock(outlinePts=fromOutlineGetPoints) { Polygon2d.ByPoints(outlinePts); b = 5; }

# group: Program Polys
opacity_2 = DoubleSlider(1, range=0..255 step 0.1)
val_4 = DoubleSlider(213, range=0..255 step 0.1)
val_5 = DoubleSlider(0, range=0..255 step 0.1)
val_6 = DoubleSlider(0, range=0..255 step 0.1)
byARGB_2 = Color.ByARGB(a=opacity_2, r=val_4, g=val_5, b=val_6)
byGeometryColor_2 = Display.Display.ByGeometryColor(polygonByPolygon2d, byARGB_2)

# group: Program Polys
opacity_3 = DoubleSlider(255, range=0..255 step 0.1)
val_7 = DoubleSlider(220.1, range=0..255 step 0.1)
val_8 = DoubleSlider(85.5, range=0..255 step 0.1)
val_9 = DoubleSlider(182.6, range=0..255 step 0.1)
byARGB_3 = Color.ByARGB(a=opacity_3, r=val_7, g=val_8, b=val_9)
byGeometryColor_3 = Display.Display.ByGeometryColor(polygonByPolygon2d_2, byARGB_3)

# group: Program Polys
opacity_4 = DoubleSlider(109, range=0..255 step 0.1)
val_10 = DoubleSlider(0, range=0..255 step 0.1)
val_11 = DoubleSlider(19.6, range=0..255 step 0.1)
val_12 = DoubleSlider(255, range=0..255 step 0.1)
byARGB_4 = Color.ByARGB(a=opacity_4, r=val_10, g=val_11, b=val_12)
byGeometryColor_4 = Display.Display.ByGeometryColor(polygonByPolygon2d_3, byARGB_4)

# group: Program Polys
opacity_5 = DoubleSlider(109, range=0..255 step 1)
val_13 = DoubleSlider(0, range=0..255 step 1)
val_14 = DoubleSlider(0, range=0..255 step 1)
val_15 = DoubleSlider(72.5, range=0..255 step 1)
byARGB_5 = Color.ByARGB(a=opacity_5, r=val_13, g=val_14, b=val_15)
byGeometryColor_5 = Display.Display.ByGeometryColor(polygonByPolygon2d_4, byARGB_5)

# group: Dept Analytics
deptAnalytics = SpacePlanning.PlaceSpace.DeptAnalytics(deptArrangeOnSite.out3)
department_placed_sorted = Watch(deptAnalytics.out0)
num_cells_taken = Watch(deptAnalytics.out1)
area_satisfied = Watch(deptAnalytics.out2)
area_needed = Watch(deptAnalytics.out3)
areaProvided = Watch(deptAnalytics.out4)
code_block_11 = CodeBlock(prog=deptAnalytics.out5) { prog.ProgramName; }
programs_in_dept = Watch(code_block_11)
poly_assigned_to_depts = Watch(deptAnalytics.out6)

# group: Dept Polys
byARGB_6 = Color.ByARGB(a=opacity_2, r=val_4, g=val_5, b=val_6)
byGeometryColor_6 = Display.Display.ByGeometryColor(polygonByPolygon2d_5, byARGB_6)
byARGB_7 = Color.ByARGB(a=opacity_3, r=val_7, g=val_8, b=val_9)
byGeometryColor_7 = Display.Display.ByGeometryColor(polygonByPolygon2d_6, byARGB_7)
byARGB_8 = Color.ByARGB(a=opacity_4, r=val_10, g=val_11, b=val_12)
byGeometryColor_8 = Display.Display.ByGeometryColor(polygonByPolygon2d_7, byARGB_8)
byARGB_9 = Color.ByARGB(a=opacity_5, r=val_13, g=val_14, b=val_15)
byGeometryColor_9 = Display.Display.ByGeometryColor(polygonByPolygon2d_8, byARGB_9)

# group: Program Analytics
code_block_12 = CodeBlock(updatedProgramData=recursiveSplitProgramsOneDirByDistance.out3) { updatedProgramData; }
programAnalytics = SpacePlanning.PlaceSpace.ProgramAnalytics(code_block_12)  # frozen
programs_in_dept_2 = Watch(programAnalytics.out0)
cells_occupied = Watch(programAnalytics.out1)
is_area_satisfied = Watch(programAnalytics.out2)
area_needed_2 = Watch(programAnalytics.out3)
area_provided = Watch(programAnalytics.out4)
quantity = Watch(programAnalytics.out5)
code_block_13 = CodeBlock(updatedProgramData=recursiveSplitProgramsOneDirByDistance.out3) { updatedProgramData[0]; }
code_block_14 = CodeBlock(updatedProgramData=recursiveSplitPolyPrograms.out3) { updatedProgramData[0]; }
code_block_15 = CodeBlock(updatedProgramData=recursiveSplitPolyPrograms.out3) { updatedProgramData; }
programAnalytics_2 = SpacePlanning.PlaceSpace.ProgramAnalytics(code_block_15)
programs_in_dept_3 = Watch(programAnalytics_2.out0)
cells_occupied_2 = Watch(programAnalytics_2.out1)
is_area_satisfied_2 = Watch(programAnalytics_2.out2)
area_needed_3 = Watch(programAnalytics_2.out3)
area_provided_2 = Watch(programAnalytics_2.out4)
quantity_2 = Watch(programAnalytics_2.out5)
code_block_16 = CodeBlock(updatedProgramData=recursiveSplitPolyPrograms_2.out3) { updatedProgramData[0]; }
code_block_17 = CodeBlock(updatedProgramData=recursiveSplitPolyPrograms_2.out3) { updatedProgramData; }
programAnalytics_3 = SpacePlanning.PlaceSpace.ProgramAnalytics(code_block_17)
programs_in_dept_4 = Watch(programAnalytics_3.out0)
cells_occupied_3 = Watch(programAnalytics_3.out1)
is_area_satisfied_3 = Watch(programAnalytics_3.out2)
area_needed_4 = Watch(programAnalytics_3.out3)
area_provided_3 = Watch(programAnalytics_3.out4)
quantity_3 = Watch(programAnalytics_3.out5)
code_block_18 = CodeBlock(updatedProgramData=recursiveSplitPolyPrograms_3.out3) { updatedProgramData[0]; }
code_block_19 = CodeBlock(updatedProgramData=recursiveSplitPolyPrograms_3.out3) { updatedProgramData; }
programAnalytics_4 = SpacePlanning.PlaceSpace.ProgramAnalytics(code_block_19)
programs_in_dept_5 = Watch(programAnalytics_4.out0)
cells_occupied_4 = Watch(programAnalytics_4.out1)
is_area_satisfied_4 = Watch(programAnalytics_4.out2)
area_needed_5 = Watch(programAnalytics_4.out3)
area_provided_4 = Watch(programAnalytics_4.out4)
quantity_4 = Watch(programAnalytics_4.out5)
poly_assigned_to_progs = Watch(programAnalytics_4.out6)
poly_assigned_to_progs_2 = Watch(programAnalytics_3.out6)
poly_assigned_to_progs_3 = Watch(programAnalytics_2.out6)
poly_assigned_to_progs_4 = Watch(programAnalytics.out6)

limit = DoubleSlider(0, range=0..200 step 0.1)

# group: Circulation Inputs
dept_corridor_width = DoubleSlider(6, range=5..12 step 1)
program_corridor_width = DoubleSlider(6, range=4..12 step 1)
allowed_circulation_ratio_l_w = DoubleSlider(5.3, range=0.5..6 step 0.3)
frequency_of_corridors = DoubleSlider(0.7, range=0.2..1 step 0.1)

# group: Circulation Between Dept
makeDeptTopology = SpacePlanning.Circulation.MakeDeptTopology(deptArrangeOnSite.out3, outline_poly_2.out0, limit)
height = CodeBlock { 7; }
circulation_network_dept = stuffer.DynamoGeometry.LineByLine2d(makeDeptTopology.out3, height)
makeDeptCirculation = SpacePlanning.Circulation.MakeDeptCirculation(deptArrangeOnSite.out3, makeDeptTopology.out3, dept_corridor_width)
code_block_20 = CodeBlock { 2.5; }

# group (continued): Generator
code_block_21 = CodeBlock(updatedDeptPoly=makeDeptCirculation.out1) { updatedDeptPoly; }

# group: Circulation Space Depts
makeSurfaceForPolygon2d = stuffer.DynamoGeometry.MakeSurfaceForPolygon2d(makeDeptCirculation.out0, code_block_20)
opacity_6 = DoubleSlider(255, range=0..255 step 1)
val_16 = DoubleSlider(240.6, range=0..255 step 1)
val_17 = DoubleSlider(131.6, range=0..255 step 1)
val_18 = DoubleSlider(27, range=0..255 step 1)
byARGB_10 = Color.ByARGB(a=opacity_6, r=val_16, g=val_17, b=val_18)
byGeometryColor_10 = Display.Display.ByGeometryColor(makeSurfaceForPolygon2d, byARGB_10)

# group: Left Over Space (if any)
makeSurfaceForPolygon2d_2 = stuffer.DynamoGeometry.MakeSurfaceForPolygon2d(deptArrangeOnSite.out1)
opacity_7 = DoubleSlider(255, range=0..255 step 1)
val_19 = DoubleSlider(231.1, range=0..255 step 1)
val_20 = DoubleSlider(109.1, range=0..255 step 1)
val_21 = DoubleSlider(215.8, range=0..255 step 1)
byARGB_11 = Color.ByARGB(a=opacity_7, r=val_19, g=val_20, b=val_21)
byGeometryColor_11 = Display.Display.ByGeometryColor(makeSurfaceForPolygon2d_2, byARGB_11)

# group: Circulation Between Program
makeCirculationTopology = SpacePlanning.Circulation.MakeCirculationTopology(outline_poly_2.out0, recursiveSplitPolyPrograms.out0, recursiveSplitPolyPrograms_2.out0, recursiveSplitPolyPrograms_3.out0)
makeProgramCirculation = SpacePlanning.Circulation.MakeProgramCirculation(makeCirculationTopology.out2, makeCirculationTopology.out3, program_corridor_width, allowed_circulation_ratio_l_w, frequency_of_corridors)
code_block_22 = CodeBlock(corridorsPrograms=makeProgramCirculation) { corridorsPrograms; ht = 2; }
height_2 = CodeBlock { 7; }
circulation_network_prog = stuffer.DynamoGeometry.LineByLine2d(makeCirculationTopology.out3, height_2)

# group: Circulation Space Programs
makeSurfaceForPolygon2d_3 = stuffer.DynamoGeometry.MakeSurfaceForPolygon2d(code_block_22.corridorsPrograms, code_block_22.ht)
opacity_8 = DoubleSlider(255, range=0..255 step 1)
val_22 = DoubleSlider(240.6, range=0..255 step 1)
val_23 = DoubleSlider(0, range=0..255 step 1)
val_24 = DoubleSlider(27, range=0..255 step 1)
byARGB_12 = Color.ByARGB(a=opacity_8, r=val_22, g=val_23, b=val_24)
byGeometryColor_12 = Display.Display.ByGeometryColor(makeSurfaceForPolygon2d_3, byARGB_12)

code_block_23 = CodeBlock(a=deptArrangeOnSite.out4) { a["NodeList"].NodeType; }
watch = Watch(code_block_23)
code_block_24 = CodeBlock(a=deptArrangeOnSite.out4) { a["SpaceTree"].CenterPtNodeList; a["SpaceTree"].RadiusNodeList; }
byCenterPointRadius_2 = Circle.ByCenterPointRadius(centerPoint=code_block_24.out0, radius=code_block_24.out1)
watch_2 = Watch(recursiveSplitProgramsOneDirByDistance.out0)
string = StringInput("D:\SUBHAJIT WORKS\01 DUKE BED TOWER AUTOMATION\08 EXCEL\ATORIGINDK.sat")
readBuildingOutline = SpacePlanning.ReadData.ReadBuildingOutline(string)
code_block_25 = CodeBlock(a=polygonByPolygon2d_2) { a.Points; }
acceptable_width = DoubleSlider(12, range=3..66 step 0.3)
min_width_allowed = DoubleSlider(8, range=4..12 step 0.3)
height_of_newplan = DoubleSlider(1, range=0..100 step 0.1)

# group: New Programs Placed 1
recursivePlaceProgramsSeries = SpacePlanning.BuildLayout.RecursivePlaceProgramsSeries(code_block_5, code_block_6, acceptable_width, min_width_allowed, recompute_prog_arrangement)
polygonByPolygon2d_9 = stuffer.DynamoGeometry.PolygonByPolygon2d(recursivePlaceProgramsSeries.out1, height_of_newplan)
polygonByPolygon2d_10 = stuffer.DynamoGeometry.PolygonByPolygon2d(recursivePlaceProgramsSeries.out0, height_of_newplan)

# group: New Programs Placed 2
recursivePlaceProgramsSeries_2 = SpacePlanning.BuildLayout.RecursivePlaceProgramsSeries(code_block_7, code_block_8, acceptable_width, min_width_allowed, recompute_prog_arrangement)
polygonByPolygon2d_11 = stuffer.DynamoGeometry.PolygonByPolygon2d(recursivePlaceProgramsSeries_2.out1, height_of_newplan)
polygonByPolygon2d_12 = stuffer.DynamoGeometry.PolygonByPolygon2d(recursivePlaceProgramsSeries_2.out0, height_of_newplan)

# group: New Programs Placed 3
recursivePlaceProgramsSeries_3 = SpacePlanning.BuildLayout.RecursivePlaceProgramsSeries(code_block_9, code_block_10, acceptable_width, min_width_allowed, recompute_prog_arrangement)
polygonByPolygon2d_13 = stuffer.DynamoGeometry.PolygonByPolygon2d(recursivePlaceProgramsSeries_3.out0, height_of_newplan)
polygonByPolygon2d_14 = stuffer.DynamoGeometry.PolygonByPolygon2d(recursivePlaceProgramsSeries_3.out1, height_of_newplan)

# group: Circulation Inputs
program_corridor_width_2 = DoubleSlider(3, range=3..12 step 1)
allowed_circulation_ratio_l_w_2 = DoubleSlider(5.3, range=0.5..6 step 0.3)
frequency_of_corridors_2 = DoubleSlider(0.6, range=0.2..1 step 0.1)
dept_corridor_width_2 = DoubleSlider(6, range=5..12 step 1)

# group: Circulation Network
makeCirculationTopology_2 = SpacePlanning.Circulation.MakeCirculationTopology(outline_poly_2.out0, recursivePlaceProgramsSeries.out2, recursivePlaceProgramsSeries_2.out2, recursivePlaceProgramsSeries_3.out2)
height_3 = CodeBlock { 7; }
circulation_network_prog_2 = stuffer.DynamoGeometry.LineByLine2d(makeCirculationTopology_2.out3, height_3)
makeProgramCirculation_2 = SpacePlanning.Circulation.MakeProgramCirculation(makeCirculationTopology_2.out2, makeCirculationTopology_2.out3, program_corridor_width_2, allowed_circulation_ratio_l_w_2, frequency_of_corridors_2)
code_block_26 = CodeBlock(corridorsPrograms=makeProgramCirculation_2) { corridorsPrograms; ht = 2; }

# group: Circulation Space Programs New
makeSurfaceForPolygon2d_4 = stuffer.DynamoGeometry.MakeSurfaceForPolygon2d(code_block_26.corridorsPrograms, code_block_26.ht)
opacity_9 = DoubleSlider(255, range=0..255 step 1)
val_25 = DoubleSlider(240.6, range=0..255 step 1)
val_26 = DoubleSlider(0, range=0..255 step 1)
val_27 = DoubleSlider(27, range=0..255 step 1)
byARGB_13 = Color.ByARGB(a=opacity_9, r=val_25, g=val_26, b=val_27)
byGeometryColor_13 = Display.Display.ByGeometryColor(makeSurfaceForPolygon2d_4, byARGB_13)

# group: Central Station
makeSurfaceForPolygon2d_5 = stuffer.DynamoGeometry.MakeSurfaceForPolygon2d(deptArrangeOnSite.out2, code_block_20)
opacity_10 = DoubleSlider(255, range=0..255 step 1)
val_28 = DoubleSlider(240.6, range=0..255 step 1)
val_29 = DoubleSlider(131.6, range=0..255 step 1)
val_30 = DoubleSlider(27, range=0..255 step 1)
byARGB_14 = Color.ByARGB(a=opacity_10, r=val_28, g=val_29, b=val_30)
byGeometryColor_14 = Display.Display.ByGeometryColor(makeSurfaceForPolygon2d_5, byARGB_14)

code_block_27 = CodeBlock { a=3; }
polygonByPolygon2d_15 = stuffer.DynamoGeometry.PolygonByPolygon2d(deptArrangeOnSite.out2, code_block_27)
code_block_28 = CodeBlock { a=3; }
polygonByPolygon2d_16 = stuffer.DynamoGeometry.PolygonByPolygon2d(recursivePlaceProgramsSeries.out2, code_block_28)
code_block_29 = CodeBlock(a=polygonByPolygon2d_10) { a.Corners(); }
code_block_30 = CodeBlock(a=recursivePlaceProgramsSeries.out2) { a[0]; }
areaCheckPolygon = SpacePlanning.PolygonUtility.AreaCheckPolygon(code_block_30)
polygonByPolygon2d_17 = stuffer.DynamoGeometry.PolygonByPolygon2d(recursivePlaceProgramsSeries_2.out2, code_block_28)
polygonByPolygon2d_18 = stuffer.DynamoGeometry.PolygonByPolygon2d(recursivePlaceProgramsSeries_3.out2, code_block_28)
code_block_31 = CodeBlock(a=polygonByPolygon2d_12) { a.Corners(); }
code_block_32 = CodeBlock(a=polygonByPolygon2d) { a.Corners(); }
