# Dynamo graph 29 MAR _ SPACE FULL NEW_2.dyn (Dynamo 0.9.1.4054)

gridcell_dim = CodeBlock { dimX = 3; dimY = 3; }
circulation_add_on_factor = DoubleSlider(1.5, range=1..3 step 0.2)

# group: Make Data Stack
autoMakeBuildingOutline = SpacePlanning.ReadData.AutoMakeBuildingOutline()
autoMakeDataStack = SpacePlanning.ReadData.AutoMakeDataStack(gridcell_dim.dimX, gridcell_dim.dimY, circulation_add_on_factor)

patient_bed_depth_ideal_val_32 = DoubleSlider(32, range=25..40 step 0.5)

# group: Slide to Generate New Design
recompute_dept_arrangement = DoubleSlider(2, range=1..5 step 1)
recompute_prog_arrangement = DoubleSlider(2, range=1..5 step 1)

patient_bed_width_ideal_val_16 = DoubleSlider(15, range=12..25 step 0.5)
height_of_space_plan = CodeBlock { height = 1; }
color_argb = CodeBlock { a=255; r=213; g=0; b=0; }
acceptable_width = DoubleSlider(17.5, range=10..25 step 0.5)
circulation_factor = DoubleSlider(9, range=8..20 step 0.5)
color_argb_2 = CodeBlock { a=255; r=220; g=85; b=182; }
color_argb_3 = CodeBlock { a=109; r=0; g=20; b=255; }
color_argb_4 = CodeBlock { a=109; r=0; g=0; b=72; }

# group: Make Regular Poly
regular_poly_inputs = CodeBlock()
# ---------- regular_poly_inputs.designscript (4 lines) ----------
a = Point.ByCoordinates(-3600,-1100);
b = Point.ByCoordinates(-3800,-1100);
c = Point.ByCoordinates(-3800,-1300);
d = Point.ByCoordinates(-3600,-1300);
# ----------------------------------------
create = List.Create(regular_poly_inputs.a, regular_poly_inputs.b, regular_poly_inputs.c, regular_poly_inputs.d)
regular_polygon_inp = CodeBlock { cen = Point.ByCoordinates(-3000,-1500); radius = 150; sides = 8; }
byCenterPointRadius = Circle.ByCenterPointRadius(centerPoint=regular_polygon_inp.cen, radius=regular_polygon_inp.radius)  # frozen
regularPolygon = Polygon.RegularPolygon(circle=byCenterPointRadius, numberSides=regular_polygon_inp.sides)

# group: Input Poly Pts
# note: Connect one of the three nodes below with outlinePts Code Block
fromOutlineGetPoints = SpacePlanning.ReadData.FromOutlineGetPoints(autoMakeBuildingOutline)
point2dFromPointList = stuffer.DynamoGeometry.Point2dFromPointList(create)
point2dFromRegularPolygon = stuffer.DynamoGeometry.Point2dFromRegularPolygon(regularPolygon)

# group (continued): Make Data Stack
outline_poly = CodeBlock(outlinePts=fromOutlineGetPoints) { Polygon2d.ByPoints(outlinePts); outlinePts; }

# group: Cells From Outline
fromPointsGetBoundingPoly = SpacePlanning.ReadData.FromPointsGetBoundingPoly(outline_poly.outlinePts)
gridPointsInsideOutline = SpacePlanning.GridObject.GridPointsInsideOutline(fromPointsGetBoundingPoly, outline_poly.outlinePts, gridcell_dim.dimX, gridcell_dim.dimY)

# group: Cell Polys
pointFromPoint2dList = stuffer.DynamoGeometry.pointFromPoint2dList(gridPointsInsideOutline.out0)
makeCellsFromGridPoints = SpacePlanning.GridObject.MakeCellsFromGridPoints(pointFromPoint2dList, gridcell_dim.dimX, gridcell_dim.dimY)
opacity = DoubleSlider(10.7, range=0..255 step 0.1)
val = DoubleSlider(164.6, range=0..255 step 1)
val_2 = DoubleSlider(183.1, range=0..255 step 1)
val_3 = DoubleSlider(165.4, range=0..255 step 1)
byARGB = Color.ByARGB(a=opacity, r=val, g=val_2, b=val_3)
byGeometryColor = Display.Display.ByGeometryColor(makeCellsFromGridPoints, byARGB)

# group: Dept & Program Generator
deptArrangeOnSite = SpacePlanning.BuildLayout.DeptArrangeOnSite(outline_poly.out0, autoMakeDataStack.out3, gridPointsInsideOutline.out1, patient_bed_depth_ideal_val_32, recompute_dept_arrangement)
department_poly = CodeBlock(dept=deptArrangeOnSite.out0) { dept[0]; dept[1]; dept[2]; dept[3]; }
programs_in_each_dept = CodeBlock(deptArrangeOnSite.out3) { Dept.ProgramsInDept; }
programData = CodeBlock(program=programs_in_each_dept) { program[0]; program[1]; program[2]; program[3]; }
polygonByPolygon2d = stuffer.DynamoGeometry.PolygonByPolygon2d(department_poly.out0, height_of_space_plan)
polygonByPolygon2d_2 = stuffer.DynamoGeometry.PolygonByPolygon2d(department_poly.out1, height_of_space_plan)
polygonByPolygon2d_3 = stuffer.DynamoGeometry.PolygonByPolygon2d(department_poly.out2, height_of_space_plan)
polygonByPolygon2d_4 = stuffer.DynamoGeometry.PolygonByPolygon2d(department_poly.out3, height_of_space_plan)
outline_poly_2 = CodeBlock(outlinePts=fromOutlineGetPoints) { Polygon2d.ByPoints(outlinePts); b = 5; }
dynamogeometry = stuffer.DynamoGeometry.PolygonByPolygon2d(deptArrangeOnSite.out1, height_of_space_plan)  # "DynamoGeometry.PolygonByPolygon2d - Left Over Space"

# group: Inpatient Program Spaces
recursiveSplitProgramsOneDirByDistance = SpacePlanning.BuildLayout.RecursiveSplitProgramsOneDirByDistance(department_poly.out0, programData.out0, patient_bed_width_ideal_val_16, recompute_prog_arrangement)
polygonByPolygon2d_5 = stuffer.DynamoGeometry.PolygonByPolygon2d(recursiveSplitProgramsOneDirByDistance.out0, height_of_space_plan)
byARGB_2 = Color.ByARGB(a=color_argb.a, r=color_argb.r, g=color_argb.g, b=color_argb.b)
byGeometryColor_2 = Display.Display.ByGeometryColor(polygonByPolygon2d_5, byARGB_2)

# group: Clinic Support Program Spaces
recursivePlaceProgramsSeries = SpacePlanning.BuildLayout.RecursivePlaceProgramsSeries(department_poly.out1, programData.out1, acceptable_width, circulation_factor, recompute_prog_arrangement)
polygonByPolygon2d_6 = stuffer.DynamoGeometry.PolygonByPolygon2d(recursivePlaceProgramsSeries.out0, height_of_space_plan)
byARGB_3 = Color.ByARGB(a=color_argb_2.a, r=color_argb_2.r, g=color_argb_2.g, b=color_argb_2.b)
byGeometryColor_3 = Display.Display.ByGeometryColor(polygonByPolygon2d_6, byARGB_3)

# group: Shared Staff Support Program Spaces
recursivePlaceProgramsSeries_2 = SpacePlanning.BuildLayout.RecursivePlaceProgramsSeries(department_poly.out2, programData.out2, acceptable_width, circulation_factor, recompute_prog_arrangement)
byARGB_4 = Color.ByARGB(a=color_argb_3.a, r=color_argb_3.r, g=color_argb_3.g, b=color_argb_3.b)

polygonByPolygon2d_7 = stuffer.DynamoGeometry.PolygonByPolygon2d(recursivePlaceProgramsSeries_2.out0, height_of_space_plan)

# group (continued): Shared Staff Support Program Spaces
byGeometryColor_4 = Display.Display.ByGeometryColor(polygonByPolygon2d_7, byARGB_4)

# group: Family Public Support Program Spaces
recursivePlaceProgramsSeries_3 = SpacePlanning.BuildLayout.RecursivePlaceProgramsSeries(department_poly.out3, programData.out3, acceptable_width, circulation_factor, recompute_prog_arrangement)
polygonByPolygon2d_8 = stuffer.DynamoGeometry.PolygonByPolygon2d(recursivePlaceProgramsSeries_3.out0, height_of_space_plan)
byARGB_5 = Color.ByARGB(a=color_argb_4.a, r=color_argb_4.r, g=color_argb_4.g, b=color_argb_4.b)
byGeometryColor_5 = Display.Display.ByGeometryColor(polygonByPolygon2d_8, byARGB_5)

# group: Dept Analytics
deptAnalytics = SpacePlanning.PlaceSpace.DeptAnalytics(deptArrangeOnSite.out3)  # frozen
department_placed_sorted = Watch(deptAnalytics.out0)
num_cells_taken = Watch(deptAnalytics.out1)
area_satisfied = Watch(deptAnalytics.out2)
area_needed = Watch(deptAnalytics.out3)
areaProvided = Watch(deptAnalytics.out4)
code_block = CodeBlock(prog=deptAnalytics.out5) { prog.ProgramName; }
programs_in_dept = Watch(code_block)
poly_assigned_to_depts = Watch(deptAnalytics.out6)

# group: Dept Polys
byARGB_6 = Color.ByARGB(a=color_argb.a, r=color_argb.r, g=color_argb.g, b=color_argb.b)
byGeometryColor_6 = Display.Display.ByGeometryColor(polygonByPolygon2d, byARGB_6)
byARGB_7 = Color.ByARGB(a=color_argb_2.a, r=color_argb_2.r, g=color_argb_2.g, b=color_argb_2.b)
byGeometryColor_7 = Display.Display.ByGeometryColor(polygonByPolygon2d_2, byARGB_7)
byARGB_8 = Color.ByARGB(a=color_argb_3.a, r=color_argb_3.r, g=color_argb_3.g, b=color_argb_3.b)
byGeometryColor_8 = Display.Display.ByGeometryColor(polygonByPolygon2d_3, byARGB_8)
byARGB_9 = Color.ByARGB(a=color_argb_4.a, r=color_argb_4.r, g=color_argb_4.g, b=color_argb_4.b)
byGeometryColor_9 = Display.Display.ByGeometryColor(polygonByPolygon2d_4, byARGB_9)

# group: Program Analytics
updatedProgramData = CodeBlock(progA=recursiveSplitProgramsOneDirByDistance.out3, progB=recursivePlaceProgramsSeries.out4, progC=recursivePlaceProgramsSeries_2.out4, progD=recursivePlaceProgramsSeries_3.out4) { progA; progB; progC; progD; }  # frozen
programAnalytics = SpacePlanning.PlaceSpace.ProgramAnalytics(updatedProgramData.progA)  # frozen
programs_in_dept_2 = Watch(programAnalytics.out0)
cells_occupied = Watch(programAnalytics.out1)
is_area_satisfied = Watch(programAnalytics.out2)
area_needed_2 = Watch(programAnalytics.out3)
area_provided = Watch(programAnalytics.out4)
quantity = Watch(programAnalytics.out5)
programAnalytics_2 = SpacePlanning.PlaceSpace.ProgramAnalytics(updatedProgramData.progB)
programs_in_dept_3 = Watch(programAnalytics_2.out0)
cells_occupied_2 = Watch(programAnalytics_2.out1)
is_area_satisfied_2 = Watch(programAnalytics_2.out2)
area_needed_3 = Watch(programAnalytics_2.out3)
area_provided_2 = Watch(programAnalytics_2.out4)
quantity_2 = Watch(programAnalytics_2.out5)
programAnalytics_3 = SpacePlanning.PlaceSpace.ProgramAnalytics(updatedProgramData.progC)
programs_in_dept_4 = Watch(programAnalytics_3.out0)
cells_occupied_3 = Watch(programAnalytics_3.out1)
is_area_satisfied_3 = Watch(programAnalytics_3.out2)
area_needed_4 = Watch(programAnalytics_3.out3)
area_provided_3 = Watch(programAnalytics_3.out4)
quantity_3 = Watch(programAnalytics_3.out5)
programAnalytics_4 = SpacePlanning.PlaceSpace.ProgramAnalytics(updatedProgramData.progD)
programs_in_dept_5 = Watch(programAnalytics_4.out0)
cells_occupied_4 = Watch(programAnalytics_4.out1)
is_area_satisfied_4 = Watch(programAnalytics_4.out2)
area_needed_5 = Watch(programAnalytics_4.out3)
area_provided_4 = Watch(programAnalytics_4.out4)
quantity_4 = Watch(programAnalytics_4.out5)
poly_assigned_to_progs = Watch(programAnalytics_4.out6)
poly_assigned_to_progs_2 = Watch(programAnalytics_3.out6)
poly_assigned_to_progs_3 = Watch(programAnalytics_2.out6)
poly_assigned_to_progs_4 = Watch(programAnalytics.out6)

limit = CodeBlock { limit = 0; }
dept_corridor_width = DoubleSlider(6, range=5..12 step 1)
color_argb_5 = CodeBlock { a=255; r=240; g=130; b=27; }

# group: Circulation Between Dept
makeDeptTopology = SpacePlanning.Circulation.MakeDeptTopology(deptArrangeOnSite.out3, outline_poly_2.out0, limit)
height = CodeBlock { 7; }
circulation_network_dept = stuffer.DynamoGeometry.LineByLine2d(makeDeptTopology.out3, height)
makeDeptCirculation = SpacePlanning.Circulation.MakeDeptCirculation(deptArrangeOnSite.out3, makeDeptTopology.out3, dept_corridor_width)
code_block_2 = CodeBlock { 2.5; }
makeSurfaceForPolygon2d = stuffer.DynamoGeometry.MakeSurfaceForPolygon2d(makeDeptCirculation, code_block_2)
byARGB_10 = Color.ByARGB(a=color_argb_5.a, r=color_argb_5.r, g=color_argb_5.g, b=color_argb_5.b)
byGeometryColor_10 = Display.Display.ByGeometryColor(makeSurfaceForPolygon2d, byARGB_10)

color_argb_6 = CodeBlock { a=255; r=230; g=215; b=109; }

# group: Left Over Space (if any)
makeSurfaceForPolygon2d_2 = stuffer.DynamoGeometry.MakeSurfaceForPolygon2d(deptArrangeOnSite.out1)
byARGB_11 = Color.ByARGB(a=color_argb_6.a, r=color_argb_6.r, g=color_argb_6.g, b=color_argb_6.b)
byGeometryColor_11 = Display.Display.ByGeometryColor(makeSurfaceForPolygon2d_2, byARGB_11)

local_sat_path = StringInput("D:\SUBHAJIT WORKS\01 DUKE BED TOWER AUTOMATION\08 EXCEL\ATORIGINDK.sat")
readBuildingOutline = SpacePlanning.ReadData.ReadBuildingOutline(local_sat_path)
program_corridor_width = DoubleSlider(5, range=3..6 step 0.5)
allowed_circulation_ratio_l_w = DoubleSlider(5, range=0.5..6 step 0.5)
frequency_of_corridors = DoubleSlider(0.7, range=0.4..1 step 0.1)
color_argb_7 = CodeBlock { a=255; r=240; g=0; b=27; }

# group: Circulation Between Programs
makeCirculationTopology = SpacePlanning.Circulation.MakeCirculationTopology(outline_poly_2.out0, recursivePlaceProgramsSeries.out2, recursivePlaceProgramsSeries_2.out2, recursivePlaceProgramsSeries_3.out2)
height_2 = CodeBlock { 7; }
circulation_network_prog = stuffer.DynamoGeometry.LineByLine2d(makeCirculationTopology.out3, height_2)
makeProgramCirculation = SpacePlanning.Circulation.MakeProgramCirculation(makeCirculationTopology.out2, makeCirculationTopology.out3, program_corridor_width, allowed_circulation_ratio_l_w, frequency_of_corridors)
code_block_3 = CodeBlock(corridorsPrograms=makeProgramCirculation) { corridorsPrograms; ht = 2; }
makeSurfaceForPolygon2d_3 = stuffer.DynamoGeometry.MakeSurfaceForPolygon2d(code_block_3.corridorsPrograms, code_block_3.ht)
byARGB_12 = Color.ByARGB(a=color_argb_7.a, r=color_argb_7.r, g=color_argb_7.g, b=color_argb_7.b)
byGeometryColor_12 = Display.Display.ByGeometryColor(makeSurfaceForPolygon2d_3, byARGB_12)

color_argb_8 = CodeBlock { a=255; r=240; g=130; b=27; }

# group: Central Station/ Lobby
makeSurfaceForPolygon2d_4 = stuffer.DynamoGeometry.MakeSurfaceForPolygon2d(deptArrangeOnSite.out2, code_block_2)
byARGB_13 = Color.ByARGB(a=color_argb_8.a, r=color_argb_8.r, g=color_argb_8.g, b=color_argb_8.b)
byGeometryColor_13 = Display.Display.ByGeometryColor(makeSurfaceForPolygon2d_4, byARGB_13)
height_3 = CodeBlock { a=3; }
polygonByPolygon2d_9 = stuffer.DynamoGeometry.PolygonByPolygon2d(deptArrangeOnSite.out2, height_3)
