# Dynamo graph 12 FEB _ ALL WORKS INCLUDING BUBBLE.dyn (Dynamo 0.9.0.3072)

building_outline_file_path = StringInput("D:\SUBHAJIT WORKS\01 DUKE BED TOWER AUTOMATION\08 EXCEL\OUTLINE.SAT")  # "Building Outline File Path String"
program_data_info_csv_file_path = StringInput("D:\SUBHAJIT WORKS\01 DUKE BED TOWER AUTOMATION\08 EXCEL\01 FEB PROGRAM.csv")  # "Program Data Info CSV File Path String"
dimX = DoubleSlider(2, range=0..200 step 0.1)
dimY = DoubleSlider(2, range=0..200 step 0.1)
makeDataStack = SpacePlanning.ReadData.MakeDataStack(program_data_info_csv_file_path, dimX, dimY)
text_editor = CodeBlock(text=makeDataStack.out0) { text[1]; 1.2; }
programPointGridFromData = SpacePlanning.BubbleChart.ProgramPointGridFromData(makeDataStack.out0)
scale = DoubleSlider(200, range=0..200 step 0.1)
include_quantity_of_program = BoolSelector(false)
bubbleRadiusFromNormalizedArea = SpacePlanning.BubbleChart.BubbleRadiusFromNormalizedArea(makeDataStack.out0, scale, include_quantity_of_program)
iteration = DoubleSlider(100, range=0..1000 step 1)
packBubbles = SpacePlanning.BubbleChart.PackBubbles(programPointGridFromData, bubbleRadiusFromNormalizedArea, iteration)
py_newpointgrid = Python(IN[0]=packBubbles)
# ---------- py_newpointgrid.python (11 lines) ----------
import clr
clr.AddReference('ProtoGeometry')
from Autodesk.DesignScript.Geometry import *
#The inputs to this node will be stored as a list in the IN variables.
dataEnteringNode = IN




#Assign your output to the OUT variable.
OUT = IN[0][1]
# ----------------------------------------
pointFromPoint2dList = stuffer.DynamoGeometry.pointFromPoint2dList(py_newpointgrid)
textProgramName = DynamoText.Text.FromStringOriginAndScale(text_editor.out0, pointFromPoint2dList, text_editor.out1)
iteration_2 = DoubleSlider(100, range=0..1000 step 1)
building_outline_file_path_2 = StringInput("D:\SUBHAJIT WORKS\01 DUKE BED TOWER AUTOMATION\08 EXCEL\OUTLINEDK.SAT")  # "Building Outline File Path String"
building_outline_file_path_3 = StringInput("D:\SUBHAJIT WORKS\01 DUKE BED TOWER AUTOMATION\08 EXCEL\OUTLINEDKtest.SAT")  # "Building Outline File Path String"
building_outline_file_path_4 = StringInput("D:\SUBHAJIT WORKS\01 DUKE BED TOWER AUTOMATION\08 EXCEL\OUTLINESCALEDDK.SAT")  # "Building Outline File Path String"
readBuildingOutline = SpacePlanning.ReadData.ReadBuildingOutline(building_outline_file_path_4)
fromOutlineGetPoints = SpacePlanning.ReadData.FromOutlineGetPoints(readBuildingOutline)
fromPointsGetBoundingPoly = SpacePlanning.ReadData.FromPointsGetBoundingPoly(fromOutlineGetPoints)
polyCurveFromPoints = stuffer.DynamoGeometry.PolyCurveFromPoints(fromPointsGetBoundingPoly)
makeAdjacencyNetwork = SpacePlanning.BubbleChart.MakeAdjacencyNetwork(py_newpointgrid, makeDataStack.out0)
fromPointsGetBoundingPoly_2 = SpacePlanning.ReadData.FromPointsGetBoundingPoly(fromOutlineGetPoints)
gridPointsInsideOutline = SpacePlanning.GridObject.GridPointsInsideOutline(fromPointsGetBoundingPoly_2, fromOutlineGetPoints, dimX, dimY)
convexHullFromPoint2D = SpacePlanning.GridObject.ConvexHullFromPoint2D(gridPointsInsideOutline.out0)
pointFromPoint2dList_2 = stuffer.DynamoGeometry.pointFromPoint2dList(convexHullFromPoint2D)
byPoints = Polygon.ByPoints(pointFromPoint2dList_2)
programObjectCheck = SpacePlanning.ReadData.ProgramObjectCheck(makeDataStack.out1)
watch = Watch(makeDataStack.out3)
deptObjectCheck = SpacePlanning.ReadData.DeptObjectCheck(watch)
factor = DoubleSlider(10, range=0..1200 step 0.1)
num = DoubleSlider(34, range=0..34 step 1)
placeProgramsInSite = SpacePlanning.PlaceSpace.PlaceProgramsInSite(makeDataStack.out1, gridPointsInsideOutline.out1, fromOutlineGetPoints, factor, num)
index = DoubleSlider(3, range=0..34 step 1)
py_get_program_cell_index = Python(IN[0]=placeProgramsInSite, IN[1]=index)
# ---------- py_get_program_cell_index.python (12 lines) ----------
import clr
clr.AddReference('ProtoGeometry')
from Autodesk.DesignScript.Geometry import *
#The inputs to this node will be stored as a list in the IN variables.
dataEnteringNode = IN

cellListAll = IN[0]
index = IN[1]
	

#Assign your output to the OUT variable.
OUT = cellListAll[int(index)]
# ----------------------------------------
py_get_point2d_lists = Python(IN[0]=gridPointsInsideOutline.out0, IN[1]=py_get_program_cell_index)
# ---------- py_get_point2d_lists.python (16 lines) ----------
import clr
clr.AddReference('ProtoGeometry')
from Autodesk.DesignScript.Geometry import *
#The inputs to this node will be stored as a list in the IN variables.
dataEnteringNode = IN

ptList = IN[0]
indexList = IN[1]

ptFinal=[]
for i in range(len(indexList)):
	ptFinal.append(ptList[indexList[i]])
	

#Assign your output to the OUT variable.
OUT = ptFinal
# ----------------------------------------
pointFromPoint2dList_3 = stuffer.DynamoGeometry.pointFromPoint2dList(py_get_point2d_lists)
pointFromPoint2dList_4 = stuffer.DynamoGeometry.pointFromPoint2dList(fromOutlineGetPoints)
code_block = CodeBlock(a=pointFromPoint2dList_4) { a[1]; }
showProgramsInSite = SpacePlanning.PlaceSpace.ShowProgramsInSite(makeDataStack.out1, gridPointsInsideOutline.out1, fromOutlineGetPoints)
fromPointsGetBoundingPoly_3 = SpacePlanning.ReadData.FromPointsGetBoundingPoly(py_get_point2d_lists)
polyCurveFromPoints_2 = stuffer.DynamoGeometry.PolyCurveFromPoints(fromPointsGetBoundingPoly_3)
colorVals = DoubleSlider(151, range=0..255 step 1)
colorVals_2 = DoubleSlider(109, range=0..255 step 1)
colorVals_3 = DoubleSlider(34, range=0..255 step 1)
colorVals_4 = DoubleSlider(118, range=0..255 step 1)
makeProgramPolygons = SpacePlanning.PlaceSpace.MakeProgramPolygons(placeProgramsInSite, gridPointsInsideOutline.out0)
pointFromPoint2dList_5 = stuffer.DynamoGeometry.pointFromPoint2dList(makeProgramPolygons.out1)
index_2 = DoubleSlider(15, range=0..34 step 1)
rvalues = stuffer.DynamoGeometry.Rvalues(makeProgramPolygons.out1, index_2)
rvalues_2 = stuffer.DynamoGeometry.Rvalues(makeProgramPolygons.out1, index_2)
rvalues_3 = stuffer.DynamoGeometry.Rvalues(makeProgramPolygons.out1, index_2)
byARGB = Color.ByARGB(r=rvalues, g=rvalues_2, b=rvalues_3)
byGeometryColor = Display.Display.ByGeometryColor(pointFromPoint2dList_5, byARGB)
index_3 = DoubleSlider(9, range=0..34 step 1)
program = CodeBlock(a=byGeometryColor, b=index_3) { a[b]; }
pointFromPoint2dList_6 = stuffer.DynamoGeometry.pointFromPoint2dList(gridPointsInsideOutline.out0)
makeCellsFromGridPoints = SpacePlanning.GridObject.MakeCellsFromGridPoints(pointFromPoint2dList_6, dimX, dimY)
opacity = DoubleSlider(10.7, range=0..255 step 0.1)
val = DoubleSlider(164.6, range=0..255 step 0.1)
val_2 = DoubleSlider(183.1, range=0..255 step 0.1)
val_3 = DoubleSlider(165.4, range=0..255 step 0.1)
byARGB_2 = Color.ByARGB(a=opacity, r=val, g=val_2, b=val_3)
byGeometryColor_2 = Display.Display.ByGeometryColor(makeCellsFromGridPoints, byARGB_2)
makeProgramConvexHulls = SpacePlanning.PlaceSpace.MakeProgramConvexHulls(placeProgramsInSite, gridPointsInsideOutline.out0)
center = Polygon.Center(makeProgramConvexHulls)
byPatch = Surface.ByPatch(makeProgramPolygons.out0)
code_block_2 = CodeBlock(a=byPatch) { a[3]; }
code_block_3 = CodeBlock { -200; }
thicken = Surface.Thicken(surface=byPatch, thickness=code_block_3)
subtractFrom = Surface.SubtractFrom(surface=code_block_2, trimmingEntity=thicken)
code_block_4 = CodeBlock(a=subtractFrom) { a[3]; }
thicken_2 = Surface.Thicken(surface=code_block_2, thickness=code_block_3)
difference = Solid.Difference(solid=thicken_2, other=thicken)
pointFromPoint2dList_7 = stuffer.DynamoGeometry.pointFromPoint2dList(fromOutlineGetPoints)
code_block_5 = CodeBlock(a=pointFromPoint2dList_7) { a[-2]; }
code_block_6 = CodeBlock(a=pointFromPoint2dList_7) { a[-1]; }
byTwoPoints = Vector.ByTwoPoints(start=code_block_5, end=code_block_6)
normalized = Vector.Normalized(byTwoPoints)
number_slider = DoubleSlider(289, range=0..3000 step 0.1)
byStartPointDirectionLength = Line.ByStartPointDirectionLength(startPoint=code_block_5, direction=normalized, length=number_slider)
