# Dynamo graph 23 FEB_1.dyn (Dynamo 0.9.0.3072)

# group: USER INPUTS
building_outline_file_path = StringInput("D:\SUBHAJIT WORKS\01 DUKE BED TOWER AUTOMATION\08 EXCEL\OUTLINE.SAT")  # "Building Outline File Path String"
program_data_info_csv_file_path = StringInput("D:\SUBHAJIT WORKS\01 DUKE BED TOWER AUTOMATION\08 EXCEL\01 FEB PROGRAM.csv")  # "Program Data Info CSV File Path String"
dimX = DoubleSlider(20, range=0..200 step 0.1)
dimY = DoubleSlider(20, range=0..200 step 0.1)
iteration = DoubleSlider(100, range=0..1000 step 1)
building_outline_file_path_2 = StringInput("D:\SUBHAJIT WORKS\01 DUKE BED TOWER AUTOMATION\08 EXCEL\OUTLINEDK.SAT")  # "Building Outline File Path String"
building_outline_file_path_3 = StringInput("D:\SUBHAJIT WORKS\01 DUKE BED TOWER AUTOMATION\08 EXCEL\OUTLINEDKtest.SAT")  # "Building Outline File Path String"
building_outline_file_path_4 = StringInput("D:\SUBHAJIT WORKS\01 DUKE BED TOWER AUTOMATION\08 EXCEL\OUTLINESCALEDDK.SAT")  # "Building Outline File Path String"
scale = DoubleSlider(200, range=0..200 step 0.1)
include_quantity_of_program = BoolSelector(false)

# group: MAKE DATA STACK
factor = DoubleSlider(5, range=0..40 step 0.5)
makeDataStack = SpacePlanning.ReadData.MakeDataStack(program_data_info_csv_file_path, dimX, dimY, factor)
readBuildingOutline = SpacePlanning.ReadData.ReadBuildingOutline(building_outline_file_path_4)
fromOutlineGetPoints = SpacePlanning.ReadData.FromOutlineGetPoints(readBuildingOutline)
fromPointsGetBoundingPoly = SpacePlanning.ReadData.FromPointsGetBoundingPoly(fromOutlineGetPoints)
programObjectCheck = SpacePlanning.ReadData.ProgramObjectCheck()
deptObjectCheck = SpacePlanning.ReadData.DeptObjectCheck()
pointFromPoint2dList = stuffer.DynamoGeometry.pointFromPoint2dList(fromOutlineGetPoints)
num = DoubleSlider(34, range=0..34 step 1)

# group: BUBBLE CHART
text_editor = CodeBlock(text=makeDataStack.out0) { text[1]; 1.2; }
textProgramName = DynamoText.Text.FromStringOriginAndScale(text_editor.out0, arg2=text_editor.out1)
bubbleRadiusFromNormalizedArea = SpacePlanning.BubbleChart.BubbleRadiusFromNormalizedArea(arg1=scale, arg2=include_quantity_of_program)
iteration_2 = DoubleSlider(50, range=0..1000 step 1)
packBubbles = SpacePlanning.BubbleChart.PackBubbles(arg1=bubbleRadiusFromNormalizedArea, arg2=iteration_2)
py_newpointgrid = Python(IN[0]=packBubbles)
# ---------- py_newpointgrid.python (11 lines) ----------
import clr
clr.AddReference('ProtoGeometry')
from Autodesk.DesignScript.Geometry import *
#The inputs to this node will be stored as a list in the IN variables.
dataEnteringNode = IN




#Assign your output to the OUT variable.
OUT = IN[0][1]
# ----------------------------------------
programPointGridFromData = SpacePlanning.BubbleChart.ProgramPointGridFromData()
makeAdjacencyNetwork = SpacePlanning.BubbleChart.MakeAdjacencyNetwork(arg1=makeDataStack.out0)
pointFromPoint2dList_2 = stuffer.DynamoGeometry.pointFromPoint2dList()

# group: CELL OBJECTS FROM POINTS
fromPointsGetBoundingPoly_2 = SpacePlanning.ReadData.FromPointsGetBoundingPoly(fromOutlineGetPoints)
gridPointsInsideOutline = SpacePlanning.GridObject.GridPointsInsideOutline(fromPointsGetBoundingPoly_2, fromOutlineGetPoints, dimX, dimY)
convexHullFromPoint2D = SpacePlanning.GridObject.ConvexHullFromPoint2D(gridPointsInsideOutline.out0)
pointFromPoint2dList_3 = stuffer.DynamoGeometry.pointFromPoint2dList(convexHullFromPoint2D)
byPoints = Polygon.ByPoints(pointFromPoint2dList_3)

# group: PROGRAM DATA STACK
recompute = DoubleSlider(6, range=0..10 step 1)
placeProgramsInSite = SpacePlanning.PlaceSpace.PlaceProgramsInSite(makeDataStack.out1, gridPointsInsideOutline.out1, fromOutlineGetPoints, num, recompute)
recompute_2 = DoubleSlider(6, range=0..10 step 1)
programAnalytics = SpacePlanning.PlaceSpace.ProgramAnalytics(placeProgramsInSite.out1, placeProgramsInSite.out3, recompute_2)
program_name = Watch(programAnalytics.out0)
number_of_cells_occupied = Watch(programAnalytics.out1)
area_satisfied = Watch(programAnalytics.out2)
area_needed = Watch(programAnalytics.out3)
area_provided = Watch(programAnalytics.out4)
quantity = Watch(programAnalytics.out5)
available_cells_and_total_cells = Watch(programAnalytics.out6)

# group: POINTS ON OUTLINES
index = DoubleSlider(3, range=0..34 step 1)
py_get_program_cell_index = Python(IN[0]=placeProgramsInSite.out0, IN[1]=index)
# ---------- py_get_program_cell_index.python (12 lines) ----------
import clr
clr.AddReference('ProtoGeometry')
from Autodesk.DesignScript.Geometry import *
#The inputs to this node will be stored as a list in the IN variables.
dataEnteringNode = IN

cellListAll = IN[0]
index = IN[1]
	

#Assign your output to the OUT variable.
OUT = cellListAll[int(index)]
# ----------------------------------------
py_get_point2d_lists = Python(IN[0]=gridPointsInsideOutline.out0, IN[1]=py_get_program_cell_index)
# ---------- py_get_point2d_lists.python (16 lines) ----------
import clr
clr.AddReference('ProtoGeometry')
from Autodesk.DesignScript.Geometry import *
#The inputs to this node will be stored as a list in the IN variables.
dataEnteringNode = IN

ptList = IN[0]
indexList = IN[1]

ptFinal=[]
for i in range(len(indexList)):
	ptFinal.append(ptList[indexList[i]])
	

#Assign your output to the OUT variable.
OUT = ptFinal
# ----------------------------------------
pointFromPoint2dList_4 = stuffer.DynamoGeometry.pointFromPoint2dList(py_get_point2d_lists)
fromPointsGetBoundingPoly_3 = SpacePlanning.ReadData.FromPointsGetBoundingPoly(py_get_point2d_lists)
polyCurveFromPoints = stuffer.DynamoGeometry.PolyCurveFromPoints(fromPointsGetBoundingPoly_3)

# group: DEPT DATA STACK
recompute_dept = DoubleSlider(3, range=0..10 step 1)
placeDeptsInSite = SpacePlanning.PlaceSpace.PlaceDeptsInSite(makeDataStack.out3, gridPointsInsideOutline.out1, fromOutlineGetPoints, num, recompute_dept)
deptAnalytics = SpacePlanning.PlaceSpace.DeptAnalytics(placeDeptsInSite.out1, placeDeptsInSite.out3, recompute_dept)
available_cells_and_total_cells_2 = Watch(deptAnalytics.out6)
area_needed_2 = Watch(deptAnalytics.out3)
quantity_2 = Watch(programAnalytics.out5)
number_of_cells_occupied_2 = Watch(deptAnalytics.out1)
area_satisfied_2 = Watch(deptAnalytics.out2)
area_provided_2 = Watch(deptAnalytics.out4)
dept_name = Watch(deptAnalytics.out0)
programs_in_depts = Watch(deptAnalytics.out5)

# group: PROGRAM OR DEPT POLYGONS/ CONVEX HULLS
makeProgramPolygons = SpacePlanning.PlaceSpace.MakeProgramPolygons(placeProgramsInSite.out0, gridPointsInsideOutline.out0)
makeDeptPolygons = SpacePlanning.PlaceSpace.MakeProgramPolygons(placeDeptsInSite.out0, gridPointsInsideOutline.out0)  # "PlaceSpace.MakeDeptPolygons"
point_lists = CodeBlock(inputPoints=makeDeptPolygons.out1) { inputPoints; }
pointFromPoint2dList_5 = stuffer.DynamoGeometry.pointFromPoint2dList(point_lists)
index_2 = DoubleSlider(2, range=0..34 step 1)
makeProgramConvexHulls = SpacePlanning.PlaceSpace.MakeProgramConvexHulls(placeDeptsInSite.out0, gridPointsInsideOutline.out0)
convex_hulls = CodeBlock(a=makeProgramConvexHulls, b=index_2) { a[b]; }
makeProgramPolygons_2 = SpacePlanning.PlaceSpace.MakeProgramPolygons(placeDeptsInSite.out0, gridPointsInsideOutline.out0)
convex_hulls_2 = CodeBlock(a=makeProgramPolygons_2, b=index_2) { a[b]; }

# group: PROGRAM OR DEPT CELL GRID POINTS
colorVals = DoubleSlider(151, range=0..255 step 1)
colorVals_2 = DoubleSlider(109, range=0..255 step 1)
colorVals_3 = DoubleSlider(34, range=0..255 step 1)
colorVals_4 = DoubleSlider(118, range=0..255 step 1)
index_3 = DoubleSlider(1, range=0..5 step 1)
rvalues = stuffer.DynamoGeometry.Rvalues(point_lists, index_3)
rvalues_2 = stuffer.DynamoGeometry.Rvalues(point_lists, index_3)
rvalues_3 = stuffer.DynamoGeometry.Rvalues(point_lists, index_3)
byARGB = Color.ByARGB(r=rvalues, g=rvalues_2, b=rvalues_3)
byGeometryColor = Display.Display.ByGeometryColor(pointFromPoint2dList_5, byARGB)

# group (continued): PROGRAM OR DEPT POLYGONS/ CONVEX HULLS
program = CodeBlock(a=byGeometryColor, b=index_2) { a[b]; }

# group: GRID CELLS ON SITE
pointFromPoint2dList_6 = stuffer.DynamoGeometry.pointFromPoint2dList(gridPointsInsideOutline.out0)
makeCellsFromGridPoints = SpacePlanning.GridObject.MakeCellsFromGridPoints(pointFromPoint2dList_6, dimX, dimY)
opacity = DoubleSlider(10.7, range=0..255 step 0.1)
val = DoubleSlider(164.6, range=0..255 step 0.1)
val_2 = DoubleSlider(183.1, range=0..255 step 0.1)
val_3 = DoubleSlider(165.4, range=0..255 step 0.1)
byARGB_2 = Color.ByARGB(a=opacity, r=val, g=val_2, b=val_3)
byGeometryColor_2 = Display.Display.ByGeometryColor(makeCellsFromGridPoints, byARGB_2)

makeProgramConvexHulls_2 = SpacePlanning.PlaceSpace.MakeProgramConvexHulls(placeProgramsInSite.out0, gridPointsInsideOutline.out0)
center = Polygon.Center(makeProgramConvexHulls_2)
code_block = CodeBlock { {00,00,00,400}; {0,1,2,3,4}; {-133,-1001.7823648723678,-25.00,-5.78234,-65}; {133,1100,25,75,65}; }
number_slider = DoubleSlider(59.8, range=0..100 step 0.1)
testQuickSort = SpacePlanning.GridObject.TestQuickSort(code_block.out2, code_block.out1, number_slider)
code_block_2 = CodeBlock(cells=placeProgramsInSite.out3) { cells; }
number_slider_2 = DoubleSlider(54.4, range=0..100 step 0.1)
code_block_3 = CodeBlock { {1,1,1,7,7,7,7,7,7,7,8,9}; 7; }
code_block_4 = CodeBlock { {1,1,1,4,5,6,7}; 1; }

# group: CELL NEIGHBOR MATRIX
cells_all = CodeBlock(cells=gridPointsInsideOutline.out1) { cells; }
number_slider_3 = DoubleSlider(3, range=0..100 step 0.1)
formsCellNeighborMatrix = SpacePlanning.GridObject.FormsCellNeighborMatrix(cells_all, number_slider_3)
some_cells = CodeBlock(cells=placeProgramsInSite.out3) { cells[85..90]; }
cells_each_dept = CodeBlock(DeptCells=placeDeptsInSite.out2) { DeptCells[0]; }
cell_each_program = CodeBlock(cellsForEachPrograms=placeProgramsInSite.out2) { cellsForEachPrograms[1]; }
code_block_5 = CodeBlock { null; 0; }
makeCellsFromCellObjects = SpacePlanning.GridObject.MakeCellsFromCellObjects(cell_each_program, code_block_5.out1)
code_block_6 = CodeBlock { 1; }
makeCellsFromCellObjects_2 = SpacePlanning.GridObject.MakeCellsFromCellObjects(cells_all, code_block_6)
makeCellsFromCellObjects_3 = SpacePlanning.GridObject.MakeCellsFromCellObjects(cells_all, formsCellNeighborMatrix.out0)
code_block_7 = CodeBlock(a=makeCellsFromCellObjects_3, b=code_block_6) { a[b]; }
number_slider_4 = DoubleSlider(3, range=0..100 step 0.1)
formsCellNeighborMatrix_2 = SpacePlanning.GridObject.FormsCellNeighborMatrix(cell_each_program, number_slider_4)
makeCellsFromCellObjects_4 = SpacePlanning.GridObject.MakeCellsFromCellObjects(cell_each_program, formsCellNeighborMatrix_2)
code_block_8 = CodeBlock(a=makeCellsFromCellObjects_4, b=code_block_5.out1) { a[b]; }
watch = Watch(formsCellNeighborMatrix.out0)

code_block_9 = CodeBlock(a=formsCellNeighborMatrix.out1) { a; }
code_block_10 = CodeBlock(pointsInside=gridPointsInsideOutline.out0) { pointsInside; }

# group: CELL NUMBER TEXTS
pointFromPoint2dList_7 = stuffer.DynamoGeometry.pointFromPoint2dList(code_block_10)
python_script = Python(IN[0]=pointFromPoint2dList_7)
# ---------- python_script.python (13 lines) ----------
import clr
clr.AddReference('ProtoGeometry')
from Autodesk.DesignScript.Geometry import *
#The inputs to this node will be stored as a list in the IN variables.
dataEnteringNode = IN

ptList = IN[0]
txt=[]
for i in range(len(ptList)):
	txt.append(i.ToString())

#Assign your output to the OUT variable.
OUT = txt
# ----------------------------------------
code_block_11 = CodeBlock { scale = 10; SCALE2 = 4; }
fromStringOriginAndScale = DynamoText.Text.FromStringOriginAndScale(python_script, pointFromPoint2dList_7, code_block_11.SCALE2)

code_block_12 = CodeBlock(a=code_block_10) { a[0]; a[5]; a[6]; }
pointFromPoint2dList_8 = stuffer.DynamoGeometry.pointFromPoint2dList(code_block_12.out0)
pointFromPoint2dList_9 = stuffer.DynamoGeometry.pointFromPoint2dList(code_block_12.out1)
byTwoPoints = Vector.ByTwoPoints(start=pointFromPoint2dList_8, end=pointFromPoint2dList_9)
pointFromPoint2dList_10 = stuffer.DynamoGeometry.pointFromPoint2dList(code_block_12.out2)
byTwoPoints_2 = Vector.ByTwoPoints(start=pointFromPoint2dList_8, end=pointFromPoint2dList_10)
testBinarySearch = SpacePlanning.GridObject.TestBinarySearch()
pointFromPoint2dList_11 = stuffer.DynamoGeometry.pointFromPoint2dList(fromOutlineGetPoints)
code_block_13 = CodeBlock(a=pointFromPoint2dList_11) { a[-2]; }
code_block_14 = CodeBlock(a=pointFromPoint2dList_11) { a[-1]; }
byTwoPoints_3 = Vector.ByTwoPoints(start=code_block_13, end=code_block_14)
normalized = Vector.Normalized(byTwoPoints_3)
number_slider_5 = DoubleSlider(289, range=0..3000 step 0.1)
byStartPointDirectionLength = Line.ByStartPointDirectionLength(startPoint=code_block_13, direction=normalized, length=number_slider_5)
makeCellsFromCellObjects_5 = SpacePlanning.GridObject.MakeCellsFromCellObjects()
code_block_15 = CodeBlock(outlinePts=fromOutlineGetPoints) { Polygon2d.ByPoints(outlinePts); outlinePts; }
ratio = DoubleSlider(0.35, range=0..1 step 0.05)
extents = DoubleSlider(2019.9, range=0..5000 step 0.1)
dir = DoubleSlider(1, range=0..1 step 1)
splitPolyIntoTwo = stuffer.Polygon2d.SplitPolyIntoTwo(code_block_15.outlinePts, ratio, extents, dir)
code_block_16 = CodeBlock(a=splitPolyIntoTwo.out0) { a[0].Points; }
pointByPoint2d = stuffer.DynamoGeometry.PointByPoint2d(code_block_16, dir)
code_block_17 = CodeBlock(a=pointByPoint2d) { Polygon.ByPoints(a); }
code_block_18 = CodeBlock(a=splitPolyIntoTwo.out0) { a[1].Points; }
pointByPoint2d_2 = stuffer.DynamoGeometry.PointByPoint2d(code_block_18, dir)
code_block_19 = CodeBlock(a=pointByPoint2d_2) { Polygon.ByPoints(a); }
code_block_20 = CodeBlock(a=splitPolyIntoTwo.out1) { a.StartPoint; a.EndPoint; }
pointByPoint2d_3 = stuffer.DynamoGeometry.PointByPoint2d(code_block_20.out0, dir)
pointByPoint2d_4 = stuffer.DynamoGeometry.PointByPoint2d(code_block_20.out1, dir)
code_block_21 = CodeBlock(a=pointByPoint2d_3, b=pointByPoint2d_4) { Line.ByStartPointEndPoint(a,b); }
code_block_22 = CodeBlock(a=splitPolyIntoTwo.out2) { a[0]; a[1]; }
pointByPoint2d_5 = stuffer.DynamoGeometry.PointByPoint2d(code_block_22.out0, dir)
pointByPoint2d_6 = stuffer.DynamoGeometry.PointByPoint2d(code_block_22.out1, dir)
sortPointsTests = stuffer.Polygon2d.SortPointsTests(code_block_18)
pointByPoint2d_7 = stuffer.DynamoGeometry.PointByPoint2d(sortPointsTests.out1, dir)
code_block_23 = CodeBlock(a=pointByPoint2d_7) { a[2]; }
pointByPoint2d_8 = stuffer.DynamoGeometry.PointByPoint2d(sortPointsTests.out2, dir)
splitPolyIntoTwo_2 = stuffer.Polygon2d.SplitPolyIntoTwo(arg1=ratio, arg2=extents, arg3=dir)
code_block_24 = CodeBlock(a=splitPolyIntoTwo_2.out1) { a.StartPoint; a.EndPoint; }
pointByPoint2d_9 = stuffer.DynamoGeometry.PointByPoint2d(code_block_24.out0, dir)
pointByPoint2d_10 = stuffer.DynamoGeometry.PointByPoint2d(code_block_24.out1, dir)
code_block_25 = CodeBlock(a=pointByPoint2d_9, b=pointByPoint2d_10) { Line.ByStartPointEndPoint(a,b); }
code_block_26 = CodeBlock(a=splitPolyIntoTwo_2.out0) { a[0].Points; }
pointByPoint2d_11 = stuffer.DynamoGeometry.PointByPoint2d(code_block_26, dir)
code_block_27 = CodeBlock(a=pointByPoint2d_11) { Polygon.ByPoints(a); }
