# Dynamo graph 23 FEB_Compressed_1.dyn (Dynamo 0.9.0.3072)

# group: USER INPUTS
building_outline_file_path = StringInput("D:\SUBHAJIT WORKS\01 DUKE BED TOWER AUTOMATION\08 EXCEL\OUTLINE.SAT")  # "Building Outline File Path String"
iteration = DoubleSlider(100, range=0..1000 step 1)
include_quantity_of_program = BoolSelector(false)
scale = DoubleSlider(200, range=0..200 step 0.1)
building_outline_file_path_2 = StringInput("D:\SUBHAJIT WORKS\01 DUKE BED TOWER AUTOMATION\08 EXCEL\OUTLINEDK.SAT")  # "Building Outline File Path String"
building_outline_file_path_3 = StringInput("D:\SUBHAJIT WORKS\01 DUKE BED TOWER AUTOMATION\08 EXCEL\OUTLINEDKtest.SAT")  # "Building Outline File Path String"
building_outline_file_path_4 = StringInput("D:\SUBHAJIT WORKS\01 DUKE BED TOWER AUTOMATION\08 EXCEL\OUTLINESCALEDDK.SAT")  # "Building Outline File Path String"
program_data_info_csv_file_path = StringInput("D:\SUBHAJIT WORKS\01 DUKE BED TOWER AUTOMATION\08 EXCEL\01 FEB PROGRAM.csv")  # "Program Data Info CSV File Path String"
dimX = DoubleSlider(50, range=0..200 step 0.1)
dimY = DoubleSlider(50, range=0..200 step 0.1)

# group: MAKE DATA STACK
readBuildingOutline = SpacePlanning.ReadData.ReadBuildingOutline(building_outline_file_path_4)
fromOutlineGetPoints = SpacePlanning.ReadData.FromOutlineGetPoints(readBuildingOutline)
fromPointsGetBoundingPoly = SpacePlanning.ReadData.FromPointsGetBoundingPoly(fromOutlineGetPoints)
factor = DoubleSlider(5, range=0..40 step 0.5)
makeDataStack = SpacePlanning.ReadData.MakeDataStack(program_data_info_csv_file_path, dimX, dimY, factor)
programObjectCheck = SpacePlanning.ReadData.ProgramObjectCheck()
deptObjectCheck = SpacePlanning.ReadData.DeptObjectCheck()
pointFromPoint2dList = stuffer.DynamoGeometry.pointFromPoint2dList(fromOutlineGetPoints)
num = DoubleSlider(34, range=0..34 step 1)

# group: CELL OBJECTS FROM POINTS
fromPointsGetBoundingPoly_2 = SpacePlanning.ReadData.FromPointsGetBoundingPoly(fromOutlineGetPoints)
gridPointsInsideOutline = SpacePlanning.GridObject.GridPointsInsideOutline(fromPointsGetBoundingPoly_2, fromOutlineGetPoints, dimX, dimY)
convexHullFromPoint2D = SpacePlanning.GridObject.ConvexHullFromPoint2D(gridPointsInsideOutline)
pointFromPoint2dList_2 = stuffer.DynamoGeometry.pointFromPoint2dList(convexHullFromPoint2D)
byPoints = Polygon.ByPoints(pointFromPoint2dList_2)

# group: GRID CELLS ON SITE
pointFromPoint2dList_3 = stuffer.DynamoGeometry.pointFromPoint2dList(gridPointsInsideOutline)
makeCellsFromGridPoints = SpacePlanning.GridObject.MakeCellsFromGridPoints(pointFromPoint2dList_3, dimX, dimY)
opacity = DoubleSlider(10.7, range=0..255 step 0.1)
val = DoubleSlider(164.6, range=0..255 step 0.1)
val_2 = DoubleSlider(183.1, range=0..255 step 0.1)
val_3 = DoubleSlider(165.4, range=0..255 step 0.1)
byARGB = Color.ByARGB(a=opacity, r=val, g=val_2, b=val_3)
byGeometryColor = Display.Display.ByGeometryColor(makeCellsFromGridPoints, byARGB)

code_block = CodeBlock(pointsInside=gridPointsInsideOutline) { pointsInside; }

# group: CELL NUMBER TEXTS
pointFromPoint2dList_4 = stuffer.DynamoGeometry.pointFromPoint2dList(code_block)
python_script = Python(IN[0]=pointFromPoint2dList_4)
# ---------- python_script.python (13 lines) ----------
import clr
clr.AddReference('ProtoGeometry')
from Autodesk.DesignScript.Geometry import *
#The inputs to this node will be stored as a list in the IN variables.
dataEnteringNode = IN

ptList = IN[0]
txt=[]
for i in range(len(ptList)):
	txt.append(i.ToString())

#Assign your output to the OUT variable.
OUT = txt
# ----------------------------------------
code_block_2 = CodeBlock { scale = 10; SCALE2 = 4; }
fromStringOriginAndScale = DynamoText.Text.FromStringOriginAndScale(python_script, pointFromPoint2dList_4, code_block_2.scale)

code_block_3 = CodeBlock(outlinePts=fromOutlineGetPoints) { Polygon2d.ByPoints(outlinePts); outlinePts; }
ratio = DoubleSlider(0.45, range=0..1 step 0.05)
extents = DoubleSlider(200, range=0..5000 step 0.1)
dir = DoubleSlider(0, range=0..1 step 1)
splitPolyIntoTwo = stuffer.Polygon2d.SplitPolyIntoTwo(code_block_3.outlinePts, ratio, extents, dir)
code_block_4 = CodeBlock(a=splitPolyIntoTwo.out0) { a[0].Points; }
pointByPoint2d = stuffer.DynamoGeometry.PointByPoint2d(code_block_4, dir)
code_block_5 = CodeBlock(a=pointByPoint2d) { Polygon.ByPoints(a); }
code_block_6 = CodeBlock(a=splitPolyIntoTwo.out0) { a[1].Points; }
pointByPoint2d_2 = stuffer.DynamoGeometry.PointByPoint2d(code_block_6, dir)
code_block_7 = CodeBlock(a=pointByPoint2d_2) { Polygon.ByPoints(a); }
code_block_8 = CodeBlock(a=splitPolyIntoTwo.out1) { a.StartPoint; a.EndPoint; }
pointByPoint2d_3 = stuffer.DynamoGeometry.PointByPoint2d(code_block_8.out0, dir)
pointByPoint2d_4 = stuffer.DynamoGeometry.PointByPoint2d(code_block_8.out1, dir)
code_block_9 = CodeBlock(a=pointByPoint2d_3, b=pointByPoint2d_4) { Line.ByStartPointEndPoint(a,b); }
code_block_10 = CodeBlock(a=splitPolyIntoTwo.out2) { a[0]; a[1]; }
pointByPoint2d_5 = stuffer.DynamoGeometry.PointByPoint2d(code_block_10.out0, dir)
pointByPoint2d_6 = stuffer.DynamoGeometry.PointByPoint2d(code_block_10.out1, dir)
sortPointsTests = stuffer.Polygon2d.SortPointsTests(code_block_6)
pointByPoint2d_7 = stuffer.DynamoGeometry.PointByPoint2d(sortPointsTests.out1, dir)
code_block_11 = CodeBlock(a=pointByPoint2d_7) { a[2]; }
pointByPoint2d_8 = stuffer.DynamoGeometry.PointByPoint2d(sortPointsTests.out2, dir)
splitPolyIntoTwo_2 = stuffer.Polygon2d.SplitPolyIntoTwo(arg1=ratio, arg2=extents, arg3=dir)
code_block_12 = CodeBlock(a=splitPolyIntoTwo_2.out1) { a.StartPoint; a.EndPoint; }
pointByPoint2d_9 = stuffer.DynamoGeometry.PointByPoint2d(code_block_12.out0, dir)
pointByPoint2d_10 = stuffer.DynamoGeometry.PointByPoint2d(code_block_12.out1, dir)
code_block_13 = CodeBlock(a=pointByPoint2d_9, b=pointByPoint2d_10) { Line.ByStartPointEndPoint(a,b); }
code_block_14 = CodeBlock(a=splitPolyIntoTwo_2.out0) { a[0].Points; }
pointByPoint2d_11 = stuffer.DynamoGeometry.PointByPoint2d(code_block_14, dir)
code_block_15 = CodeBlock(a=pointByPoint2d_11) { Polygon.ByPoints(a); }
tag = DoubleSlider(0.35, range=0..1 step 0.05)
size = DoubleSlider(20, range=0..20 step 1)
pointGenerator = stuffer.Polygon2d.PointGenerator(tag, size)
pointListByPoint2d = stuffer.DynamoGeometry.PointListByPoint2d(pointGenerator)
python_script_2 = Python(IN[0]=pointListByPoint2d)  # same code as python_script
sortPointsTests_2 = stuffer.Polygon2d.SortPointsTests(pointGenerator)
pointListByPoint2d_2 = stuffer.DynamoGeometry.PointListByPoint2d(sortPointsTests_2.out1)
code_block_16 = CodeBlock { scale = 100; SCALE2 = 4; }
fromStringOriginAndScale_2 = DynamoText.Text.FromStringOriginAndScale(python_script_2, pointListByPoint2d_2, code_block_16.scale)
pointListByPoint2d_3 = stuffer.DynamoGeometry.PointListByPoint2d(sortPointsTests_2.out2)
