# Dynamo graph 25 FEB_SPLIT WITH DEPTDATA_2.dyn (Dynamo 0.9.0.3072)

# group: USER INPUTS
building_outline_file_path = StringInput("D:\SUBHAJIT WORKS\01 DUKE BED TOWER AUTOMATION\08 EXCEL\OUTLINE.SAT")  # "Building Outline File Path String"
iteration = DoubleSlider(100, range=0..1000 step 1)
include_quantity_of_program = BoolSelector(false)
scale = DoubleSlider(200, range=0..200 step 0.1)
building_outline_file_path_2 = StringInput("D:\SUBHAJIT WORKS\01 DUKE BED TOWER AUTOMATION\08 EXCEL\OUTLINEDK.SAT")  # "Building Outline File Path String"
building_outline_file_path_3 = StringInput("D:\SUBHAJIT WORKS\01 DUKE BED TOWER AUTOMATION\08 EXCEL\OUTLINEDKtest.SAT")  # "Building Outline File Path String"
building_outline_file_path_4 = StringInput("D:\SUBHAJIT WORKS\01 DUKE BED TOWER AUTOMATION\08 EXCEL\OUTLINESCALEDDK.SAT")  # "Building Outline File Path String"
dimX = DoubleSlider(20, range=0..200 step 0.1)
dimY = DoubleSlider(20, range=0..200 step 0.1)
program_data_info_csv_file_path = StringInput("D:\SUBHAJIT WORKS\01 DUKE BED TOWER AUTOMATION\08 EXCEL\01 FEB PROGRAM.csv")  # "Program Data Info CSV File Path String"

# group: MAKE DATA STACK
readBuildingOutline = SpacePlanning.ReadData.ReadBuildingOutline(building_outline_file_path_4)
fromOutlineGetPoints = SpacePlanning.ReadData.FromOutlineGetPoints(readBuildingOutline)
fromPointsGetBoundingPoly = SpacePlanning.ReadData.FromPointsGetBoundingPoly(fromOutlineGetPoints)
programObjectCheck = SpacePlanning.ReadData.ProgramObjectCheck()
deptObjectCheck = SpacePlanning.ReadData.DeptObjectCheck()
pointFromPoint2dList = stuffer.DynamoGeometry.pointFromPoint2dList(fromOutlineGetPoints)
num = DoubleSlider(34, range=0..34 step 1)
factor = DoubleSlider(5, range=0..40 step 0.5)
makeDataStack = SpacePlanning.ReadData.MakeDataStack(program_data_info_csv_file_path, dimX, dimY, factor)

# group: CELL OBJECTS FROM POINTS
fromPointsGetBoundingPoly_2 = SpacePlanning.ReadData.FromPointsGetBoundingPoly(fromOutlineGetPoints)
gridPointsInsideOutline = SpacePlanning.GridObject.GridPointsInsideOutline(fromPointsGetBoundingPoly_2, fromOutlineGetPoints, dimX, dimY)
convexHullFromPoint2D = SpacePlanning.GridObject.ConvexHullFromPoint2D(gridPointsInsideOutline)
pointFromPoint2dList_2 = stuffer.DynamoGeometry.pointFromPoint2dList(convexHullFromPoint2D)
byPoints = Polygon.ByPoints(pointFromPoint2dList_2)

# group: GRID CELLS ON SITE
pointFromPoint2dList_3 = stuffer.DynamoGeometry.pointFromPoint2dList(gridPointsInsideOutline)
makeCellsFromGridPoints = SpacePlanning.GridObject.MakeCellsFromGridPoints(pointFromPoint2dList_3, dimX, dimY)
opacity = DoubleSlider(10.7, range=0..255 step 0.1)
val = DoubleSlider(164.6, range=0..255 step 0.1)
val_2 = DoubleSlider(183.1, range=0..255 step 0.1)
val_3 = DoubleSlider(165.4, range=0..255 step 0.1)
byARGB = Color.ByARGB(a=opacity, r=val, g=val_2, b=val_3)
byGeometryColor = Display.Display.ByGeometryColor(makeCellsFromGridPoints, byARGB)

code_block = CodeBlock(pointsInside=gridPointsInsideOutline) { pointsInside; }

# group: CELL NUMBER TEXTS
pointFromPoint2dList_4 = stuffer.DynamoGeometry.pointFromPoint2dList(code_block)
python_script = Python(IN[0]=pointFromPoint2dList_4)
# ---------- python_script.python (13 lines) ----------
import clr
clr.AddReference('ProtoGeometry')
from Autodesk.DesignScript.Geometry import *
#The inputs to this node will be stored as a list in the IN variables.
dataEnteringNode = IN

ptList = IN[0]
txt=[]
for i in range(len(ptList)):
	txt.append(i.ToString())

#Assign your output to the OUT variable.
OUT = txt
# ----------------------------------------
code_block_2 = CodeBlock { scale = 10; SCALE2 = 4; }
fromStringOriginAndScale = DynamoText.Text.FromStringOriginAndScale(python_script, pointFromPoint2dList_4, code_block_2.scale)

code_block_3 = CodeBlock(outlinePts=fromOutlineGetPoints) { Polygon2d.ByPoints(outlinePts); outlinePts; }
ratio = DoubleSlider(0.35, range=0..1.2 step 0.05)
dir = DoubleSlider(0, range=0..1 step 1)
splitPolyIntoTwoCheckNew = stuffer.Polygon2d.SplitPolyIntoTwoCheckNew(code_block_3.out0, ratio, dir)
code_block_4 = CodeBlock(a=splitPolyIntoTwoCheckNew.out0) { a[0].Points; }
height = DoubleSlider(0, range=0..50 step 1)
pointByPoint2d = stuffer.DynamoGeometry.PointByPoint2d(code_block_4, height)
code_block_5 = CodeBlock(a=pointByPoint2d) { Polygon.ByPoints(a); }
code_block_6 = CodeBlock(a=splitPolyIntoTwoCheckNew.out0) { a[1].Points; }
pointByPoint2d_2 = stuffer.DynamoGeometry.PointByPoint2d(code_block_6, height)
code_block_7 = CodeBlock(a=pointByPoint2d_2) { Polygon.ByPoints(a); }
tag = DoubleSlider(0.35, range=0..1 step 0.05)
size = DoubleSlider(20, range=0..20 step 1)
pointGenerator = stuffer.Polygon2d.PointGenerator(tag, size)
pointListByPoint2d = stuffer.DynamoGeometry.PointListByPoint2d(pointGenerator)
python_script_2 = Python(IN[0]=pointListByPoint2d)  # same code as python_script
code_block_8 = CodeBlock { scale = 50; SCALE2 = 4; }
fromStringOriginAndScale_2 = DynamoText.Text.FromStringOriginAndScale(python_script_2, pointListByPoint2d, code_block_8.scale)
code_block_9 = CodeBlock { a[0].Points; }
code_block_10 = CodeBlock { a[1].Points; }
ratio_2 = DoubleSlider(0.55, range=0..1 step 0.05)
dir_2 = DoubleSlider(0, range=0..1 step 1)

# group: REGULAR SHAPES
code_block_11 = CodeBlock { a=-1000; x=-800; b=-500; y=-800; }
code_block_12 = CodeBlock(a=code_block_11.a, b=code_block_11.b, y=code_block_11.y, x=code_block_11.x) { Point.ByCoordinates(a,b+y); Point.ByCoordinates(a+x,b); Point.ByCoordinates(a+x,b+y); Point.ByCoordinates(a,b); }
create = List.Create(code_block_12.out0, code_block_12.out2, code_block_12.out1, code_block_12.out3)
splitPolyIntoTwoCheckNew_2 = stuffer.Polygon2d.SplitPolyIntoTwoCheckNew(arg1=ratio_2, arg2=dir_2)
recompute = DoubleSlider(1, range=0..100 step 0.1)
code_block_13 = CodeBlock { 500; }
byCenterPointRadius = Circle.ByCenterPointRadius(centerPoint=code_block_12.out0, radius=code_block_13)
regularPolygon = Polygon.RegularPolygon(circle=byCenterPointRadius)
byPolygon = stuffer.Polygon2d.ByPolygon(regularPolygon)
recursiveSplitPoly = stuffer.Polygon2d.RecursiveSplitPoly(arg1=ratio_2, arg2=recompute)
code_block_14 = CodeBlock(A=code_block_11.a, B=code_block_11.x) { A*B; }
splitPolyIntoTwoCheckNew_3 = stuffer.Polygon2d.SplitPolyIntoTwoCheckNew(arg1=ratio_2, arg2=dir_2)
byWidthLength = Rectangle.ByWidthLength(width=code_block_11.a, length=code_block_11.x)
number_slider = DoubleSlider(1, range=0..100 step 0.1)

code_block_15 = CodeBlock(a=splitPolyIntoTwoCheckNew.out1) { a.StartPoint; a.EndPoint; }
pointByPoint2d_3 = stuffer.DynamoGeometry.PointByPoint2d(code_block_15.out0, recompute)
pointByPoint2d_4 = stuffer.DynamoGeometry.PointByPoint2d(code_block_15.out1, recompute)
code_block_16 = CodeBlock(a=pointByPoint2d_3, b=pointByPoint2d_4) { Line.ByStartPointEndPoint(a,b); }
pointByPoint2d_5 = stuffer.DynamoGeometry.PointByPoint2d(splitPolyIntoTwoCheckNew.out4, height)
byPoints_2 = stuffer.Polygon2d.ByPoints(code_block_3.outlinePts)
ratio_3 = DoubleSlider(0.6, range=0..1 step 0.05)
recompute_2 = DoubleSlider(4, range=0..5 step 1)
recursiveSplitPoly_2 = stuffer.Polygon2d.RecursiveSplitPoly(byPoints_2, ratio_3, recompute_2)
watch = Watch(recursiveSplitPoly_2)
watch_2 = Watch(splitPolyIntoTwoCheckNew.out6)
watch_3 = Watch(splitPolyIntoTwoCheckNew_3.out6)
polygonByPolygon2d = stuffer.DynamoGeometry.PolygonByPolygon2d(splitPolyIntoTwoCheckNew_3.out0, height)
watch_4 = Watch(splitPolyIntoTwoCheckNew.out6)
byPoints_3 = stuffer.Polygon2d.ByPoints(splitPolyIntoTwoCheckNew.out5)
polygonByPolygon2d_2 = stuffer.DynamoGeometry.PolygonByPolygon2d(byPoints_3, height)
code_block_17 = CodeBlock(a=splitPolyIntoTwoCheckNew_3.out1) { a.StartPoint; a.EndPoint; }
pointByPoint2d_6 = stuffer.DynamoGeometry.PointByPoint2d(code_block_17.out0, recompute)
pointByPoint2d_7 = stuffer.DynamoGeometry.PointByPoint2d(code_block_17.out1, recompute)
code_block_18 = CodeBlock(a=pointByPoint2d_6, b=pointByPoint2d_7) { Line.ByStartPointEndPoint(a,b); }
byPolygon_2 = stuffer.Polygon2d.ByPolygon(byWidthLength)
pointByPoint2d_8 = stuffer.DynamoGeometry.PointByPoint2d(splitPolyIntoTwoCheckNew_3.out4, recompute)
ratio_4 = DoubleSlider(0.5, range=0..1 step 0.05)
recompute_3 = DoubleSlider(17, range=0..100 step 1)
recursiveSplitPoly_3 = stuffer.Polygon2d.RecursiveSplitPoly(arg1=ratio_4, arg2=recompute_3)
polygonByPolygon2d_3 = stuffer.DynamoGeometry.PolygonByPolygon2d(recursiveSplitPoly_3, height)
byPoints_4 = stuffer.Polygon2d.ByPoints(splitPolyIntoTwoCheckNew_3.out5)
code_block_19 = CodeBlock(a=splitPolyIntoTwoCheckNew_3.out7) { a[1]; }
pointByPoint2d_9 = stuffer.DynamoGeometry.PointByPoint2d(code_block_19, recompute)
pointByPoint2d_10 = stuffer.DynamoGeometry.PointByPoint2d(splitPolyIntoTwoCheckNew_3.out2, recompute)
splitPolyIntoTwoCheckNew_4 = stuffer.Polygon2d.SplitPolyIntoTwoCheckNew(arg1=ratio_2, arg2=dir_2)
code_block_20 = CodeBlock(a=splitPolyIntoTwoCheckNew_4) { a[0]; }
polygonByPolygon2d_4 = stuffer.DynamoGeometry.PolygonByPolygon2d(code_block_20, height)
byPolygon_3 = stuffer.Polygon2d.ByPolygon(byWidthLength)
recompute_4 = DoubleSlider(4, range=0..156 step 1)
smoothCheckerForPoly = stuffer.Polygon2d.SmoothCheckerForPoly(byPolygon_3, recompute_4)
pointByPoint2d_11 = stuffer.DynamoGeometry.PointByPoint2d(smoothCheckerForPoly, recompute)
byPoints_5 = stuffer.Polygon2d.ByPoints(smoothCheckerForPoly)
polygonByPolygon2d_5 = stuffer.DynamoGeometry.PolygonByPolygon2d(byPoints_5, number_slider)
code_block_21 = CodeBlock(a=pointByPoint2d) { a[0]; }
pointByPoint2d_12 = stuffer.DynamoGeometry.PointByPoint2d(splitPolyIntoTwoCheckNew.out2, height)
polygonByPolygon2d_6 = stuffer.DynamoGeometry.PolygonByPolygon2d(recursiveSplitPoly_2, height)
code_block_22 = CodeBlock(a=polygonByPolygon2d_6) { a[4].Points; }
code_block_23 = CodeBlock(a=pointByPoint2d_2) { a[15]; }
byPoints_6 = stuffer.Polygon2d.ByPoints(code_block_3.outlinePts)
dept_data = CodeBlock(deptData=makeDataStack.out3) { deptData; }
recompute_5 = DoubleSlider(4, range=0..5 step 1)
deptSplitMake = stuffer.Polygon2d.DeptSplitMake(byPoints_6, dept_data, recompute_5)
code_block_24 = CodeBlock(a=deptSplitMake.out0) { a[3]; }
polygonByPolygon2d_7 = stuffer.DynamoGeometry.PolygonByPolygon2d(code_block_24, height)
watch_5 = Watch(deptSplitMake.out0)
watch_6 = Watch(deptSplitMake.out2)
watch_7 = Watch(deptSplitMake.out1)
polygonByPolygon2d_8 = stuffer.DynamoGeometry.PolygonByPolygon2d(deptSplitMake.out1, height)
