# Dynamo graph SPACE PLAN GRAPH AUTO.dyn (Dynamo 0.9.2.4461)

# group: Note
# note: If the Dept Recompute value is less than 3, the algorithm will be strictly placing patient rooms ( white surfaces ) on the external walls. Any value above 3, will place some patient rooms away from external wall to maximize count of patient rooms per floor.

cell_height = CodeBlock { a=0; }

# group: Slide to Generate Design
cell_dim = DoubleSlider(5.3, range=3..30 step 0.1)
groundCoverage = DoubleSlider(0.55, range=0.2..0.8 step 0.05)
recompute_dept_arrangement = DoubleSlider(2, range=0..6 step 1)
recompute_prog_arrangement = DoubleSlider(2, range=1..5 step 1)

# group: User Inputs ( for Fractal as well )
circulation_add_on_factor = DoubleSlider(1.8, range=1..3 step 0.2)
patient_bed_depth_ideal_val_32 = DoubleSlider(32, range=25..40 step 0.5)
patient_bed_width_ideal_val_16 = DoubleSlider(15, range=12..25 step 0.5)
acceptable_width_ideal_val_18 = DoubleSlider(11, range=10..25 step 0.5)
circulation_factor = DoubleSlider(7.5, range=4..25 step 0.5)
dept_corridor_width = DoubleSlider(4, range=4..12 step 1)
program_corridor_width = DoubleSlider(3, range=3..6 step 0.5)
allowed_circulation_ratio_l_w = DoubleSlider(5, range=0.5..6 step 0.5)
frequency_of_corridors = DoubleSlider(0.7, range=0.3..1 step 0.1)

# group: Make Data Stack
autoMakeBuildingOutline = SpacePlanning.ReadData.AutoMakeBuildingOutline()
gridcell_dim = CodeBlock { dimX = 3; dimY = 3; }
autoMakeDataStack = SpacePlanning.ReadData.AutoMakeDataStack(gridcell_dim.dimX, gridcell_dim.dimY, circulation_add_on_factor)
height_of_space_plan = CodeBlock { height = 1; }
local_sat_path = StringInput("D:\SUBHAJIT WORKS\01 DUKE BED TOWER AUTOMATION\08 EXCEL\ATORIGINDK.sat")
readBuildingOutline = SpacePlanning.ReadData.ReadBuildingOutline(local_sat_path)

# group: Input Poly Pts
# note: Connect one of the three nodes below with outlinePts Code Block
fromOutlineGetPoints = SpacePlanning.ReadData.FromOutlineGetPoints(autoMakeBuildingOutline)

# group (continued): Make Data Stack
outline_poly = CodeBlock(outlinePts=fromOutlineGetPoints) { Polygon2d.ByPoints(outlinePts); outlinePts; }

# group: Cells From Outline
fromPointsGetBoundingPoly = SpacePlanning.ReadData.FromPointsGetBoundingPoly(outline_poly.outlinePts)
gridPointsInsideOutline = SpacePlanning.GridObject.GridPointsInsideOutline(fromPointsGetBoundingPoly, outline_poly.outlinePts, gridcell_dim.dimX, gridcell_dim.dimY)

# group: Cell Polys
pointFromPoint2dList = stuffer.DynamoGeometry.pointFromPoint2dList(gridPointsInsideOutline.out0)
makeCellsFromGridPoints = SpacePlanning.GridObject.MakeCellsFromGridPoints(pointFromPoint2dList, gridcell_dim.dimX, gridcell_dim.dimY)
polygonByPolygon2d = stuffer.DynamoGeometry.PolygonByPolygon2d(makeCellsFromGridPoints, cell_height)
color_argb = CodeBlock { a=11; r=165; g=185; b=165; }
byARGB = Color.ByARGB(a=color_argb.a, r=color_argb.r, g=color_argb.g, b=color_argb.b)
byGeometryColor = Display.Display.ByGeometryColor(polygonByPolygon2d, byARGB)

# group: Form Maker
borderAndCellNeighborMatrix = SpacePlanning.GridObject.BorderAndCellNeighborMatrix(outline_poly.out0, cell_dim)
formMakerInSite = SpacePlanning.GridObject.FormMakerInSite(borderAndCellNeighborMatrix.out0, outline_poly.out0, borderAndCellNeighborMatrix.out3, groundCoverage)
code_block = CodeBlock { ht1 = 1; ht2 = 0; ht3=5; {}; }
polygonByPolygon2d_2 = stuffer.DynamoGeometry.PolygonByPolygon2d(formMakerInSite.out0, code_block.ht1)
polygonByPolygon2d_3 = stuffer.DynamoGeometry.PolygonByPolygon2d(formMakerInSite.out0, code_block.ht2)
byPatch = Surface.ByPatch(polygonByPolygon2d_3)
color_argb_2 = CodeBlock { a=255; r=213; g=233; b=0; }
byARGB_2 = Color.ByARGB(a=color_argb_2.a, r=color_argb_2.r, g=color_argb_2.g, b=color_argb_2.b)
byGeometryColor_2 = Display.Display.ByGeometryColor(byPatch, byARGB_2)
polygonByPolygon2d_4 = stuffer.DynamoGeometry.PolygonByPolygon2d(borderAndCellNeighborMatrix.out0, code_block.ht1)
polygonByPolygon2d_5 = stuffer.DynamoGeometry.PolygonByPolygon2d(formMakerInSite.out1, code_block.ht3)

code_block_2 = CodeBlock(BuildingOutline=formMakerInSite.out0) { BuildingOutline; }
code_block_3 = CodeBlock(deptData=autoMakeDataStack.out2) { deptData; }

# group: Dept & Program Generator
deptArrangeOnSite = SpacePlanning.BuildLayout.DeptArrangeOnSite(code_block_2, code_block_3, gridPointsInsideOutline.out1, patient_bed_depth_ideal_val_32, recompute_dept_arrangement)
department_poly = CodeBlock(dept=deptArrangeOnSite.out0) { dept[0]; dept[1]; dept[2]; dept[3]; }
programs_in_each_dept = CodeBlock(deptArrangeOnSite.out3) { Dept.ProgramsInDept; }
programData = CodeBlock(program=programs_in_each_dept) { program[0]; program[1]; program[2]; program[3]; }
polygonByPolygon2d_6 = stuffer.DynamoGeometry.PolygonByPolygon2d(department_poly.out0, height_of_space_plan)
outline_poly_2 = CodeBlock(outlinePts=fromOutlineGetPoints) { Polygon2d.ByPoints(outlinePts); b = 2; }
polygonByPolygon2d_7 = stuffer.DynamoGeometry.PolygonByPolygon2d(department_poly.out1, outline_poly_2.b)
polygonByPolygon2d_8 = stuffer.DynamoGeometry.PolygonByPolygon2d(department_poly.out2, height_of_space_plan)
polygonByPolygon2d_9 = stuffer.DynamoGeometry.PolygonByPolygon2d(department_poly.out3, height_of_space_plan)
dynamogeometry = stuffer.DynamoGeometry.PolygonByPolygon2d(deptArrangeOnSite.out1, height_of_space_plan)  # "DynamoGeometry.PolygonByPolygon2d - Left Over Space"

# group: Inpatient Program Spaces
recursiveSplitProgramsOneDirByDistance = SpacePlanning.BuildLayout.RecursiveSplitProgramsOneDirByDistance(department_poly.out0, programData.out0, patient_bed_width_ideal_val_16, recompute_prog_arrangement)
polygonByPolygon2d_10 = stuffer.DynamoGeometry.PolygonByPolygon2d(recursiveSplitProgramsOneDirByDistance.out0, height_of_space_plan)
color_argb_3 = CodeBlock { a=255; r=213; g=0; b=0; }
byARGB_3 = Color.ByARGB(a=color_argb_3.a, r=color_argb_3.r, g=color_argb_3.g, b=color_argb_3.b)
byGeometryColor_3 = Display.Display.ByGeometryColor(polygonByPolygon2d_10, byARGB_3)

# group: Clinic Support Program Spaces
recursivePlaceProgramsSeries = SpacePlanning.BuildLayout.RecursivePlaceProgramsSeries(department_poly.out1, programData.out1, acceptable_width_ideal_val_18, circulation_factor, recompute_prog_arrangement)
polygonByPolygon2d_11 = stuffer.DynamoGeometry.PolygonByPolygon2d(recursivePlaceProgramsSeries.out0, height_of_space_plan)
color_argb_4 = CodeBlock { a=255; r=220; g=85; b=182; }
byARGB_4 = Color.ByARGB(a=color_argb_4.a, r=color_argb_4.r, g=color_argb_4.g, b=color_argb_4.b)
byGeometryColor_4 = Display.Display.ByGeometryColor(polygonByPolygon2d_11, byARGB_4)

# group: Shared Staff Support Program Spaces
recursivePlaceProgramsSeries_2 = SpacePlanning.BuildLayout.RecursivePlaceProgramsSeries(department_poly.out2, programData.out2, acceptable_width_ideal_val_18, circulation_factor, recompute_prog_arrangement)
polygonByPolygon2d_12 = stuffer.DynamoGeometry.PolygonByPolygon2d(recursivePlaceProgramsSeries_2.out0, height_of_space_plan)
color_argb_5 = CodeBlock { a=109; r=0; g=20; b=255; }
byARGB_5 = Color.ByARGB(a=color_argb_5.a, r=color_argb_5.r, g=color_argb_5.g, b=color_argb_5.b)
byGeometryColor_5 = Display.Display.ByGeometryColor(polygonByPolygon2d_12, byARGB_5)

# group: Family Public Support Program Spaces
recursivePlaceProgramsSeries_3 = SpacePlanning.BuildLayout.RecursivePlaceProgramsSeries(department_poly.out3, programData.out3, acceptable_width_ideal_val_18, circulation_factor, recompute_prog_arrangement)
polygonByPolygon2d_13 = stuffer.DynamoGeometry.PolygonByPolygon2d(recursivePlaceProgramsSeries_3.out0, height_of_space_plan)
color_argb_6 = CodeBlock { a=109; r=0; g=0; b=72; }
byARGB_6 = Color.ByARGB(a=color_argb_6.a, r=color_argb_6.r, g=color_argb_6.g, b=color_argb_6.b)
byGeometryColor_6 = Display.Display.ByGeometryColor(polygonByPolygon2d_13, byARGB_6)

# group: Dept Analytics
deptAnalytics = SpacePlanning.SpaceAnalysis.DeptAnalytics(deptArrangeOnSite.out3)
department_placed_sorted = Watch(deptAnalytics.out0)
num_cells_taken = Watch(deptAnalytics.out1)
area_satisfied = Watch(deptAnalytics.out2)
area_needed = Watch(deptAnalytics.out3)
areaProvided = Watch(deptAnalytics.out4)
code_block_4 = CodeBlock(prog=deptAnalytics.out5) { prog.ProgramName; }
programs_in_dept = Watch(code_block_4)
poly_assigned_to_depts = Watch(deptAnalytics.out6)

# group: Dept Polys
byARGB_7 = Color.ByARGB(a=color_argb_3.a, r=color_argb_3.r, g=color_argb_3.g, b=color_argb_3.b)
byGeometryColor_7 = Display.Display.ByGeometryColor(polygonByPolygon2d_6, byARGB_7)
byARGB_8 = Color.ByARGB(a=color_argb_4.a, r=color_argb_4.r, g=color_argb_4.g, b=color_argb_4.b)
byGeometryColor_8 = Display.Display.ByGeometryColor(polygonByPolygon2d_7, byARGB_8)
byARGB_9 = Color.ByARGB(a=color_argb_5.a, r=color_argb_5.r, g=color_argb_5.g, b=color_argb_5.b)
byGeometryColor_9 = Display.Display.ByGeometryColor(polygonByPolygon2d_8, byARGB_9)
byARGB_10 = Color.ByARGB(a=color_argb_6.a, r=color_argb_6.r, g=color_argb_6.g, b=color_argb_6.b)
byGeometryColor_10 = Display.Display.ByGeometryColor(polygonByPolygon2d_9, byARGB_10)

# group: Program Analytics
updatedProgramData = CodeBlock(progA=recursiveSplitProgramsOneDirByDistance.out1, progB=recursivePlaceProgramsSeries.out3, progC=recursivePlaceProgramsSeries_2.out3, progD=recursivePlaceProgramsSeries_3.out3) { progA; progB; progC; progD; }
programAnalytics = SpacePlanning.SpaceAnalysis.ProgramAnalytics(updatedProgramData.progA)
programs_in_dept_2 = Watch(programAnalytics.out0)
cells_occupied = Watch(programAnalytics.out1)
is_area_satisfied = Watch(programAnalytics.out2)
area_needed_2 = Watch(programAnalytics.out3)
area_provided = Watch(programAnalytics.out4)
quantity = Watch(programAnalytics.out5)
poly_assigned_to_progs = Watch(programAnalytics.out6)
programAnalytics_2 = SpacePlanning.SpaceAnalysis.ProgramAnalytics(updatedProgramData.progB)
programs_in_dept_3 = Watch(programAnalytics_2.out0)
cells_occupied_2 = Watch(programAnalytics_2.out1)
is_area_satisfied_2 = Watch(programAnalytics_2.out2)
area_needed_3 = Watch(programAnalytics_2.out3)
area_provided_2 = Watch(programAnalytics_2.out4)
quantity_2 = Watch(programAnalytics_2.out5)
poly_assigned_to_progs_2 = Watch(programAnalytics_2.out6)
programAnalytics_3 = SpacePlanning.SpaceAnalysis.ProgramAnalytics(updatedProgramData.progC)
programs_in_dept_4 = Watch(programAnalytics_3.out0)
cells_occupied_3 = Watch(programAnalytics_3.out1)
is_area_satisfied_3 = Watch(programAnalytics_3.out2)
area_needed_4 = Watch(programAnalytics_3.out3)
area_provided_3 = Watch(programAnalytics_3.out4)
quantity_3 = Watch(programAnalytics_3.out5)
poly_assigned_to_progs_3 = Watch(programAnalytics_3.out6)
programAnalytics_4 = SpacePlanning.SpaceAnalysis.ProgramAnalytics(updatedProgramData.progD)
programs_in_dept_5 = Watch(programAnalytics_4.out0)
cells_occupied_4 = Watch(programAnalytics_4.out1)
is_area_satisfied_4 = Watch(programAnalytics_4.out2)
area_needed_5 = Watch(programAnalytics_4.out3)
area_provided_4 = Watch(programAnalytics_4.out4)
quantity_4 = Watch(programAnalytics_4.out5)
poly_assigned_to_progs_4 = Watch(programAnalytics_4.out6)

# group: Circulation Between Dept
limit = CodeBlock { limit = 0; }
makeDeptTopology = SpacePlanning.Circulation.MakeDeptTopology(deptArrangeOnSite.out3, outline_poly_2.out0, limit)
height = CodeBlock { 7; }
circulation_network_dept = stuffer.DynamoGeometry.LineByLine2d(makeDeptTopology.out3, height)
makeDeptCirculation = SpacePlanning.Circulation.MakeDeptCirculation(deptArrangeOnSite.out3, makeDeptTopology.out3, dept_corridor_width)
code_block_5 = CodeBlock { 2.5; }
makeSurfaceForPolygon2d = stuffer.DynamoGeometry.MakeSurfaceForPolygon2d(makeDeptCirculation, code_block_5)
color_argb_7 = CodeBlock { a=255; r=240; g=130; b=27; }
byARGB_11 = Color.ByARGB(a=color_argb_7.a, r=color_argb_7.r, g=color_argb_7.g, b=color_argb_7.b)
byGeometryColor_11 = Display.Display.ByGeometryColor(makeSurfaceForPolygon2d, byARGB_11)

# group: Left Over Space (if any)
makeSurfaceForPolygon2d_2 = stuffer.DynamoGeometry.MakeSurfaceForPolygon2d(deptArrangeOnSite.out1)
color_argb_8 = CodeBlock { a=255; r=230; g=215; b=109; }
byARGB_12 = Color.ByARGB(a=color_argb_8.a, r=color_argb_8.r, g=color_argb_8.g, b=color_argb_8.b)
byGeometryColor_12 = Display.Display.ByGeometryColor(makeSurfaceForPolygon2d_2, byARGB_12)

# group: Circulation Between Programs
makeCirculationTopology = SpacePlanning.Circulation.MakeCirculationTopology(outline_poly_2.out0, recursivePlaceProgramsSeries.out2, recursivePlaceProgramsSeries_2.out2, recursivePlaceProgramsSeries_3.out2)
height_2 = CodeBlock { 7; }
circulation_network_prog = stuffer.DynamoGeometry.LineByLine2d(makeCirculationTopology.out3, height_2)
makeProgramCirculation = SpacePlanning.Circulation.MakeProgramCirculation(makeCirculationTopology.out2, makeCirculationTopology.out3, program_corridor_width, allowed_circulation_ratio_l_w, frequency_of_corridors)
code_block_6 = CodeBlock(corridorsPrograms=makeProgramCirculation) { corridorsPrograms; ht = 2; }
makeSurfaceForPolygon2d_3 = stuffer.DynamoGeometry.MakeSurfaceForPolygon2d(code_block_6.corridorsPrograms, code_block_6.ht)
color_argb_9 = CodeBlock { a=255; r=240; g=0; b=27; }
byARGB_13 = Color.ByARGB(a=color_argb_9.a, r=color_argb_9.r, g=color_argb_9.g, b=color_argb_9.b)
byGeometryColor_13 = Display.Display.ByGeometryColor(makeSurfaceForPolygon2d_3, byARGB_13)

# group: Central Station/ Lobby
makeSurfaceForPolygon2d_4 = stuffer.DynamoGeometry.MakeSurfaceForPolygon2d(deptArrangeOnSite.out2, code_block_5)
color_argb_10 = CodeBlock { a=255; r=240; g=130; b=27; }
byARGB_14 = Color.ByARGB(a=color_argb_10.a, r=color_argb_10.r, g=color_argb_10.g, b=color_argb_10.b)
byGeometryColor_14 = Display.Display.ByGeometryColor(makeSurfaceForPolygon2d_4, byARGB_14)
height_3 = CodeBlock { a=3; }
polygonByPolygon2d_14 = stuffer.DynamoGeometry.PolygonByPolygon2d(deptArrangeOnSite.out2, height_3)

local_csv_path = StringInput("D:\SUBHAJIT WORKS\01 DUKE BED TOWER AUTOMATION\08 EXCEL\01 FEB PROGRAM.csv")
makeDataStack = SpacePlanning.ReadData.MakeDataStack(local_csv_path, gridcell_dim.dimY, arg3=circulation_add_on_factor)
byPatch_2 = Surface.ByPatch(polygonByPolygon2d_10)
code_block_7 = CodeBlock { a=1; b=2; }

# group (continued): Slide to Generate Design
ground_coverage_achieved = Watch(formMakerInSite.out4)

patch = Curve.Patch(polygonByPolygon2d_6)
code_block_8 = CodeBlock(a=polygonByPolygon2d_10) { a.Points; }
code_block_9 = CodeBlock(a=polygonByPolygon2d_11) { a.Points; }
code_block_10 = CodeBlock(a=polygonByPolygon2d_12) { a.Points; }
code_block_11 = CodeBlock(a=polygonByPolygon2d_13) { a.Points; }
