# Dynamo graph 02 MAR _ test_1.dyn (Dynamo 0.9.1.4054)

code_block = CodeBlock { a={Point2d.ByCoordinates(0,0)}; }
cleanDuplicatePoint2d = SpacePlanning.BuildLayout.CleanDuplicatePoint2d(code_block)
cleanDuplicatePoint2d_2 = SpacePlanning.BuildLayout.CleanDuplicatePoint2d()
watch = Watch(cleanDuplicatePoint2d_2)
code_block_2 = CodeBlock()
# ---------- code_block_2.designscript (6 lines) ----------
a  ={
Point2d.ByCoordinates(105,32),
Point2d.ByCoordinates(105,32),
Point2d.ByCoordinates(500,32),
Point2d.ByCoordinates(5,32)
};
# ----------------------------------------
cleanDuplicatePoint2dNew = SpacePlanning.BuildLayout.CleanDuplicatePoint2dNew(code_block_2)
watch_2 = Watch(cleanDuplicatePoint2dNew)
