# Dynamo graph 07 MAR_TEST1.dyn (Dynamo 0.9.1.4054)

# group: Other Inputs
dimx_cell_width = DoubleSlider(50, range=0..200 step 0.1)
dimy_cell_length = DoubleSlider(50, range=0..200 step 0.1)
height_of_space_plan = DoubleSlider(5, range=0..50 step 1)
example_proportion_to_start = DoubleSlider(0.35, range=0..1 step 0.05)  # "Example Proportion to Start Splitting Programs"
patient_bed_width_ideal_val_16 = DoubleSlider(15, range=0..30 step 0.5)
patient_bed_depth_ideal_val_32 = DoubleSlider(31.5, range=0..60 step 0.5)
circulation_add_on_factor = DoubleSlider(1.4, range=1..3 step 0.2)

# group: Slide to Generate New Design
recompute_dept_arrangement = DoubleSlider(6, range=0..10 step 1)
recompute_prog_arrangement = DoubleSlider(1, range=0..5 step 1)

# group: Make Regular Poly
regular_poly_inputs = CodeBlock()
# ---------- regular_poly_inputs.designscript (4 lines) ----------
a = Point.ByCoordinates(-3600,-1100);
b = Point.ByCoordinates(-3800,-1100);
c = Point.ByCoordinates(-3800,-1300);
d = Point.ByCoordinates(-3600,-1300);
# ----------------------------------------
create = List.Create(regular_poly_inputs.a, regular_poly_inputs.b, regular_poly_inputs.c, regular_poly_inputs.d)
regular_polygon_inp = CodeBlock { cen = Point.ByCoordinates(-3000,-1500); radius = 150; sides = 8; }
byCenterPointRadius = Circle.ByCenterPointRadius(centerPoint=regular_polygon_inp.cen, radius=regular_polygon_inp.radius)
regularPolygon = Polygon.RegularPolygon(circle=byCenterPointRadius, numberSides=regular_polygon_inp.sides)

autoMakeBuildingOutline = SpacePlanning.ReadData.AutoMakeBuildingOutline()

# group: Input Poly Pts
point2dFromPointList = stuffer.DynamoGeometry.Point2dFromPointList(create)
point2dFromRegularPolygon = stuffer.DynamoGeometry.Point2dFromRegularPolygon(regularPolygon)
# note: Connect one of the three nodes below with outlinePts Code Block
fromOutlineGetPoints = SpacePlanning.ReadData.FromOutlineGetPoints(autoMakeBuildingOutline)

code_block = CodeBlock(a=fromOutlineGetPoints) { Polygon2d.ByPoints(a); }
number_slider = DoubleSlider(0.8, range=0..1 step 0.1)
integer_slider = IntegerSlider(1, range=0..1 step 1)
basicSplitPolyIntoTwo = SpacePlanning.BuildLayout.BasicSplitPolyIntoTwo(code_block, number_slider, integer_slider)
number_slider_2 = DoubleSlider(1, range=0..1 step 1)
string = StringInput("D:\SUBHAJIT WORKS\01 DUKE BED TOWER AUTOMATION\13 EXPORTS\P2.SAT")
readBuildingOutline = SpacePlanning.ReadData.ReadBuildingOutline(string)
fromOutlineGetPoints_2 = SpacePlanning.ReadData.FromOutlineGetPoints(readBuildingOutline)
code_block_2 = CodeBlock(A=fromOutlineGetPoints_2) { Polygon2d.ByPoints(A); }
number_slider_3 = DoubleSlider(0.4, range=0..1 step 0.1)
integer_slider_2 = IntegerSlider(1, range=0..1 step 1)
basicSplitPolyIntoTwo_2 = SpacePlanning.BuildLayout.BasicSplitPolyIntoTwo(code_block_2, number_slider_3, integer_slider_2)
code_block_3 = CodeBlock(a=basicSplitPolyIntoTwo_2.out1) { a.StartPoint; a.EndPoint; }
pointByPoint2d = stuffer.DynamoGeometry.PointByPoint2d(code_block_3.out0, integer_slider)
pointByPoint2d_2 = stuffer.DynamoGeometry.PointByPoint2d(code_block_3.out1, integer_slider)
byStartPointEndPoint = Line.ByStartPointEndPoint(startPoint=pointByPoint2d, endPoint=pointByPoint2d_2)
byPoints = Polygon.ByPoints(create)
polygonByPolygon2d = stuffer.DynamoGeometry.PolygonByPolygon2d(basicSplitPolyIntoTwo_2.out0, integer_slider)
code_block_4 = CodeBlock(a=polygonByPolygon2d) { a[0]; }
pointByPoint2d_3 = stuffer.DynamoGeometry.PointByPoint2d(basicSplitPolyIntoTwo_2.out2, integer_slider)
string_2 = StringInput("D:\SUBHAJIT WORKS\01 DUKE BED TOWER AUTOMATION\13 EXPORTS\P1.SAT")
string_3 = StringInput("D:\SUBHAJIT WORKS\01 DUKE BED TOWER AUTOMATION\08 EXCEL\OUTLINESCALEDDK.SAT")
polygonByPolygon2d_2 = stuffer.DynamoGeometry.PolygonByPolygon2d(code_block_2, integer_slider_2)
pointByPoint2d_4 = stuffer.DynamoGeometry.PointByPoint2d(fromOutlineGetPoints_2, integer_slider_2)
integer_slider_3 = IntegerSlider(49, range=1..50 step 1)
smoothCheckerForPoly = stuffer.Polygon2d.SmoothCheckerForPoly(code_block_2, integer_slider_3)
pointByPoint2d_5 = stuffer.DynamoGeometry.PointByPoint2d(smoothCheckerForPoly, integer_slider_2)
string_4 = StringInput("D:\SUBHAJIT WORKS\01 DUKE BED TOWER AUTOMATION\13 EXPORTS\P3.SAT")
code_block_5 = CodeBlock(a=basicSplitPolyIntoTwo_2.out2) { a[1]; }
sortPointsByDistanceFromPoint = SpacePlanning.GraphicsUtility.SortPointsByDistanceFromPoint(smoothCheckerForPoly, code_block_5)
integer_slider_4 = IntegerSlider(50, range=1..50 step 1)
pointByPoint2d_6 = stuffer.DynamoGeometry.PointByPoint2d(sortPointsByDistanceFromPoint, integer_slider_4)
code_block_6 = CodeBlock(a=pointByPoint2d_6) { a[0]; }
pointByPoint2d_7 = stuffer.DynamoGeometry.PointByPoint2d(code_block_5, integer_slider_4)
code_block_7 = CodeBlock()
# ---------- code_block_7.designscript (8 lines) ----------
{53.3,
45.3,
23.2,
12.45,
53.3,
45.3,
23.2,
12.45};
# ----------------------------------------
sortIndex = SpacePlanning.BasicUtility.SortIndex(code_block_7)
code_block_8 = CodeBlock(a=smoothCheckerForPoly) { a[-1]; }
sortPointsByDistanceFromPoint_2 = SpacePlanning.GraphicsUtility.SortPointsByDistanceFromPoint(basicSplitPolyIntoTwo_2.out2, code_block_8)
pointByPoint2d_8 = stuffer.DynamoGeometry.PointByPoint2d(sortPointsByDistanceFromPoint_2, integer_slider_4)
code_block_9 = CodeBlock(a=pointByPoint2d_8) { a[0]; }
pointByPoint2d_9 = stuffer.DynamoGeometry.PointByPoint2d(code_block_8, integer_slider_4)
code_block_10 = CodeBlock(a=polygonByPolygon2d) { a[1]; }
integer_slider_5 = IntegerSlider(39071, range=1..50000 step 1)
integer_slider_6 = IntegerSlider(0, range=0..1 step 1)
integer_slider_7 = IntegerSlider(35, range=0..300 step 1)
recursiveSplitByArea = SpacePlanning.BuildLayout.RecursiveSplitByArea(code_block_2, integer_slider_5, integer_slider_6, integer_slider_7)
randomMaker = SpacePlanning.BuildLayout.RandomMaker()
number_slider_4 = DoubleSlider(380.6, range=0..3000 step 0.1)
integer_slider_8 = IntegerSlider(1, range=0..1 step 1)
splitByDistance = SpacePlanning.BuildLayout.SplitByDistance(code_block_2, randomMaker, number_slider_4, integer_slider_8, integer_slider_8)
polygonByPolygon2d_3 = stuffer.DynamoGeometry.PolygonByPolygon2d(splitByDistance, integer_slider)
code_block_11 = CodeBlock(a=polygonByPolygon2d_3) { a[0]; }
code_block_12 = CodeBlock(a=polygonByPolygon2d_3) { a[1]; }
number_slider_5 = DoubleSlider(0.8, range=0..1 step 0.1)
integer_slider_9 = IntegerSlider(129, range=0..300 step 1)
recursiveSplitPoly = SpacePlanning.BuildLayout.RecursiveSplitPoly(code_block_2, number_slider_5, integer_slider_9)
recursiveSplitOneDirByDistance = SpacePlanning.BuildLayout.RecursiveSplitOneDirByDistance(arg1=integer_slider_3, arg2=integer_slider_7)
