# Dynamo graph 15 MAR _SIMPLE SPACEPLAN_2.dyn (Dynamo 0.9.1.4054)

# group: Other Inputs
dimx_cell_width = DoubleSlider(8, range=0..200 step 0.1)
dimy_cell_length = DoubleSlider(8, range=0..200 step 0.1)
circulation_add_on_factor = DoubleSlider(1.5, range=1..3 step 0.2)
patient_bed_depth_ideal_val_32 = DoubleSlider(31.5, range=0..60 step 0.5)
height_of_space_plan = DoubleSlider(1, range=0..50 step 1)
example_proportion_to_start = DoubleSlider(0.35, range=0..1 step 0.05)  # "Example Proportion to Start Splitting Programs"
patient_bed_width_ideal_val_16 = DoubleSlider(15, range=5..30 step 0.5)

# group: Make Data Stack
autoMakeBuildingOutline = SpacePlanning.ReadData.AutoMakeBuildingOutline()
autoMakeDataStackSingleOut = SpacePlanning.ReadData.AutoMakeDataStackSingleOut(dimx_cell_width, dimy_cell_length, circulation_add_on_factor)
code_block = CodeBlock(a=autoMakeDataStackSingleOut) { a["DeptDataObject"]; }
code_block_2 = CodeBlock(a=code_block) { a; }

# group: Slide to Generate New Design
recompute_dept_arrangement = DoubleSlider(9, range=0..10 step 1)
recompute_prog_arrangement = DoubleSlider(4, range=0..5 step 1)

# group: Make Regular Poly
regular_poly_inputs = CodeBlock()
# ---------- regular_poly_inputs.designscript (4 lines) ----------
a = Point.ByCoordinates(-3600,-1100);
b = Point.ByCoordinates(-3800,-1100);
c = Point.ByCoordinates(-3800,-1300);
d = Point.ByCoordinates(-3600,-1300);
# ----------------------------------------
create = List.Create(regular_poly_inputs.a, regular_poly_inputs.b, regular_poly_inputs.c, regular_poly_inputs.d)
regular_polygon_inp = CodeBlock { cen = Point.ByCoordinates(-3000,-1500); radius = 150; sides = 8; }
byCenterPointRadius = Circle.ByCenterPointRadius(centerPoint=regular_polygon_inp.cen, radius=regular_polygon_inp.radius)
regularPolygon = Polygon.RegularPolygon(circle=byCenterPointRadius, numberSides=regular_polygon_inp.sides)

# group: Input Poly Pts
# note: Connect one of the three nodes below with outlinePts Code Block
fromOutlineGetPoints = SpacePlanning.ReadData.FromOutlineGetPoints(autoMakeBuildingOutline)
point2dFromPointList = stuffer.DynamoGeometry.Point2dFromPointList(create)
point2dFromRegularPolygon = stuffer.DynamoGeometry.Point2dFromRegularPolygon(regularPolygon)

# group (continued): Make Data Stack
outline_poly = CodeBlock(outlinePts=fromOutlineGetPoints) { Polygon2d.ByPoints(outlinePts); outlinePts; }

# group: Cells From Outline
fromPointsGetBoundingPoly = SpacePlanning.ReadData.FromPointsGetBoundingPoly(outline_poly.outlinePts)
gridPointsInsideOutlineSingleOut = SpacePlanning.GridObject.GridPointsInsideOutlineSingleOut(fromPointsGetBoundingPoly, outline_poly.outlinePts, dimx_cell_width, dimy_cell_length)
code_block_3 = CodeBlock(a=gridPointsInsideOutlineSingleOut) { a["PointsInsideOutline"]; a["CellsFromPoints"]; }
convexHullFromPoint2D = SpacePlanning.GridObject.ConvexHullFromPoint2D(code_block_3.out0)
pointFromPoint2dList = stuffer.DynamoGeometry.pointFromPoint2dList(convexHullFromPoint2D)
byPoints = Polygon.ByPoints(pointFromPoint2dList)

# group: Generator
deptArrangeOnSiteSingleOut = SpacePlanning.BuildLayout.DeptArrangeOnSiteSingleOut(outline_poly.out0, code_block_2, code_block_3.out1, patient_bed_depth_ideal_val_32, recompute_dept_arrangement)
code_block_4 = CodeBlock(a=deptArrangeOnSiteSingleOut) { a["DeptPolys"]; }
code_block_5 = CodeBlock(deptPolys=code_block_4) { deptPolys; }
code_block_6 = CodeBlock(A=code_block_5) { A[0]; }
polygonByPolygon2d = stuffer.DynamoGeometry.PolygonByPolygon2d(code_block_6, height_of_space_plan)
code_block_7 = CodeBlock(A=code_block_5) { A[1]; }
polygonByPolygon2d_2 = stuffer.DynamoGeometry.PolygonByPolygon2d(code_block_7, height_of_space_plan)
code_block_8 = CodeBlock(A=code_block_5) { A[2]; }
polygonByPolygon2d_3 = stuffer.DynamoGeometry.PolygonByPolygon2d(code_block_8, height_of_space_plan)
code_block_9 = CodeBlock(A=code_block_5) { A[3]; }
polygonByPolygon2d_4 = stuffer.DynamoGeometry.PolygonByPolygon2d(code_block_9, height_of_space_plan)
areaCheckPolygon = stuffer.Polygon2d.AreaCheckPolygon(code_block_9)
areaCheckPolygon_2 = stuffer.Polygon2d.AreaCheckPolygon(code_block_7)
areaCheckPolygon_3 = stuffer.Polygon2d.AreaCheckPolygon(code_block_6)
areaCheckPolygon_4 = stuffer.Polygon2d.AreaCheckPolygon(code_block_8)
code_block_10 = CodeBlock(a=deptArrangeOnSiteSingleOut) { a["LeftOverPolys"]; }
dynamogeometry = stuffer.DynamoGeometry.PolygonByPolygon2d(code_block_10, height_of_space_plan)  # "DynamoGeometry.PolygonByPolygon2d - Left Over Space"
code_block_11 = CodeBlock(a=deptArrangeOnSiteSingleOut) { a["UpdatedDeptData"]; }
programs_in_each_dept = CodeBlock(code_block_11) { Dept.ProgramsInDept; }
code_block_12 = CodeBlock(program=programs_in_each_dept) { program[1]; }
recursiveSplitPolyProgramsSingleOut = SpacePlanning.BuildLayout.RecursiveSplitPolyProgramsSingleOut(code_block_7, code_block_12, example_proportion_to_start, recompute_prog_arrangement)
code_block_13 = CodeBlock(a=recursiveSplitPolyProgramsSingleOut) { a["PolyAfterSplit"]; }
polygonByPolygon2d_5 = stuffer.DynamoGeometry.PolygonByPolygon2d(code_block_13, height_of_space_plan)
programs_in_each_dept_2 = CodeBlock(code_block_11) { Dept.ProgramsInDept; }
code_block_14 = CodeBlock(program=programs_in_each_dept_2) { program[2]; }
recursiveSplitPolyProgramsSingleOut_2 = SpacePlanning.BuildLayout.RecursiveSplitPolyProgramsSingleOut(code_block_8, code_block_14, example_proportion_to_start, recompute_prog_arrangement)
code_block_15 = CodeBlock(a=recursiveSplitPolyProgramsSingleOut_2) { a["PolyAfterSplit"]; }
polygonByPolygon2d_6 = stuffer.DynamoGeometry.PolygonByPolygon2d(code_block_15, height_of_space_plan)
programs_in_each_dept_3 = CodeBlock(code_block_11) { Dept.ProgramsInDept; }
code_block_16 = CodeBlock(program=programs_in_each_dept_3) { program[3]; }
recursiveSplitPolyProgramsSingleOut_3 = SpacePlanning.BuildLayout.RecursiveSplitPolyProgramsSingleOut(code_block_9, code_block_16, example_proportion_to_start, recompute_prog_arrangement)
code_block_17 = CodeBlock(a=recursiveSplitPolyProgramsSingleOut_3) { a["PolyAfterSplit"]; }
polygonByPolygon2d_7 = stuffer.DynamoGeometry.PolygonByPolygon2d(code_block_17, height_of_space_plan)
programs_in_each_dept_4 = CodeBlock(code_block_11) { Dept.ProgramsInDept; }
code_block_18 = CodeBlock(program=programs_in_each_dept_4) { program[0]; }
recursiveSplitProgramsOneDirByDistanceSi = SpacePlanning.BuildLayout.RecursiveSplitProgramsOneDirByDistanceSingleOut(code_block_6, code_block_18, patient_bed_width_ideal_val_16, recompute_prog_arrangement)
code_block_19 = CodeBlock(a=recursiveSplitProgramsOneDirByDistanceSi) { a["PolyAfterSplit"]; }
polygonByPolygon2d_8 = stuffer.DynamoGeometry.PolygonByPolygon2d(code_block_19, height_of_space_plan)
