# Dynamo graph 27 MAR_prog placed.dyn (Dynamo 0.9.1.4054)

# group: Other Inputs
dimx_cell_width = DoubleSlider(8, range=2..8 step 1)
dimy_cell_length = DoubleSlider(8, range=2..8 step 1)
circulation_add_on_factor = DoubleSlider(1.5, range=1..3 step 0.2)
patient_bed_depth_ideal_val_32 = DoubleSlider(31.5, range=20..45 step 0.5)
height_of_space_plan = DoubleSlider(0, range=0..3 step 1)
example_proportion_to_start = DoubleSlider(0.35, range=0.2..1 step 0.05)  # "Example Proportion to Start Splitting Programs"
patient_bed_width_ideal_val_16 = DoubleSlider(15, range=8..25 step 0.5)

# group: Make Data Stack
autoMakeBuildingOutline = SpacePlanning.ReadData.AutoMakeBuildingOutline()
autoMakeDataStack = SpacePlanning.ReadData.AutoMakeDataStack(dimx_cell_width, dimy_cell_length, circulation_add_on_factor)
code_block = CodeBlock(a=autoMakeDataStack.out3) { a; }

# group: Input Poly Pts
# note: Connect one of the three nodes below with outlinePts Code Block
fromOutlineGetPoints = SpacePlanning.ReadData.FromOutlineGetPoints(autoMakeBuildingOutline)

# group (continued): Make Data Stack
outline_poly = CodeBlock(outlinePts=fromOutlineGetPoints) { Polygon2d.ByPoints(outlinePts); outlinePts; }

# group: Cells From Outline
fromPointsGetBoundingPoly = SpacePlanning.ReadData.FromPointsGetBoundingPoly(outline_poly.outlinePts)
gridPointsInsideOutline = SpacePlanning.GridObject.GridPointsInsideOutline(fromPointsGetBoundingPoly, outline_poly.outlinePts, dimx_cell_width, dimy_cell_length)

# group: Slide to Generate New Design
recompute_dept_arrangement = DoubleSlider(3, range=1..5 step 1)
recompute_prog_arrangement = DoubleSlider(3, range=1..5 step 1)

# group: Generator
deptArrangeOnSite = SpacePlanning.BuildLayout.DeptArrangeOnSite(outline_poly.out0, code_block, gridPointsInsideOutline.out1, patient_bed_depth_ideal_val_32, recompute_dept_arrangement)
code_block_2 = CodeBlock(deptPolys=deptArrangeOnSite.out0) { deptPolys; }
code_block_3 = CodeBlock(A=code_block_2) { A[0]; }
polygonByPolygon2d = stuffer.DynamoGeometry.PolygonByPolygon2d(code_block_3, height_of_space_plan)
code_block_4 = CodeBlock(A=code_block_2) { A[1]; }
polygonByPolygon2d_2 = stuffer.DynamoGeometry.PolygonByPolygon2d(code_block_4, height_of_space_plan)
code_block_5 = CodeBlock(A=code_block_2) { A[2]; }
polygonByPolygon2d_3 = stuffer.DynamoGeometry.PolygonByPolygon2d(code_block_5, height_of_space_plan)
code_block_6 = CodeBlock(A=code_block_2) { A[3]; }
polygonByPolygon2d_4 = stuffer.DynamoGeometry.PolygonByPolygon2d(code_block_6, height_of_space_plan)
dynamogeometry = stuffer.DynamoGeometry.PolygonByPolygon2d(deptArrangeOnSite.out1, height_of_space_plan)  # "DynamoGeometry.PolygonByPolygon2d - Left Over Space"
programs_in_each_dept = CodeBlock(deptArrangeOnSite.out3) { Dept.ProgramsInDept; }
code_block_7 = CodeBlock(program=programs_in_each_dept) { program[1]; }
recursiveSplitPolyPrograms = SpacePlanning.BuildLayout.RecursiveSplitPolyPrograms(code_block_4, code_block_7, example_proportion_to_start, recompute_prog_arrangement)
polygonByPolygon2d_5 = stuffer.DynamoGeometry.PolygonByPolygon2d(recursiveSplitPolyPrograms, height_of_space_plan)
programs_in_each_dept_2 = CodeBlock(deptArrangeOnSite.out3) { Dept.ProgramsInDept; }
code_block_8 = CodeBlock(program=programs_in_each_dept_2) { program[2]; }
recursiveSplitPolyPrograms_2 = SpacePlanning.BuildLayout.RecursiveSplitPolyPrograms(code_block_5, code_block_8, example_proportion_to_start, recompute_prog_arrangement)
polygonByPolygon2d_6 = stuffer.DynamoGeometry.PolygonByPolygon2d(recursiveSplitPolyPrograms_2, height_of_space_plan)
programs_in_each_dept_3 = CodeBlock(deptArrangeOnSite.out3) { Dept.ProgramsInDept; }
code_block_9 = CodeBlock(program=programs_in_each_dept_3) { program[3]; }
recursiveSplitPolyPrograms_3 = SpacePlanning.BuildLayout.RecursiveSplitPolyPrograms(code_block_6, code_block_9, example_proportion_to_start, recompute_prog_arrangement)
polygonByPolygon2d_7 = stuffer.DynamoGeometry.PolygonByPolygon2d(recursiveSplitPolyPrograms_3, height_of_space_plan)
programs_in_each_dept_4 = CodeBlock(deptArrangeOnSite.out3) { Dept.ProgramsInDept; }
code_block_10 = CodeBlock(program=programs_in_each_dept_4) { program[0]; }
recursiveSplitProgramsOneDirByDistance = SpacePlanning.BuildLayout.RecursiveSplitProgramsOneDirByDistance(code_block_3, code_block_10, patient_bed_width_ideal_val_16, recompute_prog_arrangement)
polygonByPolygon2d_8 = stuffer.DynamoGeometry.PolygonByPolygon2d(recursiveSplitProgramsOneDirByDistance, height_of_space_plan)
outline_poly_2 = CodeBlock(outlinePts=fromOutlineGetPoints) { Polygon2d.ByPoints(outlinePts); b = 5; }

# group: Circulation Inputs
frequency_of_corridors = DoubleSlider(0.7, range=0.2..1 step 0.1)
allowed_circulation_ratio_l_w = DoubleSlider(5.3, range=0.5..6 step 0.3)
dept_corridor_width = DoubleSlider(6, range=5..12 step 1)
program_corridor_width = DoubleSlider(6, range=4..12 step 1)

code_block_11 = CodeBlock(a=deptArrangeOnSite.out4) { a["NodeList"].NodeType; }
watch = Watch(code_block_11)
code_block_12 = CodeBlock(a=deptArrangeOnSite.out4) { a["SpaceTree"].CenterPtNodeList; a["SpaceTree"].RadiusNodeList; }
byCenterPointRadius = Circle.ByCenterPointRadius(centerPoint=code_block_12.out0, radius=code_block_12.out1)
code_block_13 = CodeBlock { a[12]; }
code_block_14 = CodeBlock(a=code_block_5) { a; }
code_block_15 = CodeBlock(program=programs_in_each_dept) { program[2]; }
code_block_16 = CodeBlock(program=programs_in_each_dept) { program[1]; }
areaNeeded = SpacePlanning.ProgramData.AreaNeeded(code_block_16)
watch_2 = Watch(areaNeeded)
code_block_17 = CodeBlock(a=code_block_4) { a; }
acceptablewidth = DoubleSlider(12, range=0..100 step 0.1)
minWidth = DoubleSlider(72.4, range=0..100 step 0.1)
recursivePlaceProgramsSeries = SpacePlanning.BuildLayout.RecursivePlaceProgramsSeries(code_block_17, code_block_16, acceptablewidth, minWidth)
height = CodeBlock { a=0; b=15; c=20; }
polygonByPolygon2d_9 = stuffer.DynamoGeometry.PolygonByPolygon2d(recursivePlaceProgramsSeries.out0, height.b)
code_block_18 = CodeBlock(a=polygonByPolygon2d_9) { a[1].Corners(); }
polygonByPolygon2d_10 = stuffer.DynamoGeometry.PolygonByPolygon2d(recursivePlaceProgramsSeries.out1, height.a)
watch_3 = Watch(polygonByPolygon2d_9)
number_slider = DoubleSlider(0, range=0..25 step 1)
code_block_19 = CodeBlock(a=polygonByPolygon2d_9, b=number_slider) { a[b]; b; }
polygonByPolygon2d_11 = stuffer.DynamoGeometry.PolygonByPolygon2d(code_block_17, height.a)
code_block_20 = CodeBlock(a=recursivePlaceProgramsSeries.out0, b=number_slider) { a[b]; b; }
sum = Math.Sum(areaNeeded)
watch_4 = Watch(sum)
areaCheckPolygon = SpacePlanning.PolygonUtility.AreaCheckPolygon(recursivePlaceProgramsSeries.out0)
sum_2 = Math.Sum(areaCheckPolygon)
sum_3 = Math.Sum(sum_2)
watch_5 = Watch(sum_3)
watch_6 = Watch(sum_2)
currentAreaNeeds = SpacePlanning.ProgramData.CurrentAreaNeeds(code_block_16)
watch_7 = Watch(currentAreaNeeds)
areaCheckPolygon_2 = SpacePlanning.PolygonUtility.AreaCheckPolygon(code_block_17)
sum_4 = Math.Sum(areaCheckPolygon_2)
watch_8 = Watch(sum_4)
areaAllocatedValue = SpacePlanning.ProgramData.AreaAllocatedValue(recursivePlaceProgramsSeries.out3)
watch_9 = Watch(areaAllocatedValue)
code_block_21 = CodeBlock(a=recursivePlaceProgramsSeries.out0) { a[4].Points; }
code_block_22 = CodeBlock(a=code_block_4) { a; }
polygonByPolygon2d_12 = stuffer.DynamoGeometry.PolygonByPolygon2d(code_block_22, height.a)
watch_10 = Watch()
number_slider_2 = DoubleSlider(10, range=0..15 step 0.5)
splitBigPolys = SpacePlanning.BuildLayout.SplitBigPolys(code_block_22, number_slider_2)  # frozen
flatten = Flatten(splitBigPolys)
code_block_23 = CodeBlock(program=programs_in_each_dept) { program[1]; }
grid_x_y = DoubleSlider(3, range=0..16 step 0.5)
recursivePlaceProgramsGridCells = SpacePlanning.BuildLayout.RecursivePlaceProgramsGridCells(flatten, code_block_23, grid_x_y, grid_x_y)
polygonByPolygon2d_13 = stuffer.DynamoGeometry.PolygonByPolygon2d(recursivePlaceProgramsGridCells.out1, height.a)
polygonByPolygon2d_14 = stuffer.DynamoGeometry.PolygonByPolygon2d(recursivePlaceProgramsGridCells.out0, height.b)
areaNeeded_2 = SpacePlanning.ProgramData.AreaNeeded(code_block_23)
watch_11 = Watch(areaNeeded_2)
currentAreaNeeds_2 = SpacePlanning.ProgramData.CurrentAreaNeeds(code_block_23)
watch_12 = Watch(currentAreaNeeds_2)
areaCheckPolygon_3 = SpacePlanning.PolygonUtility.AreaCheckPolygon(recursivePlaceProgramsGridCells.out0)
sum_5 = Math.Sum(areaCheckPolygon_3)
watch_13 = Watch(sum_5)
currentAreaNeeds_3 = SpacePlanning.ProgramData.CurrentAreaNeeds(recursivePlaceProgramsGridCells.out2)
watch_14 = Watch(currentAreaNeeds_3)
areaAllocatedValue_2 = SpacePlanning.ProgramData.AreaAllocatedValue(recursivePlaceProgramsGridCells.out2)
watch_15 = Watch(areaAllocatedValue_2)
polygonByPolygon2d_15 = stuffer.DynamoGeometry.PolygonByPolygon2d(splitBigPolys, height.a)
