# Dynamo graph 17 FEB_ deptprog Outlines_1.dyn (Dynamo 0.9.0.3072)

building_outline_file_path = StringInput("D:\SUBHAJIT WORKS\01 DUKE BED TOWER AUTOMATION\08 EXCEL\OUTLINE.SAT")  # "Building Outline File Path String"
program_data_info_csv_file_path = StringInput("D:\SUBHAJIT WORKS\01 DUKE BED TOWER AUTOMATION\08 EXCEL\01 FEB PROGRAM.csv")  # "Program Data Info CSV File Path String"
dimX = DoubleSlider(30, range=0..200 step 0.1)
dimY = DoubleSlider(30, range=0..200 step 0.1)
factor = DoubleSlider(5, range=0..40 step 0.5)
makeDataStack = SpacePlanning.ReadData.MakeDataStack(program_data_info_csv_file_path, dimX, dimY, factor)
text_editor = CodeBlock(text=makeDataStack.out0) { text[1]; 1.2; }
textProgramName = DynamoText.Text.FromStringOriginAndScale(text_editor.out0, arg2=text_editor.out1)
iteration = DoubleSlider(100, range=0..1000 step 1)
building_outline_file_path_2 = StringInput("D:\SUBHAJIT WORKS\01 DUKE BED TOWER AUTOMATION\08 EXCEL\OUTLINEDK.SAT")  # "Building Outline File Path String"
building_outline_file_path_3 = StringInput("D:\SUBHAJIT WORKS\01 DUKE BED TOWER AUTOMATION\08 EXCEL\OUTLINEDKtest.SAT")  # "Building Outline File Path String"
scale = DoubleSlider(200, range=0..200 step 0.1)
include_quantity_of_program = BoolSelector(false)
bubbleRadiusFromNormalizedArea = SpacePlanning.BubbleChart.BubbleRadiusFromNormalizedArea(arg1=scale, arg2=include_quantity_of_program)
iteration_2 = DoubleSlider(50, range=0..1000 step 1)
packBubbles = SpacePlanning.BubbleChart.PackBubbles(arg1=bubbleRadiusFromNormalizedArea, arg2=iteration_2)
py_newpointgrid = Python(IN[0]=packBubbles)
# ---------- py_newpointgrid.python (11 lines) ----------
import clr
clr.AddReference('ProtoGeometry')
from Autodesk.DesignScript.Geometry import *
#The inputs to this node will be stored as a list in the IN variables.
dataEnteringNode = IN




#Assign your output to the OUT variable.
OUT = IN[0][1]
# ----------------------------------------
building_outline_file_path_4 = StringInput("D:\SUBHAJIT WORKS\01 DUKE BED TOWER AUTOMATION\08 EXCEL\OUTLINESCALEDDK.SAT")  # "Building Outline File Path String"
readBuildingOutline = SpacePlanning.ReadData.ReadBuildingOutline(building_outline_file_path_4)
fromOutlineGetPoints = SpacePlanning.ReadData.FromOutlineGetPoints(readBuildingOutline)
fromPointsGetBoundingPoly = SpacePlanning.ReadData.FromPointsGetBoundingPoly(fromOutlineGetPoints)
polyCurveFromPoints = stuffer.DynamoGeometry.PolyCurveFromPoints(fromPointsGetBoundingPoly)
programPointGridFromData = SpacePlanning.BubbleChart.ProgramPointGridFromData()
makeAdjacencyNetwork = SpacePlanning.BubbleChart.MakeAdjacencyNetwork(arg1=makeDataStack.out0)
pointFromPoint2dList = stuffer.DynamoGeometry.pointFromPoint2dList()
fromPointsGetBoundingPoly_2 = SpacePlanning.ReadData.FromPointsGetBoundingPoly(fromOutlineGetPoints)
gridPointsInsideOutline = SpacePlanning.GridObject.GridPointsInsideOutline(fromPointsGetBoundingPoly_2, fromOutlineGetPoints, dimX, dimY)
convexHullFromPoint2D = SpacePlanning.GridObject.ConvexHullFromPoint2D(gridPointsInsideOutline.out0)
pointFromPoint2dList_2 = stuffer.DynamoGeometry.pointFromPoint2dList(convexHullFromPoint2D)
byPoints = Polygon.ByPoints(pointFromPoint2dList_2)
programObjectCheck = SpacePlanning.ReadData.ProgramObjectCheck()
deptObjectCheck = SpacePlanning.ReadData.DeptObjectCheck()
num = DoubleSlider(34, range=0..34 step 1)
recompute = DoubleSlider(8, range=0..10 step 1)
placeProgramsInSite = SpacePlanning.PlaceSpace.PlaceProgramsInSite(makeDataStack.out1, gridPointsInsideOutline.out1, fromOutlineGetPoints, num, recompute)
index = DoubleSlider(3, range=0..34 step 1)
py_get_program_cell_index = Python(IN[0]=placeProgramsInSite.out0, IN[1]=index)
# ---------- py_get_program_cell_index.python (12 lines) ----------
import clr
clr.AddReference('ProtoGeometry')
from Autodesk.DesignScript.Geometry import *
#The inputs to this node will be stored as a list in the IN variables.
dataEnteringNode = IN

cellListAll = IN[0]
index = IN[1]
	

#Assign your output to the OUT variable.
OUT = cellListAll[int(index)]
# ----------------------------------------
py_get_point2d_lists = Python(IN[0]=gridPointsInsideOutline.out0, IN[1]=py_get_program_cell_index)
# ---------- py_get_point2d_lists.python (16 lines) ----------
import clr
clr.AddReference('ProtoGeometry')
from Autodesk.DesignScript.Geometry import *
#The inputs to this node will be stored as a list in the IN variables.
dataEnteringNode = IN

ptList = IN[0]
indexList = IN[1]

ptFinal=[]
for i in range(len(indexList)):
	ptFinal.append(ptList[indexList[i]])
	

#Assign your output to the OUT variable.
OUT = ptFinal
# ----------------------------------------
pointFromPoint2dList_3 = stuffer.DynamoGeometry.pointFromPoint2dList(py_get_point2d_lists)
pointFromPoint2dList_4 = stuffer.DynamoGeometry.pointFromPoint2dList(fromOutlineGetPoints)
code_block = CodeBlock(a=pointFromPoint2dList_4) { a[1]; }
showProgramsInSite = SpacePlanning.PlaceSpace.ShowProgramsInSite(makeDataStack.out1, gridPointsInsideOutline.out1, fromOutlineGetPoints)
fromPointsGetBoundingPoly_3 = SpacePlanning.ReadData.FromPointsGetBoundingPoly(py_get_point2d_lists)
polyCurveFromPoints_2 = stuffer.DynamoGeometry.PolyCurveFromPoints(fromPointsGetBoundingPoly_3)
makeProgramPolygons = SpacePlanning.PlaceSpace.MakeProgramPolygons(placeProgramsInSite.out0, gridPointsInsideOutline.out0)
colorVals = DoubleSlider(151, range=0..255 step 1)
colorVals_2 = DoubleSlider(109, range=0..255 step 1)
colorVals_3 = DoubleSlider(34, range=0..255 step 1)
colorVals_4 = DoubleSlider(118, range=0..255 step 1)
recompute_dept = DoubleSlider(8, range=0..10 step 1)
placeDeptsInSite = SpacePlanning.PlaceSpace.PlaceDeptsInSite(makeDataStack.out3, gridPointsInsideOutline.out1, fromOutlineGetPoints, num, recompute_dept)
makeDeptPolygons = SpacePlanning.PlaceSpace.MakeProgramPolygons(placeDeptsInSite.out0, gridPointsInsideOutline.out0)  # "PlaceSpace.MakeDeptPolygons"
point_lists = CodeBlock(inputPoints=makeDeptPolygons.out1) { inputPoints; }
pointFromPoint2dList_5 = stuffer.DynamoGeometry.pointFromPoint2dList(point_lists)
index_2 = DoubleSlider(1, range=0..5 step 1)
rvalues = stuffer.DynamoGeometry.Rvalues(point_lists, index_2)
rvalues_2 = stuffer.DynamoGeometry.Rvalues(point_lists, index_2)
rvalues_3 = stuffer.DynamoGeometry.Rvalues(point_lists, index_2)
byARGB = Color.ByARGB(r=rvalues, g=rvalues_2, b=rvalues_3)
byGeometryColor = Display.Display.ByGeometryColor(pointFromPoint2dList_5, byARGB)
index_3 = DoubleSlider(2, range=0..34 step 1)
program = CodeBlock(a=byGeometryColor, b=index_3) { a[b]; }
pointFromPoint2dList_6 = stuffer.DynamoGeometry.pointFromPoint2dList(gridPointsInsideOutline.out0)
makeCellsFromGridPoints = SpacePlanning.GridObject.MakeCellsFromGridPoints(pointFromPoint2dList_6, dimX, dimY)
opacity = DoubleSlider(10.7, range=0..255 step 0.1)
val = DoubleSlider(164.6, range=0..255 step 0.1)
val_2 = DoubleSlider(183.1, range=0..255 step 0.1)
val_3 = DoubleSlider(165.4, range=0..255 step 0.1)
byARGB_2 = Color.ByARGB(a=opacity, r=val, g=val_2, b=val_3)
byGeometryColor_2 = Display.Display.ByGeometryColor(makeCellsFromGridPoints, byARGB_2)
makeProgramConvexHulls = SpacePlanning.PlaceSpace.MakeProgramConvexHulls(placeProgramsInSite.out0, gridPointsInsideOutline.out0)
center = Polygon.Center(makeProgramConvexHulls)
pointFromPoint2dList_7 = stuffer.DynamoGeometry.pointFromPoint2dList(fromOutlineGetPoints)
code_block_2 = CodeBlock(a=pointFromPoint2dList_7) { a[-2]; }
code_block_3 = CodeBlock(a=pointFromPoint2dList_7) { a[-1]; }
byTwoPoints = Vector.ByTwoPoints(start=code_block_2, end=code_block_3)
normalized = Vector.Normalized(byTwoPoints)
number_slider = DoubleSlider(289, range=0..3000 step 0.1)
byStartPointDirectionLength = Line.ByStartPointDirectionLength(startPoint=code_block_2, direction=normalized, length=number_slider)
recompute_2 = DoubleSlider(6, range=0..10 step 1)
programAnalytics = SpacePlanning.PlaceSpace.ProgramAnalytics(placeProgramsInSite.out1, placeProgramsInSite.out2, recompute_2)
program_name = Watch(programAnalytics.out0)
number_of_cells_occupied = Watch(programAnalytics.out1)
area_satisfied = Watch(programAnalytics.out2)
area_needed = Watch(programAnalytics.out3)
area_provided = Watch(programAnalytics.out4)
quantity = Watch(programAnalytics.out5)
available_cells_and_total_cells = Watch(programAnalytics.out6)
deptAnalytics = SpacePlanning.PlaceSpace.DeptAnalytics(placeDeptsInSite.out1, placeDeptsInSite.out2, recompute_dept)
available_cells_and_total_cells_2 = Watch(deptAnalytics.out6)
area_needed_2 = Watch(deptAnalytics.out3)
quantity_2 = Watch(programAnalytics.out5)
number_of_cells_occupied_2 = Watch(deptAnalytics.out1)
area_satisfied_2 = Watch(deptAnalytics.out2)
area_provided_2 = Watch(deptAnalytics.out4)
dept_name = Watch(deptAnalytics.out0)
programs_in_depts = Watch(deptAnalytics.out5)
code_block_4 = CodeBlock(a=placeProgramsInSite.out1) { a.AreaProvided; }
code_block_5 = CodeBlock(a=makeDataStack.out1) { a.AreaProvided; }
code_block_6 = CodeBlock(a=makeDataStack.out1) { a; }
code_block_7 = CodeBlock(a=code_block_6) { a.AreaProvided; }
makeProgramConvexHulls_2 = SpacePlanning.PlaceSpace.MakeProgramConvexHulls(placeDeptsInSite.out0, gridPointsInsideOutline.out0)
convex_hulls = CodeBlock(a=makeProgramConvexHulls_2, b=index_3) { a[b]; }
makeProgramPolygons_2 = SpacePlanning.PlaceSpace.MakeProgramPolygons(placeDeptsInSite.out0, gridPointsInsideOutline.out0)
convex_hulls_2 = CodeBlock(a=makeProgramPolygons_2, b=index_3) { a[b]; }
code_block_8 = CodeBlock { {00,00,00,400}; {0,1,2,3,4}; {-133,-1001.7823648723678,-25.00,-5.78234,-65}; {133,1100,25,75,65}; }
number_slider_2 = DoubleSlider(59.8, range=0..100 step 0.1)
testQuickSort = SpacePlanning.GridObject.TestQuickSort(code_block_8.out2, code_block_8.out1, number_slider_2)
code_block_9 = CodeBlock(cells=placeProgramsInSite.out2) { cells; }
number_slider_3 = DoubleSlider(54.4, range=0..100 step 0.1)
testBinarySearch = SpacePlanning.GridObject.TestBinarySearch()
code_block_10 = CodeBlock { {1,1,1,7,7,7,7,7,7,7,8,9}; 7; }
code_block_11 = CodeBlock { {1,1,1,4,5,6,7}; 1; }
code_block_12 = CodeBlock(cells=gridPointsInsideOutline.out1) { cells; }
number_slider_4 = DoubleSlider(45, range=0..100 step 0.1)
formsCellNeighborMatrix = SpacePlanning.GridObject.FormsCellNeighborMatrix(code_block_12, number_slider_4)
watch = Watch(formsCellNeighborMatrix.out0)
code_block_13 = CodeBlock(pointsInside=gridPointsInsideOutline.out0) { pointsInside; }
pointFromPoint2dList_8 = stuffer.DynamoGeometry.pointFromPoint2dList(code_block_13)
python_script = Python(IN[0]=pointFromPoint2dList_8)
# ---------- python_script.python (13 lines) ----------
import clr
clr.AddReference('ProtoGeometry')
from Autodesk.DesignScript.Geometry import *
#The inputs to this node will be stored as a list in the IN variables.
dataEnteringNode = IN

ptList = IN[0]
txt=[]
for i in range(len(ptList)):
	txt.append(i.ToString())

#Assign your output to the OUT variable.
OUT = txt
# ----------------------------------------
code_block_14 = CodeBlock { scale = 10; SCALE2 = 4; }
fromStringOriginAndScale = DynamoText.Text.FromStringOriginAndScale(python_script, pointFromPoint2dList_8, code_block_14.scale)
code_block_15 = CodeBlock(a=formsCellNeighborMatrix.out0) { a[1]; }
code_block_16 = CodeBlock(a=formsCellNeighborMatrix.out1) { a; }
testQuickSort_2 = SpacePlanning.GridObject.TestQuickSort(code_block_16, code_block_8.out1, number_slider_2)
makeCellsFromIndicesPoint2d = SpacePlanning.GridObject.MakeCellsFromIndicesPoint2d(gridPointsInsideOutline.out0, dimX, dimY, formsCellNeighborMatrix.out0)
code_block_17 = CodeBlock(a=makeCellsFromIndicesPoint2d) { a[5]; }
code_block_18 = CodeBlock { 5; }
