# Dynamo graph 27 FEB_SPLIT DIFF.dyn (Dynamo 0.9.1.4054)

# group: USER INPUTS
building_outline_file_path = StringInput("D:\SUBHAJIT WORKS\01 DUKE BED TOWER AUTOMATION\08 EXCEL\OUTLINE.SAT")  # "Building Outline File Path String"
iteration = DoubleSlider(100, range=0..1000 step 1)
include_quantity_of_program = BoolSelector(false)
scale = DoubleSlider(200, range=0..200 step 0.1)
building_outline_file_path_2 = StringInput("U:\SUBHAJIT PROJECTS\00 DUKE PROJECT\08 EXCEL\OUTLINEDK.SAT")  # "Building Outline File Path String"
building_outline_file_path_3 = StringInput("U:\SUBHAJIT PROJECTS\00 DUKE PROJECT\08 EXCEL\OUTLINEDKtest.SAT")  # "Building Outline File Path String"
building_outline_file_path_4 = StringInput("U:\SUBHAJIT PROJECTS\00 DUKE PROJECT\08 EXCEL\OUTLINESCALEDDK.SAT")  # "Building Outline File Path String"
dimX = DoubleSlider(20, range=0..200 step 0.1)
dimY = DoubleSlider(20, range=0..200 step 0.1)
program_data_info_csv_file_path = StringInput("U:\SUBHAJIT PROJECTS\00 DUKE PROJECT\08 EXCEL\01 FEB PROGRAM.csv")  # "Program Data Info CSV File Path String"

# group: MAKE DATA STACK
readBuildingOutline = SpacePlanning.ReadData.ReadBuildingOutline(building_outline_file_path_4)
fromOutlineGetPoints = SpacePlanning.ReadData.FromOutlineGetPoints(readBuildingOutline)
fromPointsGetBoundingPoly = SpacePlanning.ReadData.FromPointsGetBoundingPoly(fromOutlineGetPoints)
pointFromPoint2dList = stuffer.DynamoGeometry.pointFromPoint2dList(fromOutlineGetPoints)
num = DoubleSlider(34, range=0..34 step 1)
factor = DoubleSlider(5, range=0..40 step 0.5)
makeDataStack = SpacePlanning.ReadData.MakeDataStack(program_data_info_csv_file_path, dimX, dimY, factor)

# group: CELL OBJECTS FROM POINTS
fromPointsGetBoundingPoly_2 = SpacePlanning.ReadData.FromPointsGetBoundingPoly(fromOutlineGetPoints)
gridPointsInsideOutline = SpacePlanning.GridObject.GridPointsInsideOutline(fromPointsGetBoundingPoly_2, fromOutlineGetPoints, dimX, dimY)
convexHullFromPoint2D = SpacePlanning.GridObject.ConvexHullFromPoint2D(gridPointsInsideOutline)
pointFromPoint2dList_2 = stuffer.DynamoGeometry.pointFromPoint2dList(convexHullFromPoint2D)
byPoints = Polygon.ByPoints(pointFromPoint2dList_2)

# group: GRID CELLS ON SITE
pointFromPoint2dList_3 = stuffer.DynamoGeometry.pointFromPoint2dList(gridPointsInsideOutline)
makeCellsFromGridPoints = SpacePlanning.GridObject.MakeCellsFromGridPoints(pointFromPoint2dList_3, dimX, dimY)
opacity = DoubleSlider(10.7, range=0..255 step 0.1)
val = DoubleSlider(164.6, range=0..255 step 0.1)
val_2 = DoubleSlider(183.1, range=0..255 step 0.1)
val_3 = DoubleSlider(165.4, range=0..255 step 0.1)
byARGB = Color.ByARGB(a=opacity, r=val, g=val_2, b=val_3)
byGeometryColor = Display.Display.ByGeometryColor(makeCellsFromGridPoints, byARGB)

code_block = CodeBlock(pointsInside=gridPointsInsideOutline) { pointsInside; }

# group: CELL NUMBER TEXTS
pointFromPoint2dList_4 = stuffer.DynamoGeometry.pointFromPoint2dList(code_block)
python_script = Python(IN[0]=pointFromPoint2dList_4)
# ---------- python_script.python (13 lines) ----------
import clr
clr.AddReference('ProtoGeometry')
from Autodesk.DesignScript.Geometry import *
#The inputs to this node will be stored as a list in the IN variables.
dataEnteringNode = IN

ptList = IN[0]
txt=[]
for i in range(len(ptList)):
	txt.append(i.ToString())

#Assign your output to the OUT variable.
OUT = txt
# ----------------------------------------
code_block_2 = CodeBlock { scale = 10; SCALE2 = 4; }
fromStringOriginAndScale = DynamoText.Text.FromStringOriginAndScale(python_script, pointFromPoint2dList_4, code_block_2.scale)

code_block_3 = CodeBlock(outlinePts=fromOutlineGetPoints) { Polygon2d.ByPoints(outlinePts); outlinePts; }
ratio = DoubleSlider(0.35, range=0..1.2 step 0.05)
dir = DoubleSlider(0, range=0..1 step 1)
basicSplitPolyIntoTwo = SpacePlanning.SplitObject.BasicSplitPolyIntoTwo(code_block_3.out0, ratio, dir)
code_block_4 = CodeBlock(a=basicSplitPolyIntoTwo) { a[0].Points; }
height = DoubleSlider(0, range=0..50 step 1)
pointByPoint2d = stuffer.DynamoGeometry.PointByPoint2d(code_block_4, height)
code_block_5 = CodeBlock(a=pointByPoint2d) { Polygon.ByPoints(a); }
code_block_6 = CodeBlock(a=basicSplitPolyIntoTwo) { a[1].Points; }
pointByPoint2d_2 = stuffer.DynamoGeometry.PointByPoint2d(code_block_6, height)
code_block_7 = CodeBlock(a=pointByPoint2d_2) { Polygon.ByPoints(a); }
code_block_8 = CodeBlock { a.StartPoint; a.EndPoint; }

# group: REGULAR SHAPES
recompute = DoubleSlider(1, range=0..100 step 0.1)
code_block_9 = CodeBlock { a=-1000; x=-300; b=-500; y=-800; }
byWidthLength = Rectangle.ByWidthLength(width=code_block_9.a, length=code_block_9.x)
code_block_10 = CodeBlock(A=code_block_9.a, B=code_block_9.x) { A*B; }
code_block_11 = CodeBlock(a=code_block_9.a, b=code_block_9.b, y=code_block_9.y, x=code_block_9.x) { Point.ByCoordinates(a,b+y); Point.ByCoordinates(a+x,b); Point.ByCoordinates(a+x,b+y); Point.ByCoordinates(a,b); }
code_block_12 = CodeBlock { 500; }
byCenterPointRadius = Circle.ByCenterPointRadius(centerPoint=code_block_11.out0, radius=code_block_12)
regularPolygon = Polygon.RegularPolygon(circle=byCenterPointRadius)
create = List.Create(code_block_11.out0, code_block_11.out2, code_block_11.out1, code_block_11.out3)

pointByPoint2d_3 = stuffer.DynamoGeometry.PointByPoint2d(code_block_8.out0, recompute)
pointByPoint2d_4 = stuffer.DynamoGeometry.PointByPoint2d(code_block_8.out1, recompute)
code_block_13 = CodeBlock(a=pointByPoint2d_3, b=pointByPoint2d_4) { Line.ByStartPointEndPoint(a,b); }
byPoints_2 = stuffer.Polygon2d.ByPoints(code_block_3.outlinePts)
ratio_2 = DoubleSlider(0.6, range=0..1 step 0.05)
recompute_2 = DoubleSlider(4, range=0..5 step 1)
recursiveSplitPoly = stuffer.Polygon2d.RecursiveSplitPoly(byPoints_2, ratio_2, recompute_2)
recursiveSplitPoly_2 = SpacePlanning.SplitObject.RecursiveSplitPoly(byPoints_2, ratio_2, recompute_2)
polygonByPolygon2d = stuffer.DynamoGeometry.PolygonByPolygon2d(recursiveSplitPoly_2, height)
byPolygon = stuffer.Polygon2d.ByPolygon(byWidthLength)
distance = DoubleSlider(100, range=0..1500 step 0.05)
dir_2 = DoubleSlider(1, range=0..1 step 1)
splitFromEdgePolyIntoTwo = SpacePlanning.SplitObject.SplitFromEdgePolyIntoTwo(byPolygon, distance, dir_2)
code_block_14 = CodeBlock(a=splitFromEdgePolyIntoTwo.out1) { a.StartPoint; a.EndPoint; }
pointByPoint2d_5 = stuffer.DynamoGeometry.PointByPoint2d(code_block_14.out0, recompute)
pointByPoint2d_6 = stuffer.DynamoGeometry.PointByPoint2d(code_block_14.out1, recompute)
code_block_15 = CodeBlock(a=pointByPoint2d_5, b=pointByPoint2d_6) { Line.ByStartPointEndPoint(a,b); }
code_block_16 = CodeBlock(a=pointByPoint2d) { a[0]; }
code_block_17 = CodeBlock(a=pointByPoint2d_2) { a[15]; }
byPoints_3 = stuffer.Polygon2d.ByPoints(code_block_3.outlinePts)
dept_data = CodeBlock(deptData=makeDataStack.out3) { deptData; }
recompute_3 = DoubleSlider(4, range=0..5 step 1)
deptSplitMake = stuffer.Polygon2d.DeptSplitMake(byPoints_3, dept_data, recompute_3)
deptSplitMake_2 = SpacePlanning.SplitObject.DeptSplitMake(byPoints_3, dept_data, recompute_3)
code_block_18 = CodeBlock(a=deptSplitMake_2.out0) { a[3]; }
polygonByPolygon2d_2 = stuffer.DynamoGeometry.PolygonByPolygon2d(code_block_18, height)
watch = Watch(deptSplitMake_2.out1)
watch_2 = Watch(deptSplitMake_2.out2)
building_outline_file_path_5 = StringInput("D:\SUBHAJIT WORKS\01 DUKE BED TOWER AUTOMATION\08 EXCEL\OUTLINEDKtest.SAT")  # "Building Outline File Path String"
building_outline_file_path_6 = StringInput("D:\SUBHAJIT WORKS\01 DUKE BED TOWER AUTOMATION\08 EXCEL\OUTLINESCALEDDK.SAT")  # "Building Outline File Path String"
building_outline_file_path_7 = StringInput("D:\SUBHAJIT WORKS\01 DUKE BED TOWER AUTOMATION\08 EXCEL\OUTLINEDK.SAT")  # "Building Outline File Path String"
building_outline_file_path_8 = StringInput("D:\SUBHAJIT WORKS\01 DUKE BED TOWER AUTOMATION\08 EXCEL\OUTLINE.SAT")  # "Building Outline File Path String"
program_data_info_csv_file_path_2 = StringInput("D:\SUBHAJIT WORKS\01 DUKE BED TOWER AUTOMATION\08 EXCEL\01 FEB PROGRAM.csv")  # "Program Data Info CSV File Path String"
autoMakeDataStack = SpacePlanning.ReadData.AutoMakeDataStack(dimX, dimY, factor)
autoMakeBuildingOutline = SpacePlanning.ReadData.AutoMakeBuildingOutline()
recursiveSplitPoly_3 = SpacePlanning.SplitObject.RecursiveSplitPoly(arg1=distance, arg2=recompute)
basicSplitPolyIntoTwo_2 = SpacePlanning.SplitObject.BasicSplitPolyIntoTwo(arg1=distance, arg2=dir_2)
checkLowest_HighestPoint = SpacePlanning.SplitObject.CheckLowest_HighestPoint(byPolygon)
pointByPoint2d_7 = stuffer.DynamoGeometry.PointByPoint2d(checkLowest_HighestPoint, recompute)
code_block_19 = CodeBlock(a=pointByPoint2d_7) { a[1]; }
code_block_20 = CodeBlock(a=pointByPoint2d_7) { a[0]; }
recursiveSplitOneDirByDistance = SpacePlanning.SplitObject.RecursiveSplitOneDirByDistance(byPolygon, distance, recompute)
polygonByPolygon2d_3 = stuffer.DynamoGeometry.PolygonByPolygon2d(recursiveSplitOneDirByDistance, recompute)
