# Dynamo graph 29 FEB_CLEANED_1.dyn (Dynamo 0.9.1.4054)

# group: USER INPUTS
program_data_info_csv_file_path = StringInput("D:\SUBHAJIT PROJECTS\00 DUKE PROJECT\08 EXCEL\01 FEB PROGRAM.csv")  # "Program Data Info CSV File Path String"
building_outline_file_path = StringInput("D:\SUBHAJIT WORKS\01 DUKE BED TOWER AUTOMATION\08 EXCEL\OUTLINE.SAT")  # "Building Outline File Path String"
iteration = DoubleSlider(100, range=0..1000 step 1)
include_quantity_of_program = BoolSelector(false)
scale = DoubleSlider(200, range=0..200 step 0.1)
building_outline_file_path_2 = StringInput("D:\SUBHAJIT PROJECTS\00 DUKE PROJECT\08 EXCEL\OUTLINEDK.SAT")  # "Building Outline File Path String"
building_outline_file_path_3 = StringInput("D:\SUBHAJIT PROJECTS\00 DUKE PROJECT\08 EXCEL\OUTLINEDKtest.SAT")  # "Building Outline File Path String"
dimX = DoubleSlider(20, range=0..200 step 0.1)
dimY = DoubleSlider(20, range=0..200 step 0.1)
building_outline_file_path_4 = StringInput("D:\SUBHAJIT PROJECTS\00 DUKE PROJECT\08 EXCEL\OUTLINESCALEDDK.SAT")  # "Building Outline File Path String"

building_outline_file_path_5 = StringInput("D:\SUBHAJIT WORKS\01 DUKE BED TOWER AUTOMATION\08 EXCEL\OUTLINESCALEDDK.SAT")  # "Building Outline File Path String"
ratio = DoubleSlider(0.35, range=0..1.2 step 0.05)
dir = DoubleSlider(0, range=0..1 step 1)
height = DoubleSlider(0, range=0..50 step 1)
code_block = CodeBlock { a.StartPoint; a.EndPoint; }
recompute = DoubleSlider(30, range=0..100 step 0.1)
pointByPoint2d = stuffer.DynamoGeometry.PointByPoint2d(code_block.out0, recompute)
pointByPoint2d_2 = stuffer.DynamoGeometry.PointByPoint2d(code_block.out1, recompute)
code_block_2 = CodeBlock(a=pointByPoint2d, b=pointByPoint2d_2) { Line.ByStartPointEndPoint(a,b); }
distance = DoubleSlider(50, range=0..2000 step 0.05)
recompute_2 = DoubleSlider(4, range=0..5 step 1)
code_block_3 = CodeBlock { a.StartPoint; a.EndPoint; }
pointByPoint2d_3 = stuffer.DynamoGeometry.PointByPoint2d(code_block_3.out0, recompute)
pointByPoint2d_4 = stuffer.DynamoGeometry.PointByPoint2d(code_block_3.out1, recompute)
code_block_4 = CodeBlock(a=pointByPoint2d_3, b=pointByPoint2d_4) { Line.ByStartPointEndPoint(a,b); }
program_data_info_csv_file_path_2 = StringInput("D:\SUBHAJIT WORKS\01 DUKE BED TOWER AUTOMATION\08 EXCEL\01 FEB PROGRAM.csv")  # "Program Data Info CSV File Path String"

# group: MAKE DATA STACK
readBuildingOutline = SpacePlanning.ReadData.ReadBuildingOutline(building_outline_file_path_5)
fromOutlineGetPoints = SpacePlanning.ReadData.FromOutlineGetPoints(readBuildingOutline)
fromPointsGetBoundingPoly = SpacePlanning.ReadData.FromPointsGetBoundingPoly(fromOutlineGetPoints)
pointFromPoint2dList = stuffer.DynamoGeometry.pointFromPoint2dList(fromOutlineGetPoints)
num = DoubleSlider(34, range=0..34 step 1)
factor = DoubleSlider(1, range=0..40 step 0.5)
makeDataStack = SpacePlanning.ReadData.MakeDataStack(program_data_info_csv_file_path_2, dimX, dimY, factor)

# group: CELL OBJECTS FROM POINTS
fromPointsGetBoundingPoly_2 = SpacePlanning.ReadData.FromPointsGetBoundingPoly(fromOutlineGetPoints)
gridPointsInsideOutline = SpacePlanning.GridObject.GridPointsInsideOutline(fromPointsGetBoundingPoly_2, fromOutlineGetPoints, dimX, dimY)
convexHullFromPoint2D = SpacePlanning.GridObject.ConvexHullFromPoint2D(gridPointsInsideOutline)
pointFromPoint2dList_2 = stuffer.DynamoGeometry.pointFromPoint2dList(convexHullFromPoint2D)
byPoints = Polygon.ByPoints(pointFromPoint2dList_2)

# group: GRID CELLS ON SITE
pointFromPoint2dList_3 = stuffer.DynamoGeometry.pointFromPoint2dList(gridPointsInsideOutline)
makeCellsFromGridPoints = SpacePlanning.GridObject.MakeCellsFromGridPoints(pointFromPoint2dList_3, dimX, dimY)
opacity = DoubleSlider(10.7, range=0..255 step 0.1)
val = DoubleSlider(164.6, range=0..255 step 0.1)
val_2 = DoubleSlider(183.1, range=0..255 step 0.1)
val_3 = DoubleSlider(165.4, range=0..255 step 0.1)
byARGB = Color.ByARGB(a=opacity, r=val, g=val_2, b=val_3)
byGeometryColor = Display.Display.ByGeometryColor(makeCellsFromGridPoints, byARGB)

code_block_5 = CodeBlock(pointsInside=gridPointsInsideOutline) { pointsInside; }

# group: CELL NUMBER TEXTS
pointFromPoint2dList_4 = stuffer.DynamoGeometry.pointFromPoint2dList(code_block_5)
python_script = Python(IN[0]=pointFromPoint2dList_4)
# ---------- python_script.python (13 lines) ----------
import clr
clr.AddReference('ProtoGeometry')
from Autodesk.DesignScript.Geometry import *
#The inputs to this node will be stored as a list in the IN variables.
dataEnteringNode = IN

ptList = IN[0]
txt=[]
for i in range(len(ptList)):
	txt.append(i.ToString())

#Assign your output to the OUT variable.
OUT = txt
# ----------------------------------------
code_block_6 = CodeBlock { scale = 10; SCALE2 = 4; }
fromStringOriginAndScale = DynamoText.Text.FromStringOriginAndScale(python_script, pointFromPoint2dList_4, code_block_6.scale)

code_block_7 = CodeBlock(outlinePts=fromOutlineGetPoints) { Polygon2d.ByPoints(outlinePts); outlinePts; }
basicSplitPolyIntoTwo = SpacePlanning.SplitObject.BasicSplitPolyIntoTwo(code_block_7.out0, ratio, dir)
code_block_8 = CodeBlock(a=basicSplitPolyIntoTwo) { a[1].Points; }
pointByPoint2d_5 = stuffer.DynamoGeometry.PointByPoint2d(code_block_8, height)
code_block_9 = CodeBlock(a=pointByPoint2d_5) { Polygon.ByPoints(a); }
recursiveSplitOneDirByDistance = SpacePlanning.SplitObject.RecursiveSplitOneDirByDistance(code_block_7.out0, distance, recompute_2)
polygonByPolygon2d = stuffer.DynamoGeometry.PolygonByPolygon2d(recursiveSplitOneDirByDistance, height)
byPoints_2 = stuffer.Polygon2d.ByPoints(code_block_7.outlinePts)
dept_data = CodeBlock(deptData=makeDataStack.out3) { deptData; }
recompute_3 = DoubleSlider(2, range=0..5 step 1)
deptSplitMake = SpacePlanning.SplitObject.DeptSplitMake(byPoints_2, dept_data, recompute_3)
watch = Watch(deptSplitMake.out2)
building_outline_file_path_6 = StringInput("D:\SUBHAJIT WORKS\01 DUKE BED TOWER AUTOMATION\08 EXCEL\OUTLINEDKtest.SAT")  # "Building Outline File Path String"
building_outline_file_path_7 = StringInput("D:\SUBHAJIT WORKS\01 DUKE BED TOWER AUTOMATION\08 EXCEL\OUTLINEDK.SAT")  # "Building Outline File Path String"
building_outline_file_path_8 = StringInput("D:\SUBHAJIT WORKS\01 DUKE BED TOWER AUTOMATION\08 EXCEL\OUTLINE.SAT")  # "Building Outline File Path String"
autoMakeDataStack = SpacePlanning.ReadData.AutoMakeDataStack(dimX, dimY, factor)
autoMakeBuildingOutline = SpacePlanning.ReadData.AutoMakeBuildingOutline()
ratio_2 = DoubleSlider(1, range=0..1 step 0.05)
recursiveSplitPoly = SpacePlanning.SplitObject.RecursiveSplitPoly(arg1=ratio_2, arg2=recompute)
byPoints_3 = stuffer.Polygon2d.ByPoints(code_block_7.outlinePts)
ratio_3 = DoubleSlider(0.35, range=0..1 step 0.05)
recursiveSplitPoly_2 = SpacePlanning.SplitObject.RecursiveSplitPoly(byPoints_3, ratio_3, recompute_2)
code_block_10 = CodeBlock { a=-1000; x=-300; b=-500; y=-800; }
code_block_11 = CodeBlock(A=code_block_10.a, B=code_block_10.x) { A*B; }
code_block_12 = CodeBlock(a=code_block_10.a, b=code_block_10.b, y=code_block_10.y, x=code_block_10.x) { Point.ByCoordinates(a,b+y); Point.ByCoordinates(a+x,b); Point.ByCoordinates(a+x,b+y); Point.ByCoordinates(a,b); }
create = List.Create(code_block_12.out0, code_block_12.out2, code_block_12.out1, code_block_12.out3)
distance_2 = DoubleSlider(200, range=0..2000 step 0.1)
code_block_13 = CodeBlock { 500; }
byCenterPointRadius = Circle.ByCenterPointRadius(centerPoint=code_block_12.out0, radius=code_block_13)
regularPolygon = Polygon.RegularPolygon(circle=byCenterPointRadius)
byPolygon = stuffer.Polygon2d.ByPolygon(regularPolygon)
dir_2 = DoubleSlider(0, range=0..1 step 1)
basicSplitPolyIntoTwo_2 = SpacePlanning.SplitObject.BasicSplitPolyIntoTwo(byPolygon, ratio_2, dir_2)
polygonByPolygon2d_2 = stuffer.DynamoGeometry.PolygonByPolygon2d(basicSplitPolyIntoTwo_2, dir_2)
polygonByPolygon2d_3 = stuffer.DynamoGeometry.PolygonByPolygon2d(deptSplitMake.out0, height)
areaCheckPolygon = stuffer.Polygon2d.AreaCheckPolygon(code_block_7.out0)
number_slider = DoubleSlider(0.95, range=0..1 step 0.05)
code_block_14 = CodeBlock(A=areaCheckPolygon, B=number_slider) { A*B; }
height_2 = DoubleSlider(0, range=0..50 step 1)
recursiveSplitByArea = SpacePlanning.SplitObject.RecursiveSplitByArea(code_block_7.out0, code_block_14, height_2)
code_block_15 = CodeBlock(a=recursiveSplitByArea) { a[0]; }
areaCheckPolygon_2 = stuffer.Polygon2d.AreaCheckPolygon(code_block_15)
code_block_16 = CodeBlock(a=recursiveSplitByArea) { a[1]; }
areaCheckPolygon_3 = stuffer.Polygon2d.AreaCheckPolygon(code_block_16)
code_block_17 = CodeBlock(outlinePts=fromOutlineGetPoints) { Polygon2d.ByPoints(outlinePts); outlinePts; }
dept_data_2 = CodeBlock(deptData=makeDataStack.out3) { deptData; }
deptSplitRefined = SpacePlanning.SplitObject.DeptSplitRefined(code_block_17.out0, dept_data_2, height)
code_block_18 = CodeBlock(A=deptSplitRefined.out0) { A[0]; }
polygonByPolygon2d_4 = stuffer.DynamoGeometry.PolygonByPolygon2d(code_block_18, dir_2)
areaCheckPolygon_4 = stuffer.Polygon2d.AreaCheckPolygon(code_block_7.out0)
code_block_19 = CodeBlock(A=deptSplitRefined.out0) { A[1]; }
polygonByPolygon2d_5 = stuffer.DynamoGeometry.PolygonByPolygon2d(code_block_19, dir_2)
code_block_20 = CodeBlock(A=deptSplitRefined.out0) { A[2]; }
polygonByPolygon2d_6 = stuffer.DynamoGeometry.PolygonByPolygon2d(code_block_20, dir_2)
code_block_21 = CodeBlock(A=deptSplitRefined.out0) { A[3]; }
polygonByPolygon2d_7 = stuffer.DynamoGeometry.PolygonByPolygon2d(code_block_21, dir_2)
code_block_22 = CodeBlock(a=basicSplitPolyIntoTwo) { a[0].Points; }
pointByPoint2d_6 = stuffer.DynamoGeometry.PointByPoint2d(code_block_22, height)
code_block_23 = CodeBlock(a=pointByPoint2d_6) { Polygon.ByPoints(a); }
code_block_24 = CodeBlock { a=-500; x=-300; }
byWidthLength = Rectangle.ByWidthLength(width=code_block_24.a, length=code_block_24.x)
byPolygon_2 = stuffer.Polygon2d.ByPolygon(byWidthLength)
areaCheckPolygon_5 = stuffer.Polygon2d.AreaCheckPolygon(byPolygon_2)
dir_3 = DoubleSlider(1, range=0..1 step 1)
polygonByPolygon2d_8 = stuffer.DynamoGeometry.PolygonByPolygon2d(recursiveSplitByArea, dir_3)
code_block_25 = CodeBlock(A=polygonByPolygon2d_8) { A[1]; }
recursiveSplitByAreaUse = SpacePlanning.SplitObject.RecursiveSplitByAreaUse(code_block_7.out0, code_block_14, dir_3)
polygonByPolygon2d_9 = stuffer.DynamoGeometry.PolygonByPolygon2d(recursiveSplitByAreaUse, dir_2)
areaCheckPolygon_6 = stuffer.Polygon2d.AreaCheckPolygon(recursiveSplitByAreaUse)
polygonByPolygon2d_10 = stuffer.DynamoGeometry.PolygonByPolygon2d(deptSplitRefined.out1, dir_2)
code_block_26 = CodeBlock(a=polygonByPolygon2d_10) { a[0]; }
areaCheckPolygon_7 = stuffer.Polygon2d.AreaCheckPolygon(code_block_19)
areaCheckPolygon_8 = stuffer.Polygon2d.AreaCheckPolygon(code_block_18)
